# Grasshopper definition 01_Test_1_compas.gh (Grasshopper 1.0.7)
# Copyright: Felswind

length_m = Slider(0.5, range=0..1)
layers_count = Slider(10, range=1..50)
layer_height_m = Slider(0.006, range=0..0.1)
wavy = BooleanToggle(True)
amplitude_factor = Slider(0.05, range=0..1)
waves_count = Slider(3, range=1..5)

base_point = Point(Point(2.121750057, -2.437999725, -0.400000006))
straight_line_cos_wave = GhPythonScript(
    length=length_m,
    layers=layers_count,
    layer_height=layer_height_m,
    base_point=base_point,
    wavy=wavy,
    amplitude=amplitude_factor,
    waves=waves_count)  # -> out, points; inputs layers: Int32, base_point: Point3d, wavy: Boolean, waves: Int32
# ---------- straight_line_cos_wave: Python ----------
from compas.geometry import Point
import math
import ghpythonlib.components as gh


##########################################
## Define Line Function
##########################################

def straight_line(length, height, base_point):
    
    start = Point(base_point.x,base_point.y,base_point.z+height)
    end = Point(base_point.x+length,base_point.y,base_point.z+height)
    
    return(start, end)



##########################################
## Define Cos-wave Function
##########################################

def cos_wave(length, height, amplitude, waves, base_point):
    
    points= []
    waves = waves*10
    div = 45
    
    for i in range(div):
        
        x_point = length/div*i
        y_point = amplitude*math.cos(x_point*waves)
        
        points.append(Point(base_point.x+x_point,base_point.y+y_point,base_point.z+height))
        
    return(points)



##########################################
## Run the functions
##########################################

points = []
base_point = Point(gh.Deconstruct(base_point)[0], gh.Deconstruct(base_point)[1], gh.Deconstruct(base_point)[2])

for i in range(layers):
    
    if wavy == True:
        
        curve = cos_wave(length, i*layer_height, amplitude, waves, base_point)
        
        if i%2 == 0:
            curve.reverse()
            
        for pt in curve:
            points.append(pt)
        
    else:
        
        curve = straight_line(length, i*layer_height, base_point)
        
        if i%2 == 0:
            curve = reversed(curve)
            
        for pt in curve:
            points.append(pt)
# ---------- end straight_line_cos_wave ----------
show = BooleanToggle(True)
layer_def = GhPythonScript(points_compas=straight_line_cos_wave.points)  # -> out, layer; inputs points_compas: list
# ---------- layer_def: Python ----------
import ghpythonlib.components as gh
import os
import sys
import json

from compas.geometry import Frame
from compas.geometry import Line
from compas.geometry import Vector

from am_information_model.model import Node
from am_information_model.model import Layer

def _radius_between_frames(from_frame, via_frame, to_frame, max_radius):
        in_line = Line(from_frame.point, via_frame.point)
        out_line = Line(via_frame.point, to_frame.point)
        r = min(max_radius, in_line.length/2, out_line.length/2)
        return r

# nodes
max_r = 10
frames = [Frame([pt.x, pt.y, pt.z], [0, -1, 0], [-1, 0, 0]) for pt in points_compas]

print max_r

nodes = []
for i,frame in enumerate(frames):
    r = _radius_between_frames(frames[max(0,i-1)], frame, frames[min(i+1, len(frames)-1)], max_r)
    nodes.append(Node(frame, radius=r))
layer = Layer.from_nodes(nodes)
# ---------- end layer_def ----------
draw = PythonScript(layer=layer_def.layer, points=straight_line_cos_wave.points, show=show)  # -> M, F, S, C; inputs points: list
# ---------- draw: Python ----------
from compas.geometry import Transformation, Point
from compas.geometry import Frame
from compas.datastructures import mesh_transformed
from compas_ghpython.artists import MeshArtist
from compas_ghpython import draw_frame
import ghpythonlib.components as gh



if show:
    points_gh = []
    
    for pt in points:
        
        points_gh.append(gh.ConstructPoint(pt.x, pt.y, pt.z))
    
    C = gh.PolyLine(points_gh, False)



if show:
    F = [draw_frame(node.frame) for key, node in layer.nodes()]
# ---------- end draw ----------
curve = Curve(draw.C)
