# Grasshopper definition 02_Test_2_nubian_vault.gh (Grasshopper 1.0.7)
# Copyright: Felswind
# plug-ins: Kangaroo2 Components

length_m = Slider(0.35, range=0..1)
base_point = Point(Point(2.121750057, -2.437999725, -0.400000006))
depth_m = Slider(0.35, range=0..1)
div_u_count = Slider(15, range=1..50)
div_v_count = Slider(15, range=1..50)

unit_y = UnitY(Factor=expr("-x/2", length_m))
move = Move(Geometry=base_point, Motion=unit_y)  # -> Geometry, Transform
xz_plane = XZPlane(Origin=move.Geometry)
unit_x = UnitX(Factor=1)
layer_height_m = Slider(0.006, range=0..0.1)
rotate_3d = Rotate3D(Geometry=xz_plane, Angle=degrees(Slider(-30, range=-180..180)), Center=move.Geometry, Axis=unit_x)  # -> Geometry, Transform
deconstruct_plane = DeconstructPlane(Plane=rotate_3d.Geometry)  # -> Origin, XAxis, YAxis, ZAxis
series = Series(Start=0, Step=layer_height_m, Count=51)
amplitude = Amplitude(Vector=deconstruct_plane.ZAxis, Amplitude=expr("-x", series))
move_2 = Move(Geometry=rotate_3d.Geometry, Motion=amplitude)  # -> graft(Geometry), Transform

restart = Button()
run = BooleanToggle(False)

print_test_3 = GhPythonScript(length=length_m, base_point=base_point, depth=depth_m)  # -> surface; inputs base_point: Point3d
# ---------- print_test_3: Python ----------
import ghpythonlib.components as gh



# Create base_surface: 

rec = gh.Rectangle(gh.XYPlane(base_point), gh.ConstructDomain(-length/2, length/2), gh.ConstructDomain(-depth/2, depth/2), 0)[0]
surface = gh.BoundarySurfaces(rec)
# ---------- end print_test_3 ----------
divide_surface = DivideSurface(Surface=print_test_3, UCount=div_u_count, VCount=div_v_count)  # -> Points, Normals, Parameters
flip_matrix = FlipMatrix(Data=divide_surface.Points)
polyline = PolyLine(Vertices=flip_matrix, Closed=False)
polyline_2 = PolyLine(Vertices=divide_surface.Points, Closed=False)
end_points = EndPoints(Curve=polyline_2)  # -> Start, End
end_points_2 = EndPoints(Curve=polyline)  # -> Start, End
explode = Explode(Curve=polyline_2, Recursive=True)  # -> Segments, flatten(Vertices)
explode_2 = Explode(Curve=polyline, Recursive=True)  # -> Segments, Vertices
merge = Merge(Data1=end_points.End, Data2=end_points_2.Start, Data3=end_points_2.End)  # -> flatten(Result)
merge_2 = Merge(Data1=explode_2.Segments, Data2=explode.Segments)  # -> flatten(Result)
strength = Slider(4, range=0..100)
unit_z = UnitZ(Factor=Slider(0.005, range=0..1))
list_length = ListLength(List=flatten(polyline_2))

load = Load(Point=explode.Vertices, ForceVector=unit_z)
length_line = LengthLine(Line=merge_2, Strength=strength)
anchor = Anchor(Point=merge, Strength=10000)
show = Show(G=flatten(polyline))

solver = Solver(GoalObjects=[show, length_line, load, anchor], Reset=restart, Threshold=1e-15, Tolerance=0.01, On=run)  # -> I, V, O
split_list = SplitList(List=solver.O, Index=list_length)  # -> ListA, ListB
rebuild_curve = RebuildCurve(Curve=split_list.ListA, Degree=3, Count=10, Tangents=False)
loft = Loft(Curves=rebuild_curve, Options={Adjust=False, Closed=False, LoftEnds=0, LoftSimp=0, LoftType=0, Rebuild=10, Refit=0.01})

brep_plane = BrepPlane(Brep=loft, Plane=move_2.Geometry)  # -> flatten(Curves), Points
reverse_list = ReverseList(List=brep_plane.Curves)
partition_list = PartitionList(List=reverse_list, Size=2)
list_item = ListItem(List=partition_list, Index=0, Wrap=True)  # -> Item, Item1
flip_curve = FlipCurve(Curve=list_item.Item)  # -> Curve, Flag
merge_3 = Merge(Data1=flip_curve.Curve, Data2=list_item.Item1)  # -> flatten(Result)
close_curves = GhPythonScript(curves=brep_plane.Curves)  # -> curves_add; inputs curves: list of Curve
# ---------- close_curves: Python ----------
import ghpythonlib.components as gh



# close the curves for a print path:

curves_add = []

for i in range(len(curves)):
    
    if i%2 == 0 and i > 0:
        
        end = gh.EndPoints(curves[i])[0]
        start = gh.EndPoints(last_curve)[0]
        
        close_line = gh.Line(end, start)
        curves_add.append(close_line)
        
    
    elif i%2 != 0 and i > 0:
        
        end = gh.EndPoints(curves[i])[1]
        start = gh.EndPoints(last_curve)[1]
        
        close_line = gh.Line(end, start)
        curves_add.append(close_line)
    
    last_curve = curves[i]
# ---------- end close_curves ----------
divide_curve = DivideCurve(Curve=merge_3, Count=15, Kinks=False)  # -> flatten(Points), Tangents, Parameters
show_2 = BooleanToggle(False)
join_curves = JoinCurves(Curves=flatten([close_curves, brep_plane.Curves]), Preserve=False)
layer_def = GhPythonScript(points_gh=divide_curve.Points, y_axis=deconstruct_plane.YAxis)  # -> out, layer; inputs points_gh: list of Point3d, y_axis: Vector3d
# ---------- layer_def: Python ----------
import ghpythonlib.components as gh
import os
import sys
import json

from compas.geometry import Frame
from compas.geometry import Line
from compas.geometry import Vector

from am_information_model.model import Node
from am_information_model.model import Layer

def _radius_between_frames(from_frame, via_frame, to_frame, max_radius):
        in_line = Line(from_frame.point, via_frame.point)
        out_line = Line(via_frame.point, to_frame.point)
        r = min(max_radius, in_line.length/2, out_line.length/2)
        return r



# nodes
max_r = gh.Distance(points_gh[0], points_gh[1])
frames = [Frame([gh.Deconstruct(pt)[0], gh.Deconstruct(pt)[1], gh.Deconstruct(pt)[2]], [1, 0, 0], [0, 0.5, gh.DeconstructVector(y_axis)][2]) for pt in points_gh]

print max_r

nodes = []
for i,frame in enumerate(frames):
    r = _radius_between_frames(frames[max(0,i-1)], frame, frames[min(i+1, len(frames)-1)], max_r)
    nodes.append(Node(frame, radius=r))
layer = Layer.from_nodes(nodes)
# ---------- end layer_def ----------
draw = PythonScript(layer=layer_def.layer, show=show_2)  # -> M, F, S
# ---------- draw: Python ----------
from compas.geometry import Transformation
from compas.geometry import Frame
from compas.datastructures import mesh_transformed
from compas_ghpython.artists import MeshArtist
from compas_ghpython import draw_frame

if show:
    F = [draw_frame(node.frame) for key, node in layer.nodes()]
# ---------- end draw ----------
