# Grasshopper definition fabtory_control_curve _fc_test_2.ghx (Grasshopper 1.0.7)
# plug-ins: Kangaroo2 Components

div_v_count = Slider(15, range=1..50)
length_m = Slider(0.35, range=0..1)
base_point = Point(Point(2.121750057, -2.437999725, -0.400000006))
depth_m = Slider(0.35, range=0..1)
div_u_count = Slider(15, range=1..50)

unit_y = UnitY(Factor=expr("-x/2", length_m))
move = Move(Geometry=base_point, Motion=unit_y)  # -> Geometry, Transform
xz_plane = XZPlane(Origin=move.Geometry)
unit_x = UnitX(Factor=1)
layer_height_m = Slider(0.006, range=0..0.1)
rotate_3d = Rotate3D(Geometry=xz_plane, Angle=degrees(Slider(-30, range=-180..180)), Center=move.Geometry, Axis=unit_x)  # -> Geometry, Transform
deconstruct_plane = DeconstructPlane(Plane=rotate_3d.Geometry)  # -> Origin, XAxis, YAxis, ZAxis
series = Series(Start=0, Step=layer_height_m, Count=150)
amplitude = Amplitude(Vector=deconstruct_plane.ZAxis, Amplitude=expr("-x", series))
move_2 = Move(Geometry=rotate_3d.Geometry, Motion=amplitude)  # -> graft(Geometry), Transform

restart = Button()
run = BooleanToggle(False)

reload = Button()
path = PythonScript()  # -> HERE, DATA, ROBOT_DESCRIPTION
# ---------- path: Python ----------
import os

HERE = os.path.dirname(ghdoc.Path)
DATA = os.path.abspath(os.path.join(HERE, "..", "data"))
ROBOT_DESCRIPTION = os.path.abspath(os.path.join(DATA, "robot_description"))

print(HERE)
print(DATA)
print(ROBOT_DESCRIPTION)
# ---------- end path ----------
py = PythonScript(reload=reload)
# ---------- py: Python ----------
if reload:
    from compas_ghpython import unload_modules
    unload_modules('compas')
    unload_modules("compas_fab")
    unload_modules("fabtory_fabrication_control")
    unload_modules("compas_rrc")
# ---------- end py ----------

# ----
# AM Model
number_slider = Slider(0.006, range=0..0.01)  # disabled
cp = Plane(PlaneXY(0, 0, 0))  # disabled
generate_assembly = GhPythonScript(centerplane=cp, layer_height=number_slider)  # -> am_model, planes; disabled
# ---------- generate_assembly: Python ----------
import Rhino.Geometry as rg
import math
from scriptcontext import sticky as st


from compas.geometry import Frame
from compas.geometry import Transformation
from compas.geometry import Rotation
from compas.geometry import Translation
from compas.geometry import Point

from compas_ghpython import draw_frame

from am_information_model.model import AMModel
from am_information_model.model import Layer

import Rhino.Geometry as rg


# initialize an empty assembly class
am_model = AMModel()

for i in range(len(layer)):
    print(i)


#cp = centerplane
#cf = Frame(cp.Origin, cp.XAxis, cp.YAxis)
#
#for i in range(25): # loop through the number of layers i
#    T = Translation.from_vector([0,0,layer_height*i])
#    cft = cf.transformed(T) #transforms the origin plane
#
#    T1 = Transformation.from_frame_to_frame(cf, cft)
#    # create new instances of the element
#    new_layer = layer.transformed(T) #returns a deep copy of the initial element at the new location of the frame
#    print(new_layer.node(0).frame)
#    am_model.add_layer(new_layer)
# ---------- end generate_assembly ----------
pln = Plane(generate_assembly.planes)  # disabled

y_axis = Curve(<curve referenced from the Rhino model>)
crv = Curve(<curve referenced from the Rhino model>)
x_axis = Curve(<curve referenced from the Rhino model>)

# ----
# Input
list = ValueList({"plane": 0, "plane from curve": 1, "plane from am_model": 2}, selected="plane from am_model")
div_len = Slider(0.1, range=0..1)
plane = PythonScript(plane_axes=[x_axis, y_axis])  # -> plane; inputs plane_axes: list of Curve
# ---------- plane: Python ----------
import Rhino.Geometry as rg

x_axis, y_axis = plane_axes

x_axis = rg.Line(x_axis.PointAtStart, x_axis.PointAtEnd)
y_axis = rg.Line(y_axis.PointAtStart, y_axis.PointAtEnd)

if x_axis.From.DistanceTo(y_axis.From) < 0.01:
    origin = x_axis.From
    xvec = x_axis.Direction
    yvec = y_axis.Direction
elif x_axis.To.DistanceTo(y_axis.To) < 0.01:
    origin = x_axis.To
    xvec = -x_axis.Direction
    yvec = -y_axis.Direction
elif x_axis.From.DistanceTo(y_axis.To) < 0.01:
    origin = x_axis.From
    xvec = x_axis.Direction
    yvec = -y_axis.Direction
elif x_axis.To.DistanceTo(y_axis.From) < 0.01:
    origin = x_axis.To
    xvec = -x_axis.Direction
    yvec = y_axis.Direction

plane = rg.Plane(origin, xvec, yvec)
# ---------- end plane ----------
curve_def = GhPythonScript(cplane=plane, crv=crv, div_len=div_len)  # -> planes; inputs crv: Curve
# ---------- curve_def: Python ----------
import rhinoscriptsyntax as rs
from compas.geometry import Frame, Line, Vector
from compas_ghpython import draw_frame

# dividing curve
pts = rs.DivideCurveLength(crv, div_len)
frames = [Frame([pt.X, pt.Y, pt.Z], cplane.XAxis, cplane.YAxis) for pt in pts]
print frames

# for vizualization
planes = []
for frame in frames:
    planes.append(draw_frame(frame))
# ---------- end curve_def ----------

bang = Button()
panel = Panel("Unload libraries")
unload = PythonScript(bang=bang)
# ---------- unload: Python ----------
from compas_rhino.utilities.misc import unload_modules

unload_modules("compas")
unload_modules("fabrication_control")
unload_modules("assembly_information_model")
# ---------- end unload ----------

list_2 = ValueList({"20", "50", "100", "500", "1000", "5000"}, selected="50")
back = Button()
reset = Button()
start = Button()
stop = Button()
step = Button()
full = Button()

reset_fabrication = Button()

reset_2 = Button()
back_2 = Button()
start_2 = Button()
stop_2 = Button()
step_2 = Button()
full_2 = Button()
list_3 = ValueList({"20", "50", "100", "500", "1000", "5000"}, selected="50")

# ----
# STATE  VIEWER
trigger = Trigger(Interval=100, TimerInterval=100, Target=fabrication_state)
fabrication_state = PythonScript()  # -> out, state, iterations, num_tasks_left, log_messages
# ---------- fabrication_state: Python ----------
from scriptcontext import sticky as st

fabrication = st["fabrication"]

state = "THREAD PAUSED" if fabrication.is_alive() and fabrication.is_paused() else "THREAD RUNNING" if fabrication.is_alive() and fabrication.is_paused() == False else "THREAD STOPPED"
iterations = fabrication.iterations

num_tasks_left = len(fabrication.tasks)
print num_tasks_left
log_messages = fabrication.get_log_messages()
# ---------- end fabrication_state ----------
iterations = Panel(fabrication_state.iterations)
state = Panel(fabrication_state.state)
num_tasks_left = Panel(fabrication_state.num_tasks_left)
log_messages = Panel(fabrication_state.log_messages)

tcp_speed = Slider(250, range=0..1000)
tcp_speed_2 = Slider(250, range=0..1000)

to_single_joints = Button()
to_joints = Button()

to_robtarget = Button()
to_frame = Button()

set_tool = Button()
set_tool_2 = Button()

get_frame = Button()
get_robtarget = Button()
get_joints = Button()

print_test_3 = GhPythonScript(length=length_m, base_point=base_point, depth=depth_m)  # -> surface; inputs base_point: Point3d
# ---------- print_test_3: Python ----------
import ghpythonlib.components as gh



# Create base_surface: 

rec = gh.Rectangle(gh.XYPlane(base_point), gh.ConstructDomain(-length/2, length/2), gh.ConstructDomain(-depth/2, depth/2), 0)[0]
surface = gh.BoundarySurfaces(rec)
# ---------- end print_test_3 ----------
divide_surface = DivideSurface(Surface=print_test_3, UCount=div_u_count, VCount=div_v_count)  # -> Points, Normals, Parameters
flip_matrix = FlipMatrix(Data=divide_surface.Points)
polyline = PolyLine(Vertices=flip_matrix, Closed=False)
polyline_2 = PolyLine(Vertices=divide_surface.Points, Closed=False)
end_points = EndPoints(Curve=polyline_2)  # -> Start, End
end_points_2 = EndPoints(Curve=polyline)  # -> Start, End
explode = Explode(Curve=polyline_2, Recursive=True)  # -> Segments, flatten(Vertices)
explode_2 = Explode(Curve=polyline, Recursive=True)  # -> Segments, Vertices
merge = Merge(Data1=end_points.End, Data2=end_points_2.Start, Data3=end_points_2.End)  # -> flatten(Result)
merge_2 = Merge(Data1=explode_2.Segments, Data2=explode.Segments)  # -> flatten(Result)
strength = Slider(4, range=0..100)
unit_z = UnitZ(Factor=Slider(0.005, range=0..1))
list_length = ListLength(List=flatten(polyline_2))

load = Load(Point=explode.Vertices, ForceVector=unit_z)
length_line = LengthLine(Line=merge_2, Strength=strength)
anchor = Anchor(Point=merge, Strength=10000)
show = Show(G=flatten(polyline))

solver = Solver(GoalObjects=[show, length_line, load, anchor], Reset=restart, Threshold=1e-15, Tolerance=0.01, On=run)  # -> I, V, O
split_list = SplitList(List=solver.O, Index=list_length)  # -> ListA, ListB
rebuild_curve = RebuildCurve(Curve=split_list.ListA, Degree=3, Count=10, Tangents=False)
loft = Loft(Curves=rebuild_curve, Options={Adjust=False, Closed=False, LoftEnds=0, LoftSimp=0, LoftType=0, Rebuild=10, Refit=0.01})

brep_plane = BrepPlane(Brep=loft, Plane=move_2.Geometry)  # -> flatten(Curves), Points
rotate_3d_2 = Rotate3D(Geometry=brep_plane.Curves, Angle=degrees(90), Center=base_point, Axis=Vector(0, 0, 1))  # -> Geometry, Transform
reverse_list = ReverseList(List=rotate_3d_2.Geometry)
partition_list = PartitionList(List=reverse_list, Size=2)
list_item = ListItem(List=partition_list, Index=0, Wrap=True)  # -> Item, Item1
flip_curve = FlipCurve(Curve=list_item.Item)  # -> Curve, Flag
merge_3 = Merge(Data1=flip_curve.Curve, Data2=list_item.Item1)  # -> flatten(Result)
list_length_2 = ListLength(List=brep_plane.Curves)
divide_curve = DivideCurve(Curve=merge_3, Count=15, Kinks=False)  # -> flatten(Points), Tangents, Parameters
close_curves = GhPythonScript(curves=rotate_3d_2.Geometry)  # -> curves_add; inputs curves: list of Curve
# ---------- close_curves: Python ----------
import ghpythonlib.components as gh



# close the curves for a print path:

curves_add = []

for i in range(len(curves)):
    
    if i%2 == 0 and i > 0:
        
        end = gh.EndPoints(curves[i])[0]
        start = gh.EndPoints(last_curve)[0]
        
        close_line = gh.Line(end, start)
        curves_add.append(close_line)
        
    
    elif i%2 != 0 and i > 0:
        
        end = gh.EndPoints(curves[i])[1]
        start = gh.EndPoints(last_curve)[1]
        
        close_line = gh.Line(end, start)
        curves_add.append(close_line)
    
    last_curve = curves[i]
# ---------- end close_curves ----------
show_2 = BooleanToggle(False)
layer_def = GhPythonScript(points_gh=divide_curve.Points, y_axis=deconstruct_plane.YAxis, layers=list_length_2)  # -> out, layer, am_model; inputs points_gh: list of Point3d, y_axis: Vector3d, layers: Int32
# ---------- layer_def: Python ----------
import ghpythonlib.components as gh
import os
import sys
import json

from compas.geometry import Frame
from compas.geometry import Line
from compas.geometry import Vector

from am_information_model.model import Node
from am_information_model.model import Layer
from am_information_model.model import AMModel


def _radius_between_frames(from_frame, via_frame, to_frame, max_radius):
        in_line = Line(from_frame.point, via_frame.point)
        out_line = Line(via_frame.point, to_frame.point)
        r = min(max_radius, in_line.length/2, out_line.length/2)
        return r



# nodes
max_r = gh.Distance(points_gh[0], points_gh[1])
frames = [Frame([gh.Deconstruct(pt)[0], gh.Deconstruct(pt)[1], gh.Deconstruct(pt)[2]], [0,1,0], [-0.5,0,gh.DeconstructVector(y_axis)[2]]) for pt in points_gh]

print max_r

nodes = []
for i,frame in enumerate(frames):
    r = _radius_between_frames(frames[max(0,i-1)], frame, frames[min(i+1, len(frames)-1)], max_r)
    nodes.append(Node(frame, radius=r))



# Create the print_layer: 

def partition(lst, size):
    for i in range(0, len(lst), size):
        yield lst[i : i+size]

count = int(len(nodes)/layers)
nodes_layer = list(partition(nodes, count))


layer = []


for i in range(layers):
    
    layer_loc = Layer.from_nodes(nodes_layer[i])
    layer.append(layer_loc)



# Create AM Model: 

am_model = AMModel()

for i in range(len(layer)):
    layer_new = layer[i]
    am_model.add_layer(layer_new)
# ---------- end layer_def ----------
join_curves = JoinCurves(Curves=flatten([close_curves, rotate_3d_2.Geometry]), Preserve=False)
draw = PythonScript(layer=layer_def.layer, show=show_2)  # -> M, F, S
# ---------- draw: Python ----------
from compas.geometry import Transformation
from compas.geometry import Frame
from compas.datastructures import mesh_transformed
from compas_ghpython.artists import MeshArtist
from compas_ghpython import draw_frame

if show:
    F = [draw_frame(node.frame) for key, node in layer.nodes()]
# ---------- end draw ----------

# ----
# FABRICATION PROCESS CONTROL
init = Button()
resume_fabrication = Button()
pause_fabrication = Button()
start_fabrication = Button()
stop_fabrication = Button()
set_tasks = Button()
fabrication = PythonScript(init=init)  # -> out, fabrication
# ---------- fabrication: Python ----------
from scriptcontext import sticky as st
from fabrication_control.fabrication import Fabrication
import time
import Rhino.Geometry as rg
import ghpythonlib.components as ghcomp
import math as m


class FabricationGH(Fabrication):
    
    def perform_task(self, node):
        """ this method controls the execution of one task in a list of the set tasks of the fabrication.
        --> it has to be filled in with your task routines """

        self.log("TASK STARTED: ---->>>>>")
        ok = False
        time.sleep(1.0)
        ok = True
        self.log("----<<<<< TASK FINISHED")
        return True

fabrication = FabricationGH()

st["fabrication"] = fabrication
# ---------- end fabrication ----------
set_fab_params = PythonScript(fabrication=fabrication.fabrication, am_model=layer_def.am_model, set_tasks=set_tasks)  # -> out, fabrication; inputs set_tasks: Boolean
# ---------- set_fab_params: Python ----------
from scriptcontext import sticky as st
import Rhino.Geometry as rg


guid = str(ghenv.Component.InstanceGuid)
tasks_set_key = "tasks_set" + guid

if not tasks_set_key in st:
    st[tasks_set_key] = False

if set_tasks == True:
    print "setting tasks"    
    fabrication.clear_tasks()
    fabrication.set_tasks(range(10)) #needs to be revised with am
    st[tasks_set_key] = True
# ---------- end set_fab_params ----------
fabrication_2 = PythonScript(
    fabrication=set_fab_params.fabrication,
    start=start_fabrication,
    pause=pause_fabrication,
    resume=resume_fabrication,
    stop=stop_fabrication,
    reset=reset_fabrication)  # -> out
# ---------- fabrication_2: Python ----------
from scriptcontext import sticky as st
import time
import ghpythonlib.components as ghcomp
import Rhino.Geometry as rg
import Grasshopper as gh
import math as m



if start:
    #if robot.is_connected(): #and arduino.is_connected():
    print "starting process"
    fabrication.start()

if stop:
    print "stopping process"
    fabrication.stop()

if pause:
    print "pausing process"
    fabrication.pause()

if resume:
    print "resuming process"
    fabrication.resume()
    
if reset:
    print "resuming process"
    fabrication.reset()
# ---------- end fabrication_2 ----------

# ----
# Draw
counter = CountThroughList(am_model=layer_def.am_model, start=start, stop=stop, step=step, step_back=back, reset=reset, full=full, interval=list_2)  # -> item, counter; inputs start: Boolean, stop: Boolean, step_back: Boolean
# ---------- counter: Python ----------
from scriptcontext import sticky as st
from compas_ghpython import update_component


L = list(am_model.layers())
# store data in component
guid = str(ghenv.Component.InstanceGuid)
counter_key = "counter_" + guid
running_key = "running_" + guid

if counter_key not in st:
    st[counter_key] = 0

if running_key not in st:
    st[running_key] = False
    

if st[running_key]:
    if st[counter_key] < len(L) - 1:
        st[counter_key] += 1
        update_component(ghenv, interval)
    else:
        st[counter_key] = 0
        st[running_key] = False
    
    
if start:
    st[running_key] = True

if stop:
    st[running_key] = False

if step:
    if st[counter_key] < len(L) - 1:
        st[counter_key] += 1

if step_back:
    if st[counter_key] < len(L) - 1:
        st[counter_key] -= 1

if reset:
    st[counter_key] = 0

if full:
    st[counter_key] = len(L)-1

if len(L):
    item = L[st[counter_key]]



#st["visualisation_counter"] = st[counter_key]
counter = st[counter_key]
# ---------- end counter ----------
show_3 = BooleanToggle(True)
show_4 = BooleanToggle(True)
idx = Panel(counter.counter)
draw_2 = PythonScript(am_model=layer_def.am_model, show_all=show_4, show_counter=show_3, counter=idx)  # -> G, tool_planes_WCS, current_tool_plane, current_tool_planes; inputs counter: Int32
# ---------- draw_2: Python ----------
import os
import sys

import math

from compas_ghpython.artists import MeshArtist
from compas_ghpython import draw_frame


G = []

key_index = am_model.network.key_index()
keys = [key_index[key] for key in am_model.network.nodes()]
layers = [am_model.layer(key) for key in keys]
#print elements
#print([(e.gripping_frame) for e in elements])

start_planes_WCS = [draw_frame(l.node(0).frame) for l in layers]

current_tool_plane = start_planes_WCS[counter]
current_tool_planes = [draw_frame(node.frame) for key, node in am_model.layer(counter).nodes()]

if show_all and not show_counter:
    for layer in layers:
        for key, node in layer.nodes():
            plane = draw_frame(node.frame) 
            G.append(plane)

if show_counter:
    for layer in layers[0:counter+1]:
        for key, node in layer.nodes():
            plane = draw_frame(node.frame) 
            G.append(plane)

    tool_planes_WCS = [draw_frame(l.node(0).tool_frame) for l in layers[0:counter+1]]
# ---------- end draw_2 ----------
pln_2 = Plane(draw_2.tool_planes_WCS)
geo = Geometry(draw_2.G)
pln_3 = Plane(draw_2.current_tool_plane)
preview = CustomPreview(Geometry=geo, Shader=ColourSwatch(SwatchColor=RGBA(255, 227, 227, 233)))
preview_2 = CustomPreview(Geometry=[pln_2, pln_3], Shader=ColourSwatch(SwatchColor=RGBA(209, 27, 27, 178)))

# ----
# Draw
counter_2 = CountThroughList(planes=curve_def, start=start_2, stop=stop_2, step=step_2, step_back=back_2, reset=reset_2, full=full_2, interval=list_3)  # -> item, counter; inputs planes: list, start: Boolean, stop: Boolean, step_back: Boolean
# ---------- counter_2: Python ----------
from scriptcontext import sticky as st
from compas_ghpython import update_component


L = planes
# store data in component
guid = str(ghenv.Component.InstanceGuid)
counter_key = "counter_" + guid
running_key = "running_" + guid

if counter_key not in st:
    st[counter_key] = 0

if running_key not in st:
    st[running_key] = False
    

if st[running_key]:
    if st[counter_key] < len(L) - 1:
        st[counter_key] += 1
        update_component(ghenv, interval)
    else:
        st[counter_key] = 0
        st[running_key] = False
    
    
if start:
    st[running_key] = True

if stop:
    st[running_key] = False

if step:
    if st[counter_key] < len(L) - 1:
        st[counter_key] += 1

if step_back:
    if st[counter_key] < len(L) - 1:
        st[counter_key] -= 1

if reset:
    st[counter_key] = 0

if full:
    st[counter_key] = len(L)-1

if len(L):
    item = L[st[counter_key]]



#st["visualisation_counter"] = st[counter_key]
counter = st[counter_key]
# ---------- end counter_2 ----------
filter = StreamFilter(Gate=list, Stream0=plane, Stream1=counter_2.item, Stream2=draw_2.current_tool_plane)
idx_2 = Panel(counter_2.counter)

pln_4 = Plane(pln_3)
target_plane = Plane(filter)

# ----
# Tool
panel_2 = Panel("Attach a custom tool")
list_4 = ValueList({"measurement_tool": 0, "concrete_extruder": 1}, selected="concrete_extruder")
tools = Tools(G=list_4)
remove = Button()
add = Button()

# ----
# ROS & ABB client
ros_ip = ValueList({"127.0.0.1"}, selected="127.0.0.1")
ros_port = ValueList({"9090"}, selected="9090")
ros = ROSConnect(ip=ros_ip, port=ros_port, connect=Toggle(True))  # -> ros_client, is_connected; inputs port: Int32, connect: Boolean
#   port ip: The ip address ROS. Defaults to 127.0.0.1.
#   port port: The port of ROS. Defaults to 9090.
#   port connect: If True, connects to ROS. If False, disconnects from ROS. Defaults to False.
#   port ros_client: The ROS client.
#   port is_connected: True if connection established.
# ---------- ros: Python ----------
"""
Connect or disconnect to ROS.

COMPAS FAB v0.19.1
"""
from ghpythonlib.componentbase import executingcomponent as component
from scriptcontext import sticky as st

from compas_fab.backends import RosClient
from compas_fab.ghpython.components import create_id


class ROSConnect(component):
    def RunScript(self, ip, port, connect):
        ros_client = None

        ip = ip or '127.0.0.1'
        port = port or 9090

        key = create_id(self, 'ros_client')
        ros_client = st.get(key, None)

        if ros_client:
            st[key].close()
        if connect:
            st[key] = RosClient(ip, port)
            st[key].run(5)

        ros_client = st.get(key, None)
        is_connected = ros_client.is_connected if ros_client else False
        return (ros_client, is_connected)
# ---------- end ros ----------
is_connected = Panel(ros.is_connected)
abb = GhPythonScript(ros_client=ros.ros_client, connect=Toggle(True))  # -> out, abb_client; inputs connect: Boolean
# ---------- abb: Python ----------
import compas_rrc as rrc

if ros_client:
    if ros_client.is_connected and connect: 
        # Create ABB Client
        abb_client = rrc.AbbClient(ros_client, '/rob1')
# ---------- end abb ----------

# ----
# Load Model
# Load robot from local package
load_2 = Button()
units = ValueList({"m": 1, "cm": 100, "mm": 1000}, selected="m")
list_5 = ValueList({"abb_fabtory"}, selected="abb_fabtory")

# ----
# Robot Model
panel_3 = Panel("abb_fabtory.srdf")

load_model = PythonScript(
    path=path.ROBOT_DESCRIPTION,
    package=list_5,
    urdf_name="abb_fabtory.urdf",
    srdf_name=panel_3,
    scale_factor=units,
    load=load_2)  # -> robot
# ---------- load_model: Python ----------
import os
from scriptcontext import sticky as st
import compas
from compas.robots import RobotModel
from compas.robots import LocalPackageMeshLoader
from compas_fab.robots import Robot
from compas_fab.robots import RobotSemantics
from compas_fab.ghpython import RobotArtist

packages = ["abb_irb6700_support", "abb_end_effectors", "abb_fabtory"]
loaders = []

for package in packages:
    loaders.append(LocalPackageMeshLoader(path, package))

#path directory
package_path = os.path.join(path, package)
print(package_path)

urdf_filename = os.path.join(package_path, "urdf", urdf_name)
srdf_filename = os.path.join(package_path, srdf_name)

assert os.path.isfile(urdf_filename)
assert os.path.isfile(srdf_filename)

compas.PRECISION = '12f'

# store robot in component
guid = str(ghenv.Component.InstanceGuid)
robot_key = "robot_" + guid

if robot_key not in st:
    st[robot_key] = None

#load robot model from urdf
if load:
    model = RobotModel.from_urdf_file(urdf_filename)
    model.load_geometry(*loaders)
    artist = RobotArtist(model)
    semantics = RobotSemantics.from_srdf_file(srdf_filename, model)
    robot = Robot(model, artist, semantics, client=None)

    st[robot_key] = robot
robot = st[robot_key]

#vizualize robot in the right scale of your environment
robot.scale(scale_factor)
# ---------- end load_model ----------

attach_remove = PythonScript(robot=load_model, tool=tools, attach=add, remove=remove)  # -> bang
# ---------- attach_remove: Python ----------
if attach:
    robot.attach_tool(tool)

    
if remove:
    robot.detach_tool()
# ---------- end attach_remove ----------

set = PythonScript(robot=load_model, ros_client=ros.ros_client, abb_client=abb.abb_client)  # -> out, robot, main_group_name
# ---------- set: Python ----------
if robot and ros_client and abb_client:
    robot.ros_client = ros_client
    robot.abb_client = abb_client

    robot.info()
    main_group_name = robot.main_group_name
    print robot.info
# ---------- end set ----------

robot_info = Panel(set.out)

# ----
# forward kinematics
number_slider_2 = Slider(0, range=-180..180)
# Configuration
number_slider_3 = Slider(0, range=0..4.2)
jp = GhPythonScript()  # -> configuration_values
# ---------- jp: Python ----------
import math
joint_values = [-3.136, -0.328, -1.218, 3.129, 0.852, 0.008]
#joint_values = [math.degrees(j) for j in joint_values]
#joint_positions = [0] * 6

cart = 0
joint_values = [0,0,0,0,0,0]

configuration_values = [cart] + joint_values
# ---------- end jp ----------
forward_kinematics = PythonScript(
    robot=set.robot,
    reset_configuration=Button(),
    configuration_values=jp,
    a_cart=number_slider_3,
    a_a1=number_slider_2,
    a_a2=Slider(0, range=-90..150),
    a_a3=Slider(0, range=-180..180),
    a_a4=Slider(0, range=-400..400),
    a_a5=Slider(0, range=-125..120),
    a_a6=Slider(0, range=-400..400))  # -> full_configuration; inputs reset_configuration: Boolean, configuration_values: list
# ---------- forward_kinematics: Python ----------
import math
import Grasshopper
import copy
from compas.robots import Joint
from compas_fab.robots import Configuration





if reset_configuration:
    j = 0
    for i in range(ghenv.Component.Params.Input.Count):
        nslider = ghenv.Component.Params.Input[i].Sources[0]
        if nslider.GetType() == Grasshopper.Kernel.Special.GH_NumberSlider:
            nslider.TrySetSliderValue(configuration_values[j])
            j += 1


if robot:
    joint_positions = [a_cart, a_a1, a_a2, a_a3, a_a4, a_a5, a_a6]
    #print joint_positions
    joint_positions_degrees = copy.deepcopy(joint_positions)
    joint_types = robot.get_configurable_joint_types()
    #print(joint_types)
    for i, joint_type in enumerate(joint_types):
        if joint_type == Joint.REVOLUTE:
            joint_positions[i] = math.radians(joint_positions[i])
        if joint_type == Joint.PRISMATIC:
            joint_positions[i] = joint_positions[i]
    full_configuration = Configuration(joint_positions, joint_types)
    #print full_configuration
# ---------- end forward_kinematics ----------

# ----
# inverse kinematics
py_2 = PythonScript(robot=set.robot)  # -> configuration
# ---------- py_2: Python ----------
from compas_fab.robots import Configuration

if robot:
    types = robot.get_configurable_joint_types()
    values = [0] * len(types)
    configuration = Configuration(values, types)
    print configuration
    print robot.get_configurable_joint_names()
# ---------- end py_2 ----------
list_6 = ValueList({"fk_configuration": 0, "robot_configuration": 1}, selected="fk_configuration")
go_to_start_configuration = BooleanToggle(False)
fk_configuration = Data(forward_kinematics)
list_7 = ValueList({"manipulator", "manipulator_axis"}, selected="manipulator")
avoid_collisions = BooleanToggle(False)
filter_2 = StreamFilter(Gate=list_6, Stream0=fk_configuration, Stream1=py_2)
inverse_kinematics = GhPythonScript(
    compute=Toggle(True),
    robot=set.robot,
    plane=filter,
    start_configuration=filter_2,
    go_to_start_configuration=go_to_start_configuration,
    avoid_collisions=avoid_collisions,
    group=set.main_group_name)  # -> out, ik_configuration, t0cp; inputs plane: Plane
# ---------- inverse_kinematics: Python ----------
from __future__ import print_function
import logging
from compas.geometry import Frame
from scriptcontext import sticky as st
from compas_ghpython.artists import FrameArtist

LOGGER = logging.getLogger('roslibpy')

#vizualize t0cf
if robot.attached_tool:
    t0cf = Frame(plane.Origin, plane.XAxis, plane.YAxis)
    t0cf = robot.from_tcf_to_t0cf([t0cf])[0]
    #artist = FrameArtist(t0cf)
    #t0cp = artist.draw()
    #print (t0cf)


if compute:
    if robot.attached_tool:
        tool_attached = True
    else:
        tool_attached = False

    robot.client = robot.ros_client
    if go_to_start_configuration:
        ik_configuration = start_configuration
    else:
        frame = Frame(plane.Origin, plane.XAxis, plane.YAxis)
        if tool_attached:
            tool_frame = robot.from_tcf_to_t0cf([frame])[0]
        else:
            tool_frame = frame

    ik_configuration = robot.inverse_kinematics(tool_frame,
                                                  start_configuration,
                                                  group=group,
                                                  options={
                                                    'avoid_collisions':avoid_collisions,
                                                    'return_full_configuration':True,
                                                  })        
#group_configuration = robot.get_group_configuration(group, ik_configuration)
#print (group_configuration)
st["ik_configuration"] = ik_configuration

ik_configuration = st["ik_configuration"] 
print(ik_configuration)
# ---------- end inverse_kinematics ----------
draw_3 = GhPythonScript(planes=inverse_kinematics.t0cp, scale=Slider(0.2, range=0..1))  # -> P, V, C, W; inputs planes: list
# ---------- draw_3: Python ----------
from System.Drawing import Color
from compas_ghpython.artists import FrameArtist

red = Color.FromArgb(255, 0, 0)
green = Color.FromArgb(0, 255, 0)
blue = Color.FromArgb(0, 0, 255)

P = []
V = []
C = []

scale = float(scale)

for plane in planes:
    if not plane:
        continue
    P += [plane.Origin] * 3
    V.append(plane.XAxis * scale)
    V.append(plane.YAxis * scale)
    V.append(plane.ZAxis * scale)
    C += [red, green, blue]

W = 3
# ---------- end draw_3 ----------
out = Panel(inverse_kinematics.out)
vdisex = VectorDisplayEx(Point=draw_3.P, Vector=draw_3.V, Colour=draw_3.C, Width=draw_3.W)

list_8 = ValueList({"0 forward_kinematics": 0, "1 inverse_kinematics": 1}, selected="1 inverse_kinematics")
fk_configuration_2 = Data(forward_kinematics)
ik_configuration = Data(inverse_kinematics.ik_configuration)
filter_3 = StreamFilter(Gate=list_8, Stream0=fk_configuration_2, Stream1=ik_configuration)

# ----
# Visualisation
show_end_effector_frame = BooleanToggle(False)
show_base_frame = BooleanToggle(False)
show_collision = BooleanToggle(False)
show_frames = BooleanToggle(False)
show_visual = BooleanToggle(True)
show_acm = BooleanToggle(False)
robot_visualize = RobotVisualize(
    robot=set.robot,
    group=set.main_group_name,
    configuration=filter_3,
    redraw=attach_remove,
    show_visual=show_visual,
    show_collision=show_collision,
    show_frames=show_frames,
    show_base_frame=show_base_frame,
    show_end_effector_frame=show_end_effector_frame,
    show_acm=show_acm)  # -> visual, collision, attached_meshes, frames, base_frame, ee_frame; inputs redraw: list, show_visual: Boolean, show_collision: Boolean, show_frames: Boolean, show_base_frame: Boolean, show_end_effector_frame: Boolean, show_acm: Boolean
#   port group: The planning group used for end-effector and base visualization.
#   port configuration: The robot's full configuration.
#   port redraw: A list of attached collision meshes.
#   port show_visual: Whether or not to show the robot's visual meshes.
#   port show_collision: Whether or not to show the robot's collision meshes.
#   port show_frames: Whether or not to show the robot's joint frames.
#   port show_base_frame: Whether or not to show the robot's base frame.
#   port show_end_effector_frame: Whether or not to show the robot's end-effector frame.
#   port show_acm: Whether or not to show the attached collision meshes (if any).
#   port visual: The robot's visual Rhino meshes (if any).
#   port collision: The robot's collision Rhino meshes (if any).
#   port attached_meshes: The attached collision Rhino meshes (if any).
#   port frames: The robot's joint frames as Rhino planes (if any).
#   port base_frame: The robot's base frame as a Rhino plane (if any).
#   port ee_frame: The robot's end-effector frame as a Rhino plane (if any).
# ---------- robot_visualize: Python ----------
"""
Visualizes the robot.

COMPAS FAB v0.19.1
"""
from compas.geometry import Frame
from compas.geometry import Transformation
from compas_ghpython.artists import FrameArtist
from compas_ghpython.artists import MeshArtist
from ghpythonlib.componentbase import executingcomponent as component


class RobotVisualize(component):
    def RunScript(self, robot, group, configuration, attached_collision_meshes, show_visual, show_collision,
                  show_frames, show_base_frame, show_end_effector_frame, show_acm):

        visual = None
        collision = None
        attached_meshes = None
        frames = None
        base_frame = None
        ee_frame = None

        if robot:
            show_visual = True if show_visual is None else show_visual
            configuration = configuration or robot.zero_configuration()

            robot.update(configuration, visual=show_visual, collision=show_collision)
            compas_frames = robot.transformed_frames(configuration, group)

            if show_visual:               
                visual = robot.artist.draw_visual()
                

            if show_collision:
                collision = robot.artist.draw_collision()

            if show_base_frame:
                base_compas_frame = compas_frames[0]
                artist = FrameArtist(base_compas_frame)
                base_frame = artist.draw()

            if show_end_effector_frame:
                ee_compas_frame = robot.forward_kinematics(configuration, group, options=dict(solver='model'))
                if robot.attached_tool:
                    ee_compas_frame = robot.from_t0cf_to_tcf([ee_compas_frame])[0]
                artist = FrameArtist(ee_compas_frame)
                ee_frame = artist.draw()

            if show_frames:
                frames = []
                for compas_frame in compas_frames[1:]:
                    artist = FrameArtist(compas_frame)
                    frame = artist.draw()
                    frames.append(frame)

            if show_acm:
                attached_meshes = []
                for acm in attached_collision_meshes:
                    frame = robot.forward_kinematics(configuration, options=dict(solver='model', link_name=acm.link_name))
                    T = Transformation.from_frame_to_frame(Frame.worldXY(), frame)
                    mesh = acm.collision_mesh.mesh.transformed(T)
                    attached_meshes.append(MeshArtist(mesh).draw())

        return (visual, collision, attached_meshes, frames, base_frame, ee_frame)
# ---------- end robot_visualize ----------
draw_4 = GhPythonScript(frames=[robot_visualize.frames, robot_visualize.base_frame, robot_visualize.ee_frame], scale=Slider(0.2, range=0..1))  # -> P, V, C, W; inputs frames: list
# ---------- draw_4: Python ----------
from System.Drawing import Color
from compas_ghpython.artists import FrameArtist

red = Color.FromArgb(255, 0, 0)
green = Color.FromArgb(0, 255, 0)
blue = Color.FromArgb(0, 0, 255)

P = []
V = []
C = []

scale = float(scale)

for plane in frames:
    if not plane:
        continue
    P += [plane.Origin] * 3
    V.append(plane.XAxis * scale)
    V.append(plane.YAxis * scale)
    V.append(plane.ZAxis * scale)
    C += [red, green, blue]

W = 3
# ---------- end draw_4 ----------
geo_2 = Geometry([robot_visualize.visual, robot_visualize.collision, robot_visualize.attached_meshes])
# Move Control
preview_3 = CustomPreview(Geometry=geo_2, Shader=ColourSwatch(SwatchColor=RGB(207, 157, 160)))
vdisex_2 = VectorDisplayEx(Point=draw_4.P, Vector=draw_4.V, Colour=draw_4.C, Width=draw_4.W)

# ----
# Move Joints
tcp_speed_3 = Slider(250, range=0..1000)
movej_command = GhPythonScript(
    robot=set.robot,
    configuration=filter_3,
    speed=tcp_speed_3,
    move_to_joints=to_joints,
    move_single_joints=to_single_joints)  # -> out; inputs move_to_joints: Boolean
# ---------- movej_command: Python ----------
import fabtory_fabrication_control as ffc
import compas_rrc as rrc


from compas.geometry import Scale
from compas.robots import Joint
import math



# Print text on FlexPenant
# robot.abb_client.send(rrc.PrintText('Welcome TUM to COMPAS_RRC! ;)'))

#print configuration

if move_to_joints:
    #ffc.commands.move_to_joints(robot, configuration, speed=speed, zone=rrc.Zone.FINE)
    ffc.commands.move_to_joints_2(robot, configuration, speed=speed, zone=rrc.Zone.FINE)


ext_axes = rrc.ExternalAxes.from_configuration(configuration) #store all robot values from configuration
cart = rrc.ExternalAxes(ext_axes.values[0]) #store cart values from robot values
joints = rrc.RobotJoints(ext_axes.values[1:]) #store joint values from robot values
#robot.abb_client.send(rrc.MoveToJoints(joints, cart, speed, zone)) #send move to joints command



joint_goal = movejoints.get_current_joint_values()
print joint_goal


if move_single_joints:
    pass
    # TODO
# ---------- end movej_command ----------
data_recorder = DataRecorder(movej_command, DataLimit=-10, RecordData=True)
out_2 = Panel(data_recorder)

# ----
# Move Joints from List
tcp_speed_4 = Slider(200, range=0..1000)
to_joints_2 = Button()
movej_command_2 = GhPythonScript(robot=set.robot, configurations=filter_3, speed=tcp_speed_4, move_to_joints=to_joints_2)  # -> out; inputs configurations: list, move_to_joints: Boolean
# ---------- movej_command_2: Python ----------
import fabtory_fabrication_control as ffc
import compas_rrc as rrc


if move_to_joints:
    #ffc.commands.move_to_joints(robot, configuration, speed=speed, zone=rrc.Zone.FINE)
    for configuration in configurations:
        ffc.commands.move_to_joints_2(robot, configuration, speed=speed, zone=rrc.Zone.Z200)
# ---------- end movej_command_2 ----------
data_recorder_2 = DataRecorder(movej_command_2, DataLimit=-10, RecordData=True)
out_3 = Panel(data_recorder_2)

jp_2 = GhPythonScript(robot=set.robot)  # -> full_configurations
# ---------- jp_2: Python ----------
import math
import Grasshopper
import copy
from compas.robots import Joint
from compas_fab.robots import Configuration




"""
joint_values = [-3.136, -0.328, -1.218, 3.129, 0.852, 0.008]
#joint_values = [math.degrees(j) for j in joint_values]
#joint_positions = [0] * 6

configurations_values = []

cart = 0
joint_values = [0,0,0,0,0,0]
configuration_values = [cart] + joint_values

configurations_values.append(configuration_values)

full_configurations = []

for configuration_values in configurations_values:

    joint_positions_degrees = copy.deepcopy(configuration_values)
    joint_types = robot.get_configurable_joint_types()
    #print(joint_types)
    for i, joint_type in enumerate(joint_types):
        if joint_type == Joint.REVOLUTE:
            joint_positions[i] = math.radians(joint_positions[i])
        if joint_type == Joint.PRISMATIC:
            joint_positions[i] = joint_positions[i]
    full_configurations.append(Configuration(joint_positions, joint_types))
    

if move_to_joints:
    #ffc.commands.move_to_joints(robot, configuration, speed=speed, zone=rrc.Zone.FINE)
    ffc.commands.move_to_joints_2(robot, configuration, speed=speed, zone=rrc.Zone.FINE)
"""




"""
full_configurations = []

c = Configuration((0.937, -1.328, 0.277, 0.786, 0.276, -1.079, -0.134), (2, 0, 0, 0, 0, 0, 0), ('axis_joint', 'joint_1', 'joint_2', 'joint_3', 'joint_4', 'joint_5', 'joint_6'))
full_configurations.append(c)

c = Configuration((1.691, -2.350, -0.365, 0.800, -0.258, -0.483, 0.197), (2, 0, 0, 0, 0, 0, 0), ('axis_joint', 'joint_1', 'joint_2', 'joint_3', 'joint_4', 'joint_5', 'joint_6'))
full_configurations.append(c)

c = Configuration((1.679, -1.497, 0.538, -0.330, -0.150, -1.191, 0.272), (2, 0, 0, 0, 0, 0, 0), ('axis_joint', 'joint_1', 'joint_2', 'joint_3', 'joint_4', 'joint_5', 'joint_6'))
full_configurations.append(c)
"""
# ---------- end jp_2 ----------

# ----
# Move Cartesian from List
to_robtargets = Button()
to_frames = Button()
movel_command = GhPythonScript(
    robot=set.robot,
    configuration=filter_3,
    speed=tcp_speed_2,
    target_planes=draw_2.current_tool_planes,
    move_to_frames=to_frames,
    move_to_robtargets=to_robtargets,
    set_tool=set_tool_2)  # -> out; inputs target_planes: list of Plane, move_to_frames: Boolean, move_to_robtargets: Boolean
# ---------- movel_command: Python ----------
import compas_rrc as rrc
import fabtory_fabrication_control as ffc
from compas.geometry import Frame

#set tool in RobotStudio
if set_tool:
    if robot.attached_tool:
        tool_name = robot.attached_tool.name
        done = robot.abb_client.send(rrc.SetTool(tool_name))
        print done
    else:
        robot.abb_client.send(rrc.SetTool("tool0"))

if move_to_frames:
    #transform target plane into target frame
    
    for i, target_plane in enumerate(target_planes):
        if i < len(target_planes)-1:
            zone = rrc.Zone.Z50
        else:
            zone = rrc.Zone.FINE
        print zone
        target_frame = Frame(target_plane.Origin, target_plane.XAxis, target_plane.YAxis)
        #send move to frame command
        ffc.commands.move_to_frame(robot, target_frame, speed=speed, zone=zone, scalefactor=1000)

if move_to_robtargets:
    for i, target_plane in enumerate(target_planes):
        if i < len(target_planes)-1:
            zone = rrc.Zone.Z50
        else:
            zone = rrc.Zone.FINE
        print zone
        #transform target plane into target frame
        target_frame = Frame(target_plane.Origin, target_plane.XAxis, target_plane.YAxis)
        #store cart value from configuration
        cart = (configuration.joint_values[0])
        #send move to robtarget command
        ffc.commands.move_to_robtarget(robot, target_frame, cart, speed=speed, zone=zone, scalefactor=1000)
# ---------- end movel_command ----------
data_recorder_3 = DataRecorder(movel_command, DataLimit=-10, RecordData=True)
out_4 = Panel(data_recorder_3)

# ----
# Move Cartesian
movel_command_2 = GhPythonScript(
    robot=set.robot,
    configuration=filter_3,
    speed=tcp_speed,
    target_plane=target_plane,
    move_to_frame=to_frame,
    move_to_robtarget=to_robtarget,
    set_tool=set_tool)  # -> out; inputs target_plane: Plane, move_to_frame: Boolean, move_to_robtarget: Boolean
# ---------- movel_command_2: Python ----------
import compas_rrc as rrc
import fabtory_fabrication_control as ffc
from compas.geometry import Frame

#set tool in RobotStudio
if set_tool:
    if robot.attached_tool:
        tool_name = robot.attached_tool.name
        done = robot.abb_client.send(rrc.SetTool(tool_name))
        print done
    else:
        robot.abb_client.send(rrc.SetTool("tool0"))

if move_to_frame:
    #transform target plane into target frame
    target_frame = Frame(target_plane.Origin, target_plane.XAxis, target_plane.YAxis)
    #send move to frame command
    ffc.commands.move_to_frame(robot, target_frame, speed=speed, zone=rrc.Zone.FINE, scalefactor=1000)

if move_to_robtarget:
    #transform target plane into target frame
    target_frame = Frame(target_plane.Origin, target_plane.XAxis, target_plane.YAxis)
    #store cart value from configuration
    cart = (configuration.joint_values[0])
    #send move to robtarget command
    ffc.commands.move_to_robtarget(robot, target_frame, cart, speed=speed, zone=rrc.Zone.FINE, scalefactor=1000)
# ---------- end movel_command_2 ----------
data_recorder_4 = DataRecorder(movel_command_2, DataLimit=-10, RecordData=True)
out_5 = Panel(data_recorder_4)

# ----
# Get Robot Configurations
get_joints_2 = GhPythonScript(robot=set.robot, get_frame=get_frame, get_robtarget=get_robtarget, get_joints=get_joints)  # -> joint, current_plane
# ---------- get_joints_2: Python ----------
from compas_ghpython.artists import FrameArtist
from scriptcontext import sticky as st
import fabtory_fabrication_control as ffc
import os

# store robot in component
guid = str(ghenv.Component.InstanceGuid)
current_frame_key = "current_frame_" + guid
current_robtarget_key = "current_robtarget_" + guid
current_configuration_key = "current_configuration_" + guid

if current_frame_key not in st:
    st[current_frame_key] = None

if current_robtarget_key not in st:
    st[current_robtarget_key] = None

if current_configuration_key not in st:
    st[current_configuration_key] = None


#get commands
if get_frame:
    current_frame = ffc.feedback.get_frame(robot, scalefactor=0.001)
    st[current_frame_key] = current_frame

if get_robtarget:
    current_robtarget = ffc.feedback.get_robtarget(robot, scalefactor=0.001)
    print current_robtarget
    st[current_robtarget_key] = current_robtarget


if get_joints:
    current_configuration = ffc.feedback.get_joints(robot)
    st[current_configuration_key] = current_configuration
    print current_configuration

# sticky
if st[current_frame_key]:
    current_frame = st[current_frame_key]
    artist = FrameArtist(current_frame)
    current_plane = artist.draw()

if st[current_robtarget_key]:
    current_robtarget = st[current_robtarget_key]

if st[current_configuration_key]:
    current_configuration = st[current_configuration_key]
    print current_configuration
# ---------- end get_joints_2 ----------
data_recorder_5 = DataRecorder(get_joints_2.joint, DataLimit=-10, RecordData=True)
joint_values = Panel(data_recorder_5)
draw_5 = GhPythonScript(plane=get_joints_2.current_plane, scale=Slider(0.2, range=0..1))  # -> P, V, C, W; inputs plane: Plane
# ---------- draw_5: Python ----------
from System.Drawing import Color
from compas_ghpython.artists import FrameArtist

red = Color.FromArgb(255, 0, 0)
green = Color.FromArgb(0, 255, 0)
blue = Color.FromArgb(0, 0, 255)

P = []
V = []
C = []

scale = float(scale)


if plane:
    P += [plane.Origin] * 3
    V.append(plane.XAxis * scale)
    V.append(plane.YAxis * scale)
    V.append(plane.ZAxis * scale)
    C += [red, green, blue]
    
    W = 3
# ---------- end draw_5 ----------
vdisex_3 = VectorDisplayEx(Point=draw_5.P, Vector=draw_5.V, Colour=draw_5.C, Width=draw_5.W)

# ==== cluster Tools

# ---- group: measurement tool
geo = Geometry(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)
mesh = Mesh(geo)
mjoin = MeshJoin(Meshes=mesh)
yaxis_line = Curve(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)
xaxis_line = Curve(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)
tool = PythonScript(rhmesh=mjoin, xline=xaxis_line, yline=yaxis_line)  # -> values_for_robotstudio, tool; inputs rhmesh: Mesh
# ---------- tool: Python ----------
import Rhino.Geometry as rg
import os, math
from compas.geometry import Frame, Rotation
from compas.datastructures import Mesh
from compas_ghpython.artists import MeshArtist
from compas_fab.robots import Tool
from compas_rhino.geometry import RhinoMesh

xaxis = rg.Line(xline.PointAtStart, xline.PointAtEnd)
yaxis = rg.Line(yline.PointAtStart, yline.PointAtEnd)

if xaxis.From.DistanceTo(yaxis.From) < 0.01:
    origin = xaxis.From
    xaxis = xaxis.Direction
    yaxis = yaxis.Direction
elif xaxis.To.DistanceTo(yaxis.To) < 0.01:
    origin = xaxis.To
    xaxis = -xaxis.Direction
    yaxis = -yaxis.Direction
elif xaxis.From.DistanceTo(yaxis.To) < 0.01:
    origin = xaxis.From
    xaxis = xaxis.Direction
    yaxis = -yaxis.Direction
elif xaxis.To.DistanceTo(yaxis.From) < 0.01:
    origin = xaxis.To
    xaxis = -xaxis.Direction
    yaxis = yaxis.Direction

xaxis.Unitize()
yaxis.Unitize()

ee_frame = Frame(origin, xaxis, yaxis)
ee_mesh = RhinoMesh.from_geometry(rhmesh).to_compas()

tool = Tool(ee_mesh, ee_frame, collision=None, name="t_measurement")

values_for_robotstudio = [[round(entry*1000, 5) for entry in list(ee_frame.point)], list(ee_frame.quaternion)]
print values_for_robotstudio
# ---------- end tool ----------
values_for_robotstudio = Panel(tool.values_for_robotstudio)

# ---- group: concrete extruder tool
geo_2 = Geometry(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)
mesh_2 = Mesh(geo_2)
mjoin_2 = MeshJoin(Meshes=mesh_2)
yaxis_line_2 = Curve(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)
xaxis_line_2 = Curve(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)
tool_2 = PythonScript(rhmesh=mjoin_2, xline=xaxis_line_2, yline=yaxis_line_2)  # -> values_for_robotstudio, tool; inputs rhmesh: Mesh
# ---------- tool_2: Python ----------
import Rhino.Geometry as rg
import os, math
from compas.geometry import Frame, Rotation
from compas.datastructures import Mesh
from compas_ghpython.artists import MeshArtist
from compas_fab.robots import Tool
from compas_rhino.geometry import RhinoMesh


xaxis = rg.Line(xline.PointAtStart, xline.PointAtEnd)
yaxis = rg.Line(yline.PointAtStart, yline.PointAtEnd)

if xaxis.From.DistanceTo(yaxis.From) < 0.01:
    origin = xaxis.From
    xaxis = xaxis.Direction
    yaxis = yaxis.Direction
elif xaxis.To.DistanceTo(yaxis.To) < 0.01:
    origin = xaxis.To
    xaxis = -xaxis.Direction
    yaxis = -yaxis.Direction
elif xaxis.From.DistanceTo(yaxis.To) < 0.01:
    origin = xaxis.From
    xaxis = xaxis.Direction
    yaxis = -yaxis.Direction
elif xaxis.To.DistanceTo(yaxis.From) < 0.01:
    origin = xaxis.To
    xaxis = -xaxis.Direction
    yaxis = yaxis.Direction

xaxis.Unitize()
yaxis.Unitize()

ee_frame = Frame(origin, xaxis, yaxis)
ee_mesh = RhinoMesh.from_geometry(rhmesh).to_compas()

tool = Tool(ee_mesh, ee_frame, collision=None, name="t_concreteextruder")

values_for_robotstudio = [[round(entry*1000, 5) for entry in list(ee_frame.point)], list(ee_frame.quaternion)]
print values_for_robotstudio
# ---------- end tool_2 ----------
values_for_robotstudio_2 = Panel(tool_2.values_for_robotstudio)

# ----
G = ClusterInput()
filter = StreamFilter(Gate=G, Stream0=tool.tool, Stream1=tool_2.tool)
s_1 = ClusterOutput(filter)
