# Grasshopper definition 01_Test_1.gh (Grasshopper 1.0.7)
# Copyright: Felswind

# ----
# According to the paper I have read, it should be very important that the layer height is less than the nozzle diamater  so that the planes are pressed together.
length_m = Slider(0.5, range=0..1)
amplitude_factor = Slider(0.1, range=0..1)
waves_count = Slider(3, range=1..5)
layer_height_m = Slider(0.006, range=0..0.1)
layers_count = Slider(20, range=1..50)

print_test_1 = GhPythonScript(length=length_m, amplitude=amplitude_factor, waves=waves_count, layer_height=layer_height_m, layers=layers_count)  # -> out, print_path; inputs waves: Int32, layers: Int32
# ---------- print_test_1: Python ----------
import ghpythonlib.components as gh
import math


# Create base Curve: 

pa = gh.ConstructPoint(0,0,0)
pb = gh.ConstructPoint(length,0,0)

count = 50
div = gh.DivideCurve((gh.Line(pa,pb)), count, False)[0]

points_moved = []

waves = waves * 6
factor = waves/count

for i in range(len(div)):
    
    pt = div[i]
    moved = gh.Move(pt, gh.UnitY(amplitude*math.cos(i*factor)))[0]
    points_moved.append(moved)

base_curve = gh.Interpolate(points_moved, 3, False, 1)[0]



# Create print geometry: 

layer_curves = []

for i in range(layers):
    
    curve_moved = gh.Move(base_curve, gh.UnitZ(i*layer_height))[0]
    layer_curves.append(curve_moved)
    
    if i > 0 and i%2 == 0:
        end = gh.EndPoints(curve_moved)[0]
        end_moved = gh.Move(end, gh.UnitZ(-layer_height))[0]
        
        connection = gh.Line(end, end_moved)
        layer_curves.append(connection)
        
    elif i > 0 and i%2 != 0:
        end = gh.EndPoints(curve_moved)[1]
        end_moved = gh.Move(end, gh.UnitZ(-layer_height))[0]
        
        connection = gh.Line(end, end_moved)
        layer_curves.append(connection)




print_path = gh.JoinCurves(layer_curves, False)
# ---------- end print_test_1 ----------
division_curve_count = Slider(50, range=1..500)
create_subdivision = GhPythonScript(curves=print_test_1.print_path, division=division_curve_count)  # -> out, points_div; inputs curves: list of Curve, division: Int32
# ---------- create_subdivision: Python ----------
import ghpythonlib.components as gh



# Subdivide the Curves based on the curvature: 

expl = gh.Explode(curves, True)[0]

points_div = []

for i in range(len(expl)):
    
    if str(type(expl[i])) == "<type 'NurbsCurve'>" or str(type(expl[i])) == "<type 'ArcCurve'>":
        
        div = gh.DivideCurve(expl[i], division, False)[0]
        
        if i > 0:
            
            for k in range(len(div)):
                if k > 0:
                    points_div.append(div[k])
        
        else:
            for k in range(len(div)):
                points_div.append(div[k])
    
    else:
        
        div = gh.DivideCurve(expl[i], 1, False)[0]
        
        if i > 0:
            
            for k in range(len(div)):
                if k > 0:
                    points_div.append(div[k])
        
        else:
            for k in range(len(div)):
                points_div.append(div[k])
# ---------- end create_subdivision ----------
show = BooleanToggle(False)
reverse_list = ReverseList(List=create_subdivision.points_div)
layer_def = GhPythonScript(points_gh=reverse_list)  # -> out, layer; inputs points_gh: list of Point3d
# ---------- layer_def: Python ----------
import ghpythonlib.components as gh
import os
import sys
import json

from compas.geometry import Frame
from compas.geometry import Line
from compas.geometry import Vector

from am_information_model.model import Node
from am_information_model.model import Layer

def _radius_between_frames(from_frame, via_frame, to_frame, max_radius):
        in_line = Line(from_frame.point, via_frame.point)
        out_line = Line(via_frame.point, to_frame.point)
        r = min(max_radius, in_line.length/2, out_line.length/2)
        return r

# nodes
max_r = gh.Distance(points_gh[0], points_gh[1])
frames = [Frame([gh.Deconstruct(pt)[0], gh.Deconstruct(pt)[1], gh.Deconstruct(pt)[2]], [0, -1, 0], [-1, 0, 0]) for pt in points_gh]

print max_r

nodes = []
for i,frame in enumerate(frames):
    r = _radius_between_frames(frames[max(0,i-1)], frame, frames[min(i+1, len(frames)-1)], max_r)
    nodes.append(Node(frame, radius=r))
layer = Layer.from_nodes(nodes)
# ---------- end layer_def ----------
draw = PythonScript(layer=layer_def.layer, show=show)  # -> M, F, S
# ---------- draw: Python ----------
from compas.geometry import Transformation
from compas.geometry import Frame
from compas.datastructures import mesh_transformed
from compas_ghpython.artists import MeshArtist
from compas_ghpython import draw_frame

if show:
    F = [draw_frame(node.frame) for key, node in layer.nodes()]
# ---------- end draw ----------
