# Grasshopper definition Code_Kappendecke_2.0_set_1_var_1.ghx (Grasshopper 1.0.7)
# Copyright: Felswind
# plug-ins: CEM_Build_Topology, CEM_Deviation, CEM_Extract_Topology, CEM_Support, CEM_Trail, CEM_Calculate_Structure, CEM_Origin_Node, CEM_Extract_Structure, CEM_Load

layer_numb = Slider(6, range=1..50)
layer_depth = Slider(0.1, range=0.001..1)
arch_res = Slider(31, range=1..101)
tilt_angle = Slider(45, range=0..90)
dev_mag_arch = Slider(-14, range=-100..0)
trail_length = Slider(-0.025, range=-50..0)

type = ValueList({"Single_layered": 1, "double layered": 2}, selected="double layered")
toolpath_depth = Slider(0.03, range=0.001..1)
toolpath_height = Slider(0.015, range=0.001..1)

# ----
# Part A - Topology
create_topology = GhPythonScript(
    layer_numb=layer_numb,
    layer_depth=layer_depth,
    toolpath_height=toolpath_height,
    arch_res=arch_res,
    tilt_angle=tilt_angle,
    deviaton_arch_mag=dev_mag_arch,
    trail_length=trail_length)  # -> trail, trail_lengths, self_weight_point, self_weight_mag, external_load_point, external_load_mag, deviation, deviation_mag, anchor_points; inputs layer_numb: Int32, arch_res: Int32, tilt_angle: Int32
# ---------- create_topology: Python ----------
import ghpythonlib.components as gh
import math



####################################
## Define Curve Function: 
####################################



def arch_curve_topology(depth, x_pos, arch_res, layer_depth):
    
    
    ## Output parameters:
    anchor_points = []
    deviation_arch = []
    deviation_ring = []
    trail = []
    load_point = []
    
    
    ## Create the base curve and divide it: 
    base_line = gh.Line(gh.ConstructPoint(x_pos, -depth/2, 0), gh.ConstructPoint(x_pos, depth/2, 0))
    div = gh.DivideCurve(base_line, arch_res, False)
    explode = gh.Shatter(base_line, div[2])
    
    
    ## Create the Points for the Self_weight: 
    load_point.extend(div[0])
    
    
    ## Create the anchor points: 
    anchor_points.extend((div[0][0], div[0][-1]))
    
    
    ## Create the deviation / trail elements for the main arch: 
    for i, curve in enumerate(explode):
        if i == int(arch_res/2): deviation_arch.append(curve)
        else: trail.append(curve)
    
    
    ## Create the connecting (ring) deviation elements: 
    if x_pos > 0:
        pts_moved = gh.Move(div[0], gh.UnitX(-layer_depth))[0]
        line_dev = gh.Line(div[0], pts_moved)
        
        for curve in line_dev: deviation_ring.append(curve)
    
    
    ## Return the final geometry: 
    return(anchor_points, deviation_arch, deviation_ring, trail, load_point)



####################################
## Run the Curve Function: 
####################################



## Output Topology:
anchor_points = []
deviation = []
deviation_mag = []
trail = []
trail_lengths = []


## Output forces: 
self_weight_point = []
self_weight_mag = []
external_load_point = []
external_load_mag = []


## Calcualte the layer_depth based in the toolpath thickness: 
layer_depth_factor = int(layer_depth/toolpath_height)
layer_depth = layer_depth_factor * toolpath_height


## Create the Output elements:
tilt_angle = 90 - tilt_angle

for i in range(layer_numb):
    
    curve = arch_curve_topology(0.5, i*layer_depth, arch_res, layer_depth)
    
    
    ## Anchor points: 
    anchor_points.extend(curve[0])
    
    
    ## Create the points for the forces:
    self_weight_point.extend(curve[4])
    if i == 0: external_load_point.extend(curve[4])
    
    
    ## Create a Parapolic shape: 
    
    self_weight = -2
    for pt in curve[4]: self_weight_mag.append(self_weight)
    
    external_load = (layer_numb * -self_weight) / math.tan(math.radians(tilt_angle))
    if i == 0:
       for pt in external_load_point: external_load_mag.append(external_load)
    
    
    ## Deviation Elemements and magnitude:
    deviation.extend(curve[1])
    for crv in curve[1]: deviation_mag.append(deviaton_arch_mag)
    
    deviation.extend(curve[2])
    
    for crv in curve[2]: deviation_mag.append((-external_load / layer_numb) * (layer_numb - i))
    
    
    ## Trail elements and lengths: 
    trail.extend(curve[3])
    for crv in curve[3]: trail_lengths.append(trail_length)
# ---------- end create_topology ----------
cem_deviation = CEM_Deviation(DeviationEdge=graft(create_topology.deviation), DeviationMagn=graft(create_topology.deviation_mag))
cem_load = CEM_Load(PointLoad=graft(create_topology.self_weight_point), LoadMagnZ=graft(create_topology.self_weight_mag))
cem_load_2 = CEM_Load(PointLoad=graft(create_topology.external_load_point), LoadMagnX=graft(create_topology.external_load_mag))
cem_trail = CEM_Trail(TrailEdge=graft(create_topology.trail), TrailLen=graft(create_topology.trail_lengths))
cem_support = CEM_Support(Support=create_topology.anchor_points)
cem_build_topology = CEM_Build_Topology(T=flatten(cem_trail), L=flatten([cem_load, cem_load_2]), D=flatten(cem_deviation), S=flatten(cem_support))

# ----
# Part B - Structure
height = Slider(0.25, range=0..0.75)
cem_extract_topology = CEM_Extract_Topology(TP=cem_build_topology)  # -> Nodes, NodesID, Edges, EdgesID, ConstraintPlane, ConstraintPlaneID, OriginNode, OriginNodeID
unit_z = UnitZ(Factor=height)
move = Move(Geometry=cem_extract_topology.OriginNode, Motion=unit_z)  # -> Geometry, Transform
cem_origin_node = CEM_Origin_Node(OriginNode=move.Geometry, OriginNodeID=cem_extract_topology.OriginNodeID)
cem_calculate_structure = CEM_Calculate_Structure(TP=cem_build_topology, N=cem_origin_node)

# ----
# Part C - Preview
cem_extract_structure = CEM_Extract_Structure(M=cem_calculate_structure)  # -> Nodes, NodesID, Trails, TrailsID, TrailsCol, TrailsMag, Deviations, DeviationsID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
merge = Merge(Data1=cem_extract_structure.Trails, Data2=cem_extract_structure.Deviations)
merge_2 = Merge(Data1=cem_extract_structure.TrailsMag, Data2=cem_extract_structure.DeviationsMag)
colour = GhPythonScript(mag=merge_2)  # -> out; inputs mag: list
# ---------- colour: Python ----------
for magnitude in mag:
    
    if magnitude > 0: print(255, 0, 0)
    else: print(0, 0, 255)
# ---------- end colour ----------
custom_preview = CustomPreview(Geometry=merge, Material=colour)

# ----
# Part D - Export
generate_toolpath = GhPythonScript(lines=merge, layer_depth=layer_depth, type=type, toolpath_depth=toolpath_depth, toolpath_height=toolpath_height)  # -> printpath; inputs lines: list of Curve, type: Int32
# ---------- generate_toolpath: Python ----------
import ghpythonlib.components as gh
import math



#####################################################################################################
## Define Closing Functions: 
#####################################################################################################


## Close toolpath with one layer: 
## Close toolpath with one layer: 
def close_toolpath(curves, non_flip = 'none'):
    toolpath_flipped = []
    lines = []
    
    
    if non_flip != 'none': toolpath_flipped = curves
    else:
        for i, crv in enumerate(curves):
            if i % 2 == 0:
                toolpath_flipped.append(gh.FlipCurve(crv)[0])
            else:
                toolpath_flipped.append(crv)
    
    for i in range(int(len(toolpath_flipped)-1)): lines.append(gh.Line(gh.EndPoints(toolpath_flipped[i])[0], gh.EndPoints(toolpath_flipped[i+1])[1]))
    
    toolpath_final = []
    
    toolpath_final.extend(toolpath_flipped)
    toolpath_final.extend(lines)
    
    
    toolpath_final = gh.JoinCurves(toolpath_final, False)
    return(toolpath_final, toolpath_flipped)



## Close toolpath with a double layered geometry:
def double_layered_closing(curves, layer_depth, recut):
    curves_offset = []
    
    
    if recut == 0: 
        for crv in curves:
            curves_offset.append(gh.OffsetCurve(crv, layer_depth, gh.XYPlane(gh.ConstructPoint(0,0,0)), 1))
    
    
    if recut == 1:
        for crv in curves:
            plane = gh.Planar(crv)[1]
            offset = gh.ExtendCurve(gh.OffsetCurve(crv, layer_depth, plane, 1), 2, 1, 1)
            
            plane_cut_a = gh.ConstructPlane(gh.EndPoints(crv)[0], gh.VectorXYZ(1,0,0)[0], gh.VectorXYZ(0,1.6143,1)[0])
            plane_cut_b = gh.ConstructPlane(gh.EndPoints(crv)[1], gh.VectorXYZ(1,0,0)[0], gh.VectorXYZ(0,-1.6143,1)[0])
            
            cut_a = gh.CurveXPlane(offset, plane_cut_a)[1]
            curve_cut = gh.Shatter(offset, cut_a)[1]
            
            cut_b = gh.CurveXPlane(curve_cut, plane_cut_b)[1]
            curve_cut = gh.Shatter(curve_cut, cut_b)[0]
            
            curves_offset.append(curve_cut)
    
    
    if recut == 2:
        for crv in curves:
            plane = gh.Planar(crv)[1]
            offset = gh.ExtendCurve(gh.OffsetCurve(crv, layer_depth, plane, 1), 2, 1, 1)
            
            bound = gh.Extrude(gh.BoundarySurfaces(gh.Rectangle(gh.XYPlane(gh.ConstructPoint(0,0,0)), gh.ConstructDomain(-100,100), gh.ConstructDomain(-100,100),0)[0]), gh.UnitZ(-100))
            cut = gh.TrimwithBrep(offset, bound)[1]
            
            curves_offset.append(cut)
    
    
    ## Close one side: 
    lines_close = []
    for i, crv in enumerate(curves): lines_close.append(gh.Line(gh.EndPoints(crv)[0], gh.EndPoints(curves_offset[i])[0]))
    
    
    
    ## Join the curves: 
    joined = []
    for i, crv in enumerate(curves): joined.append(gh.JoinCurves([lines_close[i], curves[i], curves_offset[i]], False))
    
    return(joined)


## Just flip curves for fabrication: 

def flip_curves_fab(curves):
    
    curves_flipped = []
    
    for i in range(len(curves)):
        if i %2 == 0: curves_flipped.append(gh.FlipCurve(curves[i])[0])
        else: curves_flipped.append(curves[i])
    
    return(curves_flipped)



#####################################################################################################



## Filter out the print_path_elements: 
line_filtered = []
for ln in lines:
    if gh.Length(ln) < layer_depth*0.8: line_filtered.append(ln)



## Join, rebuild and interpolates the curves:
joined = gh.JoinCurves(line_filtered, False)
rebuilt = gh.RebuildCurve(joined, 3, 25, False)
flipped = gh.FlipCurve(rebuilt, rebuilt[0])[0]
sorted = gh.SortList(gh.Deconstruct(gh.CurveMiddle(flipped))[0], flipped)[1]

steps = []
interpolate = int(layer_depth/toolpath_height)

toolpath = []

for i in range(interpolate): steps.append(i/interpolate)
for i in range(int(len(joined)-1)): toolpath.extend(gh.TweenCurve(sorted[i], sorted[i+1], steps))

toolpath = gh.Move(toolpath, gh.UnitZ(-gh.EndPoints(toolpath[0])[0][2]))[0]



## Create the Closing of the geometry and cut the surface: 
closing_start = toolpath[0]
split = gh.CurveXPlane(closing_start, gh.XZPlane(gh.ConstructPoint(0,0,0)))[1]
closing_start_split = gh.Shatter(closing_start, split)[1]

closing_end = gh.Project(closing_start_split, gh.BoundarySurfaces(gh.Circle(gh.YZPlane(gh.ConstructPoint(0,0,0)), 100)), gh.VectorXYZ(-1,0,0)[0])
closing = gh.Loft([closing_start_split, closing_end], gh.LoftOptions(False, False, 0, 0, 0))


pts = gh.DivideLength(gh.FlipCurve(closing_end)[0], toolpath_height)[0]
pt_orig = gh.ConstructPoint(pts[0][0],0,0)

vec_pl = []
for pt in pts: vec_pl.append(gh.Vector2Pt(pt, pt_orig, False)[0])


vec_cut = []
for i, vec in enumerate(vec_pl):
    angle = math.degrees(math.asin(pts[i][2] / gh.VectorLength(vec)))
    
    angle_control = 60
    
    if angle < angle_control: vec_cut.append(vec)
    else:
        vec_cut.append(vec_cut[-1])


cutting_planes = []
for i,vec in enumerate(vec_cut): cutting_planes.append(gh.ConstructPlane(pts[i], gh.UnitX(1), vec))


## Create one layered start - geometry: 
curves_b = gh.BrepXPlane(closing, cutting_planes)[0]

curves_toolpath = []

for crv in curves_b:
    if gh.Length(crv) > toolpath_height:
        curves_toolpath.append(crv)
        curves_toolpath.append(gh.Mirror(crv, gh.XZPlane(gh.ConstructPoint(0,0,0)))[0])
        curves_toolpath.append(gh.Line(gh.EndPoints(crv)[0], gh.EndPoints(gh.Mirror(crv, gh.XZPlane(gh.ConstructPoint(0,0,0)))[0])[0]))



## Create two layered start - geometry:
if type ==2:
    curves_b_offset = []
    for i,crv in enumerate(curves_b):
        curves_b_offset.append(gh.OffsetCurve(crv, toolpath_depth, cutting_planes[i], 1))
    
    for i,crv in enumerate(curves_b_offset):
        if gh.Length(curves_b[i]) > toolpath_height:
            crv_a = gh.ExtendCurve(crv, 0, toolpath_depth, 0)
            crv_a_mir = gh.Mirror(gh.ExtendCurve(crv, 0, toolpath_depth, 0), gh.XZPlane(gh.ConstructPoint(0,0,0)))[0]
            
            connection = gh.Line(gh.EndPoints(crv_a)[0], gh.EndPoints(crv_a_mir)[0])
            conn_cross = gh.Line(gh.EndPoints(crv_a)[1], gh.EndPoints(curves_b[i])[1])
            
            if i > 0:curves_toolpath.extend([crv_a, crv_a_mir, connection, conn_cross])

curves_toolpath = gh.Move(gh.JoinCurves(curves_toolpath, False), gh.UnitX(-toolpath_height))[0]
curves_toolpath.reverse()


## Create the toolpath previews: 

if type == 1:
    toolpath_a = close_toolpath(toolpath)[0]
    toolpath_b = close_toolpath(curves_toolpath)[0]
    
    toolpath_single_a = close_toolpath(toolpath)[1]
    toolpath_single_b = close_toolpath(curves_toolpath)[1]



if type == 2:
    toolpath_a = close_toolpath(double_layered_closing(toolpath, toolpath_depth, 1), True)[0]
    toolpath_b = close_toolpath(curves_toolpath, True)[0]
    
    

printpath = [toolpath_b, toolpath_a]
# ---------- end generate_toolpath ----------
lateral_support = Brep([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])
place_on_support = PlaceOnSupport(
    geometry=generate_toolpath,
    brep=lateral_support,
    printpath_preview=generate_toolpath,
    B=toolpath_depth,
    B_2=toolpath_height)

# ==== cluster PlaceOnSupport
printpath_preview = ClusterInput()
bounding_box = BoundingBox(Printpath_preview=printpath_preview, Plane=PlaneXY(0, 0, 0), UnionBox=True)  # -> Box, Box_2
deconstruct_box = DeconstructBox(Box=bounding_box.Box)  # -> Plane, X, Y, Z
deconstruct_domain = DeconstructDomain(Domain=deconstruct_box.X)  # -> Start, End
absolute = Absolute(Value=deconstruct_domain.Start)
B = ClusterInput()
addition = Addition(A=absolute, B=B)
unit_x = UnitX(Factor=addition)
unit_z = UnitZ(Factor=1)
geometry = ClusterInput()
move = Move(Geometry=geometry, Motion=unit_x)  # -> Geometry, Transform
list_item = ListItem(List=move.Geometry, Index=0, Wrap=True)
end_points = EndPoints(Curve=list_item)  # -> Start, End
move_2 = Move(Geometry=end_points.Start, Motion=unit_z)  # -> Geometry, Transform
line = Line(StartPoint=end_points.Start, EndPoint=move_2.Geometry)
brep = ClusterInput()
brep_curve = BrepCurve(Brep=brep, Curve=line)  # -> Curves, flatten(Points)
list_item_2 = ListItem(List=brep_curve.Points, Index=0, Wrap=True)  # -> Item, Item1
distance = Distance(PointA=list_item_2.Item, PointB=list_item_2.Item1)
B_2 = ClusterInput()
addition_2 = Addition(A=distance, B=B_2)
unit_z_2 = UnitZ(Factor=addition_2)
move_3 = Move(Geometry=move.Geometry, Motion=unit_z_2)  # -> Geometry, Transform
geometry_2 = ClusterOutput(move_3.Geometry)
