# Grasshopper definition Code_Kappendecke_2.0_var_1_catenary_planar.ghx (Grasshopper 1.0.7)
# Copyright: Felswind
# plug-ins: CEM_Build_Topology, CEM_Deviation, CEM_Extract_Topology, CEM_Support, CEM_Trail, CEM_Calculate_Structure, CEM_Origin_Node, CEM_Material_Properties, CEM_Extract_Structure, CEM_Load

layer_numb = Slider(6, range=1..50)
layer_depth = Slider(0.2, range=0.001..1)
arch_res = Slider(31, range=1..101)
tilt_angle = Slider(45, range=0..90)
sw_load_type = ValueList({"Parabolic": 1, "Catenary": 2}, selected="Parabolic")
dev_mag_arch = Slider(-15, range=-100..0)
trail_length = Slider(-0.05, range=-50..0)

construct_point = ConstructPoint(XCoordinate=0, YCoordinate=-0.5, ZCoordinate=0)  # disabled
construct_point_2 = ConstructPoint(XCoordinate=0, YCoordinate=0.5, ZCoordinate=0)  # disabled

# ----
# Part A - Topology
create_topology = GhPythonScript(
    layer_numb=layer_numb,
    layer_depth=layer_depth,
    arch_res=arch_res,
    tilt_angle=tilt_angle,
    sw_load_type=sw_load_type,
    deviaton_arch_mag=dev_mag_arch,
    trail_length=trail_length)  # -> trail, trail_lengths, self_weight_point, self_weight_mag, external_load_point, external_load_mag, deviation, deviation_mag, anchor_points; inputs layer_numb: Int32, arch_res: Int32, tilt_angle: Int32, sw_load_type: Int32
# ---------- create_topology: Python ----------
import ghpythonlib.components as gh
import math



##############################################
## Define main Arch Topology Function: 
##############################################


def arch_curve_topology(depth, x_pos, arch_res, layer_depth):
    
    
    ## Output parameters:
    anchor_points = []
    deviation_arch = []
    deviation_ring = []
    trail = []
    load_point = []
    
    
    ## Create the base curve and divide it: 
    base_line = gh.Line(gh.ConstructPoint(x_pos, -depth/2, 0), gh.ConstructPoint(x_pos, depth/2, 0))
    div = gh.DivideCurve(base_line, arch_res, False)
    explode = gh.Shatter(base_line, div[2])
    
    
    ## Create the Points for the Self_weight: 
    load_point.extend(div[0])
    
    
    ## Create the anchor points: 
    anchor_points.extend((div[0][0], div[0][-1]))
    
    
    ## Create the deviation / trail elements for the main arch: 
    for i, curve in enumerate(explode):
        if i == int(arch_res/2): deviation_arch.append(curve)
        else: trail.append(curve)
    
    
    ## Create the connecting (ring) deviation elements: 
    if x_pos > 0:
        pts_moved = gh.Move(div[0], gh.UnitX(-layer_depth))[0]
        line_dev = gh.Line(div[0], pts_moved)
        
        for curve in line_dev: deviation_ring.append(curve)
    
    
    ## Return the final geometry: 
    return(anchor_points, deviation_arch, deviation_ring, trail, load_point)



##############################################
## Define the Catbeary Function: 
##############################################


def catenary(points):
    
    x_moved = []
    for point in points: x_moved.append(gh.Move(point, gh.UnitX(math.e**gh.Deconstruct(point)[1] + math.e**-gh.Deconstruct(point)[1]))[0])
    crv = gh.Interpolate(x_moved, 3, False, 1)[0]
    
    planes_mid = []
    for i in range(int(len(points)-1)):
        line = gh.Line(points[i], points[i+1])
        points_mid = (gh.CurveMiddle(line))
        planes_mid.append(gh.XZPlane(points_mid))
    
    segments = gh.CurveXPlane(crv, planes_mid)[1]
    explode = gh.Shatter(crv, segments)
    
    lengths = []
    for segment in explode: lengths.append(gh.Length(segment))
    
    return(lengths)



##############################################
## Run the Curve Function: 
##############################################


## Output Topology:
anchor_points = []
deviation = []
deviation_mag = []
trail = []
trail_lengths = []


## Output forces: 
self_weight_point = []
self_weight_mag = []
external_load_point = []
external_load_mag = []


##############################################
## Create the Output elements:
tilt_angle = 90 - tilt_angle
force_distribution = []

for i in range(layer_numb):
    
    curve = arch_curve_topology(1.0, i*layer_depth, arch_res, layer_depth)
    
    
    ##############################################
    ## Anchor points: 
    anchor_points.extend(curve[0])
    
    
    ##############################################
    ## Create the points for the forces:
    self_weight_point.extend(curve[4])
    if i == 0: external_load_point.extend(curve[4])
    
    
    ##############################################
    ## Create a Parapolic shape: 
    if sw_load_type == 1:
        self_weight = -2
        for pt in curve[4]: self_weight_mag.append(self_weight)
        
        external_load = (layer_numb * -self_weight) / math.tan(math.radians(tilt_angle))
        if i == 0:
           for pt in external_load_point: external_load_mag.append(external_load)
    
    
    
    ##############################################
    ## Create a Catenary shape:
    
    if sw_load_type == 2:
        if i == 0: force_distribution.extend(catenary(curve[4]))
        
        self_weight_factor = -50 ## later self_wight?
        for k, point in enumerate(curve[4]): self_weight_mag.append(self_weight_factor * force_distribution[k])
        
        if i == 0:
            for load in force_distribution: external_load_mag.append((layer_numb * (-self_weight_factor*load)) / math.tan(math.radians(tilt_angle)))
    
    
    
    ##############################################
    ## Deviation Elemements and magnitude:
    
    deviation.extend(curve[1])
    for crv in curve[1]: deviation_mag.append(deviaton_arch_mag)
    deviation.extend(curve[2])
    
    if sw_load_type == 1:
        for crv in curve[2]: deviation_mag.append((-external_load / layer_numb) * (layer_numb - i))
    
    if sw_load_type == 2:
        for k in range(len(curve[2])):
            deviation_mag.append((-external_load_mag[k] / layer_numb) * (layer_numb - i))
    
    
    ##############################################
    ## Trail elements and lengths: 
    trail.extend(curve[3])
    for crv in curve[3]: trail_lengths.append(trail_length)
# ---------- end create_topology ----------
cem_deviation = CEM_Deviation(DeviationEdge=graft(create_topology.deviation), DeviationMagn=graft(create_topology.deviation_mag))
cem_load = CEM_Load(PointLoad=graft(create_topology.self_weight_point), LoadMagnZ=graft(create_topology.self_weight_mag))
cem_load_2 = CEM_Load(PointLoad=graft(create_topology.external_load_point), LoadMagnX=graft(create_topology.external_load_mag))
cem_trail = CEM_Trail(TrailEdge=graft(create_topology.trail), TrailLen=graft(create_topology.trail_lengths))
cem_support = CEM_Support(Support=create_topology.anchor_points)
cem_build_topology = CEM_Build_Topology(T=flatten(cem_trail), L=flatten([cem_load, cem_load_2]), D=flatten(cem_deviation), S=flatten(cem_support))

line = Line(StartPoint=construct_point, EndPoint=construct_point_2)  # disabled
number_slider = Slider(31, range=1..31)  # disabled
divide_curve = DivideCurve(Curve=line, Count=number_slider, Kinks=False)  # -> Points, Tangents, Parameters; disabled
deconstruct = Deconstruct(Point=divide_curve.Points)  # -> XComponent, YComponent, ZComponent; disabled
expression = Expression(x=deconstruct.YComponent, Expression="(e^x + e^-x) ")  # disabled
unit_x = UnitX(Factor=expression)  # disabled

layer_numb_2 = Slider(1, range=1..50)  # disabled
layer_depth_2 = Slider(0.1, range=0.001..0.1)  # disabled
arch_res_2 = Slider(25, range=1..101)  # disabled
load_mag_max = Slider(0, range=-25..25)  # disabled
dev_mag_ring = Slider(0, range=-100..100)  # disabled
dev_mag_arch_2 = Slider(-2, range=-100..0)  # disabled
trail_length_2 = Slider(-0.05, range=-50..0)  # disabled

move = Move(Geometry=divide_curve.Points, Motion=unit_x)  # -> Geometry, Transform; disabled

# ----
# Part B - Structure
height = Slider(0.25, range=0..0.75)
cem_extract_topology = CEM_Extract_Topology(TP=cem_build_topology)  # -> Nodes, NodesID, Edges, EdgesID, ConstraintPlane, ConstraintPlaneID, OriginNode, OriginNodeID
unit_z = UnitZ(Factor=height)
move_2 = Move(Geometry=cem_extract_topology.OriginNode, Motion=unit_z)  # -> Geometry, Transform
cem_origin_node = CEM_Origin_Node(OriginNode=move_2.Geometry, OriginNodeID=cem_extract_topology.OriginNodeID)
cem_calculate_structure = CEM_Calculate_Structure(TP=cem_build_topology, N=cem_origin_node)

create_topology_2 = GhPythonScript(
    layer_numb=layer_numb_2,
    layer_depth=layer_depth_2,
    arch_res=arch_res_2,
    load_mag_max=load_mag_max,
    dev_mag_arch=dev_mag_arch_2,
    dev_mag_ring=dev_mag_ring,
    trail_length=trail_length_2)  # -> trail, trail_lengths, port, load_point, load_point_start, load_mag, port_2, deviation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; inputs layer_numb: Int32, arch_res: Int32; disabled
# ---------- create_topology_2: Python ----------
import ghpythonlib.components as gh



####################################
## Define Curve Function: 
####################################


def arch_curve_topology(depth, x_pos, arch_res, dev_mag_arch, dev_mag_ring, layer_depth, load_mag_max, trail_length):
    
    
    ## Output parameters:
    
    anchor_points = []
    deviation = []
    deviation_mag = []
    trail = []
    load_point = []
    load_mag = []
    trail_lengths = []
    
    
    ## Create the base curve and divide it: 
    
    base_line = gh.Line(gh.ConstructPoint(x_pos, -depth/2, 0), gh.ConstructPoint(x_pos, depth/2, 0))
    div = gh.DivideCurve(base_line, arch_res, False)
    explode = gh.Shatter(base_line, div[2])
    
    
    ## Create the Points for the force: 
    
    load_point.extend(div[0])
    for point in div[0]: load_mag.append(load_mag_max)
    
    
    anchor_points.extend((div[0][0], div[0][-1]))
    
    for i, curve in enumerate(explode):
        if i == int(arch_res/2): deviation.append(curve), deviation_mag.append(dev_mag_arch)
        else: trail.append(curve),  trail_lengths.append(trail_length)
    
    
    if x_pos > 0:
        pts_moved = gh.Move(div[0], gh.UnitX(-layer_depth))[0]
        line_dev = gh.Line(div[0], pts_moved)
        
        dev_mag_loc = [] 
        for i in range(int(len(line_dev)/2)): dev_mag_loc.append(dev_mag_ring*i/(len(line_dev)/2-1))
        
        deviation_mag.extend(dev_mag_loc)
        deviation_mag.extend(reversed(dev_mag_loc))
        for curve in line_dev: deviation.append(curve)
    
    
    return(anchor_points, deviation, deviation_mag, trail, load_point, load_mag, trail_lengths)



####################################
## Run the Curve Function: 
####################################



anchor_points = []
deviation = []
deviation_mag = []
trail = []
load_point = []
load_mag = []
trail_lengths = []
load_point_start = []


for i in range(layer_numb):
    
    curve = arch_curve_topology(1.0, i*layer_depth, arch_res, dev_mag_arch, dev_mag_ring, layer_depth, load_mag_max, trail_length)
    
    
    anchor_points.extend(curve[0])
    deviation.extend(curve[1])
    deviation_mag.extend(curve[2])
    trail.extend(curve[3])
    trail_lengths.extend(curve[6])
    load_point.extend(curve[4])
    
    if i == 0: load_point_start.extend(curve[4])

for point in load_point: load_mag.append(load_mag_max)
# ---------- end create_topology_2 ----------
shatter = Shatter()  # disabled
interpolate = Interpolate(Vertices=move.Geometry, Degree=3, Periodic=False, KnotStyle=1)  # -> reparameterize(Curve), Length, Domain; disabled
curve = Curve(create_topology_2.deviation)  # disabled
xz_plane = XZPlane(Origin=divide_curve.Points)  # disabled
list_item = ListItem(List=curve, Index=0, Wrap=True)  # -> Item, Item1; disabled
curve_closest_point = CurveClosestPoint(Point=move.Geometry, Curve=interpolate.Curve)  # -> Point, Parameter, Distance; disabled
number_slider_2 = Slider(2, range=0..100)  # disabled
cem_trail_2 = CEM_Trail(TrailEdge=create_topology_2.trail, TrailLen=create_topology_2.trail_lengths)  # disabled
curve_plane = CurvePlane(Curve=interpolate.Curve, Plane=xz_plane)  # -> Points, ParamsC, ParamsP; disabled
cem_support_2 = CEM_Support(Support=create_topology_2.anchor_points)  # disabled
panel = Panel(curve_closest_point.Parameter)  # disabled
point = Point(create_topology_2.load_point_start)  # disabled
trim_tree = TrimTree(Tree=curve_plane.ParamsC, Depth=1)  # disabled
shatter_2 = Shatter(Curve=interpolate.Curve, Parameters=trim_tree)  # disabled
shatter_3 = Shatter()  # disabled
number_slider_3 = Slider(5, range=0..100)  # disabled
curve_plane_2 = CurvePlane()  # -> Points, ParamsC, ParamsP; disabled

# ----
# Part C - Export
cem_extract_structure = CEM_Extract_Structure(M=cem_calculate_structure)  # -> Nodes, NodesID, Trails, TrailsID, TrailsCol, TrailsMag, Deviations, DeviationsID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
merge = Merge(Data1=cem_extract_structure.Trails, Data2=cem_extract_structure.Deviations)
merge_2 = Merge(Data1=cem_extract_structure.TrailsMag, Data2=cem_extract_structure.DeviationsMag)
colour = GhPythonScript(mag=merge_2)  # -> out; inputs mag: list
# ---------- colour: Python ----------
for magnitude in mag:
    
    if magnitude > 0: print(255, 0, 0)
    else: print(0, 0, 255)
# ---------- end colour ----------
custom_preview = CustomPreview(Geometry=merge, Material=colour)

length = Length(Curve=shatter_2)  # disabled
multiplication = Multiplication(A=length, B=number_slider_3)  # disabled
merge_3 = Merge(Data1=multiplication, Data2=multiplication)  # disabled
cem_load_3 = CEM_Load(PointLoad=graft(create_topology_2.load_point), LoadMagnZ=expr("-x", graft(merge_3)))  # -> flatten(L); disabled
multiplication_2 = Multiplication(A=multiplication, B=number_slider_2)  # disabled
division = Division(A=multiplication_2, B=2)  # disabled
negative = Negative(Value=division)  # disabled
merge_4 = Merge(Data1=flatten(dev_mag_arch_2), Data2=flatten(dev_mag_arch_2), Data3=flatten(negative))  # disabled
cem_deviation_2 = CEM_Deviation(DeviationEdge=graft(create_topology_2.deviation), DeviationMagn=graft(merge_4))  # disabled
cem_deviation_3 = CEM_Deviation(DeviationEdge=create_topology_2.deviation, DeviationMagn=merge_4)  # disabled
cem_load_4 = CEM_Load(PointLoad=graft(point), LoadMagnX=graft(multiplication_2))  # -> flatten(L); disabled
cem_build_topology_2 = CEM_Build_Topology(T=flatten(cem_trail_2), L=flatten([cem_load_3, cem_load_4]), D=flatten(cem_deviation_2), S=cem_support_2)  # disabled
panel_2 = Panel(merge_4)  # disabled

# ----
# Part B - Structure
height_2 = Slider(0.25, range=0..0.75)  # disabled
cem_extract_topology_2 = CEM_Extract_Topology(TP=cem_build_topology_2)  # -> Nodes, NodesID, Edges, EdgesID, ConstraintPlane, ConstraintPlaneID, OriginNode, OriginNodeID; disabled
unit_z_2 = UnitZ(Factor=height_2)  # disabled
yieldstress_kn_m2 = Slider(50, range=50..1000000)  # disabled
specific_weight_kn_m3 = Slider(198.33, range=5..500)  # disabled
move_3 = Move(Geometry=cem_extract_topology_2.OriginNode, Motion=unit_z_2)  # -> Geometry, Transform; disabled
self_weight = BooleanToggle(False)  # disabled
cem_material_properties = CEM_Material_Properties(SelfWeight=self_weight, YieldStress=yieldstress_kn_m2, SpecWeight=specific_weight_kn_m3)  # disabled
cem_origin_node_2 = CEM_Origin_Node(OriginNode=move_3.Geometry, OriginNodeID=cem_extract_topology_2.OriginNodeID)  # disabled
cem_calculate_structure_2 = CEM_Calculate_Structure(TP=cem_build_topology_2, N=cem_origin_node_2, SW=cem_material_properties)  # disabled

list_item_2 = ListItem(List=multiplication_2, Index=5, Wrap=True)  # disabled
curve_middle = CurveMiddle(Curve=merge)
panel_3 = Panel(length)  # disabled
list_item_3 = ListItem(List=multiplication, Index=5, Wrap=True)  # disabled
ghpython_script = GhPythonScript(f_eig=list_item_3, f_hor=list_item_2)  # -> out, a; disabled
# ---------- ghpython_script: Python ----------
import math

f_eig = f_eig
f_hor = f_hor

angle = math.degrees(math.atan(f_eig/f_hor))
print(angle)
# ---------- end ghpython_script ----------
point_2 = Point(move_3.Geometry)  # disabled
text_tag = TextTag(Location=curve_middle, Text=merge_2)
panel_4 = Panel(ghpython_script.out)  # disabled

# ----
# Part C - Export
cem_extract_structure_2 = CEM_Extract_Structure(M=cem_calculate_structure_2)  # -> Nodes, NodesID, Trails, TrailsID, TrailsCol, TrailsMag, Deviations, DeviationsID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; disabled
merge_5 = Merge(Data1=cem_extract_structure_2.Trails, Data2=cem_extract_structure_2.Deviations)  # disabled
merge_6 = Merge(Data1=cem_extract_structure_2.TrailsMag, Data2=cem_extract_structure_2.DeviationsMag)  # disabled
colour_2 = GhPythonScript(mag=merge_6)  # -> out; inputs mag: list; disabled; same code as colour
custom_preview_2 = CustomPreview(Geometry=merge_5, Material=colour_2)  # disabled

join_curves = JoinCurves(Curves=merge_5, Preserve=False)  # disabled
planar = Planar(Curve=join_curves)  # -> Planar, Plane, Deviation; disabled
panel_5 = Panel(join_curves)  # disabled
panel_6 = Panel(planar.Planar)  # disabled

layer_numb_3 = Slider(6, range=1..50)  # disabled
arch_res_3 = Slider(31, range=1..101)  # disabled
tilt_angle_2 = Slider(40, range=0..90)  # disabled
sw_load_type_2 = ValueList({"Parabolic": 1, "Catenary": 2}, selected="Parabolic")  # disabled
trail_length_3 = Slider(-0.05, range=-50..0)  # disabled
layer_depth_3 = Slider(0.2, range=0.001..1)  # disabled
dev_mag_arch_3 = Slider(-15, range=-100..0)  # disabled

# ----
# Part A - Topology
create_topology_3 = GhPythonScript(
    layer_numb=layer_numb_3,
    layer_depth=layer_depth_3,
    arch_res=arch_res_3,
    tilt_angle=tilt_angle_2,
    sw_load_type=sw_load_type_2,
    deviaton_arch_mag=dev_mag_arch_3,
    trail_length=trail_length_3)  # -> trail, trail_lengths, self_weight_point, self_weight_mag, external_load_point, external_load_mag, deviation, deviation_mag, anchor_points; inputs layer_numb: Int32, arch_res: Int32, tilt_angle: Int32, sw_load_type: Int32; disabled
# ---------- create_topology_3: Python ----------
import ghpythonlib.components as gh
import math



####################################
## Define Curve Function: 
####################################



def arch_curve_topology(depth, x_pos, arch_res, layer_depth):
    
    
    ## Output parameters:
    anchor_points = []
    deviation_arch = []
    deviation_ring = []
    trail = []
    load_point = []
    
    
    ## Create the base curve and divide it: 
    base_line = gh.Line(gh.ConstructPoint(x_pos, -depth/2, 0), gh.ConstructPoint(x_pos, depth/2, 0))
    div = gh.DivideCurve(base_line, arch_res, False)
    explode = gh.Shatter(base_line, div[2])
    
    
    ## Create the Points for the Self_weight: 
    load_point.extend(div[0])
    
    
    ## Create the anchor points: 
    anchor_points.extend((div[0][0], div[0][-1]))
    
    
    ## Create the deviation / trail elements for the main arch: 
    for i, curve in enumerate(explode):
        if i == int(arch_res/2): deviation_arch.append(curve)
        else: trail.append(curve)
    
    
    ## Create the connecting (ring) deviation elements: 
    if x_pos > 0:
        pts_moved = gh.Move(div[0], gh.UnitX(-layer_depth))[0]
        line_dev = gh.Line(div[0], pts_moved)
        
        for curve in line_dev: deviation_ring.append(curve)
    
    
    ## Return the final geometry: 
    return(anchor_points, deviation_arch, deviation_ring, trail, load_point)



####################################
## Run the Curve Function: 
####################################



## Output Topology:
anchor_points = []
deviation = []
deviation_mag = []
trail = []
trail_lengths = []


## Output forces: 
self_weight_point = []
self_weight_mag = []
external_load_point = []
external_load_mag = []


## Create the Output elements:
tilt_angle = 90 - tilt_angle

for i in range(layer_numb):
    
    curve = arch_curve_topology(1.0, i*layer_depth, arch_res, layer_depth)
    
    
    ## Anchor points: 
    anchor_points.extend(curve[0])
    
    
    ## Create the points for the forces:
    self_weight_point.extend(curve[4])
    if i == 0: external_load_point.extend(curve[4])
    
    
    ## Create a Parapolic shape: 
    if sw_load_type == 1:
        self_weight = -2
        for pt in curve[4]: self_weight_mag.append(self_weight)
        
        external_load = (layer_numb * -self_weight) / math.tan(math.radians(tilt_angle))
        if i == 0:
           for pt in external_load_point: external_load_mag.append(external_load)
    
    
    ## Create a Catenary shape: 
    #!!!
    
    
    ## Deviation Elemements and magnitude:
    deviation.extend(curve[1])
    for crv in curve[1]: deviation_mag.append(deviaton_arch_mag)
    
    deviation.extend(curve[2])
    if sw_load_type == 1:
        for crv in curve[2]: deviation_mag.append((-external_load / layer_numb) * (layer_numb - i))
    
    
    ## Trail elements and lengths: 
    trail.extend(curve[3])
    for crv in curve[3]: trail_lengths.append(trail_length)
# ---------- end create_topology_3 ----------
cem_deviation_4 = CEM_Deviation(DeviationEdge=graft(create_topology_3.deviation), DeviationMagn=graft(create_topology_3.deviation_mag))  # disabled
cem_load_5 = CEM_Load(PointLoad=graft(create_topology_3.self_weight_point), LoadMagnZ=graft(create_topology_3.self_weight_mag))  # disabled
cem_load_6 = CEM_Load(PointLoad=graft(create_topology_3.external_load_point), LoadMagnX=graft(create_topology_3.external_load_mag))  # disabled
cem_trail_3 = CEM_Trail(TrailEdge=graft(create_topology_3.trail), TrailLen=graft(create_topology_3.trail_lengths))  # disabled
cem_support_3 = CEM_Support(Support=create_topology_3.anchor_points)  # disabled
cem_build_topology_3 = CEM_Build_Topology(T=flatten(cem_trail_3), L=flatten([cem_load_5, cem_load_6]), D=flatten(cem_deviation_4), S=flatten(cem_support_3))  # disabled

# ----
# Part B - Structure
height_3 = Slider(0.25, range=0..0.75)  # disabled
cem_extract_topology_3 = CEM_Extract_Topology(TP=cem_build_topology_3)  # -> Nodes, NodesID, Edges, EdgesID, ConstraintPlane, ConstraintPlaneID, OriginNode, OriginNodeID; disabled
unit_z_3 = UnitZ(Factor=height_3)  # disabled
move_4 = Move(Geometry=cem_extract_topology_3.OriginNode, Motion=unit_z_3)  # -> Geometry, Transform; disabled
cem_origin_node_3 = CEM_Origin_Node(OriginNode=move_4.Geometry, OriginNodeID=cem_extract_topology_3.OriginNodeID)  # disabled
cem_calculate_structure_3 = CEM_Calculate_Structure(TP=cem_build_topology_3, N=cem_origin_node_3)  # disabled

# ----
# Part C - Export
cem_extract_structure_3 = CEM_Extract_Structure(M=cem_calculate_structure_3)  # -> Nodes, NodesID, Trails, TrailsID, TrailsCol, TrailsMag, Deviations, DeviationsID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; disabled
merge_7 = Merge(Data1=cem_extract_structure_3.Trails, Data2=cem_extract_structure_3.Deviations)  # disabled
merge_8 = Merge(Data1=cem_extract_structure_3.TrailsMag, Data2=cem_extract_structure_3.DeviationsMag)  # disabled
colour_3 = GhPythonScript(mag=merge_8)  # -> out; inputs mag: list; disabled; same code as colour
custom_preview_3 = CustomPreview(Geometry=merge_7, Material=colour_3)  # disabled
