# Grasshopper definition Code_Kappendecke_2.0_var_1_not_planar.ghx (Grasshopper 1.0.7)
# Copyright: Felswind
# plug-ins: CEM_Build_Topology, CEM_Deviation, CEM_Extract_Topology, CEM_Support, CEM_Trail, CEM_Calculate_Structure, CEM_Origin_Node, CEM_Material_Properties, CEM_Extract_Structure, CEM_Optimization_Setup, CEM_Bound_Deviation, CEM_Bound_Origin_Node, CEM_Bound_Trail, CEM_Target, CEM_Load

load_type = ValueList({"none": -1, "uniform": 0, "falloff X": 1, "falloff Y": 2, "falloff XY": 3}, selected="falloff X")
layer_numb = Slider(5, range=1..50)
layer_depth = Slider(0.1, range=0.001..0.1)
dev_mag_arch = Slider(-10, range=-100..0)
dev_mag_ring = Slider(0, range=-100..100)
trail_length = Slider(-0.1, range=-50..0)
arch_res = Slider(21, range=1..101)
load_mag_max = Slider(10, range=-25..25)

load_type_2 = ValueList({"none": -1, "uniform": 0, "falloff X": 1, "falloff Y": 2, "falloff XY": 3}, selected="uniform")
layer_numb_2 = Slider(20, range=1..50)
layer_depth_2 = Slider(0.1, range=0.001..0.1)
dev_mag_arch_2 = Slider(-15, range=-100..0)
dev_mag_ring_2 = Slider(-0.01, range=-100..100)
trail_length_2 = Slider(-0.04, range=-50..0)
arch_res_2 = Slider(51, range=1..101)
load_mag_max_2 = Slider(2, range=-25..25)

layer_numb_3 = Slider(14, range=1..50)
layer_depth_3 = Slider(0.01, range=0.001..0.1)
dev_mag_arch_3 = Slider(-10, range=-100..0)
dev_mag_ring_3 = Slider(-0.1, range=-100..100)
trail_length_3 = Slider(-0.1, range=-50..0)
arch_res_3 = Slider(13, range=1..101)
load_mag_max_3 = Slider(-5, range=-25..25)

# ----
# Part A - Topology
create_topology = GhPythonScript(
    layer_numb=layer_numb,
    layer_depth=layer_depth,
    arch_res=arch_res,
    load_mag_max=load_mag_max,
    load_type=load_type,
    dev_mag_arch=dev_mag_arch,
    dev_mag_ring=dev_mag_ring,
    trail_length=trail_length)  # -> trail, trail_lengths, port, load_point, load_mag, port_2, deviation, deviation_mag, port_3, anchor_points; inputs layer_numb: Int32, arch_res: Int32, load_type: Int32
# ---------- create_topology: Python ----------
import ghpythonlib.components as gh



####################################
## Define Curve Function: 
####################################


def arch_curve_topology(depth, x_pos, arch_res, dev_mag_arch, dev_mag_ring, layer_depth, load_mag_max, trail_length):
    
    
    ## Output parameters:
    
    anchor_points = []
    deviation = []
    deviation_mag = []
    trail = []
    load_point = []
    load_mag = []
    trail_lengths = []
    
    
    ## Create the base curve and divide it: 
    
    base_line = gh.Line(gh.ConstructPoint(x_pos, -depth/2, 0), gh.ConstructPoint(x_pos, depth/2, 0))
    div = gh.DivideCurve(base_line, arch_res, False)
    explode = gh.Shatter(base_line, div[2])
    
    
    ## Create the Points for the force: 
    
    load_point.extend(div[0])
    for point in div[0]: load_mag.append(load_mag_max)
    
    
    anchor_points.extend((div[0][0], div[0][-1]))
    
    for i, curve in enumerate(explode):
        if i == int(arch_res/2): deviation.append(curve), deviation_mag.append(dev_mag_arch)
        else: trail.append(curve),  trail_lengths.append(trail_length)
    
    
    if x_pos > 0:
        pts_moved = gh.Move(div[0], gh.UnitX(-layer_depth))[0]
        line_dev = gh.Line(div[0], pts_moved)
        
        dev_mag_loc = [] 
        for i in range(int(len(line_dev)/2)): dev_mag_loc.append(dev_mag_ring*i/(len(line_dev)/2-1))
        
        deviation_mag.extend(dev_mag_loc)
        deviation_mag.extend(reversed(dev_mag_loc))
        for curve in line_dev: deviation.append(curve)
    
    
    return(anchor_points, deviation, deviation_mag, trail, load_point, load_mag, trail_lengths)



####################################
## Run the Curve Function: 
####################################



anchor_points = []
deviation = []
deviation_mag = []
trail = []
load_point = []
load_mag = []
trail_lengths = []


for i in range(layer_numb):
    
    curve = arch_curve_topology(1.0, i*layer_depth, arch_res, dev_mag_arch, dev_mag_ring, layer_depth, load_mag_max, trail_length)
    
    
    anchor_points.extend(curve[0])
    deviation.extend(curve[1])
    deviation_mag.extend(curve[2])
    trail.extend(curve[3])
    load_point.extend(curve[4])
    trail_lengths.extend(curve[6])
    
    if load_type == 0:
       load_mag.extend(curve[5])
   
    elif load_type == 1:
        for load in curve[5]:
            load_mag.append(i * load/layer_numb)
    
    elif load_type == 2:
        load_mag_loc = []
        
        for k in range(int(len(curve[5])/2)): load_mag_loc.append((k * curve[5][k]) / (len(curve[5])/2-1))
        load_mag.extend(load_mag_loc)
        load_mag.extend(reversed(load_mag_loc))
    
    elif load_type == 3:
        loads = []
        load_mag_loc = []
        
        for k in range(int(len(curve[5])/2)): load_mag_loc.append((k * curve[5][k]) / (len(curve[5])/2-1))
        loads.extend(load_mag_loc)
        loads.extend(reversed(load_mag_loc))
        
        for load in loads:
            load_mag.append(i * load/layer_numb)
# ---------- end create_topology ----------
cem_load = CEM_Load(PointLoad=graft(create_topology.load_point), LoadMagnX=graft(create_topology.load_mag))  # -> flatten(L)
cem_deviation = CEM_Deviation(DeviationEdge=create_topology.deviation, DeviationMagn=create_topology.deviation_mag)
cem_trail = CEM_Trail(TrailEdge=create_topology.trail, TrailLen=create_topology.trail_lengths)
cem_support = CEM_Support(Support=create_topology.anchor_points)
cem_build_topology = CEM_Build_Topology(T=cem_trail, L=cem_load, D=cem_deviation, S=cem_support)

# ----
# Part A - Topology
create_topology_2 = GhPythonScript(
    layer_numb=layer_numb_3,
    layer_depth=layer_depth_3,
    arch_res=arch_res_3,
    load_mag_max=load_mag_max_3,
    dev_mag_arch=dev_mag_arch_3,
    dev_mag_ring=dev_mag_ring_3,
    trail_length=trail_length_3)  # -> trail, trail_lengths, port, load_point, load_mag, port_2, deviation, deviation_mag, port_3, anchor_points; inputs layer_numb: Int32, arch_res: Int32
# ---------- create_topology_2: Python ----------
import ghpythonlib.components as gh
import math as m



####################################
## Define Curve Function: 
####################################


def arch_curve_topology(depth, x_y_pos, arch_res, dev_mag_arch, dev_mag_ring, layer_depth, load_mag_max, trail_length):
    
    
    ## Output parameters:
    
    anchor_points = []
    deviation = []
    deviation_mag = []
    trail = []
    load_point = []
    load_mag = []
    trail_lengths = []
    
    
    ## Create the base curve and divide it: 
    
    base_line = gh.Line(gh.ConstructPoint(x_y_pos, 0, 0), gh.ConstructPoint(0, x_y_pos, 0))
    div = gh.DivideCurve(base_line, arch_res, False)
    explode = gh.Shatter(base_line, div[2])
    length_base = gh.Length(base_line)
    
    ## Create the Points for the force: 
    
    load_point.extend(div[0])
    for point in div[0]: load_mag.append(load_mag_max)
    
    
    anchor_points.extend((div[0][0], div[0][-1]))
    
    for i, curve in enumerate(explode):
        if i == int(arch_res/2): deviation.append(curve), deviation_mag.append(dev_mag_arch)
        else: trail.append(curve),  trail_lengths.append((length_base*trail_length)/0.8)
    
    
    if x_y_pos > 0:
        vec_move = gh.Amplitude(gh.VectorXYZ(x_y_pos, x_y_pos, 0)[0], layer_depth)
        pts_moved = gh.Move(div[0], vec_move)[0]
        line_dev = gh.Line(div[0], pts_moved)
        
        dev_mag_loc = [] 
        for i in range(int(len(line_dev)/2)): dev_mag_loc.append(dev_mag_ring*i/(len(line_dev)/2-1))
        
        deviation_mag.extend(dev_mag_loc)
        deviation_mag.extend(reversed(dev_mag_loc))
        for curve in line_dev: deviation.append(curve)
    
    
    return(anchor_points, deviation, deviation_mag, trail, load_point, load_mag, trail_lengths)



####################################
## Run the Curve Function: 
####################################



anchor_points = []
deviation = []
deviation_mag = []
trail = []
load_point = []
load_mag = []
trail_lengths = []


for i in range(layer_numb):
    
    
    x_y_pos = 2*m.sqrt((((i+1)*layer_depth)**2)/2)
    curve = arch_curve_topology(1.0, x_y_pos, arch_res, dev_mag_arch, dev_mag_ring, layer_depth, load_mag_max, trail_length)
    
    
    anchor_points.extend(curve[0])
    deviation.extend(curve[1])
    deviation_mag.extend(curve[2])
    trail.extend(curve[3])
    load_point.extend(curve[4])
    trail_lengths.extend(curve[6])
# ---------- end create_topology_2 ----------
cem_load_2 = CEM_Load(
    PointLoad=graft(create_topology_2.load_point),
    LoadMagnX=graft(create_topology_2.load_mag),
    LoadMagnY=graft(create_topology_2.load_mag))  # -> flatten(L)
cem_deviation_2 = CEM_Deviation(DeviationEdge=create_topology_2.deviation, DeviationMagn=create_topology_2.deviation_mag)
cem_trail_2 = CEM_Trail(TrailEdge=create_topology_2.trail, TrailLen=create_topology_2.trail_lengths)
cem_support_2 = CEM_Support(Support=create_topology_2.anchor_points)
cem_build_topology_2 = CEM_Build_Topology(T=cem_trail_2, L=cem_load_2, D=cem_deviation_2, S=cem_support_2)

number_slider = Slider(0, range=0..100)  # disabled
number_slider_2 = Slider(0, range=0..100)  # disabled
number_slider_3 = Slider(100, range=0..100)  # disabled

number_slider_4 = Slider(100, range=0..100)  # disabled
number_slider_5 = Slider(0, range=0..100)  # disabled
number_slider_6 = Slider(0, range=0..100)  # disabled

number_slider_7 = Slider(100, range=0..100)  # disabled
number_slider_8 = Slider(100, range=0..100)  # disabled

number_slider_9 = Slider(0, range=0..100)  # disabled
number_slider_10 = Slider(0, range=0..100)  # disabled

number_slider_11 = Slider(0, range=0..100)  # disabled
number_slider_12 = Slider(0, range=0..100)  # disabled

number_slider_13 = Slider(100, range=0..100)  # disabled
number_slider_14 = Slider(100, range=0..100)  # disabled

# ----
# Part B - Structure
height = Slider(0.25, range=0..0.75)
cem_extract_topology = CEM_Extract_Topology(TP=cem_build_topology_2)  # -> Nodes, NodesID, Edges, EdgesID, ConstraintPlane, ConstraintPlaneID, OriginNode, OriginNodeID
unit_z = UnitZ(Factor=height)
yieldstress_kn_m2 = Slider(50, range=50..1000000)
specific_weight_kn_m3 = Slider(500, range=5..500)
move = Move(Geometry=cem_extract_topology.OriginNode, Motion=unit_z)  # -> Geometry, Transform
self_weight = BooleanToggle(True)
cem_material_properties = CEM_Material_Properties(SelfWeight=self_weight, YieldStress=yieldstress_kn_m2, SpecWeight=specific_weight_kn_m3)
cem_origin_node = CEM_Origin_Node(OriginNode=move.Geometry, OriginNodeID=cem_extract_topology.OriginNodeID)
cem_calculate_structure = CEM_Calculate_Structure(TP=cem_build_topology_2, N=cem_origin_node, SW=cem_material_properties)

list = ValueList({"LD_AUGLAG", "LD_LBFGS", "LD_SLSQP", "LD_TNEWTON", "LN_BOBYQA", "LN_COBYLA", "LN_SBPLX", "GD_MLSL", "GN_MLSL", "GN_ISRES"}, selected="LD_AUGLAG")  # disabled
number_slider_15 = Slider(0.0001, range=0.0001..1)  # disabled
number_slider_16 = Slider(1e-06, range=1e-06..1)  # disabled
number_slider_17 = Slider(25, range=1..1000)  # disabled

list_2 = ValueList({"LD_AUGLAG", "LD_LBFGS", "LD_SLSQP", "LD_TNEWTON", "LN_BOBYQA", "LN_COBYLA", "LN_SBPLX", "GD_MLSL", "GN_MLSL", "GN_ISRES"}, selected="LD_AUGLAG")  # disabled
number_slider_18 = Slider(0.0001, range=0.0001..1)  # disabled
number_slider_19 = Slider(1e-06, range=1e-06..1)  # disabled
number_slider_20 = Slider(5, range=1..1000)  # disabled

# ----
# Part C - Export
cem_extract_structure = CEM_Extract_Structure(M=cem_calculate_structure)  # -> Nodes, NodesID, Trails, TrailsID, TrailsCol, TrailsMag, Deviations, DeviationsID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
merge = Merge(Data1=cem_extract_structure.Trails, Data2=cem_extract_structure.Deviations)
merge_2 = Merge(Data1=cem_extract_structure.TrailsMag, Data2=cem_extract_structure.DeviationsMag)
colour = GhPythonScript(mag=merge_2)  # -> out; inputs mag: list
# ---------- colour: Python ----------
for magnitude in mag:
    
    if magnitude > 0: print(255, 0, 0)
    else: print(0, 0, 255)
# ---------- end colour ----------
custom_preview = CustomPreview(Geometry=merge, Material=colour)

# ----
# Part B2 - Optimization
anchor_move = Slider(0.8, range=0..10)  # disabled
unit_x = UnitX(Factor=anchor_move)  # disabled
number_slider_21 = Slider(1, range=0..100)  # disabled

# ----
# Part B2 - Optimization
list_length = ListLength(List=create_topology.trail)  # disabled
list_length_2 = ListLength(List=create_topology.deviation)  # disabled
series = Series(Start=0, Step=1, Count=list_length)  # disabled
series_2 = Series(Start=0, Step=1, Count=list_length_2)  # disabled
number_slider_22 = Slider(1, range=0..100)  # disabled
cem_bound_trail = CEM_Bound_Trail(BoundTrailID=series, BoundUpTrail=number_slider_10, BoundLowTrail=number_slider_9)  # disabled
cem_bound_deviation = CEM_Bound_Deviation(BoundDevID=series_2, BoundUpDev=number_slider_7, BoundLowDev=number_slider_8)  # disabled

# ----
# Part B - Structure
height_2 = Slider(0.25, range=0..0.75)
cem_extract_topology_2 = CEM_Extract_Topology(TP=cem_build_topology)  # -> Nodes, NodesID, Edges, EdgesID, ConstraintPlane, ConstraintPlaneID, OriginNode, OriginNodeID
unit_z_2 = UnitZ(Factor=height_2)
yieldstress_kn_m2_2 = Slider(50, range=50..1000000)
specific_weight_kn_m3_2 = Slider(103.76, range=5..500)
move_2 = Move(Geometry=cem_extract_topology_2.OriginNode, Motion=unit_z_2)  # -> Geometry, Transform
self_weight_2 = BooleanToggle(True)
cem_material_properties_2 = CEM_Material_Properties(SelfWeight=self_weight_2, YieldStress=yieldstress_kn_m2_2, SpecWeight=specific_weight_kn_m3_2)
cem_origin_node_2 = CEM_Origin_Node(OriginNode=move_2.Geometry, OriginNodeID=cem_extract_topology_2.OriginNodeID)

get_anchor_indices = GhPythonScript(
    anchor_points=create_topology.anchor_points,
    points_cloud=cem_extract_topology_2.Nodes,
    cloud_indices=cem_extract_topology_2.NodesID)  # -> indices; inputs anchor_points: list of Point3d, points_cloud: list of Point3d, cloud_indices: list; disabled
# ---------- get_anchor_indices: Python ----------
import ghpythonlib.components as gh



##########################################
## Define function for cheking the points
##########################################


def check_points(anchor_point, points_cloud, cloud_indices):
    
    
    
    for i, point in enumerate(points_cloud):
        
        dec = gh.Deconstruct(anchor_point)
        dec_cloud = gh.Deconstruct(point)
        
        if dec[0] == dec_cloud[0] and dec[1] == dec_cloud[1] and dec[2] == dec_cloud[2]:
            
            index = cloud_indices[i]
    
    return(index)



##########################################
## Run function for cheking the points
##########################################


indices = []

for point in anchor_points:
    
    index = check_points(point, points_cloud, cloud_indices)
    index = index.split( )
    
    indices.append(index[0])
# ---------- end get_anchor_indices ----------
cem_target = CEM_Target(TargetNode=create_topology.anchor_points, TargetNodeID=get_anchor_indices, TargetNodeCoeff=number_slider_22)  # disabled
cem_bound_origin_node = CEM_Bound_Origin_Node(
    BoundOriginNodeID=cem_extract_topology_2.OriginNodeID,
    BoundUpOriginNodeX=number_slider,
    BoundLowOriginNodeX=number_slider,
    BoundUpOriginNodeY=number_slider_2,
    BoundLowOriginNodeY=number_slider_2,
    BoundUpOriginNodeZ=number_slider_3,
    BoundLowOriginNodeZ=number_slider_3)  # disabled
cem_optimization_setup = CEM_Optimization_Setup(
    TO=cem_target,
    BO=cem_bound_origin_node,
    BT=cem_bound_trail,
    BD=cem_bound_deviation,
    GradientDelta=number_slider_15,
    RelativeTolerance=number_slider_16,
    MaxIterations=number_slider_17,
    OptimAlgorithm=list)  # disabled

cem_calculate_structure_2 = CEM_Calculate_Structure(TP=cem_build_topology, N=cem_origin_node_2, SW=cem_material_properties_2, O=cem_optimization_setup)

# ----
# Part C - Export
cem_extract_structure_2 = CEM_Extract_Structure(M=cem_calculate_structure_2)  # -> Nodes, NodesID, Trails, TrailsID, TrailsCol, TrailsMag, Deviations, DeviationsID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
merge_3 = Merge(Data1=cem_extract_structure_2.Trails, Data2=cem_extract_structure_2.Deviations)
merge_4 = Merge(Data1=cem_extract_structure_2.TrailsMag, Data2=cem_extract_structure_2.DeviationsMag)
colour_2 = GhPythonScript(mag=merge_4)  # -> out; inputs mag: list; same code as colour
custom_preview_2 = CustomPreview(Geometry=merge_3, Material=colour_2)

# ----
# Part B - Structure
steps_falloff = Slider(5, range=0..25)
yieldstress_kn_m2_3 = Slider(50, range=50..1000000)
specific_weight_kn_m3_3 = Slider(80, range=5..500)
self_weight_3 = BooleanToggle(True)
cem_material_properties_3 = CEM_Material_Properties(SelfWeight=self_weight_3, YieldStress=yieldstress_kn_m2_3, SpecWeight=specific_weight_kn_m3_3)

# ----
# Part A - Topology
create_topology_3 = GhPythonScript(
    layer_numb=layer_numb_2,
    layer_depth=layer_depth_2,
    arch_res=arch_res_2,
    load_mag_max=load_mag_max_2,
    load_type=load_type_2,
    dev_mag_arch=dev_mag_arch_2,
    dev_mag_ring=dev_mag_ring_2,
    trail_length=trail_length_2,
    steps_falloff=steps_falloff)  # -> trail, trail_lengths, port, load_point, load_mag, port_2, deviation, deviation_mag, port_3, anchor_points; inputs layer_numb: Int32, arch_res: Int32, load_type: Int32, steps_falloff: Int32
# ---------- create_topology_3: Python ----------
import ghpythonlib.components as gh
import math



####################################
## Define Curve Function: 
####################################


def arch_curve_topology(depth, x_pos, arch_res, dev_mag_arch, dev_mag_ring, layer_depth, load_mag_max, trail_length, length_dev):
    
    
    ## Output parameters:
    
    anchor_points = []
    deviation = []
    deviation_mag = []
    trail = []
    load_point = []
    load_mag = []
    trail_lengths = []
    
    
    ## Create the base curve and divide it: 
    
    base_line = gh.Line(gh.ConstructPoint(x_pos, -depth/2, 0), gh.ConstructPoint(x_pos, depth/2, 0))
    div = gh.DivideCurve(base_line, arch_res, False)
    explode = gh.Shatter(base_line, div[2])
    
    
    ## Create the Points for the force: 
    
    load_point.extend(div[0])
    for point in div[0]: load_mag.append(load_mag_max)
    
    
    anchor_points.extend((div[0][0], div[0][-1]))
    
    for i, curve in enumerate(explode):
        if i == int(arch_res/2): deviation.append(curve), deviation_mag.append(dev_mag_arch)
        else: trail.append(curve),  trail_lengths.append(trail_length)
    
    
    if x_pos > 0:
        pts_moved = gh.Move(div[0], gh.UnitX(-length_dev))[0]
        line_dev = gh.Line(div[0], pts_moved)
        
        dev_mag_loc = [] 
        for i in range(int(len(line_dev)/2)): dev_mag_loc.append(dev_mag_ring*i/(len(line_dev)/2-1))
        
        deviation_mag.extend(dev_mag_loc)
        deviation_mag.extend(reversed(dev_mag_loc))
        for curve in line_dev: deviation.append(curve)
    
    
    return(anchor_points, deviation, deviation_mag, trail, load_point, load_mag, trail_lengths)



####################################
## Run the Curve Function: 
####################################



anchor_points = []
deviation = []
deviation_mag = []
trail = []
load_point = []
load_mag = []
trail_lengths = []

x_pos = 0


for i in range(layer_numb):
    
    ## Set the dev_length: 
    if i-1 < steps_falloff:
      length_dev = math.sqrt((layer_depth**2)/2) 
    else:
        length_dev = layer_depth
    
    
    curve = arch_curve_topology(1.0, x_pos, arch_res, dev_mag_arch, dev_mag_ring, layer_depth, load_mag_max, trail_length, length_dev)
    
    
    anchor_points.extend(curve[0])
    deviation.extend(curve[1])
    deviation_mag.extend(curve[2])
    trail.extend(curve[3])
    load_point.extend(curve[4])
    
    # Define trail lengths: 
    if i-1 < steps_falloff:
        ## Manual Entry!!! 
        falloff = [-0.015, -0.02, -0.025, -0.03, -0.035, -0.04,]
        for number in curve[6]: trail_lengths.append(falloff[i])
    
    else: trail_lengths.extend(curve[6])
    
    if load_type == 0:
       load_mag.extend(curve[5])
   
    elif load_type == 1:
        for load in curve[5]:
            load_mag.append(i * load/layer_numb)
    
    elif load_type == 2:
        load_mag_loc = []
        
        for k in range(int(len(curve[5])/2)): load_mag_loc.append((k * curve[5][k]) / (len(curve[5])/2-1))
        load_mag.extend(load_mag_loc)
        load_mag.extend(reversed(load_mag_loc))
    
    elif load_type == 3:
        loads = []
        load_mag_loc = []
        
        for k in range(int(len(curve[5])/2)): load_mag_loc.append((k * curve[5][k]) / (len(curve[5])/2-1))
        loads.extend(load_mag_loc)
        loads.extend(reversed(load_mag_loc))
        
        for load in loads:
            load_mag.append(i * load/layer_numb)
    
    ## Set the new x_pos: 
    if i < steps_falloff:
      x_pos += math.sqrt((layer_depth**2)/2) 
    else:
        x_pos += layer_depth
# ---------- end create_topology_3 ----------
cem_load_3 = CEM_Load(PointLoad=graft(create_topology_3.load_point), LoadMagnX=graft(create_topology_3.load_mag))  # -> flatten(L)
cem_deviation_3 = CEM_Deviation(DeviationEdge=create_topology_3.deviation, DeviationMagn=create_topology_3.deviation_mag)
cem_trail_3 = CEM_Trail(TrailEdge=create_topology_3.trail, TrailLen=create_topology_3.trail_lengths)
cem_support_3 = CEM_Support(Support=create_topology_3.anchor_points)
cem_build_topology_3 = CEM_Build_Topology(T=cem_trail_3, L=cem_load_3, D=cem_deviation_3, S=cem_support_3)

list_length_3 = ListLength(List=create_topology_3.trail)  # disabled
list_length_4 = ListLength(List=create_topology_3.deviation)  # disabled
move_3 = Move(Geometry=create_topology_3.anchor_points, Motion=unit_x)  # -> Geometry, Transform; disabled
series_3 = Series(Start=0, Step=1, Count=list_length_3)  # disabled
series_4 = Series(Start=0, Step=1, Count=list_length_4)  # disabled
cem_bound_trail_2 = CEM_Bound_Trail(BoundTrailID=series_3, BoundUpTrail=number_slider_12, BoundLowTrail=number_slider_11)  # disabled
cem_bound_deviation_2 = CEM_Bound_Deviation(BoundDevID=series_4, BoundUpDev=number_slider_13, BoundLowDev=number_slider_14)  # disabled

cem_extract_topology_3 = CEM_Extract_Topology(TP=cem_build_topology_3)  # -> Nodes, NodesID, Edges, EdgesID, ConstraintPlane, ConstraintPlaneID, OriginNode, OriginNodeID
falloff_ending = GhPythonScript(
    nodes=cem_extract_topology_3.OriginNode,
    nodes_indices=cem_extract_topology_3.OriginNodeID,
    steps_falloff=steps_falloff,
    layer_depth=layer_depth_2)  # -> points_moved_final; inputs nodes: list of Point3d, nodes_indices: list of Int32, steps_falloff: Int32
# ---------- falloff_ending: Python ----------
import ghpythonlib.components as gh
import math


################################################
## Define the movement for the single values: 
################################################

nodes_x = gh.Deconstruct(nodes)[0]
sort_points = gh.SortList(nodes_x, nodes)[1]

## Define the maximum height: 
height_max = steps_falloff * math.sqrt((layer_depth**2)/2)


## Move points depending on distance
points_moved = []
points_moved_x = []
points_partition = []

for i in range(len(sort_points)):
    
    if i % 2 == 0:
        
        list_point = [sort_points[i], sort_points[i+1]]
        points_partition.append(list_point)

for i in range(len(points_partition)):
    
    if steps_falloff == 0: step = height_max
    else:
        step = math.sqrt((layer_depth**2)/2) * i
        if step > height_max: step = height_max
    
    points_moved.append(gh.Move(points_partition[i][0], gh.UnitZ(step))[0])
    points_moved.append(gh.Move(points_partition[i][1], gh.UnitZ(step))[0])



################################################
## Sort the points according to the indices: 
################################################

points_moved_final = []

for point in nodes:
    
    for point_sort in points_moved:
        
        if gh.Deconstruct(point)[0] == gh.Deconstruct(point_sort)[0] and gh.Deconstruct(point)[1] == gh.Deconstruct(point_sort)[1]:
            
            points_moved_final.append(point_sort)
# ---------- end falloff_ending ----------
cem_origin_node_3 = CEM_Origin_Node(OriginNode=falloff_ending, OriginNodeID=cem_extract_topology_3.OriginNodeID)

get_anchor_indices_2 = GhPythonScript(
    anchor_points=create_topology_3.anchor_points,
    points_cloud=cem_extract_topology_3.Nodes,
    cloud_indices=cem_extract_topology_3.NodesID)  # -> indices; inputs anchor_points: list of Point3d, points_cloud: list of Point3d, cloud_indices: list; disabled; same code as get_anchor_indices
cem_target_2 = CEM_Target(TargetNode=move_3.Geometry, TargetNodeID=get_anchor_indices_2, TargetNodeCoeff=number_slider_21)  # disabled
cem_bound_origin_node_2 = CEM_Bound_Origin_Node(
    BoundOriginNodeID=cem_extract_topology_3.OriginNodeID,
    BoundUpOriginNodeX=number_slider_5,
    BoundLowOriginNodeX=number_slider_5,
    BoundUpOriginNodeY=number_slider_6,
    BoundLowOriginNodeY=number_slider_6,
    BoundUpOriginNodeZ=number_slider_4,
    BoundLowOriginNodeZ=number_slider_4)  # disabled
cem_optimization_setup_2 = CEM_Optimization_Setup(
    TO=cem_target_2,
    BO=cem_bound_origin_node_2,
    BT=cem_bound_trail_2,
    BD=cem_bound_deviation_2,
    GradientDelta=number_slider_18,
    RelativeTolerance=number_slider_19,
    MaxIterations=number_slider_20,
    OptimAlgorithm=list_2)  # disabled

cem_calculate_structure_3 = CEM_Calculate_Structure(TP=cem_build_topology_3, N=cem_origin_node_3, SW=cem_material_properties_3, O=cem_optimization_setup_2)

# ----
# Part C - Export
cem_extract_structure_3 = CEM_Extract_Structure(M=cem_calculate_structure_3)  # -> Nodes, NodesID, Trails, TrailsID, TrailsCol, TrailsMag, Deviations, DeviationsID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
merge_5 = Merge(Data1=cem_extract_structure_3.Trails, Data2=cem_extract_structure_3.Deviations)
merge_6 = Merge(Data1=cem_extract_structure_3.TrailsMag, Data2=cem_extract_structure_3.DeviationsMag)
colour_3 = GhPythonScript(mag=merge_6)  # -> out; inputs mag: list; same code as colour
custom_preview_3 = CustomPreview(Geometry=merge_5, Material=colour_3)

# ----
# Part D - Toolpath
select_toolpath = GhPythonScript(curves=merge_5)  # -> toolpath_main; inputs curves: list of Line
# ---------- select_toolpath: Python ----------
import ghpythonlib.components as gh



## Sort curves along the vectors: 

toolpath_main = []

for curve in curves:
    
    len = gh.Length(curve)
    if len <= 0.05: toolpath_main.append(curve)
# ---------- end select_toolpath ----------
join_curves = JoinCurves(Curves=select_toolpath, Preserve=False)  # -> flatten(Curves)
curve_middle = CurveMiddle(Curve=join_curves)
deconstruct = Deconstruct(Point=curve_middle)  # -> XComponent, YComponent, ZComponent
sort_list = SortList(Keys=deconstruct.XComponent, ValuesValuesA=join_curves)  # -> Keys, ValuesValuesA
rebuild_curve = RebuildCurve(Curve=sort_list.ValuesValuesA, Degree=3, Count=10, Tangents=False)
list_item = ListItem(List=rebuild_curve, Index=0, Wrap=True)
flip_curve = FlipCurve(Curve=rebuild_curve, Guide=list_item)  # -> Curve, Flag
number_slider_23 = Slider(0, range=0..0.1)
shift_list = ShiftList(List=flip_curve.Curve, Shift=1, Wrap=True)
series_5 = Series(Start=0, Step=0.2, Count=5)
cull_index = CullIndex(List=shift_list, Indices=-1, Wrap=True)
construct_point = ConstructPoint(XCoordinate=0, YCoordinate=0, ZCoordinate=number_slider_23)
tween_curve = TweenCurve(CurveA=simplify(graft(cull_index)), CurveB=simplify(graft(flip_curve.Curve)), Factor=series_5, BlendType=0)  # -> reparameterize(flatten(Tween))
xy_plane = XYPlane(Origin=construct_point)
curve_plane = CurvePlane(Curve=tween_curve, Plane=xy_plane)  # -> Points, ParamsC, ParamsP
shatter = Shatter(Curve=graft(tween_curve), Parameters=curve_plane.ParamsC)
unit_z_3 = UnitZ(Factor=number_slider_23)
list_item_2 = ListItem(List=shatter, Index=1, Wrap=True)  # -> flatten(Item)
move_4 = Move(Geometry=list_item_2, Motion=expr("-x", unit_z_3))  # -> Geometry, Transform
clean_tree = CleanTree(RemoveNulls=True, RemoveInvalid=True, RemoveEmpty=False, Tree=move_4.Geometry)
curve_middle_2 = CurveMiddle(Curve=clean_tree)
deconstruct_2 = Deconstruct(Point=curve_middle_2)  # -> XComponent, YComponent, ZComponent
sort_list_2 = SortList(Keys=deconstruct_2.XComponent, ValuesValuesA=clean_tree)  # -> Keys, ValuesValuesA
scale = Scale(Geometry=sort_list_2.ValuesValuesA, Center=Point(0, 0, 0), Factor=0.5)  # -> Geometry, Transform
close_print_path = GhPythonScript(curves=scale.Geometry)  # -> close; inputs curves: list of Curve
# ---------- close_print_path: Python ----------
import ghpythonlib.components as gh



## Close the printpath by lines: 

close = []

for i in range(int(len(curves)-1)):
    
    if i%2 == 0:
        
        start = gh.EndPoints(curves[i])[0]
        end = gh.EndPoints(curves[i+1])[0]
        
        line = gh.Line(start, end)
        close.append(line)
    
    else:
        start = gh.EndPoints(curves[i])[1]
        end = gh.EndPoints(curves[i+1])[1]
        
        line = gh.Line(start, end)
        close.append(line)
# ---------- end close_print_path ----------
join_curves_2 = JoinCurves(Curves=[close_print_path, scale.Geometry], Preserve=False)
cull_index_2 = CullIndex(List=join_curves_2, Indices=0, Wrap=True)

curve = Curve(cull_index_2)
