# Grasshopper definition Code_Kappendecke_2.0_set_1_var_3_CEM_approach.ghx (Grasshopper 1.0.7)
# Copyright: Felswind
# plug-ins: CEM_Build_Topology, CEM_Deviation, CEM_Extract_Topology, CEM_Support, CEM_Trail, CEM_Calculate_Structure, CEM_Origin_Node, CEM_Extract_Structure, CEM_Load

layer_numb = Slider(6, range=1..100)
layer_depth = Slider(0.1, range=0.001..1)
arch_res = Slider(31, range=1..101)
tilt_angle = Slider(45, range=0..90)
dev_mag_arch = Slider(-12, range=-100..0)
trail_length = Slider(-0.025, range=-50..0)

layer_numb_2 = Slider(15, range=2..100)
dev_mag = Slider(-0.001, range=-10..10)
trail_length_max = Slider(-0.025, range=-0.5..0.5)
trail_length_min = Slider(-0.005, range=-10..10.01)

# ----
# Part A - Topology
create_topology_main = GhPythonScript(
    layer_numb=layer_numb,
    layer_depth=layer_depth,
    arch_res=arch_res,
    tilt_angle=tilt_angle,
    deviaton_arch_mag=dev_mag_arch,
    trail_length=trail_length)  # -> trail, trail_lengths, self_weight_point, self_weight_mag, external_load_point, external_load_mag, deviation, deviation_mag, anchor_points; inputs layer_numb: Int32, arch_res: Int32, tilt_angle: Int32
# ---------- create_topology_main: Python ----------
import ghpythonlib.components as gh
import math



####################################
## Define Curve Function: 
####################################



def arch_curve_topology(depth, x_pos, arch_res, layer_depth):
    
    
    ## Output parameters:
    anchor_points = []
    deviation_arch = []
    deviation_ring = []
    trail = []
    load_point = []
    
    
    ## Create the base curve and divide it: 
    base_line = gh.Line(gh.ConstructPoint(x_pos, -depth/2, 0), gh.ConstructPoint(x_pos, depth/2, 0))
    div = gh.DivideCurve(base_line, arch_res, False)
    explode = gh.Shatter(base_line, div[2])
    
    
    ## Create the Points for the Self_weight: 
    load_point.extend(div[0])
    
    
    ## Create the anchor points: 
    anchor_points.extend((div[0][0], div[0][-1]))
    
    
    ## Create the deviation / trail elements for the main arch: 
    for i, curve in enumerate(explode):
        if i == int(arch_res/2): deviation_arch.append(curve)
        else: trail.append(curve)
    
    
    ## Create the connecting (ring) deviation elements: 
    if x_pos > 0:
        pts_moved = gh.Move(div[0], gh.UnitX(-layer_depth))[0]
        line_dev = gh.Line(div[0], pts_moved)
        
        for curve in line_dev: deviation_ring.append(curve)
    
    
    ## Return the final geometry: 
    return(anchor_points, deviation_arch, deviation_ring, trail, load_point)



####################################
## Run the Curve Function: 
####################################



## Output Topology:
anchor_points = []
deviation = []
deviation_mag = []
trail = []
trail_lengths = []


## Output forces: 
self_weight_point = []
self_weight_mag = []
external_load_point = []
external_load_mag = []


## Create the Output elements:
tilt_angle = 90 - tilt_angle

for i in range(layer_numb):
    
    curve = arch_curve_topology(0.5, i*layer_depth, arch_res, layer_depth)
    
    
    ## Anchor points: 
    anchor_points.extend(curve[0])
    
    
    ## Create the points for the forces:
    self_weight_point.extend(curve[4])
    if i == 0: external_load_point.extend(curve[4])
    
    
    ## Create a Parapolic shape: 
    
    self_weight = -2
    for pt in curve[4]: self_weight_mag.append(self_weight)
    
    external_load = (layer_numb * -self_weight) / math.tan(math.radians(tilt_angle))
    if i == 0:
       for pt in external_load_point: external_load_mag.append(external_load)
    
    
    ## Deviation Elemements and magnitude:
    deviation.extend(curve[1])
    for crv in curve[1]: deviation_mag.append(deviaton_arch_mag)
    
    deviation.extend(curve[2])
    
    for crv in curve[2]: deviation_mag.append((-external_load / layer_numb) * (layer_numb - i))
    
    
    ## Trail elements and lengths: 
    trail.extend(curve[3])
    for crv in curve[3]: trail_lengths.append(trail_length)
# ---------- end create_topology_main ----------
cem_deviation = CEM_Deviation(DeviationEdge=graft(create_topology_main.deviation), DeviationMagn=graft(create_topology_main.deviation_mag))
cem_load = CEM_Load(PointLoad=graft(create_topology_main.self_weight_point), LoadMagnZ=graft(create_topology_main.self_weight_mag))
cem_load_2 = CEM_Load(PointLoad=graft(create_topology_main.external_load_point), LoadMagnX=graft(create_topology_main.external_load_mag))
cem_trail = CEM_Trail(TrailEdge=graft(create_topology_main.trail), TrailLen=graft(create_topology_main.trail_lengths))
cem_support = CEM_Support(Support=create_topology_main.anchor_points)
cem_build_topology = CEM_Build_Topology(T=flatten(cem_trail), L=flatten([cem_load, cem_load_2]), D=flatten(cem_deviation), S=flatten(cem_support))

steps = Slider(4, range=2..100)
initial_deviation_force = Slider(0.029, range=0..1)
external_force_mag = Slider(0.027, range=0..1)
resolution = Slider(6, range=0..100)
toolpath_heigth = Slider(0.027, range=0..1)
initial_trail_length = Slider(0.025, range=0..1)

create_squinch_topology = GhPythonScript(
    steps=steps,
    resolution=resolution,
    toolpath_heigth=toolpath_heigth,
    initial_deviation_force=initial_deviation_force,
    external_force_mag=external_force_mag,
    initial_trail_length=initial_trail_length)  # -> trail_elements, deviation_elements, mid_deviation_elements, extra_deviation_elements, port, trail_length, deviation_force, mid_deviation_force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; inputs steps: Int32, resolution: Int32
# ---------- create_squinch_topology: Python ----------
import ghpythonlib.components as gh
import math



#########################################################################
## Base Inputs
#########################################################################

angle_rise = 44.48
angle_side = 45.0

angle_max = 45
angle_step = 5

#########################################################################
## Define Functions
#########################################################################

##### Define Planar Intersections: 

def planar_intersection(vec_a, vec_b, p_res):
    
    vec_a_planar = gh.VectorXYZ(0, vec_a[1], vec_a[2])[0]
    vec_b_planar = gh.VectorXYZ(0, vec_b[1], vec_b[2])[0]
    
    p_a = gh.ConstructPoint(0,0,0)
    p_b_planar = gh.ConstructPoint(0,p_res[1],p_res[2])
    
    ln_a = gh.LineSDL(p_a, vec_a_planar, 1000)
    ln_b = gh.LineSDL(p_b_planar, vec_b_planar, 1000)
    
    ln_a = gh.ExtendCurve(ln_a, 0, 100, 100)
    ln_b = gh.ExtendCurve(ln_b, 0, 100, 100)
    
    int = gh.LineXLine(ln_a, ln_b)[2]
    
    if int[2] != 0:
        int_plane = gh.XYPlane(int)
        ln_a_world = gh.LineSDL(p_a, vec_a, 1000)
        int_world = gh.LineXPlane(ln_a_world, int_plane)[0]
    else: int_world = gh.ConstructPoint(int[1], int[1], 0)
    
    vec_a_adapted = gh.Vector2Pt(p_a, int_world, False)[0]
    vec_b_adapted = gh.Vector2Pt(p_res, int_world, False)[0]
    
    
    ## Additional Point for x intersection: 
    
    ln_c = gh.LineSDL(p_res, vec_b, 100)
    plane = gh.XYPlane(int_world)
    int_c = gh.LineXPlane(ln_c, plane)[0]
    
    dist = gh.Distance(int_c, int_world)
    
    return(vec_a_adapted, vec_b_adapted, dist)


##### Define Trail length reduction: 

def trail_length_reduction(p_origin, vec_origin, pts_start, dev_vec):
    
    dev_vec = dev_vec[1:]
    
    cutting_plane= gh.ConstructPlane(p_origin, gh.UnitX(1), vec_origin)
    
    points_moved = [p_origin]
    trail_vec = []
    trail_len = []
    
    for i in range(len(dev_vec)):
        
        line = gh.LineSDL(pts_start[i], dev_vec[i], 100)
        int = gh.LineXPlane(line, cutting_plane)[0]
        
        vec = gh.Vector2Pt(points_moved[i], int, False)
        points_moved.append(int)
        
        trail_vec.append(vec[0])
        trail_len.append(vec[1])
    
    points_moved.pop(0)
    
    return(points_moved, trail_vec, trail_len)


##### Define x-dist Intersections: 

def x_dist_intersection(vec_a, vec_b, p_res):
    
    vec_a_planar = gh.VectorXYZ(0, vec_a[1], vec_a[2])[0]
    vec_b_planar = gh.VectorXYZ(0, vec_b[1], vec_b[2])[0]
    
    p_a = gh.ConstructPoint(0,0,0)
    p_b_planar = gh.ConstructPoint(0,p_res[1],p_res[2])
    
    ln_a = gh.LineSDL(p_a, vec_a_planar, 1000)
    ln_b = gh.LineSDL(p_b_planar, vec_b_planar, 1000)
    
    int = gh.LineXLine(ln_a, ln_b)[2]
    
    if int[2] != 0:
        int_plane = gh.XYPlane(int)
        
        ln_a_world = gh.LineSDL(p_a, vec_a, 1000)
        ln_b_world = gh.LineSDL(p_res, vec_b, 1000)
        
        int_world_a = gh.LineXPlane(ln_a_world, int_plane)[0]
        int_world_b = gh.LineXPlane(ln_b_world, int_plane)[0]
        
    else: 
        int_plane_a = gh.XZPlane(int)
        int_plane_b = gh.XYPlane(int)
        
        ln_a_world = gh.LineSDL(p_a, vec_a, 1000)
        ln_b_world = gh.LineSDL(p_res, vec_b, 1000)
        
        int_world_a = gh.LineXPlane(ln_a_world, int_plane_a)[0]
        int_world_b = gh.LineXPlane(ln_b_world, int_plane_b)[0]
        
    
    x_vec = gh.Distance(int_world_a, int_world_b)
    
    vec_a_adapted = gh.Vector2Pt(p_a, int_world_a, False)[0]
    vec_b_adapted = gh.Vector2Pt(p_res, int_world_b, False)[0]
    
    return(vec_a_adapted, vec_b_adapted, x_vec)



#########################################################################
## Generate Deviation and main trail and external vorce Vectors: 
#########################################################################

deviation_vec = []
trail_vec_main = []

for i in range(resolution):
    
    angle_rise_dev = angle_rise - (angle_rise/(resolution-1))*i
    angle_side_dev = (angle_side/(resolution-1))*i
    
    vec_loc_x = math.tan(math.radians(angle_side_dev))
    vec_loc_z = math.tan(math.radians(angle_rise_dev))
    
    deviation_vec.append(gh.VectorXYZ(-vec_loc_x, -1, -vec_loc_z)[0])


for i in range(steps):
    
    angle_loc = angle_max - angle_step*i
    vec_trail_z = math.tan(math.radians(angle_loc))
    
    vec_trail_loc = gh.VectorXYZ(0, 1, -vec_trail_z)[0]
    trail_vec_main.append(vec_trail_loc)


external_force_vec = gh.Amplitude(deviation_vec[0], external_force_mag)
initial_dev_vec = gh.VectorXYZ(initial_deviation_force,0,0)[0]
self_weight_vec = gh.VectorXYZ(0,0,-0.02)[0]



#########################################################################
## Generate Origin Nodes: 
#########################################################################

origin_nodes = []

for i in range(steps):
    
    point_base = gh.ConstructPoint(0,0,0)
    moved = gh.Move(point_base, gh.Amplitude(deviation_vec[0], -toolpath_heigth*i))[0]
    origin_nodes.append(moved)

origin_nodes.reverse()



#########################################################################
## Output: 
#########################################################################

trail_elements = []
deviation_elements = []
mid_deviation_elements = []
extra_deviation_elements = []

trail_length = []
deviation_force = []
mid_deviation_force = []
extra_deviation_elements_force = []

self_weight_points = []
anchor_points = []
external_force_points = []
anchor_force_points = []

anchor_force_vec = []

#########################################################################
## Generate Topology Values: 
#########################################################################

trail_vec_all = []
dev_vec_all = []

points_trail = []

for i in range(steps):
    for k in range(resolution):
        
        #########################################################################
        ## First Point:
        
        if i == 0 and k == 0:
            
            vec_res_loc = external_force_vec+initial_dev_vec+self_weight_vec
            trail_vec = planar_intersection(deviation_vec[k], trail_vec_main[i], vec_res_loc)
            
            trail_vec_all.append(trail_vec[1])
            dev_vec_all.append(trail_vec[0])
            
            points_trail.append(gh.Move(origin_nodes[i], gh.Amplitude(trail_vec[1], -initial_trail_length * (k+1)))[0])
            trail_length.append(initial_trail_length)
            mid_deviation_force.append(-initial_deviation_force)
        
        
        ## First Row: 
        elif i == 0 and k >= 1:
            
            vec_res_loc = self_weight_vec-trail_vec_all[k-1]
            trail_vec = planar_intersection(deviation_vec[k], trail_vec_main[i], vec_res_loc)
            
            if k != resolution-1: trail_vec_all.append(trail_vec[1])
            dev_vec_all.append(trail_vec[0])
            
            points_trail.append(gh.Move(points_trail[k-1], gh.Amplitude(trail_vec[1], -initial_trail_length))[0])
            if k != resolution-1: trail_length.append(initial_trail_length)
        
        
        
        #########################################################################
        ## Mid Rows: 
        
        if i >= 1 and i != resolution-1:
            ## First Element of Mid Rows
            if k == 0:
                
                vec_res_loc = self_weight_vec + dev_vec_all[k+((i-1)*resolution)]
                trail_vec = planar_intersection(deviation_vec[k], trail_vec_all[k], vec_res_loc)
                
                dev_vec_all.append(trail_vec[0])
                trail_vec_all.append(gh.VectorXYZ(-trail_vec[2], trail_vec[1][1], trail_vec[1][2])[0])
                mid_deviation_force.append(-trail_vec[2])
            
            
            
            ## Other Elements of Mid Rows
            else:
                
                vec_res_loc = self_weight_vec + dev_vec_all[k+((i-1)*resolution)] - trail_vec_all[-1]
                trail_vec = x_dist_intersection(deviation_vec[k], trail_vec_all[k], vec_res_loc)
                
                dev_vec_all.append(trail_vec[0])
                if k != resolution-1: trail_vec_all.append(trail_vec[1])
                extra_deviation_elements_force.append(trail_vec[2])
    
    
    
    #########################################################################
    ## New Trail Elements: 
    if i != resolution-3: 
        trail_new = trail_length_reduction(origin_nodes[i+1], trail_vec_main[i+1], points_trail, deviation_vec)
        
        points_trail = trail_new[0]
        trail_vec_all = trail_new[1]
        trail_length.extend(trail_new[2])



#########################################################################
## Generate Geometrical Topology: 
#########################################################################


for i in range(steps):
    
    line = gh.Line(gh.ConstructPoint(-0.05/resolution,-0.1-i*0.05,0), gh.ConstructPoint(0.1-0.05/resolution,-0.1-i*0.05,0))
    div = gh.DivideCurve(line, resolution, False)
    explode = gh.Shatter(line, div[2])
    anchor_points.append(gh.ConstructPoint(0.1-0.05/resolution,-0.1-i*0.05,0))
    
    self_weight_points.extend(div[0][1:])
    
    
    if i == 0:
        external_force_points.append(div[0][0])
        external_force_points.append(div[0][1])
    
    if i < steps-1:
        div_moved = gh.Move(div[0], gh.UnitY(-0.05))[0]
        dev_loc = gh.Line(div[0], div_moved)
        dev_loc.pop(0)
        deviation_elements.extend(dev_loc)
    
    if i > 0:
        extra_dev = gh.Line(div[0], gh.Mirror(div[0], gh.YZPlane(gh.ConstructPoint(0,0,0)))[0])
        extra_dev.pop(0)
        extra_dev.pop(0)
        extra_deviation_elements.extend(extra_dev)
    
    if i == steps-1:
        pts_anchor = div[0]
        pts_anchor.pop(0)
        anchor_force_points.extend(pts_anchor)
    
    mid_deviation_elements.append(explode[0])
    explode.pop(0)
    trail_elements.extend(explode)



trail_elements.extend(gh.Mirror(trail_elements, gh.YZPlane(gh.ConstructPoint(0,0,0)))[0])
deviation_elements.extend(gh.Mirror(deviation_elements, gh.YZPlane(gh.ConstructPoint(0,0,0)))[0])
anchor_points.extend(gh.Mirror(anchor_points, gh.YZPlane(gh.ConstructPoint(0,0,0)))[0])
anchor_force_points.extend(gh.Mirror(anchor_force_points, gh.YZPlane(gh.ConstructPoint(0,0,0)))[0])
self_weight_points.extend(gh.Mirror(self_weight_points, gh.YZPlane(gh.ConstructPoint(0,0,0)))[0])

origin_nodes = gh.Move(origin_nodes, gh.UnitX(toolpath_heigth/2))[0]
origin_nodes.extend(gh.Mirror(origin_nodes, gh.YZPlane(gh.ConstructPoint(0,0,0)))[0])



#########################################################################
## Generate Output: 
#########################################################################

for i in range(len(dev_vec_all)):
    if i < resolution*(steps-1): deviation_force.append(-gh.VectorLength(dev_vec_all[i]))
    if i >= resolution*(steps-1): anchor_force_vec.append(dev_vec_all[i])

anchor_force_vec_add = []
for vec in anchor_force_vec:anchor_force_vec_add.append(gh.VectorXYZ(-vec[0], vec[1], vec[2])[0])
anchor_force_vec.extend(anchor_force_vec_add)

trail_length_neg = []
for len in trail_length: trail_length_neg.append(-len)

trail_length = trail_length_neg

trail_length.extend(trail_length)
deviation_force.extend(deviation_force)


anchor_force_vec.extend(dev_vec_all[-1:-resolution])
# ---------- end create_squinch_topology ----------

# ----
# Part B - Structure
cem_extract_topology = CEM_Extract_Topology(TP=cem_build_topology)  # -> Nodes, NodesID, Edges, EdgesID, ConstraintPlane, ConstraintPlaneID, OriginNode, OriginNodeID
height = Slider(0.25, range=0..0.75)
unit_z = UnitZ(Factor=height)
move = Move(Geometry=cem_extract_topology.OriginNode, Motion=unit_z)  # -> Geometry, Transform
cem_origin_node = CEM_Origin_Node(OriginNode=move.Geometry, OriginNodeID=cem_extract_topology.OriginNodeID)
cem_calculate_structure = CEM_Calculate_Structure(TP=cem_build_topology, N=cem_origin_node)

deconstruct_vector = DeconstructVector(Vector=expr("-x", graft(create_squinch_topology.anchor_force_vec)))  # -> XComponent, YComponent, ZComponent
deconstruct_vector_2 = DeconstructVector(Vector=graft(create_squinch_topology.self_weight_vec))  # -> XComponent, YComponent, ZComponent
deconstruct_vector_3 = DeconstructVector(Vector=graft(create_squinch_topology.external_force_vec))  # -> XComponent, YComponent, ZComponent
cem_deviation_2 = CEM_Deviation(
    DeviationEdge=graft(create_squinch_topology.deviation_elements),
    DeviationMagn=graft(create_squinch_topology.deviation_force))
cem_deviation_3 = CEM_Deviation(
    DeviationEdge=graft(create_squinch_topology.mid_deviation_elements),
    DeviationMagn=graft(create_squinch_topology.mid_deviation_force))
cem_deviation_4 = CEM_Deviation(
    DeviationEdge=graft(create_squinch_topology.extra_deviation_elements),
    DeviationMagn=graft(create_squinch_topology.extra_deviation_elements_force))
cem_load_3 = CEM_Load(
    PointLoad=graft(create_squinch_topology.self_weight_points),
    LoadMagnX=graft(deconstruct_vector_2.XComponent),
    LoadMagnY=graft(deconstruct_vector_2.YComponent),
    LoadMagnZ=graft(deconstruct_vector_2.ZComponent))
cem_load_4 = CEM_Load(
    PointLoad=graft(create_squinch_topology.external_force_points),
    LoadMagnX=graft(deconstruct_vector_3.XComponent),
    LoadMagnY=graft(deconstruct_vector_3.YComponent),
    LoadMagnZ=graft(deconstruct_vector_3.ZComponent))
cem_load_5 = CEM_Load(
    PointLoad=graft(create_squinch_topology.anchor_force_points),
    LoadMagnX=graft(deconstruct_vector.XComponent),
    LoadMagnY=graft(deconstruct_vector.YComponent),
    LoadMagnZ=graft(deconstruct_vector.ZComponent))
cem_trail_2 = CEM_Trail(TrailEdge=graft(create_squinch_topology.trail_elements), TrailLen=graft(create_squinch_topology.trail_length))
cem_support_2 = CEM_Support(Support=graft(create_squinch_topology.anchor_points))
curve = Curve([<curve referenced from the Rhino model> x12])
end_points = EndPoints(Curve=curve)  # -> Start, End
curve_2 = Curve([<curve referenced from the Rhino model> x4])
vector_2pt = Vector2Pt(PointA=end_points.Start, PointB=end_points.End, Unitize=False)  # -> Vector, Length
cem_build_topology_2 = CEM_Build_Topology(
    T=flatten(cem_trail_2),
    L=flatten([cem_load_3, cem_load_4, cem_load_5]),
    D=flatten([cem_deviation_2, cem_deviation_3, cem_deviation_4]),
    S=flatten(cem_support_2))
list_item = ListItem(List=vector_2pt.Vector, Index=11, Wrap=True)
cem_extract_topology_2 = CEM_Extract_Topology(TP=cem_build_topology_2)  # -> Nodes, NodesID, Edges, EdgesID, ConstraintPlane, ConstraintPlaneID, OriginNode, OriginNodeID
panel = Panel(vector_2pt.Vector)
length = Length(Curve=curve_2)

# ----
# Part C - Preview
cem_extract_structure = CEM_Extract_Structure(M=cem_calculate_structure)  # -> Nodes, NodesID, Trails, TrailsID, TrailsCol, TrailsMag, Deviations, DeviationsID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
merge = Merge(Data1=cem_extract_structure.Trails, Data2=cem_extract_structure.Deviations)
merge_2 = Merge(Data1=cem_extract_structure.TrailsMag, Data2=cem_extract_structure.DeviationsMag)
colour = GhPythonScript(mag=merge_2)  # -> out; inputs mag: list
# ---------- colour: Python ----------
for magnitude in mag:
    
    if magnitude > 0: print(255, 0, 0)
    else: print(0, 0, 255)
# ---------- end colour ----------
custom_preview = CustomPreview(Geometry=merge, Material=colour)

# ----
# Part A - Topology
create_topology_start = GhPythonScript(
    arch_res=arch_res,
    layer_numb=layer_numb_2,
    self_weight=create_topology_main.self_weight_mag,
    external_load=create_topology_main.external_load_mag,
    pts=cem_extract_structure.Nodes,
    pts_ind=cem_extract_structure.NodesID,
    dev_mag=dev_mag,
    trail_length_max=trail_length_max,
    trail_length_min=trail_length_min)  # -> trail, trail_length, port, load_points, load_magnitude, load_points_external, load_magnitude_external, port_2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; inputs arch_res: Int32, layer_numb: Int32, self_weight: list, external_load: list, pts: list of Point3d, pts_ind: list of Int32
# ---------- create_topology_start: Python ----------
import ghpythonlib.components as gh



################################################################################
## Create the main Curves: 


# Create the trail elements:
lines_trail = []
for i in range(arch_res+1): lines_trail.append(gh.Line(gh.ConstructPoint(0,i*0.1,0), gh.ConstructPoint(-1,i*0.1,0)))

trail = []
for line in lines_trail:
    div = gh.DivideCurve(line, layer_numb, False)
    div_curve = gh.Shatter(line, div[2])
    trail.extend(div_curve)


# Create the deviaiton elements:
deviation = []
for i in range(layer_numb+1):
    dev_loc = []
    for k in range(len(lines_trail)):
        div = gh.DivideCurve(lines_trail[k], layer_numb, False)[0]
        dev_loc.append(div[i])
    
    deviaiton_line = gh.PolyLine(dev_loc, False)
    deviation.extend(gh.Explode(deviaiton_line, True)[0])



################################################################################
## Create the anchor_points: 

support = []
for line in lines_trail: support.append(gh.EndPoints(line)[1])



################################################################################
## Create load points and magnitudes:

# External loads: 
load_points_external = []
load_magnitude_external = []

for line in lines_trail: 
    load_points_external.append(gh.EndPoints(line)[0])
    load_magnitude_external.append(-external_load[0])


# Loads due Selfweight: 
load_points = []
load_magnitude = []

for line in lines_trail:
    div = gh.DivideCurve(line, layer_numb, False)[0]
    load_points.extend(div)

for point in load_points: load_magnitude.append(self_weight[0])



################################################################################
## Create deviation magnitudes:

deviation_mag = []
for dev in deviation: deviation_mag.append(dev_mag)



################################################################################
## Create trail lengths:


# Pick the anchor nodes from the previos step: 

point_indices = []
for i in range(int(arch_res+1)): point_indices.append(i)

points_anchor = []
for i in range(len(point_indices)):
    for k in range(len(pts_ind)):
        if point_indices[i] == pts_ind[k]: points_anchor.append(pts[k])

points_anchor = points_anchor[:int(len(points_anchor)/2)]


# Calculate the trail length based on the distance:

points_anchor_flat = []
for point in points_anchor: points_anchor_flat.append(gh.ConstructPoint(point[0], 0, point[2]))

length_total = 0
for i in range(len(points_anchor_flat)-1): length_total+= gh.Length(gh.Line(points_anchor_flat[i], points_anchor_flat[i+1]))

length_loc = []
for i in range(len(points_anchor_flat)-1): length_loc.append(gh.Length(gh.Line(points_anchor_flat[-1], points_anchor_flat[i])))

trail_length_a = []
for i in range(len(length_loc)):
    tail_diff_loc = (length_loc[i] * (trail_length_max - trail_length_min))/length_total
    trail_length_loc = trail_length_max - tail_diff_loc
    trail_length_a.append(trail_length_loc)
trail_length_a.append(trail_length_max)


# Create trail_lenghts: 

trail_length_single = []
trail_length_single.extend(trail_length_a)
trail_length_a.reverse()
trail_length_single.extend(trail_length_a)

trail_length = []
for i in range(len(trail_length_single)):
    for k in range(layer_numb):
        trail_length.append(trail_length_single[i])
# ---------- end create_topology_start ----------
cem_deviation_5 = CEM_Deviation(DeviationEdge=graft(create_topology_start.deviation), DeviationMagn=graft(create_topology_start.deviation_mag))
cem_load_6 = CEM_Load(PointLoad=graft(create_topology_start.load_points), LoadMagnZ=graft(create_topology_start.load_magnitude))
cem_load_7 = CEM_Load(
    PointLoad=graft(create_topology_start.load_points_external),
    LoadMagnX=graft(create_topology_start.load_magnitude_external))
cem_trail_3 = CEM_Trail(TrailEdge=graft(create_topology_start.trail), TrailLen=graft(trail_length_max))
cem_support_3 = CEM_Support(Support=create_topology_start.support)
cem_build_topology_3 = CEM_Build_Topology(T=flatten(cem_trail_3), L=flatten([cem_load_6, cem_load_7]), D=flatten(cem_deviation_5), S=flatten(cem_support_3))

panel_2 = Panel(length)
sort_origin_nodes = GhPythonScript(
    origin_node=cem_extract_topology_2.OriginNode,
    origin_node_new=create_squinch_topology.origin_nodes,
    origin_node_id=cem_extract_topology_2.OriginNodeID)  # -> origin_node_new_sorted; inputs origin_node: list of Point3d, origin_node_new: list of Point3d, origin_node_id: list
# ---------- sort_origin_nodes: Python ----------
import ghpythonlib.components as gh


## sort nodes: 

origin_node_new_sorted = []
origin_nodes_sorted = gh.SortList(origin_node_id, origin_node)[1]


for i in range(len(origin_node)):
    
    for k in range(len(origin_nodes_sorted)):
        
        if origin_node[i] == origin_nodes_sorted[k]:
            
            origin_node_new_sorted.append(origin_node_new[k])
# ---------- end sort_origin_nodes ----------
cem_origin_node_2 = CEM_Origin_Node(OriginNode=sort_origin_nodes, OriginNodeID=cem_extract_topology_2.OriginNodeID)
cem_calculate_structure_2 = CEM_Calculate_Structure(TP=cem_build_topology_2, N=cem_origin_node_2)
cem_extract_structure_2 = CEM_Extract_Structure(M=cem_calculate_structure_2)  # -> Nodes, NodesID, Trails, TrailsID, TrailsCol, TrailsMag, Deviations, DeviationsID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
merge_3 = Merge(Data1=cem_extract_structure_2.Trails, Data2=cem_extract_structure_2.Deviations)
merge_4 = Merge(Data1=cem_extract_structure_2.TrailsMag, Data2=cem_extract_structure_2.DeviationsMag)
colour_2 = GhPythonScript(mag=merge_4)  # -> out; inputs mag: list; same code as colour
custom_preview_2 = CustomPreview(Geometry=merge_3, Material=colour_2)

# ----
# Part B - Structure
cem_extract_topology_3 = CEM_Extract_Topology(TP=cem_build_topology_3)  # -> Nodes, NodesID, Edges, EdgesID, ConstraintPlane, ConstraintPlaneID, OriginNode, OriginNodeID

sort_and_select = GhPythonScript(
    ind_origin=cem_extract_topology_3.OriginNodeID,
    pts=cem_extract_structure.Nodes,
    pts_ind=cem_extract_structure.NodesID,
    arch_res=arch_res)  # -> origin_new; inputs ind_origin: list of Int32, pts: list of Point3d, pts_ind: list of Int32, arch_res: Int32
# ---------- sort_and_select: Python ----------
import ghpythonlib.components as gh



################################################################################
## Pick the anchor nodes from the previos step: 

point_indices = []
for i in range(int(arch_res+1)): point_indices.append(i)

points_anchor = []
for i in range(len(point_indices)):
    for k in range(len(pts_ind)):
        if point_indices[i] == pts_ind[k]: points_anchor.append(pts[k])



################################################################################
## Sort the origin nodes and output the anchor nodes based on the same index: 

ind_origin_sorted = ind_origin[::]
ind_origin_sorted.sort()

origin_new = []

for i in range(len(ind_origin)):
    for k in range(len(ind_origin_sorted)):
        if ind_origin[i] == ind_origin_sorted[k]: origin_new.append(points_anchor[k])



################################################################################
# ---------- end sort_and_select ----------

cem_origin_node_3 = CEM_Origin_Node(OriginNode=sort_and_select, OriginNodeID=cem_extract_topology_3.OriginNode)
cem_calculate_structure_3 = CEM_Calculate_Structure(TP=cem_build_topology_3, N=cem_origin_node_3)

# ----
# Part C - Preview
cem_extract_structure_3 = CEM_Extract_Structure(M=cem_calculate_structure_3)  # -> Nodes, NodesID, Trails, TrailsID, TrailsCol, TrailsMag, Deviations, DeviationsID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
merge_5 = Merge(Data1=cem_extract_structure_3.Trails, Data2=cem_extract_structure_3.Deviations)
merge_6 = Merge(Data1=cem_extract_structure_3.TrailsMag, Data2=cem_extract_structure_3.DeviationsMag)
colour_3 = GhPythonScript(mag=merge_6)  # -> out; inputs mag: list; same code as colour
custom_preview_3 = CustomPreview(Geometry=merge_5, Material=colour_3)
