# Grasshopper definition Code_Kappendecke_2.0_var_1.ghx (Grasshopper 1.0.7)
# Copyright: Felswind
# plug-ins: CEM_Build_Topology, CEM_Deviation, CEM_Extract_Topology, CEM_Support, CEM_Trail, CEM_Calculate_Structure, CEM_Origin_Node, CEM_Extract_Structure, CEM_Load

curve = Curve(<curve referenced from the Rhino model>)

layer_numb = Slider(4, range=1..50)
layer_depth = Slider(0.2, range=0.001..1)
arch_res = Slider(31, range=1..101)
tilt_angle = Slider(45, range=0..90)
dev_mag_arch = Slider(-15, range=-100..0)
trail_length = Slider(-0.03, range=-50..0)

flip_curve = FlipCurve(Curve=curve)  # -> Curve, Flag
curve_2 = Curve(graft([<curve referenced from the Rhino model> x3]))
end_points = EndPoints(Curve=flip_curve.Curve)  # -> Start, End
end_points_2 = EndPoints(Curve=curve_2)  # -> Start, End

# ----
# Part A - Topology
create_topology = GhPythonScript(
    layer_numb=layer_numb,
    layer_depth=layer_depth,
    arch_res=arch_res,
    tilt_angle=tilt_angle,
    deviaton_arch_mag=dev_mag_arch,
    trail_length=trail_length)  # -> trail, trail_lengths, self_weight_point, self_weight_mag, external_load_point, external_load_mag, deviation, deviation_mag, anchor_points; inputs layer_numb: Int32, arch_res: Int32, tilt_angle: Int32
# ---------- create_topology: Python ----------
import ghpythonlib.components as gh
import math



####################################
## Define Curve Function: 
####################################



def arch_curve_topology(depth, x_pos, arch_res, layer_depth):
    
    
    ## Output parameters:
    anchor_points = []
    deviation_arch = []
    deviation_ring = []
    trail = []
    load_point = []
    
    
    ## Create the base curve and divide it: 
    base_line = gh.Line(gh.ConstructPoint(x_pos, -depth/2, 0), gh.ConstructPoint(x_pos, depth/2, 0))
    div = gh.DivideCurve(base_line, arch_res, False)
    explode = gh.Shatter(base_line, div[2])
    
    
    ## Create the Points for the Self_weight: 
    load_point.extend(div[0])
    
    
    ## Create the anchor points: 
    anchor_points.extend((div[0][0], div[0][-1]))
    
    
    ## Create the deviation / trail elements for the main arch: 
    for i, curve in enumerate(explode):
        if i == int(arch_res/2): deviation_arch.append(curve)
        else: trail.append(curve)
    
    
    ## Create the connecting (ring) deviation elements: 
    if x_pos > 0:
        pts_moved = gh.Move(div[0], gh.UnitX(-layer_depth))[0]
        line_dev = gh.Line(div[0], pts_moved)
        
        for curve in line_dev: deviation_ring.append(curve)
    
    
    ## Return the final geometry: 
    return(anchor_points, deviation_arch, deviation_ring, trail, load_point)



####################################
## Run the Curve Function: 
####################################



## Output Topology:
anchor_points = []
deviation = []
deviation_mag = []
trail = []
trail_lengths = []


## Output forces: 
self_weight_point = []
self_weight_mag = []
external_load_point = []
external_load_mag = []


## Create the Output elements:
tilt_angle = 90 - tilt_angle

for i in range(layer_numb):
    
    curve = arch_curve_topology(0.5, i*layer_depth, arch_res, layer_depth)
    
    
    ## Anchor points: 
    anchor_points.extend(curve[0])
    
    
    ## Create the points for the forces:
    self_weight_point.extend(curve[4])
    if i == 0: external_load_point.extend(curve[4])
    
    
    ## Create a Parapolic shape: 
    
    self_weight = -2
    for pt in curve[4]: self_weight_mag.append(self_weight)
    
    external_load = (layer_numb * -self_weight) / math.tan(math.radians(tilt_angle))
    if i == 0:
       for pt in external_load_point: external_load_mag.append(external_load)
    
    
    ## Deviation Elemements and magnitude:
    deviation.extend(curve[1])
    for crv in curve[1]: deviation_mag.append(deviaton_arch_mag)
    
    deviation.extend(curve[2])
    
    for crv in curve[2]: deviation_mag.append((-external_load / layer_numb) * (layer_numb - i))
    
    
    ## Trail elements and lengths: 
    trail.extend(curve[3])
    for crv in curve[3]: trail_lengths.append(trail_length)
# ---------- end create_topology ----------
cem_deviation = CEM_Deviation(DeviationEdge=graft(create_topology.deviation), DeviationMagn=graft(create_topology.deviation_mag))
cem_load = CEM_Load(PointLoad=graft(create_topology.self_weight_point), LoadMagnZ=graft(create_topology.self_weight_mag))
cem_load_2 = CEM_Load(PointLoad=graft(create_topology.external_load_point), LoadMagnX=graft(create_topology.external_load_mag))
cem_trail = CEM_Trail(TrailEdge=graft(create_topology.trail), TrailLen=graft(create_topology.trail_lengths))
cem_support = CEM_Support(Support=create_topology.anchor_points)
cem_build_topology = CEM_Build_Topology(T=flatten(cem_trail), L=flatten([cem_load, cem_load_2]), D=flatten(cem_deviation), S=flatten(cem_support))

vector_2pt = Vector2Pt(PointA=end_points_2.Start, PointB=end_points_2.End, Unitize=False)  # -> Vector, Length
vector_2pt_2 = Vector2Pt(PointA=end_points.Start, PointB=end_points.End, Unitize=False)  # -> Vector, Length
vector_display = VectorDisplay(Anchor=end_points_2.Start, Vector=vector_2pt.Vector)
deconstruct_vector = DeconstructVector(Vector=vector_2pt.Vector)  # -> flatten(XComponent), flatten(YComponent), flatten(ZComponent)
deconstruct_vector_2 = DeconstructVector(Vector=vector_2pt_2.Vector)  # -> XComponent, YComponent, ZComponent
point = Point(<point referenced from the Rhino model>)
curve_3 = Curve(<curve referenced from the Rhino model>)
length = Length(Curve=curve_3)
deconstruct = Deconstruct(Point=point)  # -> XComponent, YComponent, ZComponent
mass_addition = MassAddition(Input=deconstruct_vector.XComponent)  # -> Result, PartialResults
mass_addition_2 = MassAddition(Input=deconstruct_vector.YComponent)  # -> Result, PartialResults
mass_addition_3 = MassAddition(Input=deconstruct_vector.ZComponent)  # -> Result, PartialResults
multiplication = Multiplication(A=deconstruct_vector_2.XComponent, B=100)
multiplication_2 = Multiplication(A=deconstruct_vector_2.YComponent, B=100)
multiplication_3 = Multiplication(A=deconstruct_vector_2.ZComponent, B=100)
multiplication_4 = Multiplication(A=length, B=100)
angle_step = Slider(5, range=1..100)

layer_numb_2 = Slider(3, range=1..50)
layer_depth_2 = Slider(0.2, range=0.001..1)

trail_length_2 = Slider(-0.1, range=-50..0)
arch_res_2 = Slider(7, range=1..101)
tilt_angle_2 = Slider(0, range=0..90)
dev_mag_arch_2 = Slider(-5, range=-100..0)
panel = Panel(deconstruct.XComponent)
panel_2 = Panel(deconstruct.YComponent)
panel_3 = Panel(deconstruct.ZComponent)
panel_4 = Panel(multiplication_4)
panel_5 = Panel(mass_addition_3.Result)

# ----
# Part B - Structure
height = Slider(0.25, range=0..0.75)
cem_extract_topology = CEM_Extract_Topology(TP=cem_build_topology)  # -> Nodes, NodesID, Edges, EdgesID, ConstraintPlane, ConstraintPlaneID, OriginNode, OriginNodeID
unit_z = UnitZ(Factor=height)
move = Move(Geometry=cem_extract_topology.OriginNode, Motion=unit_z)  # -> Geometry, Transform
cem_origin_node = CEM_Origin_Node(OriginNode=move.Geometry, OriginNodeID=cem_extract_topology.OriginNodeID)
cem_calculate_structure = CEM_Calculate_Structure(TP=cem_build_topology, N=cem_origin_node)

panel_6 = Panel(multiplication)
panel_7 = Panel(multiplication_3)
panel_8 = Panel(multiplication_2)
create_topology_2 = GhPythonScript(
    layer_numb=layer_numb_2,
    layer_depth=layer_depth_2,
    arch_res=arch_res_2,
    tilt_angle=tilt_angle_2,
    deviaton_arch_mag=dev_mag_arch_2,
    trail_length=trail_length_2)  # -> trail, trail_lengths, self_weight_point, self_weight_mag, external_load_point, external_load_mag, anchor_end_load, deviation, deviation_mag, anchor_points; inputs layer_numb: Int32, arch_res: Int32, tilt_angle: Int32
# ---------- create_topology_2: Python ----------
import ghpythonlib.components as gh
import math



####################################
## Define Curve Function: 
####################################



def arch_curve_topology(depth, x_pos, arch_res, layer_depth):
    
    
    ## Output parameters:
    anchor_points = []
    deviation_arch = []
    deviation_ring = []
    trail = []
    load_point = []
    
    
    ## Create the base curve and divide it: 
    base_line = gh.Line(gh.ConstructPoint(x_pos, -depth/2, 0), gh.ConstructPoint(x_pos, depth/2, 0))
    div = gh.DivideCurve(base_line, arch_res, False)
    explode = gh.Shatter(base_line, div[2])
    
    
    ## Create the Points for the Self_weight: 
    load_point.extend(div[0])
    
    
    ## Create the anchor points: 
    anchor_points.extend((div[0][0], div[0][-1]))
    
    
    ## Create the deviation / trail elements for the main arch: 
    for i, curve in enumerate(explode):
        if i == int(arch_res/2): deviation_arch.append(curve)
        else: trail.append(curve)
    
    
    ## Create the connecting (ring) deviation elements: 
    if x_pos > 0:
        pts_moved = gh.Move(div[0], gh.UnitX(-layer_depth))[0]
        line_dev = gh.Line(div[0], pts_moved)
        
        for curve in line_dev: deviation_ring.append(curve)
    
    
    ## Return the final geometry: 
    return(anchor_points, deviation_arch, deviation_ring, trail, load_point)



####################################
## Run the Curve Function: 
####################################



## Output Topology:
anchor_points = []
deviation = []
deviation_mag = []
trail = []
trail_lengths = []


## Output forces: 
self_weight_point = []
self_weight_mag = []
external_load_point = []
external_load_mag = []
anchor_end_load=[]


## Create the Output elements:
tilt_angle = 90 - tilt_angle

for i in range(layer_numb):
    
    curve = arch_curve_topology(0.5, i*layer_depth, arch_res, layer_depth)
    
    
    ## Anchor points: 
    anchor_points.extend(curve[0])
    
    
    ## Create the points for the forces:
    self_weight_point.extend(curve[4])
    if i == int(layer_numb-1): external_load_point.extend(curve[4])## changed !!!!
    if i == 0: anchor_end_load.extend(curve[4])
    
    
    ## Create a Parapolic shape: 
    
    self_weight = -2
    for pt in curve[4]: self_weight_mag.append(self_weight)
    
    external_load = (layer_numb * -self_weight) / math.tan(math.radians(tilt_angle))
    if i == 0:
       for pt in external_load_point: external_load_mag.append(external_load)
    
    
    ## Deviation Elemements and magnitude:
    deviation.extend(curve[1])
    for crv in curve[1]: deviation_mag.append(deviaton_arch_mag)
    
    deviation.extend(curve[2])
    
    for crv in curve[2]: deviation_mag.append((-2))
    
    
    ## Trail elements and lengths: 
    trail.extend(curve[3])
    for crv in curve[3]: trail_lengths.append(trail_length)
# ---------- end create_topology_2 ----------
cem_load_3 = CEM_Load(PointLoad=create_topology_2.external_load_point, LoadMagnX=Slider(-8, range=-101..100))
panel_9 = Panel("""-5
-5
-14.453272
-11.930135
-11.196233
-11.048683
-11.048683
-11.196233
-11.930135
-14.453272
-5
-9.855388
-7.762411
-8.442853
-8.958064
-8.958064
-8.442853
-7.762411
-9.855388""")
line = Line(Line((2.163361093, 0, -0.3223099814), (2.135076812, 0.02099936282, -0.2940257005)))
line_2 = Line(Line((2.080944111, 0, -0.3061158937), (2.109071593, 0, -0.2918741306)))
panel_10 = Panel("""0
14.501635
13.54941
13.386996
13.386996
13.54941
14.501635
0""")
panel_11 = Panel("""0
-0.308052
-0.130102
0
0
0.130102
0.308052
0""")
panel_12 = Panel("""0
01.164528
1.641635
1.673375
1.673375
1.641635
1.164528
0""")
cem_deviation_2 = CEM_Deviation(DeviationEdge=graft(create_topology_2.deviation), DeviationMagn=graft(panel_9))  # disabled
cem_load_4 = CEM_Load(PointLoad=graft(create_topology_2.self_weight_point), LoadMagnZ=graft(create_topology_2.self_weight_mag))
cem_trail_2 = CEM_Trail(TrailEdge=graft(create_topology_2.trail), TrailLen=graft(create_topology_2.trail_lengths))
point_2 = Point([Point(0, -0.25, 0), Point(0, -0.1785714286, 0), Point(0, -0.1071428571, 0), Point(0, -0.03571428571, 0), Point(0, 0.03571428571, 0), Point(0, 0.1071428571, 0), Point(0, 0.1785714286, 0), Point(0, 0.25, 0)])
cem_support_2 = CEM_Support(Support=create_topology_2.anchor_points)
line_line = LineLine()  # -> ParamA, ParamB, PointA, PointB
line_line_2 = LineLine(Line1=line_2, Line2=line)  # -> ParamA, ParamB, PointA, PointB
cem_load_5 = CEM_Load(PointLoad=graft(point_2), LoadMagnX=graft(panel_10), LoadMagnY=graft(panel_11), LoadMagnZ=graft(panel_12))  # -> flatten(L); disabled
point_3 = Point(line_line_2.PointB)
panel_13 = Panel("""-5
-5
-14.453272
-11.930135
-11.196233
-11.048683
-11.048683
-11.196233
-11.930135
-14.453272
-5
-7.762411
-7.762411
-8.442853
-8.958064
-8.958064
-8.442853
-7.762411
-7.762411""")
step = Slider(0.025, range=0..0.75)

# ----
# Part C - Preview
cem_extract_structure = CEM_Extract_Structure(M=cem_calculate_structure)  # -> Nodes, NodesID, Trails, TrailsID, TrailsCol, TrailsMag, Deviations, DeviationsID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
merge = Merge(Data1=cem_extract_structure.Trails, Data2=cem_extract_structure.Deviations)
merge_2 = Merge(Data1=cem_extract_structure.TrailsMag, Data2=cem_extract_structure.DeviationsMag)
colour = GhPythonScript(mag=merge_2)  # -> out; inputs mag: list
# ---------- colour: Python ----------
for magnitude in mag:
    
    if magnitude > 0: print(255, 0, 0)
    else: print(0, 0, 255)
# ---------- end colour ----------
custom_preview = CustomPreview(Geometry=merge, Material=ColourSwatch(SwatchColor=RGBA(217, 217, 217, 237)))

# ----
# Part D - Export
toolpath_thickness = Slider(0.01, range=0.001..1)
generate_toolpath = GhPythonScript(lines=merge, layer_depth=layer_depth, toolpath_thickness=toolpath_thickness)  # -> toolpath_final; inputs lines: list of Curve
# ---------- generate_toolpath: Python ----------
import ghpythonlib.components as gh



## Filter out the print_path_elements: 
line_filtered = []
for ln in lines:
    if gh.Length(ln) < layer_depth*0.95: line_filtered.append(ln)


## Join, rebuild and interpolates the curves:
joined = gh.JoinCurves(line_filtered, False)
rebuilt = gh.RebuildCurve(joined, 3, 25, False)
flipped = gh.FlipCurve(rebuilt, rebuilt[0])[0]
sorted = gh.SortList(gh.Deconstruct(gh.CurveMiddle(flipped))[0], flipped)[1]

steps = []
interpolate = int(layer_depth/toolpath_thickness-1)

toolpath = []

for i in range(interpolate): steps.append(i/interpolate)
for i in range(int(len(joined)-1)): toolpath.extend(gh.TweenCurve(sorted[i], sorted[i+1], steps))


## Close toolpath: 

toolpath_flipped = []

for i, crv in enumerate(toolpath):
    if i % 2 == 0:
        toolpath_flipped.append(gh.FlipCurve(crv)[0])
    
    else:
        toolpath_flipped.append(crv)

lines = []
for i in range(int(len(toolpath_flipped)-1)): lines.append(gh.Line(gh.EndPoints(toolpath_flipped[i])[0], gh.EndPoints(toolpath_flipped[i+1])[1]))

toolpath_final = []

toolpath_final.extend(toolpath_flipped)
toolpath_final.extend(lines)


toolpath_final = gh.JoinCurves(toolpath_final, False)
# ---------- end generate_toolpath ----------

series = Series(Start=0.25, Step=expr("-x", step), Count=layer_numb_2)
reverse_list = ReverseList(List=series)  # -> graft(List)
ghpython_script = GhPythonScript(
    angle_step=angle_step,
    tilt_angle=tilt_angle,
    external_load_mag=create_topology.external_load_mag,
    self_weight_mag=create_topology.self_weight_mag,
    deviaton_arch_mag=dev_mag_arch_2,
    layer_depth=layer_depth_2,
    step_z=step,
    height_z=flatten(reverse_list),
    layer_num=layer_numb_2,
    arch_res=arch_res_2,
    trail_length=trail_length_2)  # -> out, dev_mag_final, force_x_anchor, force_y_anchor, force_z_anchor; inputs angle_step: Int32, tilt_angle: Int32, external_load_mag: list, self_weight_mag: list, height_z: list, layer_num: Int32
# ---------- ghpython_script: Python ----------
import ghpythonlib.components as gh
import math as m



#########################################################################################################
## Define the intersection of the trail and deviation elements: 
#########################################################################################################

def intersection(vec_a, vec_a_start, vec_b_flat):
    
    vec_a_start_flat = gh.ConstructPoint(vec_a_start[0], 0, vec_a_start[2])
    vec_a_flat = gh.VectorXYZ(vec_a[0], 0, vec_a[2])[0]
    
    dev_line_a_flat = gh.LineSDL(vec_a_start_flat, vec_a_flat, 100)
    tra_line_b_flat = gh.LineSDL(gh.ConstructPoint(0,0,0), vec_b_flat, 100) 
    
    intersection_point = gh.LineXLine(dev_line_a_flat,tra_line_b_flat)[2]
    
    dev_line_a = gh.LineSDL(vec_a_start, vec_a, 100)
    tra_line_b = gh.LineSDL(intersection_point, gh.VectorXYZ(0,-1,0)[0], 100)
    
    intersection_point_3d = gh.LineXLine(dev_line_a,tra_line_b)[2]
    
    vec_dev = gh.Vector2Pt(vec_a_start, intersection_point_3d, False)[0]
    vec_trail = gh.Vector2Pt(gh.ConstructPoint(0,0,0), intersection_point_3d, False)[0]
    
    return(vec_dev, vec_trail)



#########################################################################################################
## Define the intersection of the trail and deviation elements: 
#########################################################################################################

def dev_local(vec_a, vec_b, start_a, start_b, trail_len):
    
    vec_a = gh.Amplitude(vec_a, trail_len)
    vec_b = gh.Amplitude(vec_b, trail_len)
    
    pt_a = gh.Move(start_a, vec_a)[0]
    pt_b = gh.Move(start_b, vec_b)[0]
    
    vec_dev_local = gh.Vector2Pt(pt_b, pt_a, False)[0]
    return(vec_dev_local, pt_a)



#########################################################################################################
## Main Vectors:
vec_self_weigth = gh.VectorXYZ(0, 0, self_weight_mag[0])[0]
vec_external_load = gh.VectorXYZ(-external_load_mag[0], 0, 0)[0]
Vec_deviation_mid = gh.VectorXYZ(0, deviaton_arch_mag, 0)[0]
vec_dev_initial = gh.VectorXYZ(layer_depth, 0, step_z)[0]


#########################################################################################################
## Outout Lists:
dev_mag = []
for layer in range(layer_num): dev_mag.append([])

force_anchor_x = []
force_anchor_y = []
force_anchor_z = []


#########################################################################################################
## Create the first dev_forces: 



for k in range(int((arch_res+1)/2)):
    
    trail_row = []
    points_temp = []
    
    
    if k == 0:
        for y in range(layer_num):
            points_temp.append(gh.ConstructPoint(y*layer_depth, 0, height_z[y]))
        points_temp.reverse()
    
    
    for i in range(layer_num):
        
        # get the angle for every trail segment and the vector: 
        angle = tilt_angle-angle_step*i
        vec_angle = gh.VectorXYZ(1/m.tan(m.radians(angle)), 0, -1)[0]
        
        
        
        # get the first force Polygon:
        if k == 0 and i == 0:
            vec_add_given = vec_self_weigth+vec_external_load+Vec_deviation_mid
            vec_point_given = gh.ConstructPoint(vec_add_given[0], vec_add_given[1], vec_add_given[2])
            
            vec_dev = intersection(vec_dev_initial, vec_point_given, vec_angle)[0]
            dev_mag[i].append(-gh.VectorLength(vec_dev)) 
            trail_row.append(intersection(vec_dev_initial, vec_point_given, vec_angle)[1])
        
        
        # get the mid force polygons: 
        elif k == 0 and i < int(layer_num-1):
            vec_add_given = vec_self_weigth+Vec_deviation_mid+gh.Reverse(vec_dev)
            vec_point_given = gh.ConstructPoint(vec_add_given[0], vec_add_given[1], vec_add_given[2])
            
            vec_dev = intersection(vec_dev_initial, vec_point_given, vec_angle)[0]
            dev_mag[i].append(-gh.VectorLength(vec_dev)) #change!
            trail_row.append(intersection(vec_dev_initial, vec_point_given, vec_angle)[1])
        
        
        
        # get the last force polygon:
        elif k == 0 and i == int(layer_num-1):
            vec_add_given = vec_self_weigth+Vec_deviation_mid+gh.Reverse(vec_dev)
            vec_point_given = gh.ConstructPoint(vec_add_given[0], vec_add_given[1], vec_add_given[2])
            
            vec_force = intersection(vec_dev_initial, vec_point_given, vec_angle)[0]
            vec_trail = intersection(vec_dev_initial, vec_point_given, vec_angle)[1]
            
            force_anchor_x.append(vec_force[0])
            force_anchor_y.append(vec_force[1])
            force_anchor_z.append(vec_force[2])
            trail_row.append(vec_trail)
        
        
        
        # get the first row: 
        elif i == 0 and k > 0:
            vec_add_given = vec_self_weigth+vec_external_load+trail_row_prev[i]
            vec_point_given = gh.ConstructPoint(vec_add_given[0], vec_add_given[1], vec_add_given[2])
            
            vec_dev_local = dev_local(trail_row_prev[i], trail_row_prev[i+1], points_temp_prev[i], points_temp_prev[i+1], abs(trail_length))
            points_temp.append(vec_dev_local[1])
            
            vec_dev = intersection(vec_dev_local[0], vec_point_given, vec_angle)[0]
            dev_mag[i].append(-gh.VectorLength(vec_dev))
            trail_row.append(intersection(vec_dev_local[0], vec_point_given, vec_angle)[1])
        
        
        # get the mid rows: 
        elif i != int(layer_num-1):
            vec_add_given = vec_self_weigth+gh.Reverse(vec_dev)+trail_row_prev[i]
            vec_point_given = gh.ConstructPoint(vec_add_given[0], vec_add_given[1], vec_add_given[2])
            
            vec_dev_local = dev_local(trail_row_prev[i], trail_row_prev[i+1], points_temp_prev[i], points_temp_prev[i+1], abs(trail_length))
            points_temp.append(vec_dev_local[1])
            
            vec_dev = intersection(vec_dev_local[0], vec_point_given, vec_angle)[0]
            dev_mag[i].append(-gh.VectorLength(vec_dev))
            trail_row.append(intersection(vec_dev_initial, vec_point_given, vec_angle)[1])
        
        
        
        # get the last row: 
        elif i == int(layer_num-1):
            vec_add_given = vec_self_weigth+gh.Reverse(vec_dev)+trail_row_prev[i]
            vec_point_given = gh.ConstructPoint(vec_add_given[0], vec_add_given[1], vec_add_given[2])
            
            vec_dev_local = gh.Reverse(vec_dev)
            points_temp.append(gh.Move(points_temp_prev[i], gh.Amplitude(trail_row_prev[i], abs(trail_length)))[0])
            
            vec_force = intersection(vec_dev_local, vec_point_given, vec_angle)[0]
            
            force_anchor_x.append(vec_force[0])
            force_anchor_y.append(vec_force[1])
            force_anchor_z.append(vec_force[2])
            trail_row.append(intersection(vec_dev_initial, vec_point_given, vec_angle)[1])
    
    
    trail_row_prev = list(trail_row)
    points_temp_prev = list(points_temp)



#########################################################################################################
## Final sorting:

dev_mag_final= []

force_x_anchor = []
force_y_anchor = []
force_z_anchor = []

dev_mag.reverse()
for i in range(len(dev_mag)):
    dev_mag_final.append(deviaton_arch_mag)
    dev_mag_final.extend(dev_mag[i][::-1])
    dev_mag_final.extend(dev_mag[i])


force_x_anchor.extend((force_anchor_x[::-1]))
force_x_anchor.extend(force_anchor_x)

force_y_anchor.extend((force_anchor_y[::-1]))
force_y_anchor.extend(force_anchor_y)

force_z_anchor.extend((force_anchor_z[::-1]))
force_z_anchor.extend(force_anchor_z)



#########################################################################################################
# ---------- end ghpython_script ----------
cem_deviation_3 = CEM_Deviation(DeviationEdge=graft(create_topology_2.deviation), DeviationMagn=graft(ghpython_script.dev_mag_final))
cem_load_6 = CEM_Load(
    PointLoad=graft(create_topology_2.anchor_end_load),
    LoadMagnX=graft(ghpython_script.force_x_anchor),
    LoadMagnY=graft(ghpython_script.force_y_anchor),
    LoadMagnZ=graft(ghpython_script.force_z_anchor))
cem_build_topology_2 = CEM_Build_Topology(
    T=flatten(cem_trail_2),
    L=flatten([cem_load_4, cem_load_3, cem_load_5, cem_load_6]),
    D=flatten([cem_deviation_2, cem_deviation_3]),
    S=flatten(cem_support_2))
panel_14 = Panel(ghpython_script.dev_mag_final)
cem_extract_topology_2 = CEM_Extract_Topology(TP=cem_build_topology_2)  # -> Nodes, NodesID, Edges, EdgesID, ConstraintPlane, ConstraintPlaneID, OriginNode, OriginNodeID
deconstruct_2 = Deconstruct(Point=cem_extract_topology_2.OriginNode)  # -> XComponent, YComponent, ZComponent
sort_list = SortList(Keys=deconstruct_2.XComponent, ValuesValuesA=cem_extract_topology_2.OriginNode)  # -> Keys, ValuesValuesA
partition_list = PartitionList(List=sort_list.ValuesValuesA, Size=2)
unit_z_2 = UnitZ(Factor=reverse_list)
panel_15 = Panel(reverse_list)
move_2 = Move(Geometry=partition_list, Motion=unit_z_2)  # -> Geometry, Transform
sort_list_2 = SortList(Keys=deconstruct_2.XComponent, ValuesValuesA=cem_extract_topology_2.OriginNodeID)  # -> Keys, ValuesValuesA
sort_points_acc_to_indices = GhPythonScript(
    node_origin_index=cem_extract_topology_2.OriginNodeID,
    node_index=sort_list_2.ValuesValuesA,
    nodes=flatten(move_2.Geometry))  # -> out, nodes_sorted; inputs node_origin_index: list of Int32, node_index: list of Int32, nodes: list of Point3d
# ---------- sort_points_acc_to_indices: Python ----------
import ghpythonlib.components as gh


nodes_sorted = []


for i in range(len(node_origin_index)):
    
    for k in range(len(node_index)):
        
        if node_index[k] == node_origin_index[i]:
            
            nodes_sorted.append(nodes[k])
# ---------- end sort_points_acc_to_indices ----------
cem_origin_node_2 = CEM_Origin_Node(OriginNode=sort_points_acc_to_indices.nodes_sorted, OriginNodeID=cem_extract_topology_2.OriginNodeID)
cem_calculate_structure_2 = CEM_Calculate_Structure(TP=cem_build_topology_2, N=cem_origin_node_2)
# Part C - Preview
cem_extract_structure_2 = CEM_Extract_Structure(M=cem_calculate_structure_2)  # -> Nodes, NodesID, Trails, TrailsID, TrailsCol, TrailsMag, Deviations, DeviationsID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
merge_3 = Merge(Data1=cem_extract_structure_2.Trails, Data2=cem_extract_structure_2.Deviations)
merge_4 = Merge(Data1=cem_extract_structure_2.TrailsMag, Data2=cem_extract_structure_2.DeviationsMag)
curve_middle = CurveMiddle(Curve=merge_3)
colour_2 = GhPythonScript(mag=merge_4)  # -> out; inputs mag: list; same code as colour
custom_preview_2 = CustomPreview(Geometry=merge_3, Material=colour_2)
text_tag = TextTag(Location=curve_middle, Text=merge_4)

# ----
# Part A - Topology
layer_numb_3 = Slider(2, range=1..50)
tilt_angle_3 = Slider(0, range=0..90)
layer_depth_3 = Slider(0.2, range=0.001..1)
arch_res_3 = Slider(31, range=1..101)
dev_mag_arch_3 = Slider(-15, range=-100..0)
trail_length_3 = Slider(-0.03, range=-50..0)

negative = Negative(Value=create_topology.external_load_mag)
create_topology_3 = GhPythonScript(
    layer_numb=layer_numb_3,
    layer_depth=layer_depth_3,
    arch_res=arch_res_3,
    tilt_angle=tilt_angle_3,
    deviaton_arch_mag=dev_mag_arch_3,
    trail_length=trail_length_3)  # -> trail, trail_lengths, self_weight_point, self_weight_mag, external_load_point, external_load_mag, deviation, deviation_mag, anchor_points; inputs layer_numb: Int32, arch_res: Int32, tilt_angle: Int32
# ---------- create_topology_3: Python ----------
import ghpythonlib.components as gh
import math



####################################
## Define Curve Function: 
####################################



def arch_curve_topology(depth, x_pos, arch_res, layer_depth):
    
    
    ## Output parameters:
    anchor_points = []
    deviation_arch = []
    deviation_ring = []
    trail = []
    load_point = []
    
    
    ## Create the base curve and divide it: 
    base_line = gh.Line(gh.ConstructPoint(x_pos, -depth/2, 0), gh.ConstructPoint(x_pos, depth/2, 0))
    div = gh.DivideCurve(base_line, arch_res, False)
    explode = gh.Shatter(base_line, div[2])
    
    
    ## Create the Points for the Self_weight: 
    load_point.extend(div[0])
    
    
    ## Create the anchor points: 
    anchor_points.extend((div[0][0], div[0][-1]))
    
    
    ## Create the deviation / trail elements for the main arch: 
    for i, curve in enumerate(explode):
        if i == int(arch_res/2): deviation_arch.append(curve)
        else: trail.append(curve)
    
    
    ## Create the connecting (ring) deviation elements: 
    if x_pos < 0:
        pts_moved = gh.Move(div[0], gh.UnitX(layer_depth))[0]
        line_dev = gh.Line(div[0], pts_moved)
        
        for curve in line_dev: deviation_ring.append(curve)
    
    
    ## Return the final geometry: 
    return(anchor_points, deviation_arch, deviation_ring, trail, load_point)



####################################
## Run the Curve Function: 
####################################



## Output Topology:
anchor_points = []
deviation = []
deviation_mag = []
trail = []
trail_lengths = []


## Output forces: 
self_weight_point = []
self_weight_mag = []
external_load_point = []
external_load_mag = []


## Create the Output elements:
tilt_angle = 90 - tilt_angle

for i in range(layer_numb):
    
    curve = arch_curve_topology(0.5, -i*layer_depth, arch_res, layer_depth)
    
    
    ## Anchor points: 
    anchor_points.extend(curve[0])
    
    
    ## Create the points for the forces:
    self_weight_point.extend(curve[4])
    if i == 0: external_load_point.extend(curve[4])
    
    
    ## Create a Parapolic shape: 
    
    self_weight = -2
    for pt in curve[4]: self_weight_mag.append(self_weight)
    
    external_load = -(layer_numb * -self_weight) / math.tan(math.radians(tilt_angle))
    if i == 0:
       for pt in external_load_point: external_load_mag.append(external_load)
    
    
    ## Deviation Elemements and magnitude:
    deviation.extend(curve[1])
    if i == 0:
        for crv in curve[1]: deviation_mag.append(-15)
    elif i == 1:
        for crv in curve[1]: deviation_mag.append(-15)
    
    deviation.extend(curve[2])
    
    #for crv in curve[2]: deviation_mag.append((external_load / layer_numb) * (layer_numb - i))
    for crv in curve[2]: ### Tests!
        if i == 1: deviation_mag.append(-2) 
        elif i == 2: deviation_mag.append(-10)
    
    
    ## Trail elements and lengths: 
    trail.extend(curve[3])
    if i == 0:
        for crv in curve[3]: trail_lengths.append(-0.03)
        
    if i == 1:
        for crv in curve[3]: trail_lengths.append(-(math.sin(math.radians(45)) * 0.03))
# ---------- end create_topology_3 ----------
cem_load_7 = CEM_Load(PointLoad=create_topology_3.external_load_point, LoadMagnX=Slider(-4, range=-100..100))
point_4 = Point([Point(-0.2, -0.25, 0), Point(-0.2, -0.2338709677, 0), Point(-0.2, -0.2177419355, 0), Point(-0.2, -0.2016129032, 0), Point(-0.2, -0.185483871, 0), Point(-0.2, -0.1693548387, 0)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])
cem_load_8 = CEM_Load(PointLoad=point_4, LoadMagnX=Slider(2, range=-10..100), LoadMagnZ=Slider(0, range=-100..100))
cem_deviation_4 = CEM_Deviation(DeviationEdge=graft(create_topology_3.deviation), DeviationMagn=graft(create_topology_3.deviation_mag))
cem_load_9 = CEM_Load(PointLoad=graft(create_topology_3.self_weight_point), LoadMagnZ=graft(create_topology_3.self_weight_mag))
cem_load_10 = CEM_Load(PointLoad=graft(create_topology_3.external_load_point), LoadMagnX=graft(negative))  # disabled
cem_trail_3 = CEM_Trail(TrailEdge=graft(create_topology_3.trail), TrailLen=graft(create_topology_3.trail_lengths))
cem_support_3 = CEM_Support(Support=create_topology_3.anchor_points)
cem_build_topology_3 = CEM_Build_Topology(
    T=flatten(cem_trail_3),
    L=flatten([cem_load_9, cem_load_10, cem_load_8, cem_load_7]),
    D=flatten(cem_deviation_4),
    S=flatten(cem_support_3))
curve_4 = Curve(<curve referenced from the Rhino model>)
curve_5 = Curve([<curve referenced from the Rhino model> x4])
curve_6 = Curve([<curve referenced from the Rhino model> x4])
length_2 = Length(Curve=curve_5)
flip_curve_2 = FlipCurve(Curve=curve_4)  # -> Curve, Flag
list_item = ListItem(List=curve_6, Index=0, Wrap=True)
end_points_3 = EndPoints(Curve=curve_6)  # -> Start, End
multiplication_5 = Multiplication(A=length_2, B=100)
vector_2pt_3 = Vector2Pt(PointA=end_points_3.Start, PointB=end_points_3.End, Unitize=False)  # -> Vector, Length
end_points_4 = EndPoints(Curve=curve_4)  # -> Start, End
angles = GhPythonScript()  # -> out, a
# ---------- angles: Python ----------
import math as m

elements = 16

layer_depth = 0.2
z_moved = 0.025
trail_len = 0.03

angles = []

for i in range(elements):
    
    if i == 0: angles.append(m.degrees(m.atan(z_moved/layer_depth)))
    
    else:
        
        diff_z = (m.sin(m.radians(35)) * (trail_len*i) + z_moved) - m.sin(m.radians(45)) * (trail_len*i)
        diff_x = m.cos(m.radians(50)) * (trail_len*i) + layer_depth - m.cos(m.radians(30)) * (trail_len*i)
        
        angle = m.degrees(m.atan(diff_z/diff_x))
        
        angles.append(angle)


print(angles)
# ---------- end angles ----------

layer_numb_4 = Slider(2, range=1..50)
layer_depth_4 = Slider(0.2, range=0.001..1)
arch_res_4 = Slider(7, range=1..101)
tilt_angle_4 = Slider(0, range=0..90)
dev_mag_arch_4 = Slider(0, range=-100..0)
trail_length_4 = Slider(-0.1, range=-50..0)

negative_2 = Negative(Value=multiplication_5)
deconstruct_vector_3 = DeconstructVector(Vector=vector_2pt_3.Vector)  # -> XComponent, YComponent, ZComponent
reverse_list_2 = ReverseList(List=negative_2)
vector_2pt_4 = Vector2Pt(PointA=end_points_4.Start, PointB=end_points_4.End, Unitize=False)  # -> Vector, Length
panel_16 = Panel(angles.out)
deconstruct_vector_4 = DeconstructVector(Vector=vector_2pt_4.Vector)  # -> XComponent, YComponent, ZComponent
multiplication_6 = Multiplication(A=deconstruct_vector_3.XComponent, B=100)
multiplication_7 = Multiplication(A=deconstruct_vector_3.ZComponent, B=100)
curve_7 = Curve([<curve referenced from the Rhino model> x16])
create_topology_4 = GhPythonScript(
    layer_numb=layer_numb_4,
    layer_depth=layer_depth_4,
    arch_res=arch_res_4,
    tilt_angle=tilt_angle_4,
    deviaton_arch_mag=dev_mag_arch_4,
    trail_length=trail_length_4)  # -> trail, trail_lengths, self_weight_point, self_weight_mag, external_load_point, external_load_mag, deviation, deviation_mag, anchor_points; inputs layer_numb: Int32, arch_res: Int32, tilt_angle: Int32
# ---------- create_topology_4: Python ----------
import ghpythonlib.components as gh
import math



####################################
## Define Curve Function: 
####################################



def arch_curve_topology(depth, x_pos, arch_res, layer_depth):
    
    
    ## Output parameters:
    anchor_points = []
    deviation_arch = []
    deviation_ring = []
    trail = []
    load_point = []
    
    
    ## Create the base curve and divide it: 
    base_line = gh.Line(gh.ConstructPoint(x_pos, -depth/2, 0), gh.ConstructPoint(x_pos, depth/2, 0))
    div = gh.DivideCurve(base_line, arch_res, False)
    explode = gh.Shatter(base_line, div[2])
    
    
    ## Create the Points for the Self_weight: 
    load_point.extend(div[0])
    
    
    ## Create the anchor points: 
    anchor_points.extend((div[0][0], div[0][-1]))
    
    
    ## Create the deviation / trail elements for the main arch: 
    for i, curve in enumerate(explode):
        if i == int(arch_res/2): deviation_arch.append(curve)
        else: trail.append(curve)
    
    
    ## Create the connecting (ring) deviation elements: 
    if x_pos > 0:
        pts_moved = gh.Move(div[0], gh.UnitX(-layer_depth))[0]
        line_dev = gh.Line(div[0], pts_moved)
        
        for curve in line_dev: deviation_ring.append(curve)
    
    
    ## Return the final geometry: 
    return(anchor_points, deviation_arch, deviation_ring, trail, load_point)



####################################
## Run the Curve Function: 
####################################



## Output Topology:
anchor_points = []
deviation = []
deviation_mag = []
trail = []
trail_lengths = []


## Output forces: 
self_weight_point = []
self_weight_mag = []
external_load_point = []
external_load_mag = []


## Create the Output elements:
tilt_angle = 90 - tilt_angle

for i in range(layer_numb):
    
    curve = arch_curve_topology(0.5, i*layer_depth, arch_res, layer_depth)
    
    
    ## Anchor points: 
    anchor_points.extend(curve[0])
    
    
    ## Create the points for the forces:
    self_weight_point.extend(curve[4])
    if i == 0: external_load_point.extend(curve[4])
    
    
    ## Create a Parapolic shape: 
    
    self_weight = -2
    for pt in curve[4]: self_weight_mag.append(self_weight)
    
    external_load = (layer_numb * -self_weight) / math.tan(math.radians(tilt_angle))
    if i == 0:
       for pt in external_load_point: external_load_mag.append(external_load)
    
    
    ## Deviation Elemements and magnitude:
    deviation.extend(curve[1])
    for crv in curve[1]: deviation_mag.append(deviaton_arch_mag)
    
    deviation.extend(curve[2])
    
    for crv in curve[2]: deviation_mag.append((-2))
    
    
    ## Trail elements and lengths: 
    trail.extend(curve[3])
    for crv in curve[3]: trail_lengths.append(trail_length)
# ---------- end create_topology_4 ----------
merge_5 = Merge(Data1=dev_mag_arch_4, Data2=dev_mag_arch_4, Data3=reverse_list_2, Data4=negative_2)
curve_8 = Curve(<curve referenced from the Rhino model>)
end_points_5 = EndPoints(Curve=curve_7)  # -> Start, End
reverse_list_3 = ReverseList(List=multiplication_6)
reverse_list_4 = ReverseList(List=multiplication_7)
curve_9 = Curve([<curve referenced from the Rhino model> x16])
length_3 = Length(Curve=curve_8)
cem_load_11 = CEM_Load(PointLoad=create_topology_4.external_load_point, LoadMagnX=Slider(4, range=0..10))
vector_2pt_5 = Vector2Pt(PointA=end_points_5.Start, PointB=end_points_5.End, Unitize=False)  # -> Vector, Length
number_slider = Slider(-1, range=-100..100)
length_4 = Length(Curve=curve_9)

# ----
# Part A - Topology
layer_numb_5 = Slider(1, range=1..50)
arch_res_5 = Slider(31, range=1..101)
tilt_angle_5 = Slider(0, range=0..90)
layer_depth_5 = Slider(0.2, range=0.001..1)
dev_mag_arch_5 = Slider(0, range=-100..0)
trail_length_5 = Slider(-0.03, range=-50..0)

multiplication_8 = Multiplication(A=deconstruct_vector_4.XComponent, B=100)
multiplication_9 = Multiplication(A=deconstruct_vector_4.YComponent, B=100)
point_5 = Point([Point(0, -0.25, 0), Point(0, -0.1785714286, 0), Point(0, -0.1071428571, 0), Point(0, -0.03571428571, 0), Point(0, 0.03571428571, 0), Point(0, 0.1071428571, 0), Point(0, 0.1785714286, 0), Point(0, 0.25, 0)])
multiplication_10 = Multiplication(A=deconstruct_vector_4.ZComponent, B=100)
point_6 = Point([Point(-0.2, -0.008064516129, 0.2364890873), Point(0, -0.008064516129, 0.25), Point(0, 0.008064516129, 0.25), Point(-0.2, 0.008064516129, 0.2365181598)])

# ----
# Part B - Structure
height_2 = Slider(0.25, range=0..0.75)
cem_extract_topology_3 = CEM_Extract_Topology(TP=cem_build_topology_3)  # -> Nodes, NodesID, Edges, EdgesID, ConstraintPlane, ConstraintPlaneID, OriginNode, OriginNodeID
unit_z_3 = UnitZ(Factor=height_2)
move_3 = Move(Geometry=cem_extract_topology_3.OriginNode, Motion=unit_z_3)  # -> Geometry, Transform
cem_origin_node_3 = CEM_Origin_Node(OriginNode=point_6, OriginNodeID=cem_extract_topology_3.OriginNodeID)
cem_calculate_structure_3 = CEM_Calculate_Structure(TP=cem_build_topology_3, N=cem_origin_node_3)

angles_test = GhPythonScript()  # -> out, a
# ---------- angles_test: Python ----------
import math as m

elements = 6

layer_depth = 0.1
z_moved = 0.025
trail_len = 0.0342

angles = []

for i in range(elements):
    
    if i == 0: angles.append(m.degrees(m.atan(z_moved/layer_depth)))
    
    else:
        
        diff_z = (m.sin(m.radians(35)) * (trail_len*i) + z_moved) - m.sin(m.radians(45)) * (trail_len*i)
        diff_x = m.cos(m.radians(45)) * (trail_len*i) + layer_depth - m.cos(m.radians(30)) * (trail_len*i)
        
        angle = m.degrees(m.atan(diff_z/diff_x))
        
        angles.append(angle)


angles_rev = angles
angles_rev.reverse()
angles_rev = angles_rev [0:-1]

angles.extend(angles_rev)


print(angles)
# ---------- end angles_test ----------
merge_6 = Merge(Data1=reverse_list_3, Data2=multiplication_6)
multiplication_11 = Multiplication(A=length_3, B=100)
merge_7 = Merge(Data1=reverse_list_4, Data2=multiplication_7)
trail_length_6 = Slider(-0.1, range=-50..0)

layer_depth_6 = Slider(0.2, range=0.001..1)
layer_numb_6 = Slider(3, range=1..50)

cem_deviation_5 = CEM_Deviation(DeviationEdge=graft(create_topology_4.deviation), DeviationMagn=graft(merge_5))
arch_res_6 = Slider(7, range=1..101)
tilt_angle_6 = Slider(0, range=0..90)
dev_mag_arch_6 = Slider(-15, range=-100..0)
deconstruct_vector_5 = DeconstructVector(Vector=vector_2pt_5.Vector)  # -> XComponent, YComponent, ZComponent
cem_load_12 = CEM_Load(PointLoad=graft(create_topology_4.self_weight_point), LoadMagnZ=graft(create_topology_4.self_weight_mag))
cem_load_13 = CEM_Load(PointLoad=graft(create_topology_4.external_load_point), LoadMagnX=graft(create_topology_4.external_load_mag))  # disabled
cem_trail_4 = CEM_Trail(TrailEdge=graft(create_topology_4.trail), TrailLen=graft(create_topology_4.trail_lengths))
cem_support_4 = CEM_Support(Support=create_topology_4.anchor_points)
multiplication_12 = Multiplication(A=number_slider, B=merge_6)
panel_17 = Panel(multiplication_11)
negative_3 = Negative(Value=create_topology.external_load_mag)
multiplication_13 = Multiplication(A=merge_7, B=number_slider)
create_topology_5 = GhPythonScript(
    layer_numb=layer_numb_5,
    layer_depth=layer_depth_5,
    arch_res=arch_res_5,
    tilt_angle=tilt_angle_5,
    deviaton_arch_mag=dev_mag_arch_5,
    trail_length=trail_length_5)  # -> trail, trail_lengths, self_weight_point, self_weight_mag, external_load_point, external_load_mag, deviation, deviation_mag, anchor_points; inputs layer_numb: Int32, arch_res: Int32, tilt_angle: Int32
# ---------- create_topology_5: Python ----------
import ghpythonlib.components as gh
import math



####################################
## Define Curve Function: 
####################################



def arch_curve_topology(depth, x_pos, arch_res, layer_depth):
    
    
    ## Output parameters:
    anchor_points = []
    deviation_arch = []
    deviation_ring = []
    trail = []
    load_point = []
    
    
    ## Create the base curve and divide it: 
    base_line = gh.Line(gh.ConstructPoint(x_pos, -depth/2, 0), gh.ConstructPoint(x_pos, depth/2, 0))
    div = gh.DivideCurve(base_line, arch_res, False)
    explode = gh.Shatter(base_line, div[2])
    
    
    ## Create the Points for the Self_weight: 
    load_point.extend(div[0])
    
    
    ## Create the anchor points: 
    anchor_points.extend((div[0][0], div[0][-1]))
    
    
    ## Create the deviation / trail elements for the main arch: 
    for i, curve in enumerate(explode):
        if i == int(arch_res/2): deviation_arch.append(curve)
        else: trail.append(curve)
    
    
    ## Create the connecting (ring) deviation elements: 
    if x_pos < 0:
        pts_moved = gh.Move(div[0], gh.UnitX(layer_depth))[0]
        line_dev = gh.Line(div[0], pts_moved)
        
        for curve in line_dev: deviation_ring.append(curve)
    
    
    ## Return the final geometry: 
    return(anchor_points, deviation_arch, deviation_ring, trail, load_point)



####################################
## Run the Curve Function: 
####################################



## Output Topology:
anchor_points = []
deviation = []
deviation_mag = []
trail = []
trail_lengths = []


## Output forces: 
self_weight_point = []
self_weight_mag = []
external_load_point = []
external_load_mag = []


## Create the Output elements:
tilt_angle = 90 - tilt_angle

for i in range(layer_numb):
    
    curve = arch_curve_topology(0.5, -i*layer_depth, arch_res, layer_depth)
    
    
    ## Anchor points: 
    anchor_points.extend(curve[0])
    
    
    ## Create the points for the forces:
    self_weight_point.extend(curve[4])
    if i == 0: external_load_point.extend(curve[4])
    
    
    ## Create a Parapolic shape: 
    
    self_weight = -2
    for pt in curve[4]: self_weight_mag.append(self_weight)
    
    external_load = -(layer_numb * -self_weight) / math.tan(math.radians(tilt_angle))
    if i == 0:
       for pt in external_load_point: external_load_mag.append(external_load)
    
    
    ## Deviation Elemements and magnitude:
    deviation.extend(curve[1])
    if i == 0:
        for crv in curve[1]: deviation_mag.append(deviaton_arch_mag)
    elif i == 1:
        for crv in curve[1]: deviation_mag.append(deviaton_arch_mag)
    
    deviation.extend(curve[2])
    
    #for crv in curve[2]: deviation_mag.append((external_load / layer_numb) * (layer_numb - i))
    for crv in curve[2]: ### Tests!
        if i == 1: deviation_mag.append(-0.732) 
        elif i == 2: deviation_mag.append(-10)
    
    
    ## Trail elements and lengths: 
    trail.extend(curve[3])
    if i == 0:
        for crv in curve[3]: trail_lengths.append(trail_length)
        
    if i == 1:
        for crv in curve[3]: trail_lengths.append(trail_length)
        # (math.sin(math.radians(45)) * 0.03)
# ---------- end create_topology_5 ----------
panel_18 = Panel(multiplication_8)
panel_19 = Panel(multiplication_10)
negative_4 = Negative(Value=length_4)
multiplication_14 = Multiplication(A=deconstruct_vector_5.XComponent, B=100)
multiplication_15 = Multiplication(A=deconstruct_vector_5.ZComponent, B=100)
panel_20 = Panel(multiplication_9)
panel_21 = Panel(multiplication_12)
cem_load_14 = CEM_Load(PointLoad=graft(point_5), LoadMagnX=graft(multiplication_12), LoadMagnZ=expr("-x", graft(multiplication_13)))
cem_load_15 = CEM_Load(PointLoad=create_topology_5.external_load_point, LoadMagnX=Slider(-4, range=-100..100))  # disabled
cem_build_topology_4 = CEM_Build_Topology(
    T=flatten(cem_trail_4),
    L=flatten([cem_load_12, cem_load_13, cem_load_11, cem_load_14]),
    D=flatten(cem_deviation_5),
    S=flatten(cem_support_4))
create_topology_6 = GhPythonScript(
    layer_numb=layer_numb_6,
    layer_depth=layer_depth_6,
    arch_res=arch_res_6,
    tilt_angle=tilt_angle_6,
    deviaton_arch_mag=dev_mag_arch_6,
    trail_length=trail_length_6)  # -> trail, trail_lengths, self_weight_point, self_weight_mag, external_load_point, external_load_mag, deviation, deviation_mag, anchor_points; inputs layer_numb: Int32, arch_res: Int32, tilt_angle: Int32
# ---------- create_topology_6: Python ----------
import ghpythonlib.components as gh
import math



####################################
## Define Curve Function: 
####################################



def arch_curve_topology(depth, x_pos, arch_res, layer_depth):
    
    
    ## Output parameters:
    anchor_points = []
    deviation_arch = []
    deviation_ring = []
    trail = []
    load_point = []
    
    
    ## Create the base curve and divide it: 
    base_line = gh.Line(gh.ConstructPoint(x_pos, -depth/2, 0), gh.ConstructPoint(x_pos, depth/2, 0))
    div = gh.DivideCurve(base_line, arch_res, False)
    explode = gh.Shatter(base_line, div[2])
    
    
    ## Create the Points for the Self_weight: 
    load_point.extend(div[0])
    
    
    ## Create the anchor points: 
    anchor_points.extend((div[0][0], div[0][-1]))
    
    
    ## Create the deviation / trail elements for the main arch: 
    for i, curve in enumerate(explode):
        if i == int(arch_res/2): deviation_arch.append(curve)
        else: trail.append(curve)
    
    
    ## Create the connecting (ring) deviation elements: 
    if x_pos > 0:
        pts_moved = gh.Move(div[0], gh.UnitX(-layer_depth))[0]
        line_dev = gh.Line(div[0], pts_moved)
        
        for curve in line_dev: deviation_ring.append(curve)
    
    
    ## Return the final geometry: 
    return(anchor_points, deviation_arch, deviation_ring, trail, load_point)



####################################
## Run the Curve Function: 
####################################



## Output Topology:
anchor_points = []
deviation = []
deviation_mag = []
trail = []
trail_lengths = []


## Output forces: 
self_weight_point = []
self_weight_mag = []
external_load_point = []
external_load_mag = []


## Create the Output elements:
tilt_angle = 90 - tilt_angle

for i in range(layer_numb):
    
    curve = arch_curve_topology(0.5, i*layer_depth, arch_res, layer_depth)
    
    
    ## Anchor points: 
    anchor_points.extend(curve[0])
    
    
    ## Create the points for the forces:
    self_weight_point.extend(curve[4])
    if i == 2: external_load_point.extend(curve[4])## changed !!!!
    
    
    ## Create a Parapolic shape: 
    
    self_weight = -2
    for pt in curve[4]: self_weight_mag.append(self_weight)
    
    external_load = (layer_numb * -self_weight) / math.tan(math.radians(tilt_angle))
    if i == 0:
       for pt in external_load_point: external_load_mag.append(external_load)
    
    
    ## Deviation Elemements and magnitude:
    deviation.extend(curve[1])
    for crv in curve[1]: deviation_mag.append(deviaton_arch_mag)
    
    deviation.extend(curve[2])
    
    for crv in curve[2]: deviation_mag.append((-2))
    
    
    ## Trail elements and lengths: 
    trail.extend(curve[3])
    for crv in curve[3]: trail_lengths.append(trail_length)
# ---------- end create_topology_6 ----------
cem_load_16 = CEM_Load(PointLoad=create_topology_6.external_load_point, LoadMagnX=Slider(-8, range=-101..100))
reverse_list_5 = ReverseList(List=multiplication_14)
reverse_list_6 = ReverseList(List=multiplication_15)
panel_22 = Panel("""-5
-5
0
0
-11.196233
-11.048683
-11.048683
-11.196233
0
0
-5
0
0
-8.442853
-8.958064
-8.958064
-8.442853
0
0""")
point_7 = Point([Point(-0.2, -0.25, 0), Point(-0.2, -0.2338709677, 0), Point(-0.2, -0.2177419355, 0), Point(-0.2, -0.2016129032, 0), Point(-0.2, -0.185483871, 0), Point(-0.2, -0.1693548387, 0)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])

# ----
# Part C - Preview
cem_extract_structure_3 = CEM_Extract_Structure(M=cem_calculate_structure_3)  # -> Nodes, NodesID, Trails, TrailsID, TrailsCol, TrailsMag, Deviations, DeviationsID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
merge_8 = Merge(Data1=cem_extract_structure_3.Trails, Data2=cem_extract_structure_3.Deviations)
merge_9 = Merge(Data1=cem_extract_structure_3.TrailsMag, Data2=cem_extract_structure_3.DeviationsMag)
colour_3 = GhPythonScript(mag=merge_9)  # -> out; inputs mag: list; same code as colour
custom_preview_3 = CustomPreview(Geometry=merge_8, Material=colour_3)

multiplication_16 = Multiplication(A=negative_4, B=100)
cem_load_17 = CEM_Load(PointLoad=point_7, LoadMagnX=Slider(7.9, range=-10..100), LoadMagnZ=expr("-x", Slider(3.9, range=-100..100)))
merge_10 = Merge(Data1=multiplication_15, Data2=multiplication_14)
merge_11 = Merge(Data1=reverse_list_6, Data2=reverse_list_5)
reverse_list_7 = ReverseList(List=multiplication_16)
cem_trail_5 = CEM_Trail(TrailEdge=graft(create_topology_5.trail), TrailLen=graft(create_topology_5.trail_lengths))
cem_load_18 = CEM_Load(PointLoad=graft(create_topology_5.self_weight_point), LoadMagnZ=graft(create_topology_5.self_weight_mag))
cem_load_19 = CEM_Load(PointLoad=graft(create_topology_5.external_load_point), LoadMagnX=graft(negative_3))
panel_23 = Panel("""0
0
13.54941
13.386996
13.386996
13.54941
0
0""")
panel_24 = Panel("""0
0
-0.130102
0
0
0.130102
0
0""")
panel_25 = Panel("""0
0
1.641635
1.673375
1.673375
1.641635
0
0""")
cem_support_5 = CEM_Support(Support=create_topology_5.anchor_points)
cem_deviation_6 = CEM_Deviation(DeviationEdge=graft(create_topology_6.deviation), DeviationMagn=graft(panel_22))
cem_load_20 = CEM_Load(PointLoad=graft(create_topology_6.self_weight_point), LoadMagnZ=graft(create_topology_6.self_weight_mag))
cem_trail_6 = CEM_Trail(TrailEdge=graft(create_topology_6.trail), TrailLen=graft(create_topology_6.trail_lengths))
point_8 = Point([Point(0, -0.25, 0), Point(0, -0.1785714286, 0), Point(0, -0.1071428571, 0), Point(0, -0.03571428571, 0), Point(0, 0.03571428571, 0), Point(0, 0.1071428571, 0), Point(0, 0.1785714286, 0), Point(0, 0.25, 0)])
cem_support_6 = CEM_Support(Support=create_topology_6.anchor_points)
cem_load_21 = CEM_Load(PointLoad=graft(create_topology_5.external_load_point), LoadMagnX=graft(merge_10), LoadMagnZ=expr("-x", graft(merge_11)))
curve_10 = Curve(<curve referenced from the Rhino model>)
merge_12 = Merge(Data1=dev_mag_arch_5, Data2=tilt_angle_5, Data3=reverse_list_7, Data4=multiplication_16)
cem_deviation_7 = CEM_Deviation(DeviationEdge=graft(create_topology_5.deviation), DeviationMagn=graft(merge_12))
step_2 = Slider(0.025, range=0..0.75)
end_points_6 = EndPoints(Curve=curve_10)  # -> Start, End
cem_build_topology_5 = CEM_Build_Topology(
    T=flatten(cem_trail_5),
    L=flatten([cem_load_18, cem_load_19, cem_load_17, cem_load_15, cem_load_21]),
    D=flatten(cem_deviation_7),
    S=flatten(cem_support_5))
curve_middle_2 = CurveMiddle(Curve=merge_8)
cem_load_22 = CEM_Load(PointLoad=graft(point_8), LoadMagnX=graft(panel_23), LoadMagnY=graft(panel_24), LoadMagnZ=graft(panel_25))  # -> flatten(L)
cem_extract_topology_4 = CEM_Extract_Topology(TP=cem_build_topology_4)  # -> Nodes, NodesID, Edges, EdgesID, ConstraintPlane, ConstraintPlaneID, OriginNode, OriginNodeID
deconstruct_3 = Deconstruct(Point=cem_extract_topology_4.OriginNode)  # -> XComponent, YComponent, ZComponent
cem_build_topology_6 = CEM_Build_Topology(
    T=flatten(cem_trail_6),
    L=flatten([cem_load_20, cem_load_16, cem_load_22]),
    D=flatten(cem_deviation_6),
    S=flatten(cem_support_6))
vector_2pt_6 = Vector2Pt(PointA=end_points_6.Start, PointB=end_points_6.End, Unitize=False)  # -> Vector, Length
series_2 = Series(Start=0.25, Step=expr("-x", step_2), Count=layer_numb_4)
sort_list_3 = SortList(Keys=deconstruct_3.XComponent, ValuesValuesA=cem_extract_topology_4.OriginNode)  # -> Keys, ValuesValuesA
deconstruct_vector_6 = DeconstructVector(Vector=vector_2pt_6.Vector)  # -> XComponent, YComponent, ZComponent
text_tag_2 = TextTag(Location=curve_middle_2, Text=merge_9)
reverse_list_8 = ReverseList(List=series_2)  # -> graft(List)
partition_list_2 = PartitionList(List=sort_list_3.ValuesValuesA, Size=2)
unit_z_4 = UnitZ(Factor=reverse_list_8)
multiplication_17 = Multiplication(A=deconstruct_vector_6.XComponent, B=100)
multiplication_18 = Multiplication(A=deconstruct_vector_6.ZComponent, B=100)
step_3 = Slider(0.025, range=0..0.75)
move_4 = Move(Geometry=partition_list_2, Motion=unit_z_4)  # -> Geometry, Transform
step_4 = Slider(0.25, range=0..0.75)
sort_list_4 = SortList(Keys=deconstruct_3.XComponent, ValuesValuesA=cem_extract_topology_4.OriginNodeID)  # -> Keys, ValuesValuesA
cem_extract_topology_5 = CEM_Extract_Topology(TP=cem_build_topology_6)  # -> Nodes, NodesID, Edges, EdgesID, ConstraintPlane, ConstraintPlaneID, OriginNode, OriginNodeID
deconstruct_4 = Deconstruct(Point=cem_extract_topology_5.OriginNode)  # -> XComponent, YComponent, ZComponent
sort_points_acc_to_indices_2 = GhPythonScript(
    node_origin_index=cem_extract_topology_4.OriginNodeID,
    node_index=sort_list_4.ValuesValuesA,
    nodes=flatten(move_4.Geometry))  # -> out, nodes_sorted; inputs node_origin_index: list of Int32, node_index: list of Int32, nodes: list of Point3d; same code as sort_points_acc_to_indices
cem_origin_node_4 = CEM_Origin_Node(OriginNode=sort_points_acc_to_indices_2.nodes_sorted, OriginNodeID=cem_extract_topology_4.OriginNodeID)
cem_calculate_structure_4 = CEM_Calculate_Structure(TP=cem_build_topology_4, N=cem_origin_node_4)
series_3 = Series(Start=0.25, Step=expr("-x", step_3), Count=layer_numb_6)
series_4 = Series(Start=0.25, Step=expr("-x", step_4), Count=layer_numb_5)
sort_list_5 = SortList(Keys=deconstruct_4.XComponent, ValuesValuesA=cem_extract_topology_5.OriginNode)  # -> Keys, ValuesValuesA
reverse_list_9 = ReverseList(List=series_3)  # -> graft(List)
reverse_list_10 = ReverseList(List=series_4)  # -> graft(List)
partition_list_3 = PartitionList(List=sort_list_5.ValuesValuesA, Size=2)
unit_z_5 = UnitZ(Factor=reverse_list_9)
unit_z_6 = UnitZ(Factor=reverse_list_10)
move_5 = Move(Geometry=partition_list_3, Motion=unit_z_5)  # -> Geometry, Transform
sort_list_6 = SortList(Keys=deconstruct_4.XComponent, ValuesValuesA=cem_extract_topology_5.OriginNodeID)  # -> Keys, ValuesValuesA
cem_extract_structure_4 = CEM_Extract_Structure(M=cem_calculate_structure_4)  # -> Nodes, NodesID, Trails, TrailsID, TrailsCol, TrailsMag, Deviations, DeviationsID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
sort_points_acc_to_indices_3 = GhPythonScript(
    node_origin_index=cem_extract_topology_5.OriginNodeID,
    node_index=sort_list_6.ValuesValuesA,
    nodes=flatten(move_5.Geometry))  # -> out, nodes_sorted; inputs node_origin_index: list of Int32, node_index: list of Int32, nodes: list of Point3d; same code as sort_points_acc_to_indices
cem_origin_node_5 = CEM_Origin_Node(OriginNode=sort_points_acc_to_indices_3.nodes_sorted, OriginNodeID=cem_extract_topology_5.OriginNodeID)
cem_calculate_structure_5 = CEM_Calculate_Structure(TP=cem_build_topology_6, N=cem_origin_node_5)
merge_13 = Merge(Data1=cem_extract_structure_4.Trails, Data2=cem_extract_structure_4.Deviations)
merge_14 = Merge(Data1=cem_extract_structure_4.TrailsMag, Data2=cem_extract_structure_4.DeviationsMag)
curve_middle_3 = CurveMiddle(Curve=merge_13)
colour_4 = GhPythonScript(mag=merge_14)  # -> out; inputs mag: list; same code as colour
custom_preview_4 = CustomPreview(Geometry=merge_13, Material=colour_4)
text_tag_3 = TextTag(Location=curve_middle_3, Text=merge_14)
# Part C - Preview
cem_extract_structure_5 = CEM_Extract_Structure(M=cem_calculate_structure_5)  # -> Nodes, NodesID, Trails, TrailsID, TrailsCol, TrailsMag, Deviations, DeviationsID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
merge_15 = Merge(Data1=cem_extract_structure_5.Trails, Data2=cem_extract_structure_5.Deviations)
merge_16 = Merge(Data1=cem_extract_structure_5.TrailsMag, Data2=cem_extract_structure_5.DeviationsMag)
curve_middle_4 = CurveMiddle(Curve=merge_15)
colour_5 = GhPythonScript(mag=merge_16)  # -> out; inputs mag: list; same code as colour
custom_preview_5 = CustomPreview(Geometry=merge_15, Material=colour_5)
text_tag_4 = TextTag(Location=curve_middle_4, Text=merge_16)

# ----
# Part B - Structure
height_3 = Slider(0.25, range=0..0.75)
cem_extract_topology_6 = CEM_Extract_Topology(TP=cem_build_topology_5)  # -> Nodes, NodesID, Edges, EdgesID, ConstraintPlane, ConstraintPlaneID, OriginNode, OriginNodeID
unit_z_7 = UnitZ(Factor=height_3)
move_6 = Move(Geometry=cem_extract_topology_6.OriginNode, Motion=unit_z_7)  # -> Geometry, Transform

deconstruct_5 = Deconstruct(Point=cem_extract_topology_6.OriginNode)  # -> XComponent, YComponent, ZComponent
sort_list_7 = SortList(Keys=deconstruct_5.XComponent, ValuesValuesA=cem_extract_topology_6.OriginNode)  # -> Keys, ValuesValuesA
partition_list_4 = PartitionList(List=sort_list_7.ValuesValuesA, Size=2)
move_7 = Move(Geometry=partition_list_4, Motion=unit_z_6)  # -> Geometry, Transform
sort_list_8 = SortList(Keys=deconstruct_5.XComponent, ValuesValuesA=cem_extract_topology_6.OriginNodeID)  # -> Keys, ValuesValuesA
sort_points_acc_to_indices_4 = GhPythonScript(
    node_origin_index=cem_extract_topology_6.OriginNodeID,
    node_index=sort_list_8.ValuesValuesA,
    nodes=flatten(move_7.Geometry))  # -> out, nodes_sorted; inputs node_origin_index: list of Int32, node_index: list of Int32, nodes: list of Point3d; same code as sort_points_acc_to_indices

cem_origin_node_6 = CEM_Origin_Node(OriginNode=sort_points_acc_to_indices_4.nodes_sorted, OriginNodeID=cem_extract_topology_6.OriginNodeID)
cem_calculate_structure_6 = CEM_Calculate_Structure(TP=cem_build_topology_5, N=cem_origin_node_6)

# ----
# Part C - Preview
cem_extract_structure_6 = CEM_Extract_Structure(M=cem_calculate_structure_6)  # -> Nodes, NodesID, Trails, TrailsID, TrailsCol, TrailsMag, Deviations, DeviationsID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
merge_17 = Merge(Data1=cem_extract_structure_6.Trails, Data2=cem_extract_structure_6.Deviations)
merge_18 = Merge(Data1=cem_extract_structure_6.TrailsMag, Data2=cem_extract_structure_6.DeviationsMag)
colour_6 = GhPythonScript(mag=merge_18)  # -> out; inputs mag: list; same code as colour
custom_preview_6 = CustomPreview(Geometry=merge_17, Material=colour_6)

curve_middle_5 = CurveMiddle(Curve=merge_17)
text_tag_5 = TextTag(Location=curve_middle_5, Text=merge_18)
