# Grasshopper definition Code_Kappendecke_2.0_set_1_var_3.ghx (Grasshopper 1.0.7)
# Copyright: Felswind
# plug-ins: CEM_Build_Topology, CEM_Deviation, CEM_Extract_Topology, CEM_Support, CEM_Trail, CEM_Calculate_Structure, CEM_Origin_Node, CEM_Extract_Structure, CEM_Load

layer_numb = Slider(3, range=1..100)
layer_depth = Slider(0.2, range=0.001..1)
arch_res = Slider(31, range=1..101)
tilt_angle = Slider(45, range=0..90)
dev_mag_arch = Slider(-10, range=-100..0)
trail_length = Slider(-0.02, range=-50..0)

arch_res_2 = Slider(8, range=2..100)
trail_length_2 = Slider(-0.05, range=-0.5..0.5)

# ----
# Part A - Topology
create_topology_main = GhPythonScript(
    layer_numb=layer_numb,
    layer_depth=layer_depth,
    arch_res=arch_res,
    tilt_angle=tilt_angle,
    deviaton_arch_mag=dev_mag_arch,
    trail_length=trail_length)  # -> trail, trail_lengths, self_weight_point, self_weight_mag, external_load_point, external_load_mag, deviation, deviation_mag, anchor_points; inputs layer_numb: Int32, arch_res: Int32, tilt_angle: Int32
# ---------- create_topology_main: Python ----------
import ghpythonlib.components as gh
import math



####################################
## Define Curve Function: 
####################################



def arch_curve_topology(depth, x_pos, arch_res, layer_depth):
    
    
    ## Output parameters:
    anchor_points = []
    deviation_arch = []
    deviation_ring = []
    trail = []
    load_point = []
    
    
    ## Create the base curve and divide it: 
    base_line = gh.Line(gh.ConstructPoint(x_pos, -depth/2, 0), gh.ConstructPoint(x_pos, depth/2, 0))
    div = gh.DivideCurve(base_line, arch_res, False)
    explode = gh.Shatter(base_line, div[2])
    
    
    ## Create the Points for the Self_weight: 
    load_point.extend(div[0])
    
    
    ## Create the anchor points: 
    anchor_points.extend((div[0][0], div[0][-1]))
    
    
    ## Create the deviation / trail elements for the main arch: 
    for i, curve in enumerate(explode):
        if i == int(arch_res/2): deviation_arch.append(curve)
        else: trail.append(curve)
    
    
    ## Create the connecting (ring) deviation elements: 
    if x_pos > 0:
        pts_moved = gh.Move(div[0], gh.UnitX(-layer_depth))[0]
        line_dev = gh.Line(div[0], pts_moved)
        
        for curve in line_dev: deviation_ring.append(curve)
    
    
    ## Return the final geometry: 
    return(anchor_points, deviation_arch, deviation_ring, trail, load_point)



####################################
## Run the Curve Function: 
####################################



## Output Topology:
anchor_points = []
deviation = []
deviation_mag = []
trail = []
trail_lengths = []


## Output forces: 
self_weight_point = []
self_weight_mag = []
external_load_point = []
external_load_mag = []


## Create the Output elements:
tilt_angle = 90 - tilt_angle

for i in range(layer_numb):
    
    curve = arch_curve_topology(0.5, i*layer_depth, arch_res, layer_depth)
    
    
    ## Anchor points: 
    anchor_points.extend(curve[0])
    
    
    ## Create the points for the forces:
    self_weight_point.extend(curve[4])
    if i == 0: external_load_point.extend(curve[4])
    
    
    ## Create a Parapolic shape: 
    
    self_weight = -2
    for pt in curve[4]: self_weight_mag.append(self_weight)
    
    external_load = (layer_numb * -self_weight) / math.tan(math.radians(tilt_angle))
    if i == 0:
       for pt in external_load_point: external_load_mag.append(external_load)
    
    
    ## Deviation Elemements and magnitude:
    deviation.extend(curve[1])
    for crv in curve[1]: deviation_mag.append(deviaton_arch_mag)
    
    deviation.extend(curve[2])
    
    for crv in curve[2]: deviation_mag.append((-external_load / layer_numb) * (layer_numb - i))
    
    
    ## Trail elements and lengths: 
    trail.extend(curve[3])
    for crv in curve[3]: trail_lengths.append(trail_length)
# ---------- end create_topology_main ----------
cem_deviation = CEM_Deviation(DeviationEdge=graft(create_topology_main.deviation), DeviationMagn=graft(create_topology_main.deviation_mag))
cem_load = CEM_Load(PointLoad=graft(create_topology_main.self_weight_point), LoadMagnZ=graft(create_topology_main.self_weight_mag))
cem_load_2 = CEM_Load(PointLoad=graft(create_topology_main.external_load_point), LoadMagnX=graft(create_topology_main.external_load_mag))
cem_trail = CEM_Trail(TrailEdge=graft(create_topology_main.trail), TrailLen=graft(create_topology_main.trail_lengths))
cem_support = CEM_Support(Support=create_topology_main.anchor_points)
cem_build_topology = CEM_Build_Topology(T=flatten(cem_trail), L=flatten([cem_load, cem_load_2]), D=flatten(cem_deviation), S=flatten(cem_support))

# ----
# Part A - Topology
simple_arch = GhPythonScript(arch_res=arch_res_2)  # -> trail, self_weight_points, external_force_point, anchor; inputs arch_res: Int32
# ---------- simple_arch: Python ----------
import ghpythonlib.components as gh



####################################################
## Create base topology for a single arch: 

base_line = gh.Line(gh.ConstructPoint(0,0,0), gh.ConstructPoint(0.1,0,0))

anchor = gh.EndPoints(base_line)[0]
external_force_point = gh.EndPoints(base_line)[1]



## Subdivide: 

sub = gh.DivideCurve(base_line, arch_res, False)

self_weight_points = sub[0]
trail = gh.Shatter(base_line, sub[2])
# ---------- end simple_arch ----------
list_item = ListItem(List=create_topology_main.self_weight_mag, Index=0, Wrap=True)
list_item_2 = ListItem(List=create_topology_main.external_load_mag, Index=0, Wrap=True)
cem_load_3 = CEM_Load(PointLoad=simple_arch.external_force_point, LoadMagnX=expr("-x", list_item_2))
cem_load_4 = CEM_Load(PointLoad=simple_arch.self_weight_points, LoadMagnZ=list_item)
cem_trail_2 = CEM_Trail(TrailEdge=simple_arch.trail, TrailLen=trail_length_2)
cem_support_2 = CEM_Support(Support=simple_arch.anchor)
cem_build_topology_2 = CEM_Build_Topology(T=flatten(cem_trail_2), L=flatten([cem_load_4, cem_load_3]), S=flatten(cem_support_2))

# ----
# Part B - Structure
cem_extract_topology = CEM_Extract_Topology(TP=cem_build_topology)  # -> Nodes, NodesID, Edges, EdgesID, ConstraintPlane, ConstraintPlaneID, OriginNode, OriginNodeID
height = Slider(0.25, range=0..0.75)
unit_z = UnitZ(Factor=height)
move = Move(Geometry=cem_extract_topology.OriginNode, Motion=unit_z)  # -> Geometry, Transform
cem_origin_node = CEM_Origin_Node(OriginNode=move.Geometry, OriginNodeID=cem_extract_topology.OriginNodeID)
cem_calculate_structure = CEM_Calculate_Structure(TP=cem_build_topology, N=cem_origin_node)

# ----
# Part C - Preview
cem_extract_structure = CEM_Extract_Structure(M=cem_calculate_structure)  # -> Nodes, NodesID, Trails, TrailsID, TrailsCol, TrailsMag, Deviations, DeviationsID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
merge = Merge(Data1=cem_extract_structure.Trails, Data2=cem_extract_structure.Deviations)
merge_2 = Merge(Data1=cem_extract_structure.TrailsMag, Data2=cem_extract_structure.DeviationsMag)
colour = GhPythonScript(mag=merge_2)  # -> out; inputs mag: list
# ---------- colour: Python ----------
for magnitude in mag:
    
    if magnitude > 0: print(255, 0, 0)
    else: print(0, 0, 255)
# ---------- end colour ----------
custom_preview = CustomPreview(Geometry=merge, Material=colour)

toolpath_height = Slider(0.01, range=0..1)
layers_mid = Slider(10, range=0..100)
toolpath_height_sides = Slider(0.003, range=0..1)
fillet = Slider(0.05, range=0..1)

type = ValueList({"Single_layered": 1, "double layered": 2}, selected="double layered")
toolpath_depth = Slider(0.02, range=0.001..1)

# ----
# Part B - Structure
cem_extract_topology_2 = CEM_Extract_Topology(TP=cem_build_topology_2)  # -> Nodes, NodesID, Edges, EdgesID, ConstraintPlane, ConstraintPlaneID, OriginNode, OriginNodeID

# ----
# Part D - Export
create_toolpath_curves = GhPythonScript(lines=merge, layer_depth=layer_depth, toolpath_height=toolpath_height)  # -> toolpath_main, toolpath; inputs lines: list of Line
# ---------- create_toolpath_curves: Python ----------
import ghpythonlib.components as gh



############################################################################################################
## Create main part:
############################################################################################################

## Filter out the print_path_elements: 
line_filtered = []
for ln in lines:
    if gh.Length(ln) < layer_depth*0.95: line_filtered.append(ln)



## Join, rebuild and interpolates the curves:
joined = gh.JoinCurves(line_filtered, False)
rebuilt = gh.RebuildCurve(joined, 3, 25, False)
flipped = gh.FlipCurve(rebuilt, rebuilt[0])[0]
sorted = gh.SortList(gh.Deconstruct(gh.CurveMiddle(flipped))[0], flipped)[1]

steps = []
interpolate = int(layer_depth/toolpath_height)

toolpath = []

for i in range(interpolate): steps.append(i/interpolate)
for i in range(int(len(joined)-1)): toolpath.extend(gh.TweenCurve(sorted[i], sorted[i+1], steps))

toolpath = gh.Move(toolpath, gh.UnitZ(-gh.EndPoints(toolpath[0])[0][2]))[0]
toolpath_main = gh.Move(toolpath, gh.UnitX(toolpath_height))[0]
# ---------- end create_toolpath_curves ----------

list_item_3 = ListItem(List=create_toolpath_curves.toolpath, Index=0, Wrap=True)
curve_middle = CurveMiddle(Curve=list_item_3)
cem_origin_node_2 = CEM_Origin_Node(OriginNode=curve_middle, OriginNodeID=cem_extract_topology_2.OriginNodeID)
cem_calculate_structure_2 = CEM_Calculate_Structure(TP=cem_build_topology_2, N=cem_origin_node_2)

# ----
# Part C - Preview
cem_extract_structure_2 = CEM_Extract_Structure(M=cem_calculate_structure_2)  # -> Nodes, NodesID, Trails, TrailsID, TrailsCol, TrailsMag, Deviations, DeviationsID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
merge_3 = Merge(Data1=cem_extract_structure_2.Trails, Data2=cem_extract_structure_2.Deviations)
merge_4 = Merge(Data1=cem_extract_structure_2.TrailsMag, Data2=cem_extract_structure_2.DeviationsMag)
colour_2 = GhPythonScript(mag=merge_4)  # -> out; inputs mag: list; same code as colour
custom_preview_2 = CustomPreview(Geometry=merge_3, Material=colour_2)

create_start_and_connection_curves = GhPythonScript(
    shape_curve=merge_3,
    shape_curve_cross=create_toolpath_curves.toolpath,
    layers_mid=layers_mid,
    toolpath_height=toolpath_height,
    toolpath_height_sides=toolpath_height_sides,
    fillet=fillet,
    tilt_angle=tilt_angle)  # -> start_curves, curves_start_planar, port, points_base, base_surface, ref_surface; inputs shape_curve: list of Line, shape_curve_cross: list of Curve, layers_mid: Int32
# ---------- create_start_and_connection_curves: Python ----------
import ghpythonlib.components as gh
import math



############################################################################################################
## Create the curved starting part:
############################################################################################################


## Cut and rebuilt the main shape curve: 
shape_curve = gh.JoinCurves(shape_curve, False)

shape_curve_cut = gh.Shatter(shape_curve, gh.CurveXPlane(shape_curve, gh.XYPlane(gh.ConstructPoint(0,0,0)))[1])[0]
shape_curve_final = gh.Interpolate(gh.Explode(shape_curve_cut, True)[1], 3, False, 1)[0]


## Prepeare secondary shape curve: 
shape_curve_cross = shape_curve_cross[0] 
shape_curve_cross_final = gh.Shatter(shape_curve_cross, gh.CurveClosestPoint(gh.CurveMiddle(shape_curve_cross), shape_curve_cross)[1])[0]


## Create the mid shape curve: 
point_set_a = []
point_set_b = []

for i in range(layers_mid):
    point_set_a.append(gh.XYPlane(gh.ConstructPoint(0,0, i*toolpath_height)))
    point_set_b.append(gh.XYPlane(gh.ConstructPoint(0,0, i*toolpath_height_sides)))

start_curves = []
start_connection_shape = []
curves_start_planar = []

for i in range(layers_mid):
    pt_a = gh.CurveXPlane(shape_curve_cross_final, point_set_b[i])[0]
    
    pt_b_1 = gh.Deconstruct(gh.CurveXPlane(shape_curve_cross_final, point_set_a[i])[0])
    pt_b_2 = gh.Deconstruct(gh.CurveXPlane(shape_curve_final, point_set_a[i])[0])
    pt_b = gh.ConstructPoint(pt_b_2[0], pt_b_1[1], pt_b_1[2])
    
    pt_c = gh.CurveXPlane(shape_curve_final, point_set_b[i])[0]
    if i == layers_mid-1: start_connection_shape.append(pt_c)
    
    curves_start_planar.append(gh.PolyLine([pt_a, pt_b, pt_c], False))
    curve = gh.FilletDistance(gh.PolyLine([pt_a, pt_b, pt_c], False), fillet)
    curve_mirr = gh.Mirror(curve, gh.XZPlane(gh.ConstructPoint(0,0,0)))[0]
    
    joined = gh.JoinCurves([curve, curve_mirr], False)
    start_curves.append(joined)



############################################################################################################
## Create the arched connection part:
############################################################################################################


## main shape:
arch_shape = gh.Shatter(shape_curve_final, gh.CurveClosestPoint(start_connection_shape, shape_curve_final)[1])[0]


## cutting planes: 

base_plane = gh.ConstructPlane(gh.EndPoints(arch_shape)[0], gh.VectorXYZ(math.tan(math.radians(-tilt_angle)),0,1)[0], gh.UnitY(1))

ref_surface = []
for i in range(250):
     tilted_cutting_plane = gh.Move(base_plane, gh.UnitX(-toolpath_height*i))[0]
     pt_a_b = gh.CurveXPlane(start_curves[-1], tilted_cutting_plane)[0]
     
     if type(pt_a_b) == list:
         pt_a = pt_a_b[0]
         pt_b = pt_a_b[1]
         
         pt_c = gh.CurveXPlane(arch_shape, tilted_cutting_plane)[0]
         
         rec = gh.Rectangle3Pt(pt_a, pt_b, pt_c)
         if rec[1] > 0.05 : ref_surface.append(gh.BoundarySurfaces(rec[0]))


## create arch shaped curves base: 
div = gh.DivideCurve(shape_curve_cross, 2, False)[0]
base_surface = gh.BoundarySurfaces(gh.Rectangle3Pt(div[0], div[2], div[1])[0])

points_base = gh.DivideCurve(shape_curve_cross, 25, False)[0]
# ---------- end create_start_and_connection_curves ----------
surface_closest_point = SurfaceClosestPoint(
    Point=create_start_and_connection_curves.points_base,
    Surface=reparameterize(create_start_and_connection_curves.base_surface))  # -> Point, UVPoint, Distance
curve_on_surface = CurveOnSurface(
    Surface=reparameterize(create_start_and_connection_curves.ref_surface),
    UVCoordinates=surface_closest_point.UVPoint,
    Closed=False)  # -> flatten(Curve), Length, Domain
extend_curve = ExtendCurve(Curve=curve_on_surface.Curve, Type=2, Start=expr("-x/2", toolpath_height), End=expr("-x/2", toolpath_height))
generate_toolpath = GhPythonScript(
    curves_a=create_toolpath_curves.toolpath_main,
    curves_b=extend_curve,
    start_curves=create_start_and_connection_curves.start_curves,
    start_curves_planar=create_start_and_connection_curves.curves_start_planar,
    type=type,
    toolpath_depth=toolpath_depth,
    toolpath_height=toolpath_height,
    fillet=fillet)  # -> toolpath_a, toolpath_b; inputs curves_a: list of Curve, curves_b: list of Curve, start_curves: list of Curve, start_curves_planar: list of Curve, type: Int32
# ---------- generate_toolpath: Python ----------
import ghpythonlib.components as gh



#############################################################################################
## Define Layering Functions
#############################################################################################

## Close toolpath with one layer: 
def close_toolpath(curves):
    toolpath_flipped = []
    
    for i, crv in enumerate(curves):
        if i % 2 == 0:
            toolpath_flipped.append(gh.FlipCurve(crv)[0])
        
        else:
            toolpath_flipped.append(crv)
    
    lines = []
    for i in range(int(len(toolpath_flipped)-1)): lines.append(gh.Line(gh.EndPoints(toolpath_flipped[i])[0], gh.EndPoints(toolpath_flipped[i+1])[1]))
    
    toolpath_final = []
    
    toolpath_final.extend(toolpath_flipped)
    toolpath_final.extend(lines)
    
    
    toolpath_final = gh.JoinCurves(toolpath_final, False)
    return(toolpath_final)



## Close toolpath with a double layered geometry:
def double_layered_closing(curves, layer_depth, recut):
    curves_offset = []
    
    
    if recut == False: 
        for crv in curves:
            curves_offset.append(gh.OffsetCurve(crv, layer_depth, gh.XYPlane(gh.ConstructPoint(0,0,0)), 1))
    
    
    if recut == True:
        for i, crv in enumerate(curves):
            plane = gh.Planar(crv)[1]
            
            if gh.EndPoints(crv)[0][2] < 0.01: 
                offset = gh.ExtendCurve(gh.OffsetCurve(crv, layer_depth, plane, 1), 1, 0.1, 0.1)
                bound = gh.Extrude(gh.BoundarySurfaces(gh.Rectangle(gh.XYPlane(gh.EndPoints(crv)[0]), gh.ConstructDomain(-100,100), gh.ConstructDomain(-100,100),0)[0]), gh.UnitZ(-100))
                cut = gh.TrimwithBrep(offset, bound)[1]
                
            else:
                crv = gh.OffsetCurve(crv, layer_depth, plane, 1)
                cut = gh.ExtendCurve(crv, 2, -i*0.0007, -i*0.0007)
            
            curves_offset.append(cut)
    
    
    ## Close one side: 
    lines_close = []
    for i, crv in enumerate(curves): lines_close.append(gh.Line(gh.EndPoints(crv)[0], gh.EndPoints(curves_offset[i])[0]))
    
    
    
    ## Join the curves: 
    joined = []
    for i, crv in enumerate(curves): joined.append(gh.JoinCurves([lines_close[i], curves[i], curves_offset[i]], False))
    
    return(joined)



#############################################################################################
## Main Part
#############################################################################################

## Sort and extend the input curves: 
curves_main = []

if type == 1:
    curve_longer = gh.ExtendCurve(curves_b[0], 2, 0, 1) 
    curve_longer_final = gh.Shatter(curve_longer, gh.CurveXPlane(curve_longer, gh.XYPlane(gh.ConstructPoint(0,0,0)))[1])[0]

if type == 2:
    curve_longer = gh.ExtendCurve(curves_b[0], 2, 1, 0) 
    curve_longer_final = gh.Shatter(curve_longer, gh.CurveXPlane(curve_longer, gh.XYPlane(gh.ConstructPoint(0,0,0)))[1])[1]

curves_b.reverse()

curves_main.extend(curves_b[0:-1])
curves_main.append(curve_longer_final)

curves_main.extend(curves_a)


## Generate toolpath_a: 

if type == 1: toolpath_a = close_toolpath(curves_main)
if type == 2: toolpath_a = close_toolpath(double_layered_closing(curves_main, toolpath_depth, True))



#############################################################################################
## Closing Part
#############################################################################################

if type == 1:
    curves_start = []
    for crv in start_curves: curves_start.append(gh.ExtendCurve(crv, 2, 0, -toolpath_height))
    
    toolpath_b = close_toolpath(curves_start)

if type == 2:
    curves_start = []
    
    for i, crv in enumerate(start_curves_planar):
        
        pl = gh.Planar(crv)[1]
        curve_a = gh.FilletDistance(gh.OffsetCurve(crv, toolpath_depth, pl, 1), fillet)
        curve_b = gh.Mirror(curve_a, gh.XZPlane(gh.ConstructPoint(0,0,0)))[0]
        curve_c = gh.Line(gh.EndPoints(curve_a)[1], gh.EndPoints(curve_b)[1])
        
        curve_total_a = gh.ExtendCurve(gh.JoinCurves([curve_a, curve_b, curve_c], False), 2, -toolpath_height, -toolpath_height )
        curve_total_b = gh.ExtendCurve(start_curves[i], 2, -toolpath_height, 0)
        
        line_connection = gh.Line(gh.EndPoints(curve_total_a)[0], gh.EndPoints(curve_total_b)[0])
        
        curve_total = gh.JoinCurves([curve_total_a, line_connection, curve_total_b], False)
        curves_start.append(curve_total)
    
    toolpath_b = close_toolpath(curves_start)
# ---------- end generate_toolpath ----------
