# Grasshopper definition Code_Kappendecke_2.0_set_2_fabtory_all.ghx (Grasshopper 1.0.7)
# Copyright: Felswind

# ----
# Kappendecke - Var. 1
var_1_one_layered_pattern = Curve(reparameterize(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))
var_1_double_layered_pattern = Curve(reparameterize(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))
var_1_one_layered = Curve(reparameterize(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))
var_1_double_layered = Curve(reparameterize(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))

# ----
# Kappendecke - Var. 2
var_2_one_layered = Curve(reparameterize(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))
var_2_double_layered = Curve(reparameterize(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))

# ----
# Kappendecke - Var. 4
var_4_one_layered = Curve(reparameterize([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]))
var_4_double_layered = Curve(reparameterize([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]))

# ----
# Kappendecke - Var. 3
var_3_one_layered = Curve(reparameterize([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]))
var_3_double_layered = Curve(reparameterize([<curve referenced from the Rhino model> x3]))

# ----
# Kappendecke - Var. 5
var_5_one_layered = Curve(reparameterize(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))
var_5_double_layered = Curve(reparameterize(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))

# ----
# Var. 1 - planes
show = BooleanToggle(True)  # disabled
fab_planes = GhPythonScript(toolpath=flatten(var_1_double_layered_pattern), show_preview=show)  # -> fab_planes_a, planes_layer_a, port, preview; inputs toolpath: list of Curve, show_preview: Boolean; disabled
# ---------- fab_planes: Python ----------
import ghpythonlib.components as gh 
import math



###########################################################
## Define fabrication planes: 
###########################################################

def fab_planes(toolpath, subdivision = 65):
    
    ## remove the connection lines:
    curves_filtered = []
    
    single_curves = gh.Explode(toolpath, True)[0]
    for crv in single_curves:
      if str(type(crv)) != "<type 'LineCurve'>": curves_filtered.append(crv)
    
    curves_filtered = gh.JoinCurves(curves_filtered, False)
    
    pts_mid = gh.CurveMiddle(curves_filtered)
    pts_ind = gh.SortAlongCurve(pts_mid, toolpath)[1]
    
    curves_filtered_new = []
    for i in range(len(pts_ind)): curves_filtered_new.append(curves_filtered[pts_ind[i]])
    
    
    ## resort the curves:
    curves_sorted = []
    
    curves_flipped = gh.FlipCurve(curves_filtered_new, curves_filtered_new[0])[0]
    for i in range(len(curves_flipped)):
        if i %2 == 0: curves_sorted.append(gh.FlipCurve(curves_flipped[i])[0])
        else: curves_sorted.append(curves_flipped[i])
    
    
    ## Create the fabrication planes: 
    fab_planes = []
    planes_layer = []
    
    for crv in curves_sorted:
        
        divisions = int(subdivision*gh.Length(crv)/0.85)
        if divisions < 3: divisions = 3
        
        base_plane = gh.Planar(crv)[1]
        div = gh.DivideCurve(crv, divisions, False)[0]
        planes_layer.append(len(div))
        
        for pt in div:
            plane_loc = gh.PlaneOrigin(base_plane, pt)
            plane_loc_dec = gh.DeconstructPlane(plane_loc)
            
            plane_new = gh.PlaneNormal(plane_loc_dec[0], plane_loc_dec[3])
            plane_new_dec = gh.DeconstructPlane(plane_new)
            
            flip_x = False
            flip_y = False
            if plane_new_dec[1][1] < 0: flip_x = True
            if plane_new_dec[1][0] < 0: flip_x = True
            if plane_new_dec[2][0] < 0: flip_y = True
            plane_new = gh.FlipPlane(plane_new, flip_x, flip_y, False)
            
            fab_planes.append(plane_new)
    
    
    return(fab_planes, planes_layer)



###########################################################
## Optimize curves: 
###########################################################

planes = fab_planes(toolpath[0])
fab_planes_a = planes[0]
planes_layer_a = planes[1]



###########################################################
## Add additional planes for the last step: 
###########################################################

plane_a = gh.DeconstructPlane(fab_planes_a[-1])
plane_a_end = gh.ConstructPlane(gh.ConstructPoint(plane_a[0][0], plane_a[0][1]-0.15, plane_a[0][2]+0.15), plane_a[1], plane_a[2])
fab_planes_a.append(plane_a_end)
planes_layer_a[-1] += 1



###########################################################
## Preview curves: 
###########################################################

if show_preview == True:
    preview = []
    
    preview.append(gh.PolyLine(gh.DeconstructPlane(fab_planes_a)[0], False))
# ---------- end fab_planes ----------
colour_swatch = ColourSwatch(SwatchColor=RGB(184, 0, 0))  # disabled
custom_preview = CustomPreview(Geometry=fab_planes.preview, Material=colour_swatch)  # disabled

# ----
# Var. 2 - planes
show_2 = BooleanToggle(True)  # disabled
fab_planes_2 = GhPythonScript(toolpath=flatten(var_2_double_layered), show_preview=show_2)  # -> fab_planes_a, planes_layer_a, port, preview; inputs toolpath: list of Curve, show_preview: Boolean; disabled
# ---------- fab_planes_2: Python ----------
import ghpythonlib.components as gh 
import math



###########################################################
## Define fabrication planes: 
###########################################################

def fab_planes(toolpath, subdivision = 50):
    
    ## remove the connection lines:
    curves_filtered = []
    
    single_curves = gh.Explode(toolpath, True)[0]
    for crv in single_curves:
      if str(type(crv)) != "<type 'LineCurve'>": curves_filtered.append(crv)
    
    curves_filtered = gh.JoinCurves(curves_filtered, False)
    
    pts_mid = gh.CurveMiddle(curves_filtered)
    pts_ind = gh.SortAlongCurve(pts_mid, toolpath)[1]
    
    curves_filtered_new = []
    for i in range(len(pts_ind)): curves_filtered_new.append(curves_filtered[pts_ind[i]])
    
    
    ## resort the curves:
    curves_sorted = []
    
    curves_flipped = gh.FlipCurve(curves_filtered_new, curves_filtered_new[0])[0]
    for i in range(len(curves_flipped)):
        if i %2 == 0: curves_sorted.append(gh.FlipCurve(curves_flipped[i])[0])
        else: curves_sorted.append(curves_flipped[i])
    
    
    ## Create the fabrication planes: 
    fab_planes = []
    planes_layer = []
    
    for crv in curves_sorted:
        
        divisions = int(subdivision*gh.Length(crv)/0.85)
        if divisions < 3: divisions = 3
        
        base_plane = gh.Planar(crv)[1]
        div = gh.DivideCurve(crv, divisions, False)[0]
        planes_layer.append(len(div))
        
        for pt in div:
            plane_loc = gh.PlaneOrigin(base_plane, pt)
            plane_loc_dec = gh.DeconstructPlane(plane_loc)
            
            plane_new = gh.PlaneNormal(plane_loc_dec[0], plane_loc_dec[3])
            plane_new_dec = gh.DeconstructPlane(plane_new)
            
            flip_x = False
            flip_y = False
            if plane_new_dec[1][1] < 0: flip_x = True
            if plane_new_dec[1][0] < 0: flip_x = True
            if plane_new_dec[2][0] < 0: flip_y = True
            plane_new = gh.FlipPlane(plane_new, flip_x, flip_y, False)
            
            fab_planes.append(plane_new)
    
    
    return(fab_planes, planes_layer)



###########################################################
## Optimize curves: 
###########################################################

planes = fab_planes(toolpath[0])
fab_planes_a = planes[0]
planes_layer_a = planes[1]



###########################################################
## Add additional planes for the last step: 
###########################################################

plane_a = gh.DeconstructPlane(fab_planes_a[-1])
plane_a_end = gh.ConstructPlane(gh.ConstructPoint(plane_a[0][0], plane_a[0][1]-0.15, plane_a[0][2]+0.15), plane_a[1], plane_a[2])
fab_planes_a.append(plane_a_end)
planes_layer_a[-1] += 1



###########################################################
## Preview curves: 
###########################################################

if show_preview == True:
    preview = []
    
    preview.append(gh.PolyLine(gh.DeconstructPlane(fab_planes_a)[0], False))
# ---------- end fab_planes_2 ----------
colour_swatch_2 = ColourSwatch(SwatchColor=RGB(184, 0, 0))  # disabled
custom_preview_2 = CustomPreview(Geometry=fab_planes_2.preview, Material=colour_swatch_2)  # disabled

show_3 = BooleanToggle(True)  # disabled
angle_max = Slider(25, range=0..90)  # disabled
double_layer = BooleanToggle(False)  # disabled

show_4 = BooleanToggle(True)  # disabled
angle_max_2 = Slider(25, range=0..90)  # disabled
double_layer_2 = BooleanToggle(True)  # disabled

# ----
# Var. 5 - planes
show_5 = BooleanToggle(True)  # disabled
fab_planes_3 = GhPythonScript(toolpath=flatten(var_5_double_layered), show_preview=show_5)  # -> fab_planes_a, planes_layer_a, port, preview; inputs toolpath: list of Curve, show_preview: Boolean; disabled
# ---------- fab_planes_3: Python ----------
import ghpythonlib.components as gh 
import math



###########################################################
## Define fabrication planes: 
###########################################################

def fab_planes(toolpath, subdivision = 40):
    
    ## remove the connection lines:
    curves_filtered = []
    
    single_curves = gh.Explode(toolpath, True)[0]
    for crv in single_curves:
      if str(type(crv)) != "<type 'LineCurve'>": curves_filtered.append(crv)
    
    curves_filtered = gh.JoinCurves(curves_filtered, False)
    
    pts_mid = gh.CurveMiddle(curves_filtered)
    pts_ind = gh.SortAlongCurve(pts_mid, toolpath)[1]
    
    curves_filtered_new = []
    for i in range(len(pts_ind)): curves_filtered_new.append(curves_filtered[pts_ind[i]])
    
    
    ## resort the curves:
    curves_sorted = []
    
    curves_flipped = gh.FlipCurve(curves_filtered_new, curves_filtered_new[0])[0]
    for i in range(len(curves_flipped)):
        if i %2 == 0: curves_sorted.append(gh.FlipCurve(curves_flipped[i])[0])
        else: curves_sorted.append(curves_flipped[i])
    
    
    ## Create the fabrication planes: 
    fab_planes = []
    planes_layer = []
    
    for crv in curves_sorted:
        
        divisions = int(subdivision*gh.Length(crv)/0.85)
        if divisions < 3: divisions = 3
        
        base_plane = gh.Planar(crv)[1]
        div = gh.DivideCurve(crv, divisions, False)[0]
        planes_layer.append(len(div))
        
        for pt in div:
            plane_loc = gh.PlaneOrigin(base_plane, pt)
            plane_loc_dec = gh.DeconstructPlane(plane_loc)
            
            plane_new = gh.PlaneNormal(plane_loc_dec[0], plane_loc_dec[3])
            plane_new_dec = gh.DeconstructPlane(plane_new)
            
            flip_x = False
            flip_y = False
            if plane_new_dec[1][1] < 0: flip_x = True
            if plane_new_dec[1][0] < 0: flip_x = True
            if plane_new_dec[2][0] < 0: flip_y = True
            plane_new = gh.FlipPlane(plane_new, flip_x, flip_y, False)
            
            fab_planes.append(plane_new)
    
    
    return(fab_planes, planes_layer)



###########################################################
## Optimize curves: 
###########################################################

planes = fab_planes(toolpath[0])
fab_planes_a = planes[0]
planes_layer_a = planes[1]



###########################################################
## Add additional planes for the last step: 
###########################################################

plane_a = gh.DeconstructPlane(fab_planes_a[-1])
plane_a_end = gh.ConstructPlane(gh.ConstructPoint(plane_a[0][0], plane_a[0][1]-0.15, plane_a[0][2]+0.15), plane_a[1], plane_a[2])
fab_planes_a.append(plane_a_end)
planes_layer_a[-1] += 1



###########################################################
## Preview curves: 
###########################################################

if show_preview == True:
    preview = []
    
    preview.append(gh.PolyLine(gh.DeconstructPlane(fab_planes_a)[0], False))
# ---------- end fab_planes_3 ----------
colour_swatch_3 = ColourSwatch(SwatchColor=RGB(184, 0, 0))  # disabled
custom_preview_3 = CustomPreview(Geometry=fab_planes_3.preview, Material=colour_swatch_3)  # disabled

# ----
# Var. 3 - planes
fab_planes_4 = GhPythonScript(toolpath=flatten(var_3_double_layered), show_preview=show_3, angle_max=angle_max, double_layer=double_layer)  # -> fab_planes_a, planes_layer_a, fab_planes_b, planes_layer_b, fab_planes_c, planes_layer_c, port, preview; inputs toolpath: list of Curve, show_preview: Boolean, double_layer: Boolean; disabled
# ---------- fab_planes_4: Python ----------
import ghpythonlib.components as gh 
import math



###########################################################
## Define fabrication planes: 
###########################################################
def fab_planes(toolpath, subdivision = 35):
    
    ## remove the connection lines:
    curves_filtered = []
    
    single_curves = gh.Explode(toolpath, True)[0]
    for crv in single_curves:
      if str(type(crv)) != "<type 'LineCurve'>": curves_filtered.append(crv)
    
    curves_filtered = gh.JoinCurves(curves_filtered, False)
    
    pts_mid = gh.CurveMiddle(curves_filtered)
    pts_ind = gh.SortAlongCurve(pts_mid, toolpath)[1]
    
    curves_filtered_new = []
    for i in range(len(pts_ind)): curves_filtered_new.append(curves_filtered[pts_ind[i]])
    
    
    ## resort the curves:
    curves_sorted = []
    
    curves_flipped = gh.FlipCurve(curves_filtered_new, curves_filtered_new[0])[0]
    for i in range(len(curves_flipped)):
        if i %2 == 0: curves_sorted.append(gh.FlipCurve(curves_flipped[i])[0])
        else: curves_sorted.append(curves_flipped[i])
    
    
    ## Create the fabrication planes: 
    fab_planes = []
    planes_layer = []
    
    for crv in curves_sorted:
        
        divisions = int(subdivision*gh.Length(crv)/0.85)
        if divisions < 3: divisions = 3
        
        base_plane = gh.Planar(crv)[1]
        div = gh.DivideCurve(crv, divisions, False)[0]
        planes_layer.append(len(div))
        
        for pt in div:
            plane_loc = gh.PlaneOrigin(base_plane, pt)
            plane_loc_dec = gh.DeconstructPlane(plane_loc)
            
            plane_new = gh.PlaneNormal(plane_loc_dec[0], plane_loc_dec[3])
            plane_new_dec = gh.DeconstructPlane(plane_new)
            
            flip_x = False
            flip_y = False
            if plane_new_dec[1][1] < 0: flip_x = True
            if plane_new_dec[1][0] < 0: flip_x = True
            if plane_new_dec[2][0] < 0: flip_y = True
            plane_new = gh.FlipPlane(plane_new, flip_x, flip_y, False)
            
            fab_planes.append(plane_new)
    
    
    return(fab_planes, planes_layer)



def fab_planes_angled(toolpath, double, subdivision = 35):
    
    ## remove the connection lines:
    curves_filtered = []
    
    single_curves = gh.Explode(toolpath, True)[0]
    for crv in single_curves:
      if str(type(crv)) != "<type 'LineCurve'>": curves_filtered.append(crv)
    
    curves_filtered = gh.JoinCurves(curves_filtered, False)
    
    pts_mid = gh.CurveMiddle(curves_filtered)
    pts_ind = gh.SortAlongCurve(pts_mid, toolpath)[1]
    
    curves_filtered_new = []
    for i in range(len(pts_ind)): curves_filtered_new.append(curves_filtered[pts_ind[i]])
    
    
    ## resort the curves:
    curves_sorted = []
    
    curves_flipped = gh.FlipCurve(curves_filtered_new, curves_filtered_new[3])[0]
    
    for i in range(len(curves_flipped)):
        if i %2 == 0: curves_sorted.append(gh.FlipCurve(curves_flipped[i])[0])
        else: curves_sorted.append(curves_flipped[i])
    
    
    ## Create the fabrication planes: 
    fab_planes = []
    planes_layer = []
    
    for i, crv in enumerate(curves_sorted):
        
        divisions = int(subdivision*gh.Length(crv)/0.85)
        if divisions < 3: divisions = 3
        
        ## Create base_plane: 
        if i == 0: angle = 0
        if double == True:
            if i %2 == 0: angle = angle_max/(len(curves_sorted)/2-1) * i/2 
        else: angle = angle_max/(len(curves_sorted)-1) * i
        print(angle)
        x_axis = gh.Vector2Pt(gh.EndPoints(crv)[0], gh.EndPoints(crv)[1], False)[0]
        y_axis = gh.VectorXYZ(0,1,math.tan(math.radians(angle)))[0]
        base_plane = gh.ConstructPlane(gh.ConstructPoint(0,0,0), x_axis, y_axis)
        
        div = gh.DivideCurve(crv, divisions, False)[0]
        planes_layer.append(len(div))
        
        for pt in div:
            plane_loc = gh.PlaneOrigin(base_plane, pt)
            fab_planes.append(plane_loc)
    
    
    return(fab_planes, planes_layer)



###########################################################
## Optimize curves: 
###########################################################

part_a = fab_planes_angled(toolpath[0], double_layer)
part_b = fab_planes_angled(toolpath[1], double_layer)
part_c = fab_planes(toolpath[2])

fab_planes_a = part_a[0]
fab_planes_b = part_b[0]
fab_planes_c = part_c[0]

#fab_planes_a = gh.XYPlane(gh.DeconstructPlane(fab_planes_a)[0])
#fab_planes_b = gh.XYPlane(gh.DeconstructPlane(fab_planes_b)[0])

planes_layer_a = part_a[1]
planes_layer_b = part_b[1]
planes_layer_c = part_c[1]



###########################################################
## Add additional planes for the last step: 
###########################################################

plane_a = gh.DeconstructPlane(fab_planes_a[-1])
plane_a_end = gh.ConstructPlane(gh.ConstructPoint(plane_a[0][0], plane_a[0][1]-0.15, plane_a[0][2]+0.15), plane_a[1], plane_a[2])
fab_planes_a.append(plane_a_end)
planes_layer_a[-1] += 1


plane_b = gh.DeconstructPlane(fab_planes_b[-1])
plane_b_end = gh.ConstructPlane(gh.ConstructPoint(plane_b[0][0], plane_b[0][1]-0.15, plane_b[0][2]+0.15), plane_b[1], plane_b[2])
fab_planes_b.append(plane_b_end)
planes_layer_b[-1] += 1


plane_c = gh.DeconstructPlane(fab_planes_c[-1])
plane_c_end = gh.ConstructPlane(gh.ConstructPoint(plane_c[0][0], plane_c[0][1]-0.15, plane_c[0][2]+0.15), plane_c[1], plane_c[2])
fab_planes_c.append(plane_c_end)
planes_layer_c[-1] += 1



###########################################################
## Preview curves: 
###########################################################

if show_preview == True:
    preview = []
    
    preview.append(gh.PolyLine(gh.DeconstructPlane(fab_planes_a)[0], False))
    preview.append(gh.PolyLine(gh.DeconstructPlane(fab_planes_b)[0], False))
    preview.append(gh.PolyLine(gh.DeconstructPlane(fab_planes_c)[0], False))
# ---------- end fab_planes_4 ----------
colour_swatch_4 = ColourSwatch(SwatchColor=RGB(184, 0, 0))  # disabled
custom_preview_4 = CustomPreview(Geometry=fab_planes_4.preview, Material=colour_swatch_4)  # disabled

# ----
# Var. 4 - planes
fab_planes_5 = GhPythonScript(toolpath=flatten(var_4_double_layered), show_preview=show_4, angle_max=angle_max_2, double_layer=double_layer_2)  # -> fab_planes_a, planes_layer_a, fab_planes_b, planes_layer_b, fab_planes_c, planes_layer_c, port, preview; inputs toolpath: list of Curve, show_preview: Boolean, double_layer: Boolean; disabled
# ---------- fab_planes_5: Python ----------
import ghpythonlib.components as gh 
import math



###########################################################
## Define fabrication planes: 
###########################################################
def fab_planes(toolpath, subdivision = 35):
    
    ## remove the connection lines:
    curves_filtered = []
    
    single_curves = gh.Explode(toolpath, True)[0]
    for crv in single_curves:
      if str(type(crv)) != "<type 'LineCurve'>": curves_filtered.append(crv)
    
    curves_filtered = gh.JoinCurves(curves_filtered, False)
    
    pts_mid = gh.CurveMiddle(curves_filtered)
    pts_ind = gh.SortAlongCurve(pts_mid, toolpath)[1]
    
    curves_filtered_new = []
    for i in range(len(pts_ind)): curves_filtered_new.append(curves_filtered[pts_ind[i]])
    
    
    ## resort the curves:
    curves_sorted = []
    curves_flipped = []
    
    curves_flipped = gh.FlipCurve(curves_filtered_new, curves_filtered_new[2])[0]
    
    
    
    
    
    for i in range(len(curves_flipped)):
        if i %2 == 0: curves_sorted.append(gh.FlipCurve(curves_flipped[i])[0])
        else: curves_sorted.append(curves_flipped[i])
    
    
    ## Create the fabrication planes: 
    fab_planes = []
    planes_layer = []
    
    for crv in curves_sorted:
        
        divisions = int(subdivision*gh.Length(crv)/0.85)
        if divisions < 3: divisions = 3
        
        base_plane = gh.Planar(crv)[1]
        div = gh.DivideCurve(crv, divisions, False)[0]
        planes_layer.append(len(div))
        
        for pt in div:
            plane_loc = gh.PlaneOrigin(base_plane, pt)
            plane_loc_dec = gh.DeconstructPlane(plane_loc)
            
            plane_new = gh.PlaneNormal(plane_loc_dec[0], plane_loc_dec[3])
            plane_new_dec = gh.DeconstructPlane(plane_new)
            
            flip_x = False
            flip_y = False
            if plane_new_dec[1][1] < 0: flip_x = True
            if plane_new_dec[1][0] < 0: flip_x = True
            if plane_new_dec[2][0] < 0: flip_y = True
            plane_new = gh.FlipPlane(plane_new, flip_x, flip_y, False)
            
            fab_planes.append(plane_new)
    
    
    return(fab_planes, planes_layer)



def fab_planes_angled(toolpath, double, subdivision = 35):
    
    ## remove the connection lines:
    curves_filtered = []
    
    single_curves = gh.Explode(toolpath, True)[0]
    for crv in single_curves:
      if str(type(crv)) != "<type 'LineCurve'>": curves_filtered.append(crv)
    
    curves_filtered = gh.JoinCurves(curves_filtered, False)
    
    pts_mid = gh.CurveMiddle(curves_filtered)
    pts_ind = gh.SortAlongCurve(pts_mid, toolpath)[1]
    
    curves_filtered_new = []
    for i in range(len(pts_ind)): curves_filtered_new.append(curves_filtered[pts_ind[i]])
    
    
    ## resort the curves:
    curves_sorted = []
    
    curves_flipped = gh.FlipCurve(curves_filtered_new, curves_filtered_new[3])[0]
    for i in range(len(curves_flipped)):
        if i %2 == 0: curves_sorted.append(gh.FlipCurve(curves_flipped[i])[0])
        else: curves_sorted.append(curves_flipped[i])
    
    
    ## Create the fabrication planes: 
    fab_planes = []
    planes_layer = []
    
    for i, crv in enumerate(curves_sorted):
        
        divisions = int(subdivision*gh.Length(crv)/0.85)
        if divisions < 3: divisions = 3
        
        ## Create base_plane: 
        if i == 0: angle = 0
        if double == True:
            if i %2 == 0: angle = angle_max/(len(curves_sorted)/2-1) * i/2 
        else: angle = angle_max/(len(curves_sorted)-1) * i
        
        x_axis = gh.Vector2Pt(gh.EndPoints(crv)[0], gh.EndPoints(crv)[1], False)[0]
        y_axis = gh.VectorXYZ(0,1,math.tan(math.radians(angle)))[0]
        base_plane = gh.ConstructPlane(gh.ConstructPoint(0,0,0), x_axis, y_axis)
        
        div = gh.DivideCurve(crv, divisions, False)[0]
        planes_layer.append(len(div))
        
        for pt in div:
            plane_loc = gh.PlaneOrigin(base_plane, pt)
            fab_planes.append(plane_loc)
    
    
    return(fab_planes, planes_layer)



###########################################################
## Optimize curves: 
###########################################################

part_a = fab_planes_angled(toolpath[0], double_layer)
part_b = fab_planes_angled(toolpath[1], double_layer)
part_c = fab_planes(toolpath[2])

fab_planes_a = part_a[0]
fab_planes_b = part_b[0]
fab_planes_c = part_c[0]

#fab_planes_a = gh.XYPlane(gh.DeconstructPlane(fab_planes_a)[0])
#fab_planes_b = gh.XYPlane(gh.DeconstructPlane(fab_planes_b)[0])

planes_layer_a = part_a[1]
planes_layer_b = part_b[1]
planes_layer_c = part_c[1]



###########################################################
## Add additional planes for the last step: 
###########################################################

plane_a = gh.DeconstructPlane(fab_planes_a[-1])
plane_a_end = gh.ConstructPlane(gh.ConstructPoint(plane_a[0][0], plane_a[0][1]-0.15, plane_a[0][2]+0.15), plane_a[1], plane_a[2])
fab_planes_a.append(plane_a_end)
planes_layer_a[-1] += 1


plane_b = gh.DeconstructPlane(fab_planes_b[-1])
plane_b_end = gh.ConstructPlane(gh.ConstructPoint(plane_b[0][0], plane_b[0][1]-0.15, plane_b[0][2]+0.15), plane_b[1], plane_b[2])
fab_planes_b.append(plane_b_end)
planes_layer_b[-1] += 1


plane_c = gh.DeconstructPlane(fab_planes_c[-1])
plane_c_end = gh.ConstructPlane(gh.ConstructPoint(plane_c[0][0], plane_c[0][1]-0.15, plane_c[0][2]+0.15), plane_c[1], plane_c[2])
fab_planes_c.append(plane_c_end)
planes_layer_c[-1] += 1



###########################################################
## Preview curves: 
###########################################################

if show_preview == True:
    preview = []
    
    preview.append(gh.PolyLine(gh.DeconstructPlane(fab_planes_a)[0], False))
    preview.append(gh.PolyLine(gh.DeconstructPlane(fab_planes_b)[0], False))
    preview.append(gh.PolyLine(gh.DeconstructPlane(fab_planes_c)[0], False))
# ---------- end fab_planes_5 ----------
colour_swatch_5 = ColourSwatch(SwatchColor=RGB(184, 0, 0))  # disabled
custom_preview_5 = CustomPreview(Geometry=fab_planes_5.preview, Material=colour_swatch_5)  # disabled

# ----
# Var. 1 - AM Model
transform = BooleanToggle(False)  # disabled
t_value = Slider(0.015, range=0..0.25)  # disabled
layer_def = GhPythonScript(fab_planes=fab_planes.fab_planes_a, planes_layer=fab_planes.planes_layer_a, transform=transform, t_value=t_value)  # -> out, layer, am_model, planes; inputs fab_planes: list of Plane, planes_layer: list of Int32, transform: Boolean; disabled
# ---------- layer_def: Python ----------
import ghpythonlib.components as gh
import os
import sys
import json

from compas.geometry import Frame
from compas.geometry import Line
from compas.geometry import Vector
from compas_ghpython import draw_frame

from am_information_model.model import Node
from am_information_model.model import Layer
from am_information_model.model import AMModel


def _radius_between_frames(from_frame, via_frame, to_frame, max_radius):
        in_line = Line(from_frame.point, via_frame.point)
        out_line = Line(via_frame.point, to_frame.point)
        r = min(max_radius, in_line.length/2, out_line.length/2)
        return r



# nodes
max_r = 0.1
frames = []

for plane in fab_planes:
    
    plane_dec = gh.DeconstructPlane(plane)
    
    p_orig = plane_dec[0]
    p_x = plane_dec[2]
    p_y = -plane_dec[1]
    p_z = plane_dec[3]
    
    
    frame = Frame([p_orig[0], p_orig[1], p_orig[2]], [p_x[0], p_x[1], p_x[2]], [p_y[0], p_y[1], p_y[2]])
    frames.append(frame)

nodes = []
for i,frame in enumerate(frames):
    r = _radius_between_frames(frames[max(0,i-1)], frame, frames[min(i+1, len(frames)-1)], max_r)
    nodes.append(Node(frame, radius=r))



# Create the print_layer: 
def partition(lst, size):
    for i in range(0, len(lst), size):
        yield lst[i : i+size]

nodes_layer = []
numb_old = 0

for i in range(len(planes_layer)):
    
    if i == 0: nodes_layer.append(nodes[0:planes_layer[i]])
    else: nodes_layer.append(nodes[numb_old:numb_old+planes_layer[i]])
    
    numb_old += planes_layer[i]


layer = []
for i in range(len(planes_layer)):
    layer_loc = Layer.from_nodes(nodes_layer[i])
    layer.append(layer_loc)



# Create AM Model: 
am_model = AMModel()

for i in range(len(layer)):
    layer_new = layer[i]
    am_model.add_layer(layer_new)



# Create Planes:

planes = []
for l, layer in am_model.layers():
    for k, node in layer.nodes():
        planes.append(draw_frame(node.frame)) 



# Z_Movement:

import Rhino.Geometry as rg
planes = []
frame = []
frames_transformed = []
for l, layer in am_model.layers():
    for k, node in layer.nodes():
        planes.append(draw_frame(node.frame))
if transform:
    for plane in planes:
        plane.Translate(rg.Vector3d.ZAxis*t_value)
# ---------- end layer_def ----------

# ----
# Var. 2 - AM Model
transform_2 = BooleanToggle(False)  # disabled
t_value_2 = Slider(0.015, range=0..0.25)  # disabled
layer_def_2 = GhPythonScript(fab_planes=fab_planes_2.fab_planes_a, planes_layer=fab_planes_2.planes_layer_a, transform=transform_2, t_value=t_value_2)  # -> out, layer, am_model, planes; inputs fab_planes: list of Plane, planes_layer: list of Int32, transform: Boolean; disabled; same code as layer_def

# ----
# Var. 3 - AM Model - Part A
transform_3 = BooleanToggle(False)  # disabled
t_value_3 = Slider(0.015, range=0..0.25)  # disabled
layer_def_3 = GhPythonScript(fab_planes=fab_planes_4.fab_planes_a, planes_layer=fab_planes_4.planes_layer_a, transform=transform_3, t_value=t_value_3)  # -> out, layer, am_model, planes; inputs fab_planes: list of Plane, planes_layer: list of Int32, transform: Boolean; disabled
# ---------- layer_def_3: Python ----------
import ghpythonlib.components as gh
import os
import sys
import json

from compas.geometry import Frame
from compas.geometry import Line
from compas.geometry import Vector
from compas_ghpython import draw_frame

from am_information_model.model import Node
from am_information_model.model import Layer
from am_information_model.model import AMModel


def _radius_between_frames(from_frame, via_frame, to_frame, max_radius):
        in_line = Line(from_frame.point, via_frame.point)
        out_line = Line(via_frame.point, to_frame.point)
        r = min(max_radius, in_line.length/2, out_line.length/2)
        return r



# nodes
max_r = 0.1
frames = []

for plane in fab_planes:
    
    plane_dec = gh.DeconstructPlane(plane)
    
    p_orig = plane_dec[0]
    
    p_x = plane_dec[1]
    if p_x[0] < 0: p_x = -p_x
    
    p_y = -plane_dec[2]
    p_z = plane_dec[3]
    
    
    frame = Frame([p_orig[0], p_orig[1], p_orig[2]], [p_x[0], p_x[1], p_x[2]], [p_y[0], p_y[1], p_y[2]])
    frames.append(frame)

nodes = []
for i,frame in enumerate(frames):
    r = _radius_between_frames(frames[max(0,i-1)], frame, frames[min(i+1, len(frames)-1)], max_r)
    nodes.append(Node(frame, radius=r))



# Create the print_layer: 
def partition(lst, size):
    for i in range(0, len(lst), size):
        yield lst[i : i+size]

nodes_layer = []
numb_old = 0

for i in range(len(planes_layer)):
    
    if i == 0: nodes_layer.append(nodes[0:planes_layer[i]])
    else: nodes_layer.append(nodes[numb_old:numb_old+planes_layer[i]])
    
    numb_old += planes_layer[i]


layer = []
for i in range(len(planes_layer)):
    layer_loc = Layer.from_nodes(nodes_layer[i])
    layer.append(layer_loc)



# Create AM Model: 
am_model = AMModel()

for i in range(len(layer)):
    layer_new = layer[i]
    am_model.add_layer(layer_new)



# Create Planes:

planes = []
for l, layer in am_model.layers():
    for k, node in layer.nodes():
        planes.append(draw_frame(node.frame))



# Z_Movement:

import Rhino.Geometry as rg
planes = []
frame = []
frames_transformed = []
for l, layer in am_model.layers():
    for k, node in layer.nodes():
        planes.append(draw_frame(node.frame))
if transform:
    for plane in planes:
        plane.Translate(rg.Vector3d.ZAxis*t_value)
# ---------- end layer_def_3 ----------

# ----
# Var. 4 - AM Model - Part A
transform_4 = BooleanToggle(False)  # disabled
t_value_4 = Slider(0.015, range=0..0.25)  # disabled
layer_def_4 = GhPythonScript(fab_planes=fab_planes_5.fab_planes_a, planes_layer=fab_planes_5.planes_layer_a, transform=transform_4, t_value=t_value_4)  # -> out, layer, am_model, planes; inputs fab_planes: list of Plane, planes_layer: list of Int32, transform: Boolean; disabled
# ---------- layer_def_4: Python ----------
import ghpythonlib.components as gh
import os
import sys
import json

from compas.geometry import Frame
from compas.geometry import Line
from compas.geometry import Vector
from compas_ghpython import draw_frame

from am_information_model.model import Node
from am_information_model.model import Layer
from am_information_model.model import AMModel


def _radius_between_frames(from_frame, via_frame, to_frame, max_radius):
        in_line = Line(from_frame.point, via_frame.point)
        out_line = Line(via_frame.point, to_frame.point)
        r = min(max_radius, in_line.length/2, out_line.length/2)
        return r




# nodes
max_r = 0.1
frames = []

for plane in fab_planes:
    
    plane_dec = gh.DeconstructPlane(plane)
    
    p_orig = plane_dec[0]
    
    p_x = plane_dec[1]
    if p_x[0] < 0: p_x = -p_x
    
    p_y = -plane_dec[2]
    p_z = plane_dec[3]
    
    
    frame = Frame([p_orig[0], p_orig[1], p_orig[2]], [p_x[0], p_x[1], p_x[2]], [p_y[0], p_y[1], p_y[2]])
    frames.append(frame)

nodes = []
for i,frame in enumerate(frames):
    r = _radius_between_frames(frames[max(0,i-1)], frame, frames[min(i+1, len(frames)-1)], max_r)
    nodes.append(Node(frame, radius=r))



# Create the print_layer: 
def partition(lst, size):
    for i in range(0, len(lst), size):
        yield lst[i : i+size]

nodes_layer = []
numb_old = 0

for i in range(len(planes_layer)):
    
    if i == 0: nodes_layer.append(nodes[0:planes_layer[i]])
    else: nodes_layer.append(nodes[numb_old:numb_old+planes_layer[i]])
    
    numb_old += planes_layer[i]


layer = []
for i in range(len(planes_layer)):
    layer_loc = Layer.from_nodes(nodes_layer[i])
    layer.append(layer_loc)



# Create AM Model: 
am_model = AMModel()

for i in range(len(layer)):
    layer_new = layer[i]
    am_model.add_layer(layer_new)



# Create Planes:

planes = []
for l, layer in am_model.layers():
    for k, node in layer.nodes():
        planes.append(draw_frame(node.frame))



# Z_Movement:

import Rhino.Geometry as rg
planes = []
frame = []
frames_transformed = []
for l, layer in am_model.layers():
    for k, node in layer.nodes():
        planes.append(draw_frame(node.frame))
if transform:
    for plane in planes:
        plane.Translate(rg.Vector3d.ZAxis*t_value)
# ---------- end layer_def_4 ----------

# ----
# Var. 5 - AM Model
transform_5 = BooleanToggle(False)  # disabled
t_value_5 = Slider(0.015, range=0..0.25)  # disabled
layer_def_5 = GhPythonScript(fab_planes=fab_planes_3.fab_planes_a, planes_layer=fab_planes_3.planes_layer_a, transform=transform_5, t_value=t_value_5)  # -> out, layer, am_model, planes; inputs fab_planes: list of Plane, planes_layer: list of Int32, transform: Boolean; disabled; same code as layer_def

# ----
# Var. 3 - AM Model - Part B
layer_def_6 = GhPythonScript(fab_planes=fab_planes_4.fab_planes_b, planes_layer=fab_planes_4.planes_layer_b, transform=transform_3, t_value=t_value_3)  # -> out, layer, am_model, planes; inputs fab_planes: list of Plane, planes_layer: list of Int32, transform: Boolean; disabled
# ---------- layer_def_6: Python ----------
import ghpythonlib.components as gh
import os
import sys
import json

from compas.geometry import Frame
from compas.geometry import Line
from compas.geometry import Vector
from compas_ghpython import draw_frame

from am_information_model.model import Node
from am_information_model.model import Layer
from am_information_model.model import AMModel


def _radius_between_frames(from_frame, via_frame, to_frame, max_radius):
        in_line = Line(from_frame.point, via_frame.point)
        out_line = Line(via_frame.point, to_frame.point)
        r = min(max_radius, in_line.length/2, out_line.length/2)
        return r



# nodes
max_r = 0.1
frames = []

for plane in fab_planes:
    
    plane_dec = gh.DeconstructPlane(plane)
    
    p_orig = plane_dec[0]
    p_x = plane_dec[2]
    
    p_y = plane_dec[1]
    if p_y[0] < 0: p_y = -p_y
    
    p_z = plane_dec[3]
    
    
    frame = Frame([p_orig[0], p_orig[1], p_orig[2]], [p_x[0], p_x[1], p_x[2]], [p_y[0], p_y[1], p_y[2]])
    frames.append(frame)

nodes = []
for i,frame in enumerate(frames):
    r = _radius_between_frames(frames[max(0,i-1)], frame, frames[min(i+1, len(frames)-1)], max_r)
    nodes.append(Node(frame, radius=r))



# Create the print_layer: 
def partition(lst, size):
    for i in range(0, len(lst), size):
        yield lst[i : i+size]

nodes_layer = []
numb_old = 0

for i in range(len(planes_layer)):
    
    if i == 0: nodes_layer.append(nodes[0:planes_layer[i]])
    else: nodes_layer.append(nodes[numb_old:numb_old+planes_layer[i]])
    
    numb_old += planes_layer[i]


layer = []
for i in range(len(planes_layer)):
    layer_loc = Layer.from_nodes(nodes_layer[i])
    layer.append(layer_loc)



# Create AM Model: 
am_model = AMModel()

for i in range(len(layer)):
    layer_new = layer[i]
    am_model.add_layer(layer_new)



# Create Planes:

planes = []
for l, layer in am_model.layers():
    for k, node in layer.nodes():
        planes.append(draw_frame(node.frame))



# Z_Movement:

import Rhino.Geometry as rg
planes = []
frame = []
frames_transformed = []
for l, layer in am_model.layers():
    for k, node in layer.nodes():
        planes.append(draw_frame(node.frame))
if transform:
    for plane in planes:
        plane.Translate(rg.Vector3d.ZAxis*t_value)
# ---------- end layer_def_6 ----------

# ----
# Var. 3 - AM Model - Part C
layer_def_7 = GhPythonScript(fab_planes=fab_planes_4.fab_planes_c, planes_layer=fab_planes_4.planes_layer_c, transform=transform_3, t_value=t_value_3)  # -> out, layer, am_model, planes; inputs fab_planes: list of Plane, planes_layer: list of Int32, transform: Boolean; disabled
# ---------- layer_def_7: Python ----------
import ghpythonlib.components as gh
import os
import sys
import json

from compas.geometry import Frame
from compas.geometry import Line
from compas.geometry import Vector
from compas_ghpython import draw_frame

from am_information_model.model import Node
from am_information_model.model import Layer
from am_information_model.model import AMModel


def _radius_between_frames(from_frame, via_frame, to_frame, max_radius):
        in_line = Line(from_frame.point, via_frame.point)
        out_line = Line(via_frame.point, to_frame.point)
        r = min(max_radius, in_line.length/2, out_line.length/2)
        return r



# nodes
max_r = 0.1
frames = []

for plane in fab_planes:
    
    plane_dec = gh.DeconstructPlane(plane)
    
    p_orig = plane_dec[0]
    p_x = plane_dec[2]
    p_y = -plane_dec[1]
    p_z = plane_dec[3]
    
    
    frame = Frame([p_orig[0], p_orig[1], p_orig[2]], [p_x[0], p_x[1], p_x[2]], [p_y[0], p_y[1], p_y[2]])
    frames.append(frame)

nodes = []
for i,frame in enumerate(frames):
    r = _radius_between_frames(frames[max(0,i-1)], frame, frames[min(i+1, len(frames)-1)], max_r)
    nodes.append(Node(frame, radius=r))



# Create the print_layer: 
def partition(lst, size):
    for i in range(0, len(lst), size):
        yield lst[i : i+size]

nodes_layer = []
numb_old = 0

for i in range(len(planes_layer)):
    
    if i == 0: nodes_layer.append(nodes[0:planes_layer[i]])
    else: nodes_layer.append(nodes[numb_old:numb_old+planes_layer[i]])
    
    numb_old += planes_layer[i]


layer = []
for i in range(len(planes_layer)):
    layer_loc = Layer.from_nodes(nodes_layer[i])
    layer.append(layer_loc)



# Create AM Model: 
am_model = AMModel()

for i in range(len(layer)):
    layer_new = layer[i]
    am_model.add_layer(layer_new)



# Create Planes:

planes = []
for l, layer in am_model.layers():
    for k, node in layer.nodes():
        planes.append(draw_frame(node.frame))



# Z_Movement:

import Rhino.Geometry as rg
planes = []
frame = []
frames_transformed = []
for l, layer in am_model.layers():
    for k, node in layer.nodes():
        planes.append(draw_frame(node.frame))
if transform:
    for plane in planes:
        plane.Translate(rg.Vector3d.ZAxis*t_value)
# ---------- end layer_def_7 ----------

# ----
# Var. 4 - AM Model - Part B
layer_def_8 = GhPythonScript(fab_planes=fab_planes_5.fab_planes_b, planes_layer=fab_planes_5.planes_layer_b, transform=transform_4, t_value=t_value_4)  # -> out, layer, am_model, planes; inputs fab_planes: list of Plane, planes_layer: list of Int32, transform: Boolean; disabled
# ---------- layer_def_8: Python ----------
import ghpythonlib.components as gh
import os
import sys
import json

from compas.geometry import Frame
from compas.geometry import Line
from compas.geometry import Vector
from compas_ghpython import draw_frame

from am_information_model.model import Node
from am_information_model.model import Layer
from am_information_model.model import AMModel


def _radius_between_frames(from_frame, via_frame, to_frame, max_radius):
        in_line = Line(from_frame.point, via_frame.point)
        out_line = Line(via_frame.point, to_frame.point)
        r = min(max_radius, in_line.length/2, out_line.length/2)
        return r




# nodes
max_r = 0.1
frames = []

for plane in fab_planes:
    
    plane_dec = gh.DeconstructPlane(plane)
    
    p_orig = plane_dec[0]
    p_x = plane_dec[2]
    
    p_y = plane_dec[1]
    if p_y[0] < 0: p_y = -p_y
    
    p_z = plane_dec[3]
    
    
    frame = Frame([p_orig[0], p_orig[1], p_orig[2]], [p_x[0], p_x[1], p_x[2]], [p_y[0], p_y[1], p_y[2]])
    frames.append(frame)

nodes = []
for i,frame in enumerate(frames):
    r = _radius_between_frames(frames[max(0,i-1)], frame, frames[min(i+1, len(frames)-1)], max_r)
    nodes.append(Node(frame, radius=r))



# Create the print_layer: 
def partition(lst, size):
    for i in range(0, len(lst), size):
        yield lst[i : i+size]

nodes_layer = []
numb_old = 0

for i in range(len(planes_layer)):
    
    if i == 0: nodes_layer.append(nodes[0:planes_layer[i]])
    else: nodes_layer.append(nodes[numb_old:numb_old+planes_layer[i]])
    
    numb_old += planes_layer[i]


layer = []
for i in range(len(planes_layer)):
    layer_loc = Layer.from_nodes(nodes_layer[i])
    layer.append(layer_loc)



# Create AM Model: 
am_model = AMModel()

for i in range(len(layer)):
    layer_new = layer[i]
    am_model.add_layer(layer_new)



# Create Planes:

planes = []
for l, layer in am_model.layers():
    for k, node in layer.nodes():
        planes.append(draw_frame(node.frame))



# Z_Movement:

import Rhino.Geometry as rg
planes = []
frame = []
frames_transformed = []
for l, layer in am_model.layers():
    for k, node in layer.nodes():
        planes.append(draw_frame(node.frame))
if transform:
    for plane in planes:
        plane.Translate(rg.Vector3d.ZAxis*t_value)
# ---------- end layer_def_8 ----------

# ----
# Var. 4 - AM Model - Part C
layer_def_9 = GhPythonScript(fab_planes=fab_planes_5.fab_planes_c, planes_layer=fab_planes_5.planes_layer_c, transform=transform_4, t_value=t_value_4)  # -> out, layer, am_model, planes; inputs fab_planes: list of Plane, planes_layer: list of Int32, transform: Boolean; disabled; same code as layer_def_7

plane = Plane(layer_def.planes)  # disabled
plane_2 = Plane(layer_def_2.planes)  # disabled
plane_3 = Plane(layer_def_3.planes)  # disabled
plane_4 = Plane(layer_def_6.planes)  # disabled
plane_5 = Plane(layer_def_7.planes)  # disabled
plane_6 = Plane(layer_def_4.planes)  # disabled
plane_7 = Plane(layer_def_8.planes)  # disabled
plane_8 = Plane(layer_def_9.planes)  # disabled
plane_9 = Plane(layer_def_5.planes)  # disabled
