# Grasshopper definition Code_Kappendecke_2.0_set_2_var_5.ghx (Grasshopper 1.0.7)
# Copyright: Felswind
# plug-ins: CEM_Build_Topology, CEM_Trail, CEM_Load, CEM_Deviation, CEM_Support, CEM_Extract_Topology, CEM_Calculate_Structure, CEM_Extract_Structure, CEM_Origin_Node

layer_numb = Slider(10, range=1..100)
layer_depth = Slider(0.1, range=0.001..1)
arch_res = Slider(11, range=1..101)
tilt_angle_layer = Slider(45, range=0..90)
tilt_angle_main = Slider(10, range=0..90)
deviaton_arch_mag = Slider(-8, range=-100..0)
trail_length = Slider(-0.05, range=-50..0)

layer_numb_2 = Slider(26, range=2..100)
dev_mag = Slider(-0.001, range=-10..10)
trail_length_max = Slider(-0.015, range=-0.5..0.5)
trail_length_min = Slider(-0.005, range=-10..10.01)

# ----
# Part A - Topology
main_topology_main_tilted = GhPythonScript(
    layer_numb=layer_numb,
    layer_depth=layer_depth,
    arch_res=arch_res,
    tilt_angle_layer=tilt_angle_layer,
    tilt_angle_main=tilt_angle_main,
    deviaton_arch_mag=deviaton_arch_mag,
    trail_length=trail_length)  # -> trail, trail_lengths, port, self_weight_pts, self_weight, port_2, external_force_pts, force_external_x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; inputs layer_numb: Int32, arch_res: Int32, tilt_angle_layer: Int32, tilt_angle_main: Int32
# ---------- main_topology_main_tilted: Python ----------
import ghpythonlib.components as gh
import math



#############################################################################
## Define Intersection Function
#############################################################################


def vector_intersect(res_vec, glob_dev_vec, glob_trail_vec):
    
    # Create endpoints: 
    start = gh.ConstructPoint(0,0,0)
    end_plan = gh.ConstructPoint(res_vec[0], 0, res_vec[2])
    end = res_vec
    
    
    # Create planar intersection: 
    line_a = gh.LineSDL(start, glob_dev_vec, 10)
    line_b_plan = gh.LineSDL(end_plan, glob_trail_vec, 10)
    
    intersection_point = gh.LineXLine(line_a, line_b_plan)[2]
    
    
    # Generate Lines: 
    deviation = gh.Vector2Pt(start, intersection_point, False)[0]
    trail = gh.Vector2Pt(end, intersection_point, False)[0]
    
    
    return(deviation, trail)



#############################################################################
## Create Main Inputs: 
#############################################################################

glob_trail_vec = gh.VectorXYZ(1, 0, -math.tan(math.radians(tilt_angle_layer)))[0]
glob_deviation_vec = gh.VectorXYZ(-1, 0, -math.tan(math.radians(tilt_angle_main)))[0]

self_weight = -2
force_external = -5

vec_self = gh.VectorXYZ(0,0,self_weight)[0]
vec_external = gh.Amplitude(glob_deviation_vec, -force_external)
deviaton_arch_mag = gh.VectorXYZ(0,deviaton_arch_mag,0)[0]

force_external_x = gh.DeconstructVector(vec_external)[0]
force_external_z = gh.DeconstructVector(vec_external)[2]



#############################################################################
## Create Deviation Magnitudes: 
#############################################################################

deviation_vec = []

for i in range(layer_numb):
    for k in range(arch_res):
        
        if i == 0 and k == 0: vec_loc = vec_self + vec_external + deviaton_arch_mag
        elif i == 0 and k >= 1: vec_loc = vec_self + trail_loc
        elif i >= 1 and k == 0: vec_loc = vec_self + deviaton_arch_mag + deviation_vec[((i-1)*arch_res)+k]
        else: vec_loc = vec_self + trail_loc + deviation_vec[((i-1)*arch_res)+k]
        
        vec_trail_dev = vector_intersect(vec_loc, glob_deviation_vec, glob_trail_vec)
        
        trail_loc = vec_trail_dev[1]
        deviation_loc = vec_trail_dev[0]
        
        deviation_vec.append(deviation_loc)



# Create Output: 
deviation_mag = []
force_anchor_x = []
force_anchor_y = []
force_anchor_z = []

for i in range(len(deviation_vec)):
    if i < arch_res*(layer_numb-1): deviation_mag.append(gh.VectorLength(-deviation_vec[i]))
    else:
        vec_loc = deviation_vec[i]
        force_anchor_x.append(-vec_loc[0])
        force_anchor_y.append(-vec_loc[1])
        force_anchor_z.append(-vec_loc[2])



#############################################################################
## Topology: 
#############################################################################

trail = []
deviation = []
anchor_points = []

self_weight_pts = []
external_force_pts = []
sim_anchor_forces = []

dist_x = math.cos(math.radians(tilt_angle_main)) * layer_depth
for i in range(layer_numb):
    line = gh.Line(gh.ConstructPoint(-i*dist_x,-trail_length*2*arch_res/2,0), gh.ConstructPoint(-i*dist_x,trail_length*2*arch_res/2,0))
    
    div = gh.DivideCurve(line, arch_res*2-1, False)
    
    
    # Geometry: 
    explode = gh.Shatter(line, div[2])
    deviation.append(explode[arch_res-1])
    del explode[arch_res-1]
    trail.extend(explode)
    
    if i != 0:
        for k in range(len(div[0])): deviation.append(gh.Line(div[0][k], pts_prev[k]))
    pts_prev = div[0]
    
    
    # Force Points: 
    self_weight_pts.extend(div[0])
    anchor_points.extend(gh.EndPoints(line))
    if i == 0: external_force_pts.extend([div[0][arch_res-1], div[0][arch_res]])
    if i == layer_numb-1:  sim_anchor_forces.extend(div[0])




#############################################################################
## Create Lengths and Magnitudes: 
#############################################################################

trail_lengths = []
for i in range(len(trail)): trail_lengths.append(trail_length)

force_anchor_x.reverse()
force_anchor_y.reverse()
force_anchor_z.reverse()

force_anchor_x.extend(force_anchor_x[::-1])
force_anchor_y.extend(force_anchor_y[::-1])
force_anchor_z.extend(force_anchor_z[::-1])


deviation_magnitude = []
deviation_mag = [deviation_mag[i:i + arch_res] for i in xrange(0, len(deviation_mag), arch_res)]
deviation_magnitude.append(deviaton_arch_mag[1])

for i in range(len(deviation_mag)):
    deviation_magnitude.append(deviaton_arch_mag[1])
    list_loc = deviation_mag[i]
    list_loc.reverse()
    
    deviation_magnitude.extend(list_loc)
    deviation_magnitude.extend(list_loc[::-1])

for i in range(len(deviation_magnitude)):
    if deviation_magnitude[i] > 0: deviation_magnitude[i] *= -1
# ---------- end main_topology_main_tilted ----------
cem_deviation = CEM_Deviation(
    DeviationEdge=graft(main_topology_main_tilted.deviation),
    DeviationMagn=graft(main_topology_main_tilted.deviation_magnitude))
cem_load = CEM_Load(
    PointLoad=graft(main_topology_main_tilted.sim_anchor_forces),
    LoadMagnX=graft(main_topology_main_tilted.force_anchor_x),
    LoadMagnZ=graft(main_topology_main_tilted.force_anchor_z))
cem_trail = CEM_Trail(TrailEdge=graft(main_topology_main_tilted.trail), TrailLen=graft(main_topology_main_tilted.trail_lengths))
cem_load_2 = CEM_Load(PointLoad=main_topology_main_tilted.self_weight_pts, LoadMagnZ=main_topology_main_tilted.self_weight)
cem_load_3 = CEM_Load(
    PointLoad=main_topology_main_tilted.external_force_pts,
    LoadMagnX=main_topology_main_tilted.force_external_x,
    LoadMagnZ=main_topology_main_tilted.force_external_z)
cem_support = CEM_Support(Support=main_topology_main_tilted.anchor_points)
cem_build_topology = CEM_Build_Topology(T=flatten(cem_trail), L=flatten([cem_load_2, cem_load_3, cem_load]), D=flatten(cem_deviation), S=flatten(cem_support))

# ----
# Part B - Structure
cem_extract_topology = CEM_Extract_Topology(TP=cem_build_topology)  # -> Nodes, NodesID, Edges, EdgesID, ConstraintPlane, ConstraintPlaneID, OriginNode, OriginNodeID
origin_nodes = GhPythonScript(
    nodes=cem_extract_topology.OriginNode,
    indices=cem_extract_topology.OriginNodeID,
    layer_depth=layer_depth,
    tilt_angle_main=tilt_angle_main)  # -> origin_new; inputs nodes: list of Vector3d, indices: list of Int32, tilt_angle_main: Int32
# ---------- origin_nodes: Python ----------
import ghpythonlib.components as gh
import math



## Sort the points and move them: 
x_value = gh.Absolute(gh.Deconstruct(nodes)[0])
sorted = gh.SortList(x_value, nodes)[1]
sorted_ind = gh.SortList(x_value, indices)[1]

sorted = [sorted[i:i + 2] for i in xrange(0, len(sorted), 2)]

z_move = -math.sin(math.radians(tilt_angle_main)) * layer_depth 

points_moved = []
for i in range(len(sorted)): points_moved.extend(gh.Move(sorted[i], gh.UnitZ(z_move*i+0.25))[0])


## Resort origin:
origin_new = []

for i in range(len(indices)):
    for k in range(len(sorted_ind)):
        if indices[i] == sorted_ind[k]:
            origin_new.append(points_moved[k])
# ---------- end origin_nodes ----------
cem_origin_node = CEM_Origin_Node(OriginNode=origin_nodes, OriginNodeID=cem_extract_topology.OriginNodeID)
cem_calculate_structure = CEM_Calculate_Structure(TP=cem_build_topology, N=cem_origin_node)

# ----
# Part C - Preview
cem_extract_structure = CEM_Extract_Structure(M=cem_calculate_structure)  # -> Nodes, NodesID, Trails, TrailsID, TrailsCol, TrailsMag, Deviations, DeviationsID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
merge = Merge(Data1=cem_extract_structure.Trails, Data2=cem_extract_structure.Deviations)
merge_2 = Merge(Data1=cem_extract_structure.TrailsMag, Data2=cem_extract_structure.DeviationsMag)
colour = GhPythonScript(mag=merge_2)  # -> out; inputs mag: list
# ---------- colour: Python ----------
for magnitude in mag:
    
    if magnitude > 0: print(255, 0, 0)
    else: print(0, 0, 255)
# ---------- end colour ----------
custom_preview = CustomPreview(Geometry=merge, Material=colour)

# ----
# Part A - Topology
create_topology_start = GhPythonScript(
    arch_res=arch_res,
    layer_numb=layer_numb_2,
    self_weight=main_topology_main_tilted.self_weight,
    external_load_x=main_topology_main_tilted.force_anchor_x,
    external_load_z=main_topology_main_tilted.force_anchor_z,
    pts=cem_extract_structure.Nodes,
    pts_ind=cem_extract_structure.NodesID,
    dev_mag=dev_mag,
    trail_length_max=trail_length_max,
    trail_length_min=trail_length_min)  # -> trail, trail_length, port, load_points, load_magnitude, load_points_external, load_magnitude_external_x, load_magnitude_external_z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; inputs arch_res: Int32, layer_numb: Int32, self_weight: list, external_load_x: list, external_load_z: list, pts: list of Point3d, pts_ind: list of Int32
# ---------- create_topology_start: Python ----------
import ghpythonlib.components as gh



################################################################################
## Create the main Curves: 
arch_res = arch_res*2-1


# Create the trail elements:
lines_trail = []
for i in range(arch_res+1): lines_trail.append(gh.Line(gh.ConstructPoint(0,i*0.1,0), gh.ConstructPoint(-1,i*0.1,0)))

trail = []
for line in lines_trail:
    div = gh.DivideCurve(line, layer_numb, False)
    div_curve = gh.Shatter(line, div[2])
    trail.extend(div_curve)


# Create the deviaiton elements:
deviation = []
for i in range(layer_numb+1):
    dev_loc = []
    for k in range(len(lines_trail)):
        div = gh.DivideCurve(lines_trail[k], layer_numb, False)[0]
        dev_loc.append(div[i])
    
    deviaiton_line = gh.PolyLine(dev_loc, False)
    deviation.extend(gh.Explode(deviaiton_line, True)[0])



################################################################################
## Create the anchor_points: 

support = []
for line in lines_trail: support.append(gh.EndPoints(line)[1])



################################################################################
## Create load points and magnitudes:

# External loads: 
load_points_external = []
load_magnitude_external_x = []
load_magnitude_external_z = []

for i, line in enumerate(lines_trail): 
    load_points_external.append(gh.EndPoints(line)[0])
    load_magnitude_external_x.append(-external_load_x[0])
    load_magnitude_external_z.append(-external_load_z[0])


# Loads due Selfweight: 
load_points = []
load_magnitude = []

for line in lines_trail:
    div = gh.DivideCurve(line, layer_numb, False)[0]
    load_points.extend(div)

for point in load_points: load_magnitude.append(self_weight[0])



################################################################################
## Create deviation magnitudes:

deviation_mag = []
for dev in deviation: deviation_mag.append(dev_mag)



################################################################################
## Create trail lengths:


# Pick the anchor nodes from the previos step: 

point_indices = []
for i in range(int(arch_res+1)): point_indices.append(i)

points_anchor = []
for i in range(len(point_indices)):
    for k in range(len(pts_ind)):
        if point_indices[i] == pts_ind[k]: points_anchor.append(pts[k])

points_anchor = points_anchor[:int(len(points_anchor)/2)]


# Calculate the trail length based on the distance:

points_anchor_flat = []
for point in points_anchor: points_anchor_flat.append(gh.ConstructPoint(point[0], 0, point[2]))

length_total = 0
for i in range(len(points_anchor_flat)-1): length_total+= gh.Length(gh.Line(points_anchor_flat[i], points_anchor_flat[i+1]))

length_loc = []
for i in range(len(points_anchor_flat)-1): length_loc.append(gh.Length(gh.Line(points_anchor_flat[-1], points_anchor_flat[i])))

trail_length_a = []
for i in range(len(length_loc)):
    tail_diff_loc = (length_loc[i] * (trail_length_max - trail_length_min))/length_total
    trail_length_loc = trail_length_max - tail_diff_loc
    trail_length_a.append(trail_length_loc)
trail_length_a.append(trail_length_max)


# Create trail_lenghts: 

trail_length_single = []
trail_length_single.extend(trail_length_a)
trail_length_a.reverse()
trail_length_single.extend(trail_length_a)

trail_length = []
for i in range(len(trail_length_single)):
    for k in range(layer_numb):
        trail_length.append(trail_length_single[i])
# ---------- end create_topology_start ----------
cem_deviation_2 = CEM_Deviation(DeviationEdge=graft(create_topology_start.deviation), DeviationMagn=graft(create_topology_start.deviation_mag))
cem_load_4 = CEM_Load(PointLoad=graft(create_topology_start.load_points), LoadMagnZ=graft(create_topology_start.load_magnitude))
cem_load_5 = CEM_Load(
    PointLoad=graft(create_topology_start.load_points_external),
    LoadMagnX=graft(create_topology_start.load_magnitude_external_x),
    LoadMagnZ=graft(create_topology_start.load_magnitude_external_z))
cem_trail_2 = CEM_Trail(TrailEdge=graft(create_topology_start.trail), TrailLen=graft(create_topology_start.trail_length))
cem_support_2 = CEM_Support(Support=create_topology_start.support)
cem_build_topology_2 = CEM_Build_Topology(T=flatten(cem_trail_2), L=flatten([cem_load_4, cem_load_5]), D=flatten(cem_deviation_2), S=flatten(cem_support_2))

type = ValueList({"Single_layered": 1, "double layered": 2}, selected="double layered")
toolpath_depth = Slider(0.03, range=0.001..1)
toolpath_height = Slider(0.015, range=0.001..1)
lateral_anchors = Brep([<brep referenced from the Rhino model> x3])

# ----
# Part B - Structure
cem_extract_topology_2 = CEM_Extract_Topology(TP=cem_build_topology_2)  # -> Nodes, NodesID, Edges, EdgesID, ConstraintPlane, ConstraintPlaneID, OriginNode, OriginNodeID

sort_and_select = GhPythonScript(
    ind_origin=cem_extract_topology_2.OriginNodeID,
    pts=cem_extract_structure.Nodes,
    pts_ind=cem_extract_structure.NodesID,
    arch_res=arch_res)  # -> origin_new; inputs ind_origin: list of Int32, pts: list of Point3d, pts_ind: list of Int32, arch_res: Int32
# ---------- sort_and_select: Python ----------
import ghpythonlib.components as gh



################################################################################
## Pick the anchor nodes from the previos step: 

arch_res = arch_res*2

point_indices = []
for i in range(int(arch_res+1)): point_indices.append((len(pts)-1)-i)

points_anchor = []
for i in range(len(point_indices)):
    for k in range(len(pts_ind)):
        if point_indices[i] == pts_ind[k]: points_anchor.append(pts[k])



################################################################################
## Sort the origin nodes and output the anchor nodes based on the same index: 

ind_origin_sorted = ind_origin[::]
ind_origin_sorted.sort()

origin_new = []

for i in range(len(ind_origin)):
    for k in range(len(ind_origin_sorted)):
        if ind_origin[i] == ind_origin_sorted[k]: origin_new.append(points_anchor[k])



################################################################################
# ---------- end sort_and_select ----------

cem_origin_node_2 = CEM_Origin_Node(OriginNode=sort_and_select, OriginNodeID=cem_extract_topology_2.OriginNode)
cem_calculate_structure_2 = CEM_Calculate_Structure(TP=cem_build_topology_2, N=cem_origin_node_2)

# ----
# Part C - Preview
cem_extract_structure_2 = CEM_Extract_Structure(M=cem_calculate_structure_2)  # -> Nodes, NodesID, Trails, TrailsID, TrailsCol, TrailsMag, Deviations, DeviationsID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
merge_3 = Merge(Data1=cem_extract_structure_2.Trails, Data2=cem_extract_structure_2.Deviations)
merge_4 = Merge(Data1=cem_extract_structure_2.TrailsMag, Data2=cem_extract_structure_2.DeviationsMag)
colour_2 = GhPythonScript(mag=merge_4)  # -> out; inputs mag: list; same code as colour
custom_preview_2 = CustomPreview(Geometry=merge_3, Material=colour_2)

# ----
# Part D - Export
generate_toolpath = GhPythonScript(
    lines=merge,
    layer_depth=layer_depth,
    lines_closing=cem_extract_structure_2.Deviations,
    type=type,
    toolpath_depth=toolpath_depth,
    toolpath_height=toolpath_height,
    lateral_anchors=lateral_anchors)  # -> toolpath_final; inputs lines: list of Curve, lines_closing: list of Curve, type: Int32, lateral_anchors: list of Brep
# ---------- generate_toolpath: Python ----------
import ghpythonlib.components as gh



#############################################################################################
## Define Layering Functions
#############################################################################################

## Close toolpath with one layer: 
def close_toolpath(curves, non_flip = 'none', cutting_volume= 'none'):
    toolpath_flipped = []
    lines = []
    
    if cutting_volume != 'none': curves = gh.TrimwithBreps(curves, cutting_volume)[1]
    
    if non_flip != 'none': toolpath_flipped = curves
    else:
        for i, crv in enumerate(curves):
            if i % 2 == 0:
                toolpath_flipped.append(gh.FlipCurve(crv)[0])
            else:
                toolpath_flipped.append(crv)
    
    for i in range(int(len(toolpath_flipped)-1)): lines.append(gh.Line(gh.EndPoints(toolpath_flipped[i])[0], gh.EndPoints(toolpath_flipped[i+1])[1]))
    
    toolpath_final = []
    
    toolpath_final.extend(toolpath_flipped)
    toolpath_final.extend(lines)
    
    
    toolpath_final = gh.JoinCurves(toolpath_final, False)
    return(toolpath_final, toolpath_flipped)



## Close toolpath with a double layered geometry:
def double_layered_closing(curves, layer_depth, recut, cutting_volume= 'none'):
    curves_offset = []
    
    
    if recut == False: 
        for crv in curves:
            curves_offset.append(gh.OffsetCurve(crv, layer_depth, gh.XYPlane(gh.ConstructPoint(0,0,0)), 1))
    
    
    if recut == True:
        for crv in curves:
            plane = gh.Planar(crv)[1]
            offset = gh.ExtendCurve(gh.OffsetCurve(crv, layer_depth, plane, 1), 2, 0.05, 0.05)
            
            bound = gh.Extrude(gh.BoundarySurfaces(gh.Rectangle(gh.XYPlane(gh.ConstructPoint(0,0,0)), gh.ConstructDomain(-10,10), gh.ConstructDomain(-10,10),0)[0]), gh.UnitZ(-10))
            cut = gh.TrimwithBrep(offset, bound)[1]
            
            curves_offset.append(cut)
    
    
    
    ## Cut the Curves by the lateral supports: 
    if cutting_volume != 'none': curves = gh.TrimwithBreps(curves, cutting_volume)[1]
    if cutting_volume != 'none': curves_offset = gh.TrimwithBreps(curves_offset, cutting_volume)[1]
    
    
    
    ## Close one side: 
    lines_close = []
    for i, crv in enumerate(curves): lines_close.append(gh.Line(gh.EndPoints(crv)[0], gh.EndPoints(curves_offset[i])[0]))
    
    
    
    ## Join the curves: 
    joined = []
    for i, crv in enumerate(curves): joined.append(gh.JoinCurves([lines_close[i], curves[i], curves_offset[i]], False))
    
    
    
    ## Create the fab export: 
    curves_single = []
    
    for i in range(len(curves)):
        curves_single.append(curves_offset[i])
        curves_single.append(curves[i])
    
    
    return(joined, curves_single)



#############################################################################################
## Main Part
#############################################################################################

## Filter out the print_path_elements: 
line_filtered = []
for ln in lines:
    if gh.Length(ln) < layer_depth*0.95: line_filtered.append(ln)



## Join, rebuild and interpolates the curves:
joined = gh.JoinCurves(line_filtered, False)
rebuilt = gh.RebuildCurve(joined, 2, 25, False)
flipped = gh.FlipCurve(rebuilt, rebuilt[0])[0]
sorted = gh.SortList(gh.Deconstruct(gh.CurveMiddle(flipped))[0], flipped)[1]

steps = []
interpolate = int(layer_depth/toolpath_height)

toolpath = []

for i in range(interpolate): steps.append(i/interpolate)
for i in range(int(len(joined)-1)): toolpath.extend(gh.TweenCurve(sorted[i], sorted[i+1], steps))

toolpath_a = gh.Move(toolpath, gh.UnitZ(-0.005-gh.EndPoints(toolpath[-1])[0][2]))[0]


# Cut toolpath: 

toolpath_loc = []
for i in range(len(toolpath_a)):
    plane_loc = gh.XYPlane(gh.ConstructPoint(0,0,0))
    int_loc = gh.CurveXPlane(toolpath_a[i], plane_loc)[1]
    shatter_loc = gh.Shatter(toolpath_a[i], int_loc)[1]
    toolpath_loc.append(shatter_loc)

toolpath_a = toolpath_loc



## Build toolpath:
toolpath_single_curves = []

if type == 1:
    toolpath_a = close_toolpath(toolpath_a, 'none', lateral_anchors)[0]

if type == 2:
    toolpath_a = gh.FlipCurve(toolpath_a)[0]
    toolpath_a = close_toolpath(double_layered_closing(toolpath_a, toolpath_depth, True, lateral_anchors)[0], True)[0]



#############################################################################################
## Closing Part
#############################################################################################

## Join, rebuild and interpolates the curves:
joined = gh.JoinCurves(lines_closing, False)
rebuilt = gh.RebuildCurve(joined, 2, 25, False)
flipped = gh.FlipCurve(rebuilt, rebuilt[0])[0]
sorted_closing = gh.SortList(gh.Deconstruct(gh.CurveMiddle(flipped))[0], flipped)[1]



## Move the curves down, flip and cut them: 

toolpath_closing = gh.Move(sorted_closing, gh.UnitZ(-0.005-gh.EndPoints(toolpath[-1])[0][2]))[0]
bound = gh.Extrude(gh.BoundarySurfaces(gh.Rectangle(gh.XYPlane(gh.ConstructPoint(0,0,0)), gh.ConstructDomain(-100,100), gh.ConstructDomain(-100,100),0)[0]), gh.UnitZ(-100))

toolpath_closing_cut = gh.TrimwithBrep(toolpath_closing, bound)[1]
toolpath_closing_cut = gh.Move(toolpath_closing_cut, gh.UnitX(-toolpath_height))[0]

flipped = []
for curve in toolpath_closing_cut: flipped.append(gh.FlipCurve(curve, toolpath_closing_cut[0])[0])



## Build toolpath:
toolpath_single_curves = []

if type == 1:
    flipped = gh.FlipCurve(flipped)[0]
    toolpath_b = close_toolpath(flipped, 'none', lateral_anchors)[0]

if type == 2:
    toolpath_single_curves.extend(close_toolpath(double_layered_closing(flipped[::-1], toolpath_depth, True)[1])[1])
    toolpath_b = close_toolpath(double_layered_closing(flipped, toolpath_depth, True, lateral_anchors)[0], True)[0]

toolpath_single_curves.reverse()



#############################################################################################
## Join both parts:
#############################################################################################

start = gh.EndPoints(toolpath_b)[0]
end = gh.EndPoints(toolpath_a)[1]

line_conn = gh.Line(start, end)
toolpath_final = gh.FlipCurve(gh.JoinCurves([toolpath_a, toolpath_b, line_conn], False))[0]

toolpath_final = gh.Move(toolpath_final, gh.UnitZ(toolpath_height))[0]
# ---------- end generate_toolpath ----------
