# Grasshopper definition Code_Kappendecke_2.0_set_2_var_3.ghx (Grasshopper 1.0.7)
# Copyright: Felswind
# plug-ins: CEM_Build_Topology, CEM_Deviation, CEM_Extract_Topology, CEM_Support, CEM_Trail, CEM_Calculate_Structure, CEM_Origin_Node, CEM_Extract_Structure, CEM_Load

layer_numb = Slider(4, range=1..100)
layer_depth = Slider(0.11, range=0.001..1)
arch_res = Slider(31, range=1..101)
tilt_angle = Slider(45, range=0..90)
dev_mag_arch = Slider(-12, range=-100..0)
trail_length = Slider(-0.025, range=-50..0)

layer_numb_2 = Slider(26, range=2..100)
dev_mag = Slider(-0.001, range=-10..10)
trail_length_max = Slider(-0.015, range=-0.5..0.5)
trail_length_min = Slider(-0.01, range=-10..10.01)

# ----
# Part A - Topology
create_topology_main = GhPythonScript(
    layer_numb=layer_numb,
    layer_depth=layer_depth,
    arch_res=arch_res,
    tilt_angle=tilt_angle,
    deviaton_arch_mag=dev_mag_arch,
    trail_length=trail_length)  # -> trail, trail_lengths, self_weight_point, self_weight_mag, external_load_point, external_load_mag, deviation, deviation_mag, anchor_points; inputs layer_numb: Int32, arch_res: Int32, tilt_angle: Int32
# ---------- create_topology_main: Python ----------
import ghpythonlib.components as gh
import math



####################################
## Define Curve Function: 
####################################



def arch_curve_topology(depth, x_pos, arch_res, layer_depth):
    
    
    ## Output parameters:
    anchor_points = []
    deviation_arch = []
    deviation_ring = []
    trail = []
    load_point = []
    
    
    ## Create the base curve and divide it: 
    base_line = gh.Line(gh.ConstructPoint(x_pos, -depth/2, 0), gh.ConstructPoint(x_pos, depth/2, 0))
    div = gh.DivideCurve(base_line, arch_res, False)
    explode = gh.Shatter(base_line, div[2])
    
    
    ## Create the Points for the Self_weight: 
    load_point.extend(div[0])
    
    
    ## Create the anchor points: 
    anchor_points.extend((div[0][0], div[0][-1]))
    
    
    ## Create the deviation / trail elements for the main arch: 
    for i, curve in enumerate(explode):
        if i == int(arch_res/2): deviation_arch.append(curve)
        else: trail.append(curve)
    
    
    ## Create the connecting (ring) deviation elements: 
    if x_pos > 0:
        pts_moved = gh.Move(div[0], gh.UnitX(-layer_depth))[0]
        line_dev = gh.Line(div[0], pts_moved)
        
        for curve in line_dev: deviation_ring.append(curve)
    
    
    ## Return the final geometry: 
    return(anchor_points, deviation_arch, deviation_ring, trail, load_point)



####################################
## Run the Curve Function: 
####################################



## Output Topology:
anchor_points = []
deviation = []
deviation_mag = []
trail = []
trail_lengths = []


## Output forces: 
self_weight_point = []
self_weight_mag = []
external_load_point = []
external_load_mag = []


## Create the Output elements:
tilt_angle = 90 - tilt_angle

for i in range(layer_numb):
    
    curve = arch_curve_topology(0.5, i*layer_depth, arch_res, layer_depth)
    
    
    ## Anchor points: 
    anchor_points.extend(curve[0])
    
    
    ## Create the points for the forces:
    self_weight_point.extend(curve[4])
    if i == 0: external_load_point.extend(curve[4])
    
    
    ## Create a Parapolic shape: 
    
    self_weight = -2
    for pt in curve[4]: self_weight_mag.append(self_weight)
    
    external_load = (layer_numb * -self_weight) / math.tan(math.radians(tilt_angle))
    if i == 0:
       for pt in external_load_point: external_load_mag.append(external_load)
    
    
    ## Deviation Elemements and magnitude:
    deviation.extend(curve[1])
    for crv in curve[1]: deviation_mag.append(deviaton_arch_mag)
    
    deviation.extend(curve[2])
    
    for crv in curve[2]: deviation_mag.append((-external_load / layer_numb) * (layer_numb - i))
    
    
    ## Trail elements and lengths: 
    trail.extend(curve[3])
    for crv in curve[3]: trail_lengths.append(trail_length)
# ---------- end create_topology_main ----------
cem_deviation = CEM_Deviation(DeviationEdge=graft(create_topology_main.deviation), DeviationMagn=graft(create_topology_main.deviation_mag))
cem_load = CEM_Load(PointLoad=graft(create_topology_main.self_weight_point), LoadMagnZ=graft(create_topology_main.self_weight_mag))
cem_load_2 = CEM_Load(PointLoad=graft(create_topology_main.external_load_point), LoadMagnX=graft(create_topology_main.external_load_mag))
cem_trail = CEM_Trail(TrailEdge=graft(create_topology_main.trail), TrailLen=graft(create_topology_main.trail_lengths))
cem_support = CEM_Support(Support=create_topology_main.anchor_points)
cem_build_topology = CEM_Build_Topology(T=flatten(cem_trail), L=flatten([cem_load, cem_load_2]), D=flatten(cem_deviation), S=flatten(cem_support))

# ----
# Part B - Structure
cem_extract_topology = CEM_Extract_Topology(TP=cem_build_topology)  # -> Nodes, NodesID, Edges, EdgesID, ConstraintPlane, ConstraintPlaneID, OriginNode, OriginNodeID
height = Slider(0.25, range=0..0.75)
unit_z = UnitZ(Factor=height)
move = Move(Geometry=cem_extract_topology.OriginNode, Motion=unit_z)  # -> Geometry, Transform
cem_origin_node = CEM_Origin_Node(OriginNode=move.Geometry, OriginNodeID=cem_extract_topology.OriginNodeID)
cem_calculate_structure = CEM_Calculate_Structure(TP=cem_build_topology, N=cem_origin_node)

# ----
# Part C - Preview
cem_extract_structure = CEM_Extract_Structure(M=cem_calculate_structure)  # -> Nodes, NodesID, Trails, TrailsID, TrailsCol, TrailsMag, Deviations, DeviationsID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
merge = Merge(Data1=cem_extract_structure.Trails, Data2=cem_extract_structure.Deviations)
merge_2 = Merge(Data1=cem_extract_structure.TrailsMag, Data2=cem_extract_structure.DeviationsMag)
colour = GhPythonScript(mag=merge_2)  # -> out; inputs mag: list
# ---------- colour: Python ----------
for magnitude in mag:
    
    if magnitude > 0: print(255, 0, 0)
    else: print(0, 0, 255)
# ---------- end colour ----------
custom_preview = CustomPreview(Geometry=merge, Material=colour)

# ----
# Part A - Topology
create_topology_start = GhPythonScript(
    arch_res=arch_res,
    layer_numb=layer_numb_2,
    self_weight=create_topology_main.self_weight_mag,
    external_load=create_topology_main.external_load_mag,
    pts=cem_extract_structure.Nodes,
    pts_ind=cem_extract_structure.NodesID,
    dev_mag=dev_mag,
    trail_length_max=trail_length_max,
    trail_length_min=trail_length_min)  # -> trail, trail_length, port, load_points, load_magnitude, load_points_external, load_magnitude_external, port_2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; inputs arch_res: Int32, layer_numb: Int32, self_weight: list, external_load: list, pts: list of Point3d, pts_ind: list of Int32
# ---------- create_topology_start: Python ----------
import ghpythonlib.components as gh



################################################################################
## Create the main Curves: 


# Create the trail elements:
lines_trail = []
for i in range(arch_res+1): lines_trail.append(gh.Line(gh.ConstructPoint(0,i*0.1,0), gh.ConstructPoint(-1,i*0.1,0)))

trail = []
for line in lines_trail:
    div = gh.DivideCurve(line, layer_numb, False)
    div_curve = gh.Shatter(line, div[2])
    trail.extend(div_curve)


# Create the deviaiton elements:
deviation = []
for i in range(layer_numb+1):
    dev_loc = []
    for k in range(len(lines_trail)):
        div = gh.DivideCurve(lines_trail[k], layer_numb, False)[0]
        dev_loc.append(div[i])
    
    deviaiton_line = gh.PolyLine(dev_loc, False)
    deviation.extend(gh.Explode(deviaiton_line, True)[0])



################################################################################
## Create the anchor_points: 

support = []
for line in lines_trail: support.append(gh.EndPoints(line)[1])



################################################################################
## Create load points and magnitudes:

# External loads: 
load_points_external = []
load_magnitude_external = []

for line in lines_trail: 
    load_points_external.append(gh.EndPoints(line)[0])
    load_magnitude_external.append(-external_load[0])


# Loads due Selfweight: 
load_points = []
load_magnitude = []

for line in lines_trail:
    div = gh.DivideCurve(line, layer_numb, False)[0]
    load_points.extend(div)

for point in load_points: load_magnitude.append(self_weight[0])



################################################################################
## Create deviation magnitudes:

deviation_mag = []
for dev in deviation: deviation_mag.append(dev_mag)



################################################################################
## Create trail lengths:


# Pick the anchor nodes from the previos step: 

point_indices = []
for i in range(int(arch_res+1)): point_indices.append(i)

points_anchor = []
for i in range(len(point_indices)):
    for k in range(len(pts_ind)):
        if point_indices[i] == pts_ind[k]: points_anchor.append(pts[k])

points_anchor = points_anchor[:int(len(points_anchor)/2)]


# Calculate the trail length based on the distance:

points_anchor_flat = []
for point in points_anchor: points_anchor_flat.append(gh.ConstructPoint(point[0], 0, point[2]))

length_total = 0
for i in range(len(points_anchor_flat)-1): length_total+= gh.Length(gh.Line(points_anchor_flat[i], points_anchor_flat[i+1]))

length_loc = []
for i in range(len(points_anchor_flat)-1): length_loc.append(gh.Length(gh.Line(points_anchor_flat[-1], points_anchor_flat[i])))

trail_length_a = []
for i in range(len(length_loc)):
    tail_diff_loc = (length_loc[i] * (trail_length_max - trail_length_min))/length_total
    trail_length_loc = trail_length_max - tail_diff_loc
    trail_length_a.append(trail_length_loc)
trail_length_a.append(trail_length_max)


# Create trail_lenghts: 

trail_length_single = []
trail_length_single.extend(trail_length_a)
trail_length_a.reverse()
trail_length_single.extend(trail_length_a)

trail_length = []
for i in range(len(trail_length_single)):
    for k in range(layer_numb):
        trail_length.append(trail_length_single[i])
# ---------- end create_topology_start ----------
cem_deviation_2 = CEM_Deviation(DeviationEdge=graft(create_topology_start.deviation), DeviationMagn=graft(create_topology_start.deviation_mag))
cem_load_3 = CEM_Load(PointLoad=graft(create_topology_start.load_points), LoadMagnZ=graft(create_topology_start.load_magnitude))
cem_load_4 = CEM_Load(
    PointLoad=graft(create_topology_start.load_points_external),
    LoadMagnX=graft(create_topology_start.load_magnitude_external))
cem_trail_2 = CEM_Trail(TrailEdge=graft(create_topology_start.trail), TrailLen=graft(create_topology_start.trail_length))
cem_support_2 = CEM_Support(Support=create_topology_start.support)
cem_build_topology_2 = CEM_Build_Topology(T=flatten(cem_trail_2), L=flatten([cem_load_3, cem_load_4]), D=flatten(cem_deviation_2), S=flatten(cem_support_2))

type = ValueList({"Single_layered": 1, "double layered": 2}, selected="double layered")
toolpath_depth = Slider(0.03, range=0.001..1)
toolpath_height = Slider(0.015, range=0.001..1)
fillet_distance = Slider(0.088, range=0.001..1)
tilt_angle_2 = Slider(45, range=0..90)
lateral_anchors = Brep([<brep referenced from the Rhino model> x2])

# ----
# Part B - Structure
cem_extract_topology_2 = CEM_Extract_Topology(TP=cem_build_topology_2)  # -> Nodes, NodesID, Edges, EdgesID, ConstraintPlane, ConstraintPlaneID, OriginNode, OriginNodeID

sort_and_select = GhPythonScript(
    ind_origin=cem_extract_topology_2.OriginNodeID,
    pts=cem_extract_structure.Nodes,
    pts_ind=cem_extract_structure.NodesID,
    arch_res=arch_res)  # -> origin_new; inputs ind_origin: list of Int32, pts: list of Point3d, pts_ind: list of Int32, arch_res: Int32
# ---------- sort_and_select: Python ----------
import ghpythonlib.components as gh



################################################################################
## Pick the anchor nodes from the previos step: 

point_indices = []
for i in range(int(arch_res+1)): point_indices.append(i)

points_anchor = []
for i in range(len(point_indices)):
    for k in range(len(pts_ind)):
        if point_indices[i] == pts_ind[k]: points_anchor.append(pts[k])



################################################################################
## Sort the origin nodes and output the anchor nodes based on the same index: 

ind_origin_sorted = ind_origin[::]
ind_origin_sorted.sort()

origin_new = []

for i in range(len(ind_origin)):
    for k in range(len(ind_origin_sorted)):
        if ind_origin[i] == ind_origin_sorted[k]: origin_new.append(points_anchor[k])



################################################################################
# ---------- end sort_and_select ----------

cem_origin_node_2 = CEM_Origin_Node(OriginNode=sort_and_select, OriginNodeID=cem_extract_topology_2.OriginNode)
cem_calculate_structure_2 = CEM_Calculate_Structure(TP=cem_build_topology_2, N=cem_origin_node_2)

# ----
# Part C - Preview
cem_extract_structure_2 = CEM_Extract_Structure(M=cem_calculate_structure_2)  # -> Nodes, NodesID, Trails, TrailsID, TrailsCol, TrailsMag, Deviations, DeviationsID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
merge_3 = Merge(Data1=cem_extract_structure_2.Trails, Data2=cem_extract_structure_2.Deviations)
merge_4 = Merge(Data1=cem_extract_structure_2.TrailsMag, Data2=cem_extract_structure_2.DeviationsMag)
colour_2 = GhPythonScript(mag=merge_4)  # -> out; inputs mag: list; same code as colour
custom_preview_2 = CustomPreview(Geometry=merge_3, Material=colour_2)

# ----
# Part D - Export
generate_toolpath = GhPythonScript(
    lines=merge,
    layer_depth=layer_depth,
    lines_closing=cem_extract_structure_2.Deviations,
    type=type,
    toolpath_depth=toolpath_depth,
    toolpath_height=toolpath_height,
    fillet_distance=fillet_distance,
    start_angle=tilt_angle_2,
    lateral_anchors=lateral_anchors)  # -> printpath; inputs lines: list of Curve, lines_closing: list of Curve, type: Int32, start_angle: Int32, lateral_anchors: list of Brep
# ---------- generate_toolpath: Python ----------
import ghpythonlib.components as gh
import math



#############################################################################################
## Define Layering Functions
#############################################################################################

## Close toolpath with one layer: 
def close_toolpath(curves, non_flip = 'none', cutting_volume= 'none'):
    toolpath_flipped = []
    lines = []
    
    if cutting_volume != 'none': curves = gh.TrimwithBreps(curves, cutting_volume)[1]
    
    if non_flip != 'none': toolpath_flipped = curves
    else:
        for i, crv in enumerate(curves):
            if i % 2 == 0:
                toolpath_flipped.append(gh.FlipCurve(crv)[0])
            else:
                toolpath_flipped.append(crv)
    
    for i in range(int(len(toolpath_flipped)-1)): lines.append(gh.Line(gh.EndPoints(toolpath_flipped[i])[0], gh.EndPoints(toolpath_flipped[i+1])[1]))
    
    toolpath_final = []
    
    toolpath_final.extend(toolpath_flipped)
    toolpath_final.extend(lines)
    
    
    toolpath_final = gh.JoinCurves(toolpath_final, False)
    return(toolpath_final)


## Close toolpath with a double layered geometry:
def double_layered_closing(curves, layer_depth, recut, cutting_curve='none', cutting_volume='none'):
    curves_offset = []
    
    if recut == False: 
        for crv in curves:
            plane = gh.Planar(crv)[1]
            curves_offset.append(gh.OffsetCurve(crv, layer_depth, plane, 1))
    
    if recut == True:
        for i, crv in enumerate(curves):
            plane = gh.Planar(crv)[1]
            
            if i == 0:
                cut = gh.OffsetCurve(crv, layer_depth, plane, 1)
            else:
                offset = gh.ExtendCurve(gh.OffsetCurve(crv, layer_depth, plane, 1), 2, 0.05, 0.05)
                cut_par = gh.CurveXPlane(offset, gh.XYPlane(gh.ConstructPoint(0,0,0)))[1]
                
                cut = gh.Shatter(offset, cut_par)[1]
            curves_offset.append(cut)
    
    if cutting_curve != 'none':
        cutting_plane_a = gh.Planar(cutting_curve)[1]
        cutting_plane_b = gh.Mirror(cutting_plane_a, gh.XZPlane(gh.ConstructPoint(0,0,0)))[0]
        
        curves_offset_new = []
        for i in range(len(curves)):
            end = gh.EndPoints(curves[i])
            plane_a = gh.PlaneOrigin(cutting_plane_a, end[0])
            plane_b = gh.PlaneOrigin(cutting_plane_b, end[1])
            
            cut = gh.CurveXPlane(curves_offset[i], [plane_a, plane_b])[1]
            
            if cut:
               cut = gh.Shatter(curves_offset[i], cut)[1]
               curves_offset_new.append(cut)
            else:
                curves_offset_new.append(curves_offset[i])
        
        curves_offset = curves_offset_new
    
    
        ## Cut the Curves by the lateral supports: 
    if cutting_volume != 'none': curves = gh.TrimwithBreps(curves, cutting_volume)[1]
    if cutting_volume != 'none': curves_offset = gh.TrimwithBreps(curves_offset, cutting_volume)[1]
    
    
    ## Close one side: 
    lines_close = []
    for i, crv in enumerate(curves): lines_close.append(gh.Line(gh.EndPoints(crv)[0], gh.EndPoints(curves_offset[i])[0]))
    
    
    
    ## Join the curves: 
    joined = []
    for i, crv in enumerate(curves): joined.append(gh.JoinCurves([lines_close[i], curves[i], curves_offset[i]], False))
    
    return(joined)



#############################################################################################
## Main Part
#############################################################################################

## Filter out the print_path_elements: 
line_filtered = []
for ln in lines:
    if gh.Length(ln) < layer_depth*0.95: line_filtered.append(ln)



## Join, rebuild and interpolates the curves:
joined = gh.JoinCurves(line_filtered, False)
rebuilt = gh.RebuildCurve(joined, 2, 25, False)
flipped = gh.FlipCurve(rebuilt, rebuilt[0])[0]
sorted = gh.SortList(gh.Deconstruct(gh.CurveMiddle(flipped))[0], flipped)[1]

steps = []
interpolate = int(layer_depth/toolpath_height)

toolpath = []

for i in range(interpolate): steps.append(i/interpolate)
for i in range(int(len(joined)-1)): toolpath.extend(gh.TweenCurve(sorted[i], sorted[i+1], steps))

toolpath_mid = gh.Move(toolpath, gh.UnitZ(-gh.EndPoints(toolpath[0])[0][2]))[0]



#############################################################################################
## Closing Part
#############################################################################################

## Join, rebuild and interpolates the curves:
joined = gh.JoinCurves(lines_closing, False)
rebuilt = gh.RebuildCurve(joined, 2, 25, False)
flipped = gh.FlipCurve(rebuilt, rebuilt[0])[0]
sorted_closing = gh.SortList(gh.Deconstruct(gh.CurveMiddle(flipped))[0], flipped)[1]



## Move the curves down, flip and cut them: 
toolpath_closing = gh.Move(sorted_closing, gh.UnitZ(-gh.EndPoints(toolpath[0])[0][2]))[0]
bound = gh.Extrude(gh.BoundarySurfaces(gh.Rectangle(gh.XYPlane(gh.ConstructPoint(0,0,0)), gh.ConstructDomain(-100,100), gh.ConstructDomain(-100,100),0)[0]), gh.UnitZ(-100))

toolpath_closing_cut = gh.TrimwithBrep(toolpath_closing, bound)[1]
toolpath_closing_cut = gh.Move(toolpath_closing_cut, gh.UnitX(-toolpath_height))[0]
toolpath_closing_cut.reverse()



#############################################################################################
## Construct the First starting parts
#############################################################################################

## Create the flat base curve: 
curve_middle = gh.ExtendCurve(gh.PolyLine(gh.CurveMiddle(toolpath_closing_cut), False), 2, 1, 1)

p_start = gh.CurveXPlane(curve_middle, gh.XYPlane(gh.ConstructPoint(0,0,0)))[0]
p_end = gh.EndPoints(toolpath_closing_cut[0])[1]
p_mid = gh.ConstructPoint(p_start[0],p_end[1],0)

base_curve_flat = gh.FilletDistance(gh.PolyLine([p_start, p_mid, p_end], False), fillet_distance)


## Create the cutting curve: 
plane_cut = gh.ConstructPlane(gh.CurveMiddle(gh.Line(p_start, p_end)), gh.Vector2Pt(p_start, p_end, False)[0], gh.VectorXYZ(1, 0, math.tan(math.radians(-start_angle)))[0])

cutting_curve = gh.ExtendCurve(gh.Interpolate(gh.CurveXPlane(toolpath_closing_cut, plane_cut)[0], 3, False, 1)[0], 2, 0.2, 0.2)
cutting_curve = gh.Shatter(cutting_curve, gh.CurveXPlane(cutting_curve, gh.XYPlane(gh.ConstructPoint(0,0,0)))[1])[1]


## Create the Diagonal Curve: 
p_start = gh.Extremes(cutting_curve, gh.XYPlane(gh.ConstructPoint(0,0,0)))[0]
p_end = gh.CurveXPlane(base_curve_flat, gh.ConstructPlane(p_mid, gh.UnitZ(1), gh.VectorXYZ(1,1,0)[0]) )[0]

diagonal_curve = gh.Line(p_start, p_end)


## Create Surfaces to Interpolate onto: 
div = int(gh.Length(diagonal_curve) / toolpath_height)

pts_a = gh.DivideCurve(gh.Explode(base_curve_flat, True)[0][0], div, False)[0]
pts_b = gh.DivideCurve(diagonal_curve, div, False)[0]
pts_c = gh.DivideCurve(gh.Explode(base_curve_flat, True)[0][2], div, False)[0]

pts_a.reverse()
pts_b.reverse()

surfaces_project = []
for i in range(div+1):
    
    rectangle = gh.Rectangle3Pt(pts_a[i], pts_c[i], pts_b[i])[0]
    surface = gh.BoundarySurfaces(rectangle)
    
    surfaces_project.append(surface)


## Create Reference Surfaces and rebuild new curves: 
uv_a = gh.SurfaceClosestPoint(gh.DivideCurve(cutting_curve, 50, False)[0], surfaces_project[-1])[1]
curve_b = gh.Shatter(base_curve_flat, gh.CurveClosestPoint([pts_a[0], pts_c[0]], base_curve_flat)[1])[1]
uv_b = gh.SurfaceClosestPoint(gh.DivideCurve(curve_b, 50, False)[0], surfaces_project[0])[1]
uv_b.reverse()

curves_first_start = []

for i in range(len(surfaces_project)):
    
    factor_a = (1/(len(surfaces_project)-1))*i
    factor_b = 1-factor_a
    
    uv_new = []
    
    for k in range(len(uv_a)):
        
        x_val = uv_a[k][0] * factor_a + uv_b[k][0] * factor_b
        y_val = uv_a[k][1] * factor_a + uv_b[k][1] * factor_b
        uv_loc = gh.ConstructPoint(x_val,y_val,0)
        uv_new.append(uv_loc)
    
    curve_new = gh.CurveOnSurface(surfaces_project[i], uv_new, False)[0]
    curves_first_start.append(curve_new)

curves_first_start = curves_first_start[:-1]


## Create Secondary part: 
curves_second_start = []

end = toolpath_closing_cut[0]
toolpath_closing_cut = toolpath_closing_cut[1:]
for i in range(len(toolpath_closing_cut)):
    
    crv_loc = gh.CurveDomain(toolpath_closing_cut[i], gh.ConstructDomain(0,1))[0]
    int_a = gh.CurveXPlane(crv_loc, plane_cut)[1]
    int_b = 1-int_a
    
    crv_loc = gh.Shatter(crv_loc, [int_a, int_b])[1]
    curves_second_start.append(crv_loc)

curves_second_start.reverse()
curves_second_start.append(end)


#############################################################################################
## Create Printpath: 
#############################################################################################

printpath = []

if type == 1:
    
    printpath_a = close_toolpath(curves_first_start, 'none', lateral_anchors)
    printpath_b = gh.Mirror(printpath_a, gh.XZPlane(gh.ConstructPoint(0,0,0)))[0]
    
    printpath_c = []
    printpath_c.extend(curves_second_start)
    printpath_c.extend(toolpath_mid)
    printpath_c = close_toolpath(printpath_c, 'none', lateral_anchors)
    
    printpath.extend([printpath_a, printpath_b, printpath_c])



if type == 2:
    
    ## Starting Part: 
    printpath_a = double_layered_closing(curves_first_start, toolpath_depth, True, 'none', lateral_anchors)
    last_curve = printpath_a[-1]
    printpath_a = printpath_a[:-1]
    last_curve = gh.ExtendCurve(last_curve, 2, 0, -0.02)
    printpath_a.append(last_curve)
    printpath_a = close_toolpath(printpath_a, True)
    printpath_b = gh.Mirror(printpath_a, gh.XZPlane(gh.ConstructPoint(0,0,0)))[0]
    
    printpath.extend([printpath_a, printpath_b])
    
    ## Main Part: 
    main = []
    
    main_a = double_layered_closing(curves_second_start, toolpath_depth, False, last_curve, lateral_anchors)
    main_b = double_layered_closing(toolpath_mid, toolpath_depth, True, 'none', lateral_anchors)
    main.extend(main_a)
    main.extend(main_b)
    
    
    printpath.append(close_toolpath(main, True))



printpath = gh.Move(printpath, gh.UnitZ(toolpath_height))[0]
# ---------- end generate_toolpath ----------
