# Grasshopper definition Code_Kappendecke_2.0_set_2_var_5.ghx (Grasshopper 1.0.7)
# Copyright: Felswind
# plug-ins: CEM_Build_Topology, CEM_Deviation, CEM_Extract_Topology, CEM_Support, CEM_Trail, CEM_Calculate_Structure, CEM_Origin_Node, CEM_Extract_Structure, CEM_Load

layer_numb = Slider(3, range=1..50)
layer_depth = Slider(0.06, range=0.001..1)
arch_res = Slider(41, range=1..101)
tilt_angle = Slider(45, range=0..90)
dev_mag_arch = Slider(-19.17, range=-100..0)
# -22.0 -> Single layered value
# -19.17 -> Double layered value
trail_length = Slider(-0.025, range=-50..0)

type = ValueList({"Single_layered": 1, "double layered": 2}, selected="double layered")
toolpath_depth = Slider(0.03, range=0.001..1)
toolpath_height = Slider(0.015, range=0.001..1)
fillet_start = Slider(0.2, range=0.001..1)
angle_start = Slider(50, range=0..90)
lateral_anchors = Brep([<brep referenced from the Rhino model> x2])

# ----
# Part A - Topology
create_topology = GhPythonScript(
    layer_numb=layer_numb,
    layer_depth=layer_depth,
    toolpath_height=toolpath_height,
    arch_res=arch_res,
    tilt_angle=tilt_angle,
    deviaton_arch_mag=dev_mag_arch,
    trail_length=trail_length)  # -> trail, trail_lengths, self_weight_point, self_weight_mag, external_load_point, external_load_mag, deviation, deviation_mag, anchor_points; inputs layer_numb: Int32, arch_res: Int32, tilt_angle: Int32
# ---------- create_topology: Python ----------
import ghpythonlib.components as gh
import math



####################################
## Define Curve Function: 
####################################



def arch_curve_topology(depth, x_pos, arch_res, layer_depth):
    
    
    ## Output parameters:
    anchor_points = []
    deviation_arch = []
    deviation_ring = []
    trail = []
    load_point = []
    
    
    ## Create the base curve and divide it: 
    base_line = gh.Line(gh.ConstructPoint(x_pos, -depth/2, 0), gh.ConstructPoint(x_pos, depth/2, 0))
    div = gh.DivideCurve(base_line, arch_res, False)
    explode = gh.Shatter(base_line, div[2])
    
    
    ## Create the Points for the Self_weight: 
    load_point.extend(div[0])
    
    
    ## Create the anchor points: 
    anchor_points.extend((div[0][0], div[0][-1]))
    
    
    ## Create the deviation / trail elements for the main arch: 
    for i, curve in enumerate(explode):
        if i == int(arch_res/2): deviation_arch.append(curve)
        else: trail.append(curve)
    
    
    ## Create the connecting (ring) deviation elements: 
    if x_pos > 0:
        pts_moved = gh.Move(div[0], gh.UnitX(-layer_depth))[0]
        line_dev = gh.Line(div[0], pts_moved)
        
        for curve in line_dev: deviation_ring.append(curve)
    
    
    ## Return the final geometry: 
    return(anchor_points, deviation_arch, deviation_ring, trail, load_point)



####################################
## Run the Curve Function: 
####################################



## Output Topology:
anchor_points = []
deviation = []
deviation_mag = []
trail = []
trail_lengths = []


## Output forces: 
self_weight_point = []
self_weight_mag = []
external_load_point = []
external_load_mag = []


## Calcualte the layer_depth based in the toolpath thickness: 
layer_depth_factor = int(layer_depth/toolpath_height)
layer_depth = layer_depth_factor * toolpath_height


## Create the Output elements:
tilt_angle = 90 - tilt_angle

for i in range(layer_numb):
    
    curve = arch_curve_topology(0.5, i*layer_depth, arch_res, layer_depth)
    
    
    ## Anchor points: 
    anchor_points.extend(curve[0])
    
    
    ## Create the points for the forces:
    self_weight_point.extend(curve[4])
    if i == 0: external_load_point.extend(curve[4])
    
    
    ## Create a Parapolic shape: 
    
    self_weight = -2
    for pt in curve[4]: self_weight_mag.append(self_weight)
    
    external_load = (layer_numb * -self_weight) / math.tan(math.radians(tilt_angle))
    if i == 0:
       for pt in external_load_point: external_load_mag.append(external_load)
    
    
    ## Deviation Elemements and magnitude:
    deviation.extend(curve[1])
    for crv in curve[1]: deviation_mag.append(deviaton_arch_mag)
    
    deviation.extend(curve[2])
    
    for crv in curve[2]: deviation_mag.append((-external_load / layer_numb) * (layer_numb - i))
    
    
    ## Trail elements and lengths: 
    trail.extend(curve[3])
    for crv in curve[3]: trail_lengths.append(trail_length)
# ---------- end create_topology ----------
cem_deviation = CEM_Deviation(DeviationEdge=graft(create_topology.deviation), DeviationMagn=graft(create_topology.deviation_mag))
cem_load = CEM_Load(PointLoad=graft(create_topology.self_weight_point), LoadMagnZ=graft(create_topology.self_weight_mag))
cem_load_2 = CEM_Load(PointLoad=graft(create_topology.external_load_point), LoadMagnX=graft(create_topology.external_load_mag))
cem_trail = CEM_Trail(TrailEdge=graft(create_topology.trail), TrailLen=graft(create_topology.trail_lengths))
cem_support = CEM_Support(Support=create_topology.anchor_points)
cem_build_topology = CEM_Build_Topology(T=flatten(cem_trail), L=flatten([cem_load, cem_load_2]), D=flatten(cem_deviation), S=flatten(cem_support))

# ----
# Part B - Structure
height = Slider(0.25, range=0..0.75)
cem_extract_topology = CEM_Extract_Topology(TP=cem_build_topology)  # -> Nodes, NodesID, Edges, EdgesID, ConstraintPlane, ConstraintPlaneID, OriginNode, OriginNodeID
unit_z = UnitZ(Factor=height)
move = Move(Geometry=cem_extract_topology.OriginNode, Motion=unit_z)  # -> Geometry, Transform
cem_origin_node = CEM_Origin_Node(OriginNode=move.Geometry, OriginNodeID=cem_extract_topology.OriginNodeID)
cem_calculate_structure = CEM_Calculate_Structure(TP=cem_build_topology, N=cem_origin_node)

# ----
# Part C - Preview
cem_extract_structure = CEM_Extract_Structure(M=cem_calculate_structure)  # -> Nodes, NodesID, Trails, TrailsID, TrailsCol, TrailsMag, Deviations, DeviationsID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
merge = Merge(Data1=cem_extract_structure.Trails, Data2=cem_extract_structure.Deviations)
merge_2 = Merge(Data1=cem_extract_structure.TrailsMag, Data2=cem_extract_structure.DeviationsMag)
colour = GhPythonScript(mag=merge_2)  # -> out; inputs mag: list
# ---------- colour: Python ----------
for magnitude in mag:
    
    if magnitude > 0: print(255, 0, 0)
    else: print(0, 0, 255)
# ---------- end colour ----------
custom_preview = CustomPreview(Geometry=merge, Material=colour)

# ----
# Part D - Export
generate_toolpath = GhPythonScript(
    lines=merge,
    layer_depth=layer_depth,
    type=type,
    toolpath_depth=toolpath_depth,
    toolpath_height=toolpath_height,
    fillet_start=fillet_start,
    angle_start=angle_start,
    lateral_anchors=lateral_anchors)  # -> printpath; inputs lines: list of Curve, type: Int32, angle_start: Int32, lateral_anchors: list of Brep
# ---------- generate_toolpath: Python ----------
import ghpythonlib.components as gh
import math



#####################################################################################################
## Define Closing Functions: 
#####################################################################################################


## Close toolpath with one layer: 
def close_toolpath(curves, non_flip = 'none'):
    toolpath_flipped = []
    lines = []
    
    
    if non_flip != 'none': toolpath_flipped = curves
    else:
        for i, crv in enumerate(curves):
            if i % 2 == 0:
                toolpath_flipped.append(gh.FlipCurve(crv)[0])
            else:
                toolpath_flipped.append(crv)
    
    for i in range(int(len(toolpath_flipped)-1)): lines.append(gh.Line(gh.EndPoints(toolpath_flipped[i])[0], gh.EndPoints(toolpath_flipped[i+1])[1]))
    
    toolpath_final = []
    
    toolpath_final.extend(toolpath_flipped)
    toolpath_final.extend(lines)
    
    
    toolpath_final = gh.JoinCurves(toolpath_final, False)
    return(toolpath_final)


## Close toolpath with a double layered geometry:
def double_layered_closing(curves, layer_depth, recut):
    curves_offset = []
    
    
    if recut == False: 
        for crv in curves:
            curves_offset.append(gh.OffsetCurve(crv, layer_depth, gh.XYPlane(gh.ConstructPoint(0,0,0)), 1))
    
    
    if recut == True:
        for crv in curves:
            plane = gh.Planar(crv)[1]
            offset = gh.ExtendCurve(gh.OffsetCurve(crv, layer_depth, plane, 1), 2, 10, 10)
            
            plane_cut = gh.XYPlane(gh.ConstructPoint(0,0,0))
            cut = gh.CurveXPlane(offset, plane_cut)[1]
            
            curve_cut = gh.Shatter(offset, cut)[2]
            curves_offset.append(curve_cut)
    
    
    
    ## Close one side: 
    lines_close = []
    for i, crv in enumerate(curves): lines_close.append(gh.Line(gh.EndPoints(crv)[0], gh.EndPoints(curves_offset[i])[0]))
    
    
    
    ## Join the curves: 
    joined = []
    for i, crv in enumerate(curves): joined.append(gh.JoinCurves([lines_close[i], curves[i], curves_offset[i]], False))
    
    return(joined)

#####################################################################################################



## Filter out the print_path_elements: 
line_filtered = []
for ln in lines:
    if gh.Length(ln) < layer_depth*0.95: line_filtered.append(ln)



## Join, rebuild and interpolates the curves:
joined = gh.JoinCurves(line_filtered, False)
rebuilt = gh.RebuildCurve(joined, 3, 25, False)
flipped = gh.FlipCurve(rebuilt, rebuilt[0])[0]
sorted = gh.SortList(gh.Deconstruct(gh.CurveMiddle(flipped))[0], flipped)[1]

steps = []
interpolate = int(layer_depth/toolpath_height)

toolpath = []

for i in range(interpolate): steps.append(i/interpolate)
for i in range(int(len(joined)-1)): toolpath.extend(gh.TweenCurve(sorted[i], sorted[i+1], steps))

toolpath = gh.Move(toolpath, gh.UnitZ(-gh.EndPoints(toolpath[0])[0][2]))[0]



#####################################################################################################
## Create the Closing of the geometry:
#####################################################################################################

## Main Curves: 
start_curve = gh.Shatter(gh.CurveDomain(toolpath[0], gh.ConstructDomain(0,1))[0], 0.5)[0]

pts_start = gh.DivideCurve(start_curve, 15, False)[0]
pts_mid = []
pts_end = []

for i in range(len(pts_start)):
    pts_end.append(gh.ConstructPoint(-pts_start[i][1], 0, pts_start[i][2]))
    pts_mid.append(gh.ConstructPoint(-pts_start[i][1], pts_start[i][1], pts_start[i][2]))



## Main Surface: 

base_curves = []
for i in range(len(pts_start)-1): base_curves.append(gh.PolyLine([pts_start[i], pts_mid[i], pts_end[i]], False))
base_curves = gh.FilletDistance(base_curves, fillet_start)


points_div = []
for i in range(len(base_curves)):
    
    points_loc = []
    
    curves_split = gh.Explode(base_curves[i], True)[0]
    for k in range(len(curves_split)):
        points_loc_temp = gh.DivideCurve(curves_split[k], 10, False)[0]
        if k > 0:
            points_loc_temp = points_loc_temp[1:] 
        points_loc.extend(points_loc_temp)
    
    points_div.append(points_loc)


points_end_extra = []
for i in range(len(points_div[0])): points_end_extra.append(pts_start[-1])
points_div.append(points_end_extra)


curves_loft = []
for i in range(len(points_div[0])):
    
    points_loc_crv = []
    
    for k in range(len(points_div)): points_loc_crv.append(points_div[k][i])
    
    curve_loc = gh.Interpolate(points_loc_crv, 3, False, 1)[0]
    curves_loft.append(curve_loc)

options = gh.LoftOptions(False, False, 0, 0, 0)
main_surface = gh.Loft(curves_loft, options)



## Cutting Planes for split Surface: 

p_a_plane = pts_end[0]
p_b_plane = gh.ConstructPoint(0,pts_start[0][1],0)

vec_a = gh.Vector2Pt(p_a_plane, p_b_plane, False)[0]
vec_b = gh.VectorXYZ(0, 1, math.tan(math.radians(angle_start)))[0]

cutting_plane = gh.ConstructPlane(p_a_plane, vec_a, vec_b)
cutting_curve = gh.BrepXPlane(main_surface, cutting_plane)[0]


main_surface_a = gh.SurfaceSplit(main_surface, cutting_curve)[0]
main_surface_b = gh.SurfaceSplit(main_surface, cutting_curve)[1]



## Create main Opening Surface: 

edges = gh.BrepEdges(main_surface_a)[0]
surface_div_new = gh.SurfaceClosestPoint(gh.DivideSurface(gh.EdgeSurface(edges[0], edges[1], edges[2], edges[3]), 10, 10)[0], main_surface_a)[0]

crvs_new = []
for i in range(11):
    
    points_loc = []
    
    for k in range(11): points_loc.append(surface_div_new[k*11+i])
    
    curve_new_loc = gh.Interpolate(points_loc, 3, False, 1)[0]
    curve_new_mirr = gh.Mirror(curve_new_loc, gh.XZPlane(gh.ConstructPoint(0,0,0)))[0]
    
    joined = gh.RebuildCurve(gh.JoinCurves([curve_new_loc, curve_new_mirr], False), 2, 50, True)
    crvs_new.append(joined)

loft_new = gh.Loft(crvs_new, options)



## Create main Opening Toolpath: 

divitions = int(gh.Length(gh.PolyLine(pts_end, False)) / toolpath_height)
points_new = gh.DivideSurface(loft_new, divitions, divitions)[0]

toolpath_opening_main = []
for i in range(divitions+1):
    
    points_loc = points_new[i*(divitions+1):i*(divitions+1)+1+divitions]
    
    curve_new_loc = gh.Interpolate(points_loc, 3, False, 1)[0]
    toolpath_opening_main.append(curve_new_loc)

#toolpath_opening_main = toolpath_opening_main[0:-1]



## Create start Opening Toolpath: 

pt_a = p_a_plane
pt_b = gh.ConstructPoint(p_a_plane[0], p_b_plane[1], 0)
pt_c = p_b_plane

line_a = gh.Line(pt_a, pt_b)
line_b = gh.Line(pt_c, pt_b)

plane_mid = gh.ConstructPlane(pt_b, gh.VectorXYZ(1,-1,0)[0],  gh.VectorXYZ(0,0,1)[0])
curve_sec = gh.BrepXPlane(main_surface_b, plane_mid)[0]

distance_mid = gh.Distance(gh.EndPoints(toolpath_opening_main[0])[0], gh.EndPoints(toolpath_opening_main[1])[0])
distance_down = gh.Distance(gh.CurveXPlane(toolpath_opening_main[0], plane_mid)[0], gh.CurveXPlane(toolpath_opening_main[1], plane_mid)[0])

divisions_mid = int(gh.Length(curve_sec) / distance_down)+4 ########################
div_mid = gh.DivideCurve(curve_sec, divisions_mid, False)[0]

div_a = gh.DivideLength(line_a, distance_mid)[0]
div_b = gh.DivideLength(line_b, distance_mid)[0]

cutting_planes = []

for i in range(len(div_mid)):
    
    line_center = gh.Line(div_a[i], div_b[i])
    mid = gh.CurveMiddle(line_center)
    
    vec_a = gh.Vector2Pt(mid, div_a[i], False)[0]
    vec_b = gh.Vector2Pt(mid, div_mid[i], False)[0]
    
    plane_new = gh.ConstructPlane(mid, vec_a, vec_b)
    cutting_planes.append(plane_new)

curves_start_opening = gh.BrepXPlane(main_surface_b, cutting_planes)[0]
curve_start = curves_start_opening[-1]

curves_start_opening = curves_start_opening[1:-1]
curve_start = gh.Shatter(curve_start, gh.CurveXCurve(curve_start, curves_start_opening[-1])[1])[1]
curve_start = gh.ExtendCurve(curve_start, 2, -distance_mid, -distance_mid)
curves_start_opening.append(gh.FlipCurve(curve_start)[0])


#####################################################################################################
## Create Printpath: 
#####################################################################################################

if type == 1:
    printpath = []
    
    ## start: 
    
    curves_start_opening = gh.TrimwithBreps(curves_start_opening, lateral_anchors)[1]
    
    start_a = close_toolpath(curves_start_opening)
    start_b = gh.Mirror(start_a, gh.XZPlane(gh.ConstructPoint(0,0,0)))[0]
    
    printpath.extend([start_a, start_b])
    
    ## mid: 
    mid = []
    
    mid.extend(toolpath_opening_main)
    mid.reverse()
    mid.extend(toolpath[1:])
    
    mid = gh.TrimwithBreps(mid, lateral_anchors)[1]
    
    mid = close_toolpath(mid)
    printpath.append(mid)



if type == 2:
    printpath = []
    
    ## start: 
    start_a = curves_start_opening
    mid_a = toolpath_opening_main
    
    
    #####################################################################################################
    ## Create the Closing of the geometry:
    #####################################################################################################
    
    ## Main Curves: 
    start_curve = gh.Shatter(gh.CurveDomain(toolpath[0], gh.ConstructDomain(0,1))[0], 0.5)[0]
    start_curve = gh.OffsetCurve(start_curve, toolpath_depth, gh.Planar(start_curve)[1], 1)
    start_curve = gh.ExtendCurve(start_curve, 0, 0.1,0)
    
    cut = gh.CurveXPlane(start_curve, gh.XYPlane(gh.ConstructPoint(0,0,0)))[1]
    start_curve = gh.Shatter(start_curve, cut)[1:]
    start_curve = gh.JoinCurves(start_curve, False)
    
    
    pts_start = gh.DivideCurve(start_curve, 15, False)[0]
    pts_mid = []
    pts_end = []
    
    for i in range(len(pts_start)):
        pts_end.append(gh.ConstructPoint(-pts_start[i][1], 0, pts_start[i][2]))
        pts_mid.append(gh.ConstructPoint(-pts_start[i][1], pts_start[i][1], pts_start[i][2]))
    
    
    
    ## Main Surface: 
    
    base_curves = []
    for i in range(len(pts_start)-1): base_curves.append(gh.PolyLine([pts_start[i], pts_mid[i], pts_end[i]], False))
    base_curves = gh.FilletDistance(base_curves, fillet_start)
    
    
    points_div = []
    for i in range(len(base_curves)):
        
        points_loc = []
        
        curves_split = gh.Explode(base_curves[i], True)[0]
        for k in range(len(curves_split)):
            points_loc_temp = gh.DivideCurve(curves_split[k], 10, False)[0]
            if k > 0:
                points_loc_temp = points_loc_temp[1:] 
            points_loc.extend(points_loc_temp)
        
        points_div.append(points_loc)
    
    
    points_end_extra = []
    for i in range(len(points_div[0])): points_end_extra.append(pts_start[-1])
    points_div.append(points_end_extra)
    
    
    curves_loft = []
    for i in range(len(points_div[0])):
        
        points_loc_crv = []
        
        for k in range(len(points_div)): points_loc_crv.append(points_div[k][i])
        
        curve_loc = gh.Interpolate(points_loc_crv, 3, False, 1)[0]
        curves_loft.append(curve_loc)
    
    options = gh.LoftOptions(False, False, 0, 0, 0)
    main_surface = gh.Loft(curves_loft, options)
    
    
    
    ## Cutting Planes for split Surface: 
    
    p_a_plane = pts_end[0]
    p_b_plane = gh.ConstructPoint(0,pts_start[0][1],0)
    
    vec_a = gh.Vector2Pt(p_a_plane, p_b_plane, False)[0]
    vec_b = gh.VectorXYZ(0, 1, math.tan(math.radians(angle_start)))[0]
    
    cutting_plane = gh.ConstructPlane(p_a_plane, vec_a, vec_b)
    cutting_curve = gh.BrepXPlane(main_surface, cutting_plane)[0]
    
    
    main_surface_a = gh.SurfaceSplit(main_surface, cutting_curve)[0]
    main_surface_b = gh.SurfaceSplit(main_surface, cutting_curve)[1]
    
    
    
    ## Create main Opening Surface: 
    
    edges = gh.BrepEdges(main_surface_a)[0]
    surface_div_new = gh.SurfaceClosestPoint(gh.DivideSurface(gh.EdgeSurface(edges[0], edges[1], edges[2], edges[3]), 10, 10)[0], main_surface_a)[0]
    
    crvs_new = []
    for i in range(11):
        
        points_loc = []
        
        for k in range(11): points_loc.append(surface_div_new[i*11+k])
        
        curve_new_loc = gh.Interpolate(points_loc, 3, False, 1)[0]
        curve_new_mirr = gh.Mirror(curve_new_loc, gh.XZPlane(gh.ConstructPoint(0,0,0)))[0]
        
        joined = gh.RebuildCurve(gh.JoinCurves([curve_new_loc, curve_new_mirr], False), 2, 50, True)
        crvs_new.append(joined)
    
    loft_new = gh.Loft(crvs_new, options)
    
    
    
    ## Create main Opening Toolpath: 
    
    divitions = divitions
    points_new = gh.DivideSurface(loft_new, divitions, divitions)[0]
    
    toolpath_opening_main = []
    for i in range(divitions+1):
        
        points_loc = points_new[i*(divitions+1):i*(divitions+1)+1+divitions]
        
        curve_new_loc = gh.Interpolate(points_loc, 3, False, 1)[0]
        toolpath_opening_main.append(curve_new_loc)
    
    #toolpath_opening_main = toolpath_opening_main[0:-1]
    
    
    
    ## Create start Opening Toolpath: 
    
    pt_a = p_a_plane
    pt_b = gh.ConstructPoint(p_a_plane[0], p_b_plane[1], 0)
    pt_c = p_b_plane
    
    line_a = gh.Line(pt_a, pt_b)
    line_b = gh.Line(pt_c, pt_b)
    
    plane_mid = gh.ConstructPlane(pt_b, gh.VectorXYZ(1,-1,0)[0],  gh.VectorXYZ(0,0,1)[0])
    curve_sec = gh.BrepXPlane(main_surface_b, plane_mid)[0]
    
    distance_mid = gh.Distance(gh.EndPoints(toolpath_opening_main[0])[0], gh.EndPoints(toolpath_opening_main[1])[0])
    distance_down = gh.Distance(gh.CurveXPlane(toolpath_opening_main[0], plane_mid)[0], gh.CurveXPlane(toolpath_opening_main[1], plane_mid)[0])
    
    divisions_mid = divisions_mid
    div_mid = gh.DivideCurve(curve_sec, divisions_mid, False)[0]
    
    div_a = gh.DivideLength(line_a, distance_mid)[0]
    div_b = gh.DivideLength(line_b, distance_mid)[0]
    
    cutting_planes = []
    
    for i in range(len(div_mid)):
        
        line_center = gh.Line(div_a[i], div_b[i])
        mid = gh.CurveMiddle(line_center)
        
        vec_a = gh.Vector2Pt(mid, div_a[i], False)[0]
        vec_b = gh.Vector2Pt(mid, div_mid[i], False)[0]
        
        plane_new = gh.ConstructPlane(mid, vec_a, vec_b)
        cutting_planes.append(plane_new)
    
    curves_start_opening = gh.BrepXPlane(main_surface_b, cutting_planes)[0]
    curve_start = curves_start_opening[-1]
    
    curves_start_opening = curves_start_opening[1:-1]
    curve_start = gh.Shatter(curve_start, gh.CurveXCurve(curve_start, curves_start_opening[-1])[1])[1]
    curve_start = gh.ExtendCurve(curve_start, 2, -distance_mid, -distance_mid)
    curves_start_opening.append(gh.FlipCurve(curve_start)[0])
    
    
    
    #####################################################################################################
    ## Create final printpath: 
    
    ## Start: 
    start = []
    start.extend(start_a)
    start.extend(curves_start_opening)
    for i in range(len(start_a)): start.append(gh.Line(gh.EndPoints(start_a[i])[0], gh.EndPoints(curves_start_opening[i])[0]))
    
    start = gh.JoinCurves(start, False)
    b = start
    
    start = gh.TrimwithBreps(start, lateral_anchors)[1]
    
    start = close_toolpath(start, True)
    
    start_mirr = gh.Mirror(start, gh.XZPlane(gh.ConstructPoint(0,0,0)))[0]
    printpath.extend([start, start_mirr])
    
    ## Mid: 
    mid = []
    mid.extend(mid_a)
    mid.extend(toolpath_opening_main)
    for i in range(len(mid_a)): mid.append(gh.Line(gh.EndPoints(mid[i])[0], gh.EndPoints(toolpath_opening_main[-i-1])[0]))
    
    mid = gh.JoinCurves(mid, False)
    
    mid_b = double_layered_closing(toolpath, toolpath_depth, True)
    
    mid_b = mid_b[1:]
    
    mid.reverse()
    mid.extend(mid_b)
    
    mid = gh.TrimwithBreps(mid, lateral_anchors)[1]
    
    mid = close_toolpath(mid, True)
    printpath.append(gh.FlipCurve(mid)[0])


printpath = gh.Move(printpath, gh.UnitZ(toolpath_height))[0]
# ---------- end generate_toolpath ----------
