# Grasshopper definition Code_Kappendecke_2.0_set_3_var_1_a.ghx (Grasshopper 1.0.7)
# Copyright: Felswind
# plug-ins: CEM_Build_Topology, CEM_Trail, CEM_Load, CEM_Deviation, CEM_Support, CEM_Extract_Topology, CEM_Calculate_Structure, CEM_Extract_Structure, CEM_Origin_Node

layer_numb = Slider(8, range=1..100)
layer_depth = Slider(0.163, range=0.001..1)
arch_res = Slider(13, range=1..101)
tilt_angle_layer = Slider(45, range=0..90)
tilt_angle_main = Slider(10, range=0..90)
deviaton_arch_mag = Slider(-12, range=-100..0)
trail_length = Slider(-0.045, range=-50..0)

# ----
# Part A - Topology
main_topology_main_tilted = GhPythonScript(
    layer_numb=layer_numb,
    layer_depth=layer_depth,
    arch_res=arch_res,
    tilt_angle_layer=tilt_angle_layer,
    tilt_angle_main=tilt_angle_main,
    deviaton_arch_mag=deviaton_arch_mag,
    trail_length=trail_length)  # -> trail, trail_lengths, port, self_weight_pts, self_weight, port_2, external_force_pts, force_external_x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; inputs layer_numb: Int32, arch_res: Int32, tilt_angle_layer: Int32, tilt_angle_main: Int32
# ---------- main_topology_main_tilted: Python ----------
import ghpythonlib.components as gh
import math



#############################################################################
## Define Intersection Function
#############################################################################


def vector_intersect(res_vec, glob_dev_vec, glob_trail_vec):
    
    # Create endpoints: 
    start = gh.ConstructPoint(0,0,0)
    end_plan = gh.ConstructPoint(res_vec[0], 0, res_vec[2])
    end = res_vec
    
    
    # Create planar intersection: 
    line_a = gh.LineSDL(start, glob_dev_vec, 10)
    line_b_plan = gh.LineSDL(end_plan, glob_trail_vec, 10)
    
    intersection_point = gh.LineXLine(line_a, line_b_plan)[2]
    
    
    # Generate Lines: 
    deviation = gh.Vector2Pt(start, intersection_point, False)[0]
    trail = gh.Vector2Pt(end, intersection_point, False)[0]
    
    
    return(deviation, trail)



#############################################################################
## Create Main Inputs: 
#############################################################################

glob_trail_vec = gh.VectorXYZ(1, 0, -math.tan(math.radians(tilt_angle_layer)))[0]
glob_deviation_vec = gh.VectorXYZ(-1, 0, -math.tan(math.radians(tilt_angle_main)))[0]

self_weight = -2
force_external = -5

vec_self = gh.VectorXYZ(0,0,self_weight)[0]
vec_external = gh.Amplitude(glob_deviation_vec, -force_external)
deviaton_arch_mag = gh.VectorXYZ(0,deviaton_arch_mag,0)[0]

force_external_x = gh.DeconstructVector(vec_external)[0]
force_external_z = gh.DeconstructVector(vec_external)[2]



#############################################################################
## Create Deviation Magnitudes: 
#############################################################################

deviation_vec = []

for i in range(layer_numb):
    for k in range(arch_res):
        
        if i == 0 and k == 0: vec_loc = vec_self + vec_external + deviaton_arch_mag
        elif i == 0 and k >= 1: vec_loc = vec_self + trail_loc
        elif i >= 1 and k == 0: vec_loc = vec_self + deviaton_arch_mag + deviation_vec[((i-1)*arch_res)+k]
        else: vec_loc = vec_self + trail_loc + deviation_vec[((i-1)*arch_res)+k]
        
        vec_trail_dev = vector_intersect(vec_loc, glob_deviation_vec, glob_trail_vec)
        
        trail_loc = vec_trail_dev[1]
        deviation_loc = vec_trail_dev[0]
        
        deviation_vec.append(deviation_loc)



# Create Output: 
deviation_mag = []
force_anchor_x = []
force_anchor_y = []
force_anchor_z = []

for i in range(len(deviation_vec)):
    if i < arch_res*(layer_numb-1): deviation_mag.append(gh.VectorLength(-deviation_vec[i]))
    else:
        vec_loc = deviation_vec[i]
        force_anchor_x.append(-vec_loc[0])
        force_anchor_y.append(-vec_loc[1])
        force_anchor_z.append(-vec_loc[2])



#############################################################################
## Topology: 
#############################################################################

trail = []
deviation = []
anchor_points = []

self_weight_pts = []
external_force_pts = []
sim_anchor_forces = []

dist_x = math.cos(math.radians(tilt_angle_main)) * layer_depth
for i in range(layer_numb):
    line = gh.Line(gh.ConstructPoint(-i*dist_x,-trail_length*2*arch_res/2,0), gh.ConstructPoint(-i*dist_x,trail_length*2*arch_res/2,0))
    
    div = gh.DivideCurve(line, arch_res*2-1, False)
    
    
    # Geometry: 
    explode = gh.Shatter(line, div[2])
    deviation.append(explode[arch_res-1])
    del explode[arch_res-1]
    trail.extend(explode)
    
    if i != 0:
        for k in range(len(div[0])): deviation.append(gh.Line(div[0][k], pts_prev[k]))
    pts_prev = div[0]
    
    
    # Force Points: 
    self_weight_pts.extend(div[0])
    anchor_points.extend(gh.EndPoints(line))
    if i == 0: external_force_pts.extend([div[0][arch_res-1], div[0][arch_res]])
    if i == layer_numb-1:  sim_anchor_forces.extend(div[0])




#############################################################################
## Create Lengths and Magnitudes: 
#############################################################################

trail_lengths = []
for i in range(len(trail)): trail_lengths.append(trail_length)

force_anchor_x.reverse()
force_anchor_y.reverse()
force_anchor_z.reverse()

force_anchor_x.extend(force_anchor_x[::-1])
force_anchor_y.extend(force_anchor_y[::-1])
force_anchor_z.extend(force_anchor_z[::-1])


deviation_magnitude = []
deviation_mag = [deviation_mag[i:i + arch_res] for i in xrange(0, len(deviation_mag), arch_res)]
deviation_magnitude.append(deviaton_arch_mag[1])

for i in range(len(deviation_mag)):
    deviation_magnitude.append(deviaton_arch_mag[1])
    list_loc = deviation_mag[i]
    list_loc.reverse()
    
    deviation_magnitude.extend(list_loc)
    deviation_magnitude.extend(list_loc[::-1])

for i in range(len(deviation_magnitude)):
    if deviation_magnitude[i] > 0: deviation_magnitude[i] *= -1
# ---------- end main_topology_main_tilted ----------
cem_deviation = CEM_Deviation(
    DeviationEdge=graft(main_topology_main_tilted.deviation),
    DeviationMagn=graft(main_topology_main_tilted.deviation_magnitude))
cem_load = CEM_Load(
    PointLoad=graft(main_topology_main_tilted.sim_anchor_forces),
    LoadMagnX=graft(main_topology_main_tilted.force_anchor_x),
    LoadMagnZ=graft(main_topology_main_tilted.force_anchor_z))
cem_trail = CEM_Trail(TrailEdge=graft(main_topology_main_tilted.trail), TrailLen=graft(main_topology_main_tilted.trail_lengths))
cem_load_2 = CEM_Load(PointLoad=main_topology_main_tilted.self_weight_pts, LoadMagnZ=main_topology_main_tilted.self_weight)
cem_load_3 = CEM_Load(
    PointLoad=main_topology_main_tilted.external_force_pts,
    LoadMagnX=main_topology_main_tilted.force_external_x,
    LoadMagnZ=main_topology_main_tilted.force_external_z)
cem_support = CEM_Support(Support=main_topology_main_tilted.anchor_points)
cem_build_topology = CEM_Build_Topology(T=flatten(cem_trail), L=flatten([cem_load_2, cem_load_3, cem_load]), D=flatten(cem_deviation), S=flatten(cem_support))

# ----
# Part B - Structure
cem_extract_topology = CEM_Extract_Topology(TP=cem_build_topology)  # -> Nodes, NodesID, Edges, EdgesID, ConstraintPlane, ConstraintPlaneID, OriginNode, OriginNodeID
origin_nodes = GhPythonScript(
    nodes=cem_extract_topology.OriginNode,
    indices=cem_extract_topology.OriginNodeID,
    layer_depth=layer_depth,
    tilt_angle_main=tilt_angle_main)  # -> origin_new; inputs nodes: list of Vector3d, indices: list of Int32, tilt_angle_main: Int32
# ---------- origin_nodes: Python ----------
import ghpythonlib.components as gh
import math



## Sort the points and move them: 
x_value = gh.Absolute(gh.Deconstruct(nodes)[0])
sorted = gh.SortList(x_value, nodes)[1]
sorted_ind = gh.SortList(x_value, indices)[1]

sorted = [sorted[i:i + 2] for i in xrange(0, len(sorted), 2)]

z_move = -math.sin(math.radians(tilt_angle_main)) * layer_depth 

points_moved = []
for i in range(len(sorted)): points_moved.extend(gh.Move(sorted[i], gh.UnitZ(z_move*i+0.25))[0])


## Resort origin:
origin_new = []

for i in range(len(indices)):
    for k in range(len(sorted_ind)):
        if indices[i] == sorted_ind[k]:
            origin_new.append(points_moved[k])
# ---------- end origin_nodes ----------
cem_origin_node = CEM_Origin_Node(OriginNode=origin_nodes, OriginNodeID=cem_extract_topology.OriginNodeID)
cem_calculate_structure = CEM_Calculate_Structure(TP=cem_build_topology, N=cem_origin_node)

# ----
# Part C - Preview
cem_extract_structure = CEM_Extract_Structure(M=cem_calculate_structure)  # -> Nodes, NodesID, Trails, TrailsID, TrailsCol, TrailsMag, Deviations, DeviationsID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
merge = Merge(Data1=cem_extract_structure.Trails, Data2=cem_extract_structure.Deviations)
merge_2 = Merge(Data1=cem_extract_structure.TrailsMag, Data2=cem_extract_structure.DeviationsMag)
colour = GhPythonScript(mag=merge_2)  # -> out; inputs mag: list
# ---------- colour: Python ----------
for magnitude in mag:
    
    if magnitude > 0: print(255, 0, 0)
    else: print(0, 0, 255)
# ---------- end colour ----------
custom_preview = CustomPreview(Geometry=merge, Material=colour)

type = ValueList({"Single_layered": 1, "double layered": 2}, selected="double layered")
toolpath_depth = Slider(0.025, range=0.001..1)
toolpath_height = Slider(0.02, range=0.001..1)
support = Brep([<brep referenced from the Rhino model> x3])

# ----
# Part D - Export
generate_toolpath = GhPythonScript(
    lines=merge,
    layer_depth=layer_depth,
    type=type,
    toolpath_depth=toolpath_depth,
    toolpath_height=toolpath_height,
    support=support)  # -> printpath; inputs lines: list of Curve, lines_closing: list of Curve, type: Int32, support: list of Brep
# ---------- generate_toolpath: Python ----------
import ghpythonlib.components as gh
import math



#############################################################################################
## Define Functions
#############################################################################################

## Close toolpath with one layer: 
def close_toolpath(curves, non_flip = 'none', cutting_volume= 'none'):
    toolpath_flipped = []
    lines = []
    
    if cutting_volume != 'none': curves = gh.TrimwithBreps(curves, cutting_volume)[1]
    
    if non_flip != 'none': toolpath_flipped = curves
    else:
        for i, crv in enumerate(curves):
            if i % 2 == 0:
                toolpath_flipped.append(gh.FlipCurve(crv)[0])
            else:
                toolpath_flipped.append(crv)
    
    for i in range(int(len(toolpath_flipped)-1)): lines.append(gh.Line(gh.EndPoints(toolpath_flipped[i])[0], gh.EndPoints(toolpath_flipped[i+1])[1]))
    
    toolpath_final = []
    
    toolpath_final.extend(toolpath_flipped)
    toolpath_final.extend(lines)
    
    
    toolpath_final = gh.JoinCurves(toolpath_final, False)
    return(toolpath_final, toolpath_flipped)



## Close toolpath with a double layered geometry:
def double_layered_closing(curves, layer_depth, recut, cutting_curve='none', cutting_volume='none'):
    curves_offset = []
    
    if recut == False: 
        for crv in curves:
            plane = gh.Planar(crv)[1]
            curves_offset.append(gh.OffsetCurve(crv, layer_depth, plane, 1))
    
    if recut == True:
        for i, crv in enumerate(curves):
            plane = gh.Planar(crv)[1]
            
            if i == 0:
                cut = gh.OffsetCurve(crv, layer_depth, plane, 1)
            else:
                offset = gh.ExtendCurve(gh.OffsetCurve(crv, layer_depth, plane, 1), 2, 0.05, 0.05)
                cut_par = gh.CurveXPlane(offset, gh.XYPlane(gh.ConstructPoint(0,0,0)))[1]
                
                cut = gh.Shatter(offset, cut_par)[1]
            curves_offset.append(cut)
    
    if cutting_curve != 'none':
        cutting_plane_a = gh.Planar(cutting_curve)[1]
        cutting_plane_b = gh.Mirror(cutting_plane_a, gh.XZPlane(gh.ConstructPoint(0,0,0)))[0]
        
        curves_offset_new = []
        for i in range(len(curves)):
            end = gh.EndPoints(curves[i])
            plane_a = gh.PlaneOrigin(cutting_plane_a, end[0])
            plane_b = gh.PlaneOrigin(cutting_plane_b, end[1])
            
            cut = gh.CurveXPlane(curves_offset[i], [plane_a, plane_b])[1]
            
            if cut:
               cut = gh.Shatter(curves_offset[i], cut)[1]
               curves_offset_new.append(cut)
            else:
                curves_offset_new.append(curves_offset[i])
        
        curves_offset = curves_offset_new
    
    
        ## Cut the Curves by the lateral supports: 
    if cutting_volume != 'none': curves = gh.TrimwithBreps(curves, cutting_volume)[1]
    if cutting_volume != 'none': curves_offset = gh.TrimwithBreps(curves_offset, cutting_volume)[1]
    
    
    ## Close one side: 
    lines_close = []
    for i, crv in enumerate(curves): lines_close.append(gh.Line(gh.EndPoints(crv)[0], gh.EndPoints(curves_offset[i])[0]))
    
    
    
    ## Join the curves: 
    joined = []
    for i, crv in enumerate(curves): joined.append(gh.JoinCurves([lines_close[i], curves[i], curves_offset[i]], False))
    joined = gh.FlipCurve(joined)[0]
    
    return(joined)


#############################################################################################
## Main Part
#############################################################################################

## Filter out the print_path_elements: 
line_filtered = []
for ln in lines:
    if gh.Length(ln) < layer_depth*0.95: line_filtered.append(ln)


## Join, rebuild and interpolates the curves:
joined = gh.JoinCurves(line_filtered, False)
rebuilt = gh.RebuildCurve(joined, 2, 25, False)
flipped = gh.FlipCurve(rebuilt, rebuilt[0])[0]
sorted = gh.SortList(gh.Deconstruct(gh.CurveMiddle(flipped))[0], flipped)[1]
sorted = [sorted[1], sorted[-1]]
trimmed = gh.TrimwithBrep(sorted, gh.CenterBox(gh.XYPlane(gh.ConstructPoint(0,0, -1)), 1, 1, 1))[1]

steps = []
interpolate = int(gh.Distance(gh.EndPoints(trimmed[0])[0], gh.EndPoints(trimmed[1])[0])/toolpath_height)
for i in range(interpolate): steps.append(i/interpolate)

toolpath = []
for step in steps: toolpath.append(gh.TweenCurve(trimmed[0], trimmed[-1], step))



######################################################################################################################################
## Create Start Strucutre: 
######################################################################################################################################

## Start Surface: 
base_curve = toolpath[0]
toolpath = toolpath[1:]

vec_a = gh.Vector2Pt(gh.EndPoints(toolpath[-1])[0], gh.EndPoints(base_curve)[0], False)[0]
vec_mid = gh.Vector2Pt(gh.CurveMiddle(toolpath[-1]), gh.CurveMiddle(base_curve), False)[0]

p_mid = gh.Move(gh.CurveMiddle(base_curve), gh.Amplitude(vec_mid, toolpath_height))[0]
p_base = gh.EndPoints(base_curve)[0]
p_end = gh.LineXPlane(gh.Line(gh.Move(p_base, vec_a)[0], p_base), gh.YZPlane(p_mid))[0]


ref_face = gh.BoundarySurfaces(gh.Rectangle3Pt(gh.EndPoints(base_curve)[0], gh.EndPoints(base_curve)[1], gh.CurveMiddle(base_curve))[0])
target_face = gh.BoundarySurfaces(gh.Rectangle3Pt(p_end, gh.Mirror(p_end, gh.XZPlane(gh.ConstructPoint(0,0,0)))[0], p_mid)[0])

curve_new = gh.RectangleMapping(base_curve, ref_face, target_face)[0]
curve_new = gh.TrimwithBreps(curve_new, gh.BoxRectangle(gh.Rectangle(gh.XZPlane(gh.ConstructPoint(0,1,0)), gh.ConstructDomain(-2,2), gh.ConstructDomain(-2,2), 0)[0], gh.ConstructDomain(-1,1)))[1]
base_curve = gh.TrimwithBreps(base_curve, gh.BoxRectangle(gh.Rectangle(gh.XZPlane(gh.ConstructPoint(0,1,0)), gh.ConstructDomain(-2,2), gh.ConstructDomain(-2,2), 0)[0], gh.ConstructDomain(-1,1)))[1]


if type ==2:
    base_curve_double = gh.ExtendCurve(gh.OffsetCurve(base_curve, toolpath_depth, gh.Planar(base_curve)[1], 0), 2, 0.0025, 0)
    curve_new_double = gh.Move(gh.ExtendCurve(gh.OffsetCurve(curve_new, toolpath_depth, gh.Planar(curve_new)[1], 0), 2, 0.011, 0), gh.UnitX(-toolpath_depth))[0]


## Printpath: 
divisions = int(gh.Length(base_curve) / toolpath_height)

div_start = gh.DivideCurve(base_curve, divisions, False)[0]
div_start = div_start[:-1]

div_mid = gh.DivideCurve(curve_new, divisions, False)[0]
div_mid = div_mid[:-1]


if type == 2:
    divisions += 3
    div_start_double = gh.DivideCurve(base_curve_double, divisions, False)[0]
    div_start_double = div_start_double[:-1]
    
    div_mid_double = gh.DivideCurve(curve_new_double, divisions, False)[0]
    div_mid_double = div_mid_double[:-1]


printpath_start = []
for i in range(len(div_start)):
    
    if type == 1:
        line_loc = gh.PolyLine([div_start[i], div_mid[i], gh.Mirror(div_mid[i], gh.XZPlane(gh.ConstructPoint(0,0,0)))[0], gh.Mirror(div_start[i], gh.XZPlane(gh.ConstructPoint(0,0,0)))[0]], False)
        printpath_start.append(line_loc)
    
    if type == 2:
        line_loc = gh.PolyLine([div_start[i], div_mid[i], gh.Mirror(div_mid[i], gh.XZPlane(gh.ConstructPoint(0,0,0)))[0], gh.Mirror(div_start[i], gh.XZPlane(gh.ConstructPoint(0,0,0)))[0], gh.Mirror(div_start_double[i], gh.XZPlane(gh.ConstructPoint(0,0,0)))[0], gh.Mirror(div_mid_double[i], gh.XZPlane(gh.ConstructPoint(0,0,0)))[0],div_mid_double[i], div_start_double[i]], False)
        printpath_start.append(line_loc)



######################################################################################################################################
## Create Final Toolpath: 
######################################################################################################################################


printpath = []
if type == 1:
    start = close_toolpath(printpath_start)[0]
    printpath.append(start)
    
    mid = close_toolpath(toolpath)[0]
    printpath.append(mid)



if type == 2:
    start = gh.FlipCurve(close_toolpath(printpath_start, True)[0])[0]
    printpath.append(start)
    
    mid = gh.FlipCurve(close_toolpath(double_layered_closing(toolpath, toolpath_depth, False, 'none', support), True)[0])[0]
    printpath.append(mid)


printpath = gh.Move(printpath, gh.UnitZ(toolpath_height))[0]
# ---------- end generate_toolpath ----------

custom_preview_2 = CustomPreview(Geometry=generate_toolpath, Material=ColourSwatch(SwatchColor=RGB(201, 0, 0)))
