# Grasshopper definition Code_Kappendecke_2.0_set_3_var_1_b - strucutral analysis.ghx (Grasshopper 1.0.7)
# Copyright: Felswind
# plug-ins: CEM_Build_Topology, CEM_Trail, CEM_Load, CEM_Deviation, CEM_Support, CEM_Extract_Topology, CEM_Calculate_Structure, CEM_Extract_Structure, CEM_Origin_Node, Karamba3D

layer_numb = Slider(8, range=1..100)
layer_depth = Slider(0.15, range=0.001..1)
arch_res = Slider(13, range=1..101)
tilt_angle_layer = Slider(45, range=0..90)
tilt_angle_main = Slider(10, range=0..90)
deviaton_arch_mag = Slider(-12, range=-100..0)
trail_length = Slider(-0.045, range=-50..0)

# ----
# Part A - Topology
main_topology_main_tilted = GhPythonScript(
    layer_numb=layer_numb,
    layer_depth=layer_depth,
    arch_res=arch_res,
    tilt_angle_layer=tilt_angle_layer,
    tilt_angle_main=tilt_angle_main,
    deviaton_arch_mag=deviaton_arch_mag,
    trail_length=trail_length)  # -> trail, trail_lengths, port, self_weight_pts, self_weight, port_2, external_force_pts, force_external_x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; inputs layer_numb: Int32, arch_res: Int32, tilt_angle_layer: Int32, tilt_angle_main: Int32
# ---------- main_topology_main_tilted: Python ----------
import ghpythonlib.components as gh
import math



#############################################################################
## Define Intersection Function
#############################################################################


def vector_intersect(res_vec, glob_dev_vec, glob_trail_vec):
    
    # Create endpoints: 
    start = gh.ConstructPoint(0,0,0)
    end_plan = gh.ConstructPoint(res_vec[0], 0, res_vec[2])
    end = res_vec
    
    
    # Create planar intersection: 
    line_a = gh.LineSDL(start, glob_dev_vec, 10)
    line_b_plan = gh.LineSDL(end_plan, glob_trail_vec, 10)
    
    intersection_point = gh.LineXLine(line_a, line_b_plan)[2]
    
    
    # Generate Lines: 
    deviation = gh.Vector2Pt(start, intersection_point, False)[0]
    trail = gh.Vector2Pt(end, intersection_point, False)[0]
    
    
    return(deviation, trail)



#############################################################################
## Create Main Inputs: 
#############################################################################

glob_trail_vec = gh.VectorXYZ(1, 0, -math.tan(math.radians(tilt_angle_layer)))[0]
glob_deviation_vec = gh.VectorXYZ(-1, 0, -math.tan(math.radians(tilt_angle_main)))[0]

self_weight = -2
force_external = -5

vec_self = gh.VectorXYZ(0,0,self_weight)[0]
vec_external = gh.Amplitude(glob_deviation_vec, -force_external)
deviaton_arch_mag = gh.VectorXYZ(0,deviaton_arch_mag,0)[0]

force_external_x = gh.DeconstructVector(vec_external)[0]
force_external_z = gh.DeconstructVector(vec_external)[2]



#############################################################################
## Create Deviation Magnitudes: 
#############################################################################

deviation_vec = []

for i in range(layer_numb):
    for k in range(arch_res):
        
        if i == 0 and k == 0: vec_loc = vec_self + vec_external + deviaton_arch_mag
        elif i == 0 and k >= 1: vec_loc = vec_self + trail_loc
        elif i >= 1 and k == 0: vec_loc = vec_self + deviaton_arch_mag + deviation_vec[((i-1)*arch_res)+k]
        else: vec_loc = vec_self + trail_loc + deviation_vec[((i-1)*arch_res)+k]
        
        vec_trail_dev = vector_intersect(vec_loc, glob_deviation_vec, glob_trail_vec)
        
        trail_loc = vec_trail_dev[1]
        deviation_loc = vec_trail_dev[0]
        
        deviation_vec.append(deviation_loc)



# Create Output: 
deviation_mag = []
force_anchor_x = []
force_anchor_y = []
force_anchor_z = []

for i in range(len(deviation_vec)):
    if i < arch_res*(layer_numb-1): deviation_mag.append(gh.VectorLength(-deviation_vec[i]))
    else:
        vec_loc = deviation_vec[i]
        force_anchor_x.append(-vec_loc[0])
        force_anchor_y.append(-vec_loc[1])
        force_anchor_z.append(-vec_loc[2])



#############################################################################
## Topology: 
#############################################################################

trail = []
deviation = []
anchor_points = []

self_weight_pts = []
external_force_pts = []
sim_anchor_forces = []

dist_x = math.cos(math.radians(tilt_angle_main)) * layer_depth
for i in range(layer_numb):
    line = gh.Line(gh.ConstructPoint(-i*dist_x,-trail_length*2*arch_res/2,0), gh.ConstructPoint(-i*dist_x,trail_length*2*arch_res/2,0))
    
    div = gh.DivideCurve(line, arch_res*2-1, False)
    
    
    # Geometry: 
    explode = gh.Shatter(line, div[2])
    deviation.append(explode[arch_res-1])
    del explode[arch_res-1]
    trail.extend(explode)
    
    if i != 0:
        for k in range(len(div[0])): deviation.append(gh.Line(div[0][k], pts_prev[k]))
    pts_prev = div[0]
    
    
    # Force Points: 
    self_weight_pts.extend(div[0])
    anchor_points.extend(gh.EndPoints(line))
    if i == 0: external_force_pts.extend([div[0][arch_res-1], div[0][arch_res]])
    if i == layer_numb-1:  sim_anchor_forces.extend(div[0])




#############################################################################
## Create Lengths and Magnitudes: 
#############################################################################

trail_lengths = []
for i in range(len(trail)): trail_lengths.append(trail_length)

force_anchor_x.reverse()
force_anchor_y.reverse()
force_anchor_z.reverse()

force_anchor_x.extend(force_anchor_x[::-1])
force_anchor_y.extend(force_anchor_y[::-1])
force_anchor_z.extend(force_anchor_z[::-1])


deviation_magnitude = []
deviation_mag = [deviation_mag[i:i + arch_res] for i in xrange(0, len(deviation_mag), arch_res)]
deviation_magnitude.append(deviaton_arch_mag[1])

for i in range(len(deviation_mag)):
    deviation_magnitude.append(deviaton_arch_mag[1])
    list_loc = deviation_mag[i]
    list_loc.reverse()
    
    deviation_magnitude.extend(list_loc)
    deviation_magnitude.extend(list_loc[::-1])

for i in range(len(deviation_magnitude)):
    if deviation_magnitude[i] > 0: deviation_magnitude[i] *= -1
# ---------- end main_topology_main_tilted ----------
cem_deviation = CEM_Deviation(
    DeviationEdge=graft(main_topology_main_tilted.deviation),
    DeviationMagn=graft(main_topology_main_tilted.deviation_magnitude))
cem_load = CEM_Load(
    PointLoad=graft(main_topology_main_tilted.sim_anchor_forces),
    LoadMagnX=graft(main_topology_main_tilted.force_anchor_x),
    LoadMagnZ=graft(main_topology_main_tilted.force_anchor_z))
cem_trail = CEM_Trail(TrailEdge=graft(main_topology_main_tilted.trail), TrailLen=graft(main_topology_main_tilted.trail_lengths))
cem_load_2 = CEM_Load(PointLoad=main_topology_main_tilted.self_weight_pts, LoadMagnZ=main_topology_main_tilted.self_weight)
cem_load_3 = CEM_Load(
    PointLoad=main_topology_main_tilted.external_force_pts,
    LoadMagnX=main_topology_main_tilted.force_external_x,
    LoadMagnZ=main_topology_main_tilted.force_external_z)
cem_support = CEM_Support(Support=main_topology_main_tilted.anchor_points)
cem_build_topology = CEM_Build_Topology(T=flatten(cem_trail), L=flatten([cem_load_2, cem_load_3, cem_load]), D=flatten(cem_deviation), S=flatten(cem_support))

# ----
# Part B - Structure
cem_extract_topology = CEM_Extract_Topology(TP=cem_build_topology)  # -> Nodes, NodesID, Edges, EdgesID, ConstraintPlane, ConstraintPlaneID, OriginNode, OriginNodeID
origin_nodes = GhPythonScript(
    nodes=cem_extract_topology.OriginNode,
    indices=cem_extract_topology.OriginNodeID,
    layer_depth=layer_depth,
    tilt_angle_main=tilt_angle_main)  # -> origin_new; inputs nodes: list of Vector3d, indices: list of Int32, tilt_angle_main: Int32
# ---------- origin_nodes: Python ----------
import ghpythonlib.components as gh
import math



## Sort the points and move them: 
x_value = gh.Absolute(gh.Deconstruct(nodes)[0])
sorted = gh.SortList(x_value, nodes)[1]
sorted_ind = gh.SortList(x_value, indices)[1]

sorted = [sorted[i:i + 2] for i in xrange(0, len(sorted), 2)]

z_move = -math.sin(math.radians(tilt_angle_main)) * layer_depth 

points_moved = []
for i in range(len(sorted)): points_moved.extend(gh.Move(sorted[i], gh.UnitZ(z_move*i+0.25))[0])


## Resort origin:
origin_new = []

for i in range(len(indices)):
    for k in range(len(sorted_ind)):
        if indices[i] == sorted_ind[k]:
            origin_new.append(points_moved[k])
# ---------- end origin_nodes ----------
cem_origin_node = CEM_Origin_Node(OriginNode=origin_nodes, OriginNodeID=cem_extract_topology.OriginNodeID)
cem_calculate_structure = CEM_Calculate_Structure(TP=cem_build_topology, N=cem_origin_node)

# ----
# Part C - Preview
cem_extract_structure = CEM_Extract_Structure(M=cem_calculate_structure)  # -> Nodes, NodesID, Trails, TrailsID, TrailsCol, TrailsMag, Deviations, DeviationsID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
merge = Merge(Data1=cem_extract_structure.Trails, Data2=cem_extract_structure.Deviations)
merge_2 = Merge(Data1=cem_extract_structure.TrailsMag, Data2=cem_extract_structure.DeviationsMag)
colour = GhPythonScript(mag=merge_2)  # -> out; inputs mag: list
# ---------- colour: Python ----------
for magnitude in mag:
    
    if magnitude > 0: print(255, 0, 0)
    else: print(0, 0, 255)
# ---------- end colour ----------
custom_preview = CustomPreview(Geometry=merge, Material=colour)

type = ValueList({"Single_layered": 1, "double layered": 2}, selected="double layered")
toolpath_depth = Slider(0.025, range=0.001..1)
toolpath_height = Slider(0.02, range=0.001..1)
anchor_cross_section = Curve(reparameterize(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))
start_length = Slider(0.1, range=0.001..1)
fillet_start = Slider(0.1, range=0.001..1)
angle_start = Slider(45, range=0..90)
cp_start = Point(Point(-0.9840673903, 0, 0.08033334019))
brep = Brep(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)

# ----
# Part D - Export
generate_toolpath = GhPythonScript(
    lines=merge,
    layer_depth=layer_depth,
    type=type,
    toolpath_depth=toolpath_depth,
    toolpath_height=toolpath_height,
    anchor_cross_section=anchor_cross_section,
    start_length=start_length,
    fillet_start=fillet_start,
    angle_start=angle_start,
    cp_start=cp_start,
    support_back=brep)  # -> toolpath, lateral_support, volume_main; inputs lines: list of Curve, lines_closing: list of Curve, type: Int32, anchor_cross_section: Curve, angle_start: Int32, cp_start: Point3d, support_back: Brep
# ---------- generate_toolpath: Python ----------
import ghpythonlib.components as gh
import math



#############################################################################################
## Define Functions
#############################################################################################

## Close toolpath with one layer: 
def close_toolpath(curves, non_flip = 'none', cutting_volume= 'none'):
    toolpath_flipped = []
    lines = []
    
    if cutting_volume != 'none': curves = gh.TrimwithBreps(curves, cutting_volume)[1]
    
    if non_flip != 'none': toolpath_flipped = curves
    else:
        for i, crv in enumerate(curves):
            if i % 2 == 0:
                toolpath_flipped.append(gh.FlipCurve(crv)[0])
            else:
                toolpath_flipped.append(crv)
    
    for i in range(int(len(toolpath_flipped)-1)): lines.append(gh.Line(gh.EndPoints(toolpath_flipped[i])[0], gh.EndPoints(toolpath_flipped[i+1])[1]))
    
    toolpath_final = []
    
    toolpath_final.extend(toolpath_flipped)
    toolpath_final.extend(lines)
    
    
    toolpath_final = gh.JoinCurves(toolpath_final, False)
    return(toolpath_final, toolpath_flipped)



#############################################################################################
## Main Part
#############################################################################################

## Filter out the print_path_elements: 
line_filtered = []
for ln in lines:
    if gh.Length(ln) < layer_depth*0.95: line_filtered.append(ln)


## Join, rebuild and interpolates the curves:
joined = gh.JoinCurves(line_filtered, False)
rebuilt = gh.RebuildCurve(joined, 2, 25, False)
flipped = gh.FlipCurve(rebuilt, rebuilt[0])[0]
sorted = gh.SortList(gh.Deconstruct(gh.CurveMiddle(flipped))[0], flipped)[1]
sorted = [sorted[1], sorted[-1]]
trimmed = gh.TrimwithBrep(sorted, gh.CenterBox(gh.XYPlane(gh.ConstructPoint(0,0, -1)), 1, 1, 1))[1]

steps = []
interpolate = int(gh.Distance(gh.EndPoints(trimmed[0])[0], gh.EndPoints(trimmed[1])[0])/toolpath_height)
for i in range(interpolate): steps.append(i/interpolate)

toolpath = []
for step in steps: toolpath.append(gh.TweenCurve(trimmed[0], trimmed[-1], step))



######################################################################################################################################
## Create lateral supports: 
######################################################################################################################################

lateral_curve = gh.Line(gh.EndPoints(toolpath[0])[0], gh.EndPoints(toolpath[-1])[0])
lateral_curve = gh.ExtendCurve(lateral_curve, 0, 0.275, 0.025)

cross_plane = gh.XZPlane(gh.ConstructPoint(0,0,0))
tan = gh.Vector2Pt(gh.EndPoints(lateral_curve)[0], gh.EndPoints(lateral_curve)[1], False)[0]
plane_ref = gh.ConstructPlane(gh.EndPoints(lateral_curve)[0], tan, gh.UnitZ(1))
section_oriented = gh.Orient(anchor_cross_section, cross_plane, plane_ref)[0]

lateral_support = []
lateral_support.append(gh.Extrude(gh.BoundarySurfaces(section_oriented), tan))
lateral_support.append(gh.Mirror(lateral_support[0], gh.XZPlane(gh.ConstructPoint(0,0,0)))[0])



######################################################################################################################################
## Create Starting Geometry: 
######################################################################################################################################

## Create Main Curves: 
p_end_top = gh.CurveXPlane(toolpath[0], gh.XZPlane(gh.ConstructPoint(0,0,0)))[0]
p_end_bot = gh.ConstructPoint(p_end_top[0]-start_length, 0, 0)
p_start = gh.EndPoints(toolpath[0])[0]
p_mid = gh.CurveXPlane(gh.ExtendCurve(lateral_curve, 0, 1, 1), gh.YZPlane(p_end_bot))[0]

start_curve = gh.Shatter(toolpath[0], gh.CurveXPlane(toolpath[0], gh.XZPlane(gh.ConstructPoint(0,0,0)))[1])[0]
mid_curve = gh.Interpolate([p_end_bot, cp_start, p_end_top], 3, False, 0)[0]

base_curve_main = gh.FilletDistance(gh.PolyLine([p_end_bot, p_mid, p_start], False), fillet_start)
base_div = gh.Explode(base_curve_main, True)[0][-1]
base_curve = gh.JoinCurves(gh.Explode(base_curve_main, True)[0][:-1], False)



## Interpolate Curves: 
ref_faces = []
div = int(gh.Length(start_curve) / toolpath_height)

div_start = gh.DivideCurve(mid_curve, div, False)[0]
div_base = gh.DivideCurve(base_div, div, False)[0]
div_base_mirr = gh.Mirror(div_base, gh.XZPlane(gh.ConstructPoint(0,0,0)))[0]

for i in range(len(div_start)): ref_faces.append(gh.BoundarySurfaces(gh.Rectangle3Pt(div_base[i], div_base_mirr[i], div_start[i])[0]))

curves_int = []
for i in range(len(ref_faces)):
    factor_a = i / (len(ref_faces) -1)
    factor_b = 1- factor_a
    
    ref_a = gh.SurfaceClosestPoint(gh.DivideCurve(start_curve, 25, False)[0], ref_faces[-1])[1]
    ref_b = gh.SurfaceClosestPoint(gh.DivideCurve(gh.FlipCurve(base_curve)[0], 25, False)[0], ref_faces[0])[1]
    
    pts_int = []
    for k in range(len(ref_a)):
        p_a = ref_a[k]
        p_b = ref_b[k]
        
        pts_int.append(gh.ConstructPoint(p_a[0]*factor_a + p_b[0]*factor_b, p_a[1]*factor_a + p_b[1]*factor_b, 0))
    
    curve_loc = gh.CurveOnSurface(ref_faces[i], pts_int, False)[0]
    curve_loc_mirr = gh.Mirror(curve_loc, gh.XZPlane(gh.ConstructPoint(0,0,0)))[0]
    curve_loc = gh.JoinCurves([curve_loc, curve_loc_mirr], False)
    
    curves_int.append(curve_loc)



## Create the Main and Start Surface-Curves: 
curves_main = []
curves_main.extend(curves_int[:-1])
curves_main.extend(toolpath)

p_a = gh.EndPoints(base_curve_main)[0]
p_b = gh.EndPoints(base_curve_main)[1]

vec_a = gh.Vector2Pt(p_a, p_b, False)[0]
vec_b = gh.VectorXYZ(0, 1, -math.tan(math.radians(angle_start)))[0]

cutting_plane = gh.ConstructPlane(p_a, vec_a, vec_b)
cutting_volume = gh.BoxRectangle(gh.Rectangle(cutting_plane, gh.ConstructDomain(-5,5), gh.ConstructDomain(-5,5),0)[0], gh.ConstructDomain(0,-5))
cutting_volume_mirr = gh.Mirror(cutting_volume, gh.XZPlane(gh.ConstructPoint(0,0,0)))[0]

options = gh.LoftOptions(False, False, 10, 0, 1)
volume_main = gh.Loft(curves_main, options)

part_main_step = gh.SplitBrep(volume_main, cutting_volume)
part_start = part_main_step[1]
part_main =  gh.SplitBrep(part_main_step[0], cutting_volume_mirr)[0]



## Create the Main Printpath: 
edges_all = gh.BrepEdges(part_main)[0]
edges_start = []
edges_start.append(edges_all[2])
edges_start.append(edges_all[4])
edges_start.append(edges_all[5])

edges_start = gh.JoinCurves(edges_start, False)
edges_end = gh.FlipCurve(edges_all[0])[0]

steps_local = int(gh.Distance(gh.CurveMiddle(edges_start), gh.CurveMiddle(edges_end))/toolpath_height) +1

steps = []
for i in range(steps_local): steps.append(1/(steps_local-1) *i)
main_crvs = gh.TweenCurve(edges_start, edges_end, steps)
main_crvs = gh.Project(main_crvs, part_main, gh.UnitZ(1))
main_crvs = gh.RebuildCurve(main_crvs, 3, 17, False)
main_crvs = main_crvs[1:]
main_crvs = gh.FlipCurve(main_crvs, main_crvs[2])[0]

curves_main_final = []
for i, crv in enumerate(main_crvs):
    if type == 2:
        div = gh.DivideCurve(crv, 25, False)[0]
        div = gh.SurfaceClosestPoint(div, volume_main)
        
        vec = gh.EvaluateSurface(volume_main, div[1])[1]
        moved = gh.Move(div[0], gh.Amplitude(vec, toolpath_depth))[0]
        curve_off = gh.Interpolate(moved, 3, False, 0)[0]
        curve_off = gh.TrimwithBreps(gh.ExtendCurve(curve_off, 2, 0.025, 0.025), lateral_support)[1]
        crv = gh.TrimwithBreps(gh.ExtendCurve(crv, 2, 0.01, 0.01), lateral_support)[1]
        con = gh.Line(gh.EndPoints(crv)[0], gh.EndPoints(curve_off)[0])
        joined = gh.FlipCurve(gh.JoinCurves([crv, con, curve_off], False))[0]
    
    else: joined = gh.TrimwithBreps(gh.ExtendCurve(crv, 2, 0.01, 0.01), lateral_support)[1]
    curves_main_final.append(joined)



## Create the Start Printpath: 
edges_all = gh.BrepEdges(part_start)[0]
edges_start = []
edges_start.append(edges_all[0])
edges_start.append(edges_all[2])

edges_start = gh.JoinCurves(edges_start, False)
edges_end = edges_all[1]

steps_local = int(gh.Distance(gh.CurveMiddle(edges_start), gh.CurveMiddle(edges_end))/toolpath_height) +2
line_loc = gh.Line(gh.CurveMiddle(edges_start), gh.CurveMiddle(edges_end))
line_loc = gh.Project(line_loc, part_start, gh.UnitZ(1))
div = gh.DivideCurve(line_loc, steps_local, False)[0]


curves_new = []
for i in range(len(div)-1):
    vec_a = gh.Vector2Pt(gh.EndPoints(edges_end)[0], gh.EndPoints(edges_end)[1], False)[0]
    
    angle_loc = angle_start / (len(div)-2)*i
    vec_b = gh.VectorXYZ(-1, 0, math.tan(math.radians(angle_loc)))[0]
    
    plane = gh.ConstructPlane(div[i], vec_a, vec_b)
    curve_new = gh.BrepXPlane(part_start, plane)[0]
    curves_new.append(curve_new)

curves_new.append(edges_end)
start_crvs = []
start_crvs.append(gh.ExtendCurve((gh.TrimwithBrep(curves_new[0], gh.Pipe(curves_new[1], toolpath_height, 1))[0]), 1, -0.03, -0.03))
start_crvs.extend(curves_new[1:])
start_crvs = gh.FlipCurve(start_crvs, start_crvs[2])[0]


lateral_support.append(support_back)

curves_start_final = []
for i, crv in enumerate(start_crvs):
    joined = []
    trimmed_loc = gh.TrimwithBreps(crv, lateral_support)[1]
    joined.append(trimmed_loc)
    
    if type == 2:
        plane = gh.Planar(crv)[1]
        offset = gh.OffsetCurve(crv, toolpath_depth, plane, 0)
        offset = gh.ExtendCurve(offset, 1, 0.05, 0.05)
        trimmed = gh.TrimwithBreps(offset, lateral_support)[1]
        joined.append(trimmed)
        joined.append(gh.Line(gh.EndPoints(trimmed)[0], gh.EndPoints(trimmed_loc)[0]))
    
    joined = gh.JoinCurves(joined, False)
    trim_body = gh.Extrude(gh.BoundarySurfaces(gh.Rectangle(gh.XZPlane(gh.ConstructPoint(0,-toolpath_height/2,0)), gh.ConstructDomain(-5,5), gh.ConstructDomain(-5,5),0)[0]), gh.UnitY(1))
    joined = gh.TrimwithBrep(joined, trim_body)[1]
    
    
    curves_start_final.append(joined)




## Build toolpath:
part_a = close_toolpath(curves_start_final, False)[0]
part_b = gh.Mirror(part_a, gh.XZPlane(gh.ConstructPoint(0,0,0)))[0]
part_c = close_toolpath(curves_main_final, False)[0]

toolpath = [part_a, part_b, part_c]
toolpath = gh.Move(toolpath, gh.UnitZ(toolpath_height))[0]
toolpath = gh.FlipCurve(toolpath)[0]
# ---------- end generate_toolpath ----------

custom_preview_2 = CustomPreview(Geometry=generate_toolpath.toolpath, Material=ColourSwatch(SwatchColor=RGB(201, 0, 0)))
custom_preview_3 = CustomPreview(Geometry=generate_toolpath.lateral_support, Material=ColourSwatch(SwatchColor=RGB(161, 148, 119)))
rotate = Rotate(Geometry=generate_toolpath.volume_main, Angle=degrees(180), Plane=PlaneXY(0, 0, 0))  # -> Geometry, Transform

# ----
# Part E - Strucutral Analysis
# ULS -> Tragfähigkeit (Utilizitaion)
# SLS -> Gebrauchtauglihkeit Displacement
# Sicherheitsbeiwert ständige Lasten: 1.35
# Lastannahnme: Kategorie B2; Büroflächen - Arbeitsfächen = 3.0 KN/m²
# 
# Zusätzlich:
# 1.2 KN/m² Trennwandzuschlag
# Sicherheitsbeiwert veränderliche Lasten: 1.5
strucutre_main = Surface(reparameterize(rotate.Geometry))
eigengewicht = Slider(1.35, range=0..10)
veränderl_lasten = Slider(10, range=0..10)
dicke_shell = Slider(4, range=0..100)
mesh = GhPythonScript(surface=strucutre_main)  # -> mesh, anchor_nodes, port, face_loads; inputs surface: Surface
# ---------- mesh: Python ----------
import ghpythonlib.components as gh




## Create the mesh: 
mesh = gh.MeshSurface(surface, 50, 25, True, False)
points_all = gh.DeconstructMesh(mesh)[0]

anchor_nodes = []

for node in points_all:
    if node[2] < 0.001: anchor_nodes.append(node)



## Calculate the volume and the loads based on this: 
points_z = []

for node in points_all: points_z.append(node[2])
points_z.sort()

plane_floor = gh.XYPlane(gh.ConstructPoint(0,0, points_z[-1] + 0.05))
faces = gh.DeconstructMesh(mesh)[1]
options = gh.LoftOptions(False, False, 0, 0, 0)


face_loads = []
for face in faces:
    
    i = gh.DeconstructFace(face)
    pts = [points_all[i[0]], points_all[i[1]], points_all[i[2]], points_all[i[3]]]
    
    pline = gh.PolyLine(pts, True)
    pline_proj = gh.ProjectAlong(pline, plane_floor, gh.UnitZ(1))[0]
    
    floor_load = gh.Area(pline_proj)[0] * 2.0 #2,0KN/m² - Fußbodenaufbau
    loft = gh.Loft([pline, pline_proj], options)
    
    srf_a = gh.FragmentPatch(pline)
    srf_b = gh.FragmentPatch(pline_proj)
    
    loft = gh.BrepJoin([srf_a, srf_b, loft])[0]
    volume = gh.Volume(loft)[0]
    
    volume_load = volume * 18 #18KN/m³ Sand / Geröll
    load = volume_load+floor_load
    
    load_vec = gh.VectorXYZ(0,0,-load*1.35)[0]
    
    face_loads.append(load_vec)
# ---------- end mesh ----------
unit_z = UnitZ(Factor=eigengewicht)  # -> expr("-x", UnitVector)
unit_z_2 = UnitZ(Factor=veränderl_lasten)  # -> expr("-x", UnitVector)
material_selection_karamba3d = MaterialSelectionKaramba3D(menu=[dropdown(7), dropdown(5)])
cross_section_karamba3d = CrossSectionKaramba3D(
    FamilyNameOfCrossSection="DefaultCroSec",
    Material=material_selection_karamba3d,
    Height_cm=dicke_shell,
    mode="Shell - Const")
support_karamba3d = SupportKaramba3D(PosInd=mesh.anchor_nodes, menu=[buttons(on, on, on, off, off, off)])
mesh_to_shell_karamba3d = MeshToShellKaramba3D(Mesh=mesh.mesh, LimitDistance_m=0.005, Bending=True)  # -> Element, Points, Info
loads_karamba3d = LoadsKaramba3D(Vector=unit_z, LCase="0", mode="Gravity")
loads_karamba3d_2 = LoadsKaramba3D(Vector=unit_z_2, Mesh=mesh.mesh, LCase="1", mode="MeshLoad -Const.", menu=[buttons(off, on, off), buttons(on, on)])
loads_karamba3d_3 = LoadsKaramba3D(
    Vectors=mesh.face_loads,
    Mesh=mesh.mesh,
    LCase="1",
    mode="MeshLoad -Variable",
    menu=[buttons(off, on, off), buttons(on, on)])
assemble_model_karamba3d = AssembleModelKaramba3D(
    Elem=mesh_to_shell_karamba3d.Element,
    Support=support_karamba3d,
    Load=flatten([loads_karamba3d, loads_karamba3d_2, loads_karamba3d_3]),
    CrossSection=cross_section_karamba3d,
    Material=material_selection_karamba3d,
    LimitDistance_m=0.005)  # -> Model, Info, Mass_kg, CenterOfGravity, LoadCaseNames
analyze_karamba3d = AnalyzeKaramba3D(Model=assemble_model_karamba3d.Model)  # -> CalculatedModel, MaximumDisplacement_cm, ResultingForceOfGravity_kN, ElasticEnergyChange_kNm
maximum_displacement_cm = Panel(analyze_karamba3d.MaximumDisplacement_cm)
gradient = Gradient(
    LowerLimit=0,
    UpperLimit=9,
    Parameter=[0, 1, 2, 3, 4, 5, 6, 7, 8, 9],
    stops=[0: RGB(0, 0, 255), 0.348: RGB(100, 100, 255), 0.499: RGB(224, 224, 224), 0.648: RGB(255, 100, 100)])
model_view_karamba3d = ModelViewKaramba3D(Model=analyze_karamba3d.CalculatedModel, ResultFactors=1, ResultCase=-1)  # -> Model, DeformedMesh, DeformedAxes, DeformedModel
shell_view_karamba3d = ShellViewKaramba3D(Model=model_view_karamba3d.Model, IndexOfLayer=0)  # -> Model, MeshesOfRenderedShells, LegendColors, LegendTags

legend = Legend(Colour=shell_view_karamba3d.LegendColors, Tags=shell_view_karamba3d.LegendTags, LegendType=1)
