# Grasshopper definition Code_Kappendecke_2.0_set_3_var_1_b.ghx (Grasshopper 1.0.7)
# Copyright: Felswind
# plug-ins: CEM_Build_Topology, CEM_Trail, CEM_Load, CEM_Deviation, CEM_Support, CEM_Extract_Topology, CEM_Calculate_Structure, CEM_Extract_Structure, CEM_Origin_Node

layer_numb = Slider(8, range=1..100)
layer_depth = Slider(0.15, range=0.001..1)
arch_res = Slider(13, range=1..101)
tilt_angle_layer = Slider(45, range=0..90)
tilt_angle_main = Slider(10, range=0..90)
deviaton_arch_mag = Slider(-12, range=-100..0)
trail_length = Slider(-0.045, range=-50..0)

# ----
# Part A - Topology
main_topology_main_tilted = GhPythonScript(
    layer_numb=layer_numb,
    layer_depth=layer_depth,
    arch_res=arch_res,
    tilt_angle_layer=tilt_angle_layer,
    tilt_angle_main=tilt_angle_main,
    deviaton_arch_mag=deviaton_arch_mag,
    trail_length=trail_length)  # -> trail, trail_lengths, port, self_weight_pts, self_weight, port_2, external_force_pts, force_external_x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; inputs layer_numb: Int32, arch_res: Int32, tilt_angle_layer: Int32, tilt_angle_main: Int32
# ---------- main_topology_main_tilted: Python ----------
import ghpythonlib.components as gh
import math



#############################################################################
## Define Intersection Function
#############################################################################


def vector_intersect(res_vec, glob_dev_vec, glob_trail_vec):
    
    # Create endpoints: 
    start = gh.ConstructPoint(0,0,0)
    end_plan = gh.ConstructPoint(res_vec[0], 0, res_vec[2])
    end = res_vec
    
    
    # Create planar intersection: 
    line_a = gh.LineSDL(start, glob_dev_vec, 10)
    line_b_plan = gh.LineSDL(end_plan, glob_trail_vec, 10)
    
    intersection_point = gh.LineXLine(line_a, line_b_plan)[2]
    
    
    # Generate Lines: 
    deviation = gh.Vector2Pt(start, intersection_point, False)[0]
    trail = gh.Vector2Pt(end, intersection_point, False)[0]
    
    
    return(deviation, trail)



#############################################################################
## Create Main Inputs: 
#############################################################################

glob_trail_vec = gh.VectorXYZ(1, 0, -math.tan(math.radians(tilt_angle_layer)))[0]
glob_deviation_vec = gh.VectorXYZ(-1, 0, -math.tan(math.radians(tilt_angle_main)))[0]

self_weight = -2
force_external = -5

vec_self = gh.VectorXYZ(0,0,self_weight)[0]
vec_external = gh.Amplitude(glob_deviation_vec, -force_external)
deviaton_arch_mag = gh.VectorXYZ(0,deviaton_arch_mag,0)[0]

force_external_x = gh.DeconstructVector(vec_external)[0]
force_external_z = gh.DeconstructVector(vec_external)[2]



#############################################################################
## Create Deviation Magnitudes: 
#############################################################################

deviation_vec = []

for i in range(layer_numb):
    for k in range(arch_res):
        
        if i == 0 and k == 0: vec_loc = vec_self + vec_external + deviaton_arch_mag
        elif i == 0 and k >= 1: vec_loc = vec_self + trail_loc
        elif i >= 1 and k == 0: vec_loc = vec_self + deviaton_arch_mag + deviation_vec[((i-1)*arch_res)+k]
        else: vec_loc = vec_self + trail_loc + deviation_vec[((i-1)*arch_res)+k]
        
        vec_trail_dev = vector_intersect(vec_loc, glob_deviation_vec, glob_trail_vec)
        
        trail_loc = vec_trail_dev[1]
        deviation_loc = vec_trail_dev[0]
        
        deviation_vec.append(deviation_loc)



# Create Output: 
deviation_mag = []
force_anchor_x = []
force_anchor_y = []
force_anchor_z = []

for i in range(len(deviation_vec)):
    if i < arch_res*(layer_numb-1): deviation_mag.append(gh.VectorLength(-deviation_vec[i]))
    else:
        vec_loc = deviation_vec[i]
        force_anchor_x.append(-vec_loc[0])
        force_anchor_y.append(-vec_loc[1])
        force_anchor_z.append(-vec_loc[2])



#############################################################################
## Topology: 
#############################################################################

trail = []
deviation = []
anchor_points = []

self_weight_pts = []
external_force_pts = []
sim_anchor_forces = []

dist_x = math.cos(math.radians(tilt_angle_main)) * layer_depth
for i in range(layer_numb):
    line = gh.Line(gh.ConstructPoint(-i*dist_x,-trail_length*2*arch_res/2,0), gh.ConstructPoint(-i*dist_x,trail_length*2*arch_res/2,0))
    
    div = gh.DivideCurve(line, arch_res*2-1, False)
    
    
    # Geometry: 
    explode = gh.Shatter(line, div[2])
    deviation.append(explode[arch_res-1])
    del explode[arch_res-1]
    trail.extend(explode)
    
    if i != 0:
        for k in range(len(div[0])): deviation.append(gh.Line(div[0][k], pts_prev[k]))
    pts_prev = div[0]
    
    
    # Force Points: 
    self_weight_pts.extend(div[0])
    anchor_points.extend(gh.EndPoints(line))
    if i == 0: external_force_pts.extend([div[0][arch_res-1], div[0][arch_res]])
    if i == layer_numb-1:  sim_anchor_forces.extend(div[0])




#############################################################################
## Create Lengths and Magnitudes: 
#############################################################################

trail_lengths = []
for i in range(len(trail)): trail_lengths.append(trail_length)

force_anchor_x.reverse()
force_anchor_y.reverse()
force_anchor_z.reverse()

force_anchor_x.extend(force_anchor_x[::-1])
force_anchor_y.extend(force_anchor_y[::-1])
force_anchor_z.extend(force_anchor_z[::-1])


deviation_magnitude = []
deviation_mag = [deviation_mag[i:i + arch_res] for i in xrange(0, len(deviation_mag), arch_res)]
deviation_magnitude.append(deviaton_arch_mag[1])

for i in range(len(deviation_mag)):
    deviation_magnitude.append(deviaton_arch_mag[1])
    list_loc = deviation_mag[i]
    list_loc.reverse()
    
    deviation_magnitude.extend(list_loc)
    deviation_magnitude.extend(list_loc[::-1])

for i in range(len(deviation_magnitude)):
    if deviation_magnitude[i] > 0: deviation_magnitude[i] *= -1
# ---------- end main_topology_main_tilted ----------
cem_deviation = CEM_Deviation(
    DeviationEdge=graft(main_topology_main_tilted.deviation),
    DeviationMagn=graft(main_topology_main_tilted.deviation_magnitude))
cem_load = CEM_Load(
    PointLoad=graft(main_topology_main_tilted.sim_anchor_forces),
    LoadMagnX=graft(main_topology_main_tilted.force_anchor_x),
    LoadMagnZ=graft(main_topology_main_tilted.force_anchor_z))
cem_trail = CEM_Trail(TrailEdge=graft(main_topology_main_tilted.trail), TrailLen=graft(main_topology_main_tilted.trail_lengths))
cem_load_2 = CEM_Load(PointLoad=main_topology_main_tilted.self_weight_pts, LoadMagnZ=main_topology_main_tilted.self_weight)
cem_load_3 = CEM_Load(
    PointLoad=main_topology_main_tilted.external_force_pts,
    LoadMagnX=main_topology_main_tilted.force_external_x,
    LoadMagnZ=main_topology_main_tilted.force_external_z)
cem_support = CEM_Support(Support=main_topology_main_tilted.anchor_points)
cem_build_topology = CEM_Build_Topology(T=flatten(cem_trail), L=flatten([cem_load_2, cem_load_3, cem_load]), D=flatten(cem_deviation), S=flatten(cem_support))

# ----
# Part B - Structure
cem_extract_topology = CEM_Extract_Topology(TP=cem_build_topology)  # -> Nodes, NodesID, Edges, EdgesID, ConstraintPlane, ConstraintPlaneID, OriginNode, OriginNodeID
origin_nodes = GhPythonScript(
    nodes=cem_extract_topology.OriginNode,
    indices=cem_extract_topology.OriginNodeID,
    layer_depth=layer_depth,
    tilt_angle_main=tilt_angle_main)  # -> origin_new; inputs nodes: list of Vector3d, indices: list of Int32, tilt_angle_main: Int32
# ---------- origin_nodes: Python ----------
import ghpythonlib.components as gh
import math



## Sort the points and move them: 
x_value = gh.Absolute(gh.Deconstruct(nodes)[0])
sorted = gh.SortList(x_value, nodes)[1]
sorted_ind = gh.SortList(x_value, indices)[1]

sorted = [sorted[i:i + 2] for i in xrange(0, len(sorted), 2)]

z_move = -math.sin(math.radians(tilt_angle_main)) * layer_depth 

points_moved = []
for i in range(len(sorted)): points_moved.extend(gh.Move(sorted[i], gh.UnitZ(z_move*i+0.25))[0])


## Resort origin:
origin_new = []

for i in range(len(indices)):
    for k in range(len(sorted_ind)):
        if indices[i] == sorted_ind[k]:
            origin_new.append(points_moved[k])
# ---------- end origin_nodes ----------
cem_origin_node = CEM_Origin_Node(OriginNode=origin_nodes, OriginNodeID=cem_extract_topology.OriginNodeID)
cem_calculate_structure = CEM_Calculate_Structure(TP=cem_build_topology, N=cem_origin_node)

number_slider = Slider(8, range=0..100)  # disabled
curve = Curve(reparameterize(<curve referenced from the Rhino model>))  # disabled
curve_2 = Curve(reparameterize(<curve referenced from the Rhino model>))  # disabled
point = Point([<point referenced from the Rhino model> x3])  # disabled
polyline = PolyLine(Vertices=point, Closed=False)  # disabled

# ----
# Part C - Preview
cem_extract_structure = CEM_Extract_Structure(M=cem_calculate_structure)  # -> Nodes, NodesID, Trails, TrailsID, TrailsCol, TrailsMag, Deviations, DeviationsID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
merge = Merge(Data1=cem_extract_structure.Trails, Data2=cem_extract_structure.Deviations)
merge_2 = Merge(Data1=cem_extract_structure.TrailsMag, Data2=cem_extract_structure.DeviationsMag)
colour = GhPythonScript(mag=merge_2)  # -> out; inputs mag: list
# ---------- colour: Python ----------
for magnitude in mag:
    
    if magnitude > 0: print(255, 0, 0)
    else: print(0, 0, 255)
# ---------- end colour ----------
custom_preview = CustomPreview(Geometry=merge, Material=colour)

divide_curve = DivideCurve(Curve=polyline, Count=number_slider, Kinks=False)  # -> Points, Tangents, Parameters; disabled
nurbs_curve = NurbsCurve(Vertices=divide_curve.Points, Degree=3, Periodic=False)  # -> Curve, Length, Domain; disabled

type = ValueList({"Single_layered": 1, "double layered": 2}, selected="Single_layered")
toolpath_depth = Slider(0.03, range=0.001..1)
toolpath_height = Slider(0.015, range=0.001..1)
anchor_cross_section = Curve(reparameterize(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))

flip_curve = FlipCurve()  # -> Curve, Flag; disabled

fillet_start = Slider(0.4, range=0.001..1)
angle_start = Slider(45, range=0..90)

# ----
# Part D - Export
generate_toolpath = GhPythonScript(
    lines=merge,
    layer_depth=layer_depth,
    type=type,
    toolpath_depth=toolpath_depth,
    toolpath_height=toolpath_height,
    anchor_cross_section=anchor_cross_section,
    fillet_start=fillet_start,
    angle_start=angle_start)  # -> toolpath_a, lateral_support, toolpath, loft_new, main_surface_b; inputs lines: list of Curve, lines_closing: list of Curve, type: Int32, anchor_cross_section: Curve
# ---------- generate_toolpath: Python ----------
import ghpythonlib.components as gh
import math



#############################################################################################
## Define Layering Functions
#############################################################################################

## Close toolpath with one layer: 
def close_toolpath(curves, non_flip = 'none', cutting_volume= 'none'):
    toolpath_flipped = []
    lines = []
    
    if cutting_volume != 'none': curves = gh.TrimwithBreps(curves, cutting_volume)[1]
    
    if non_flip != 'none': toolpath_flipped = curves
    else:
        for i, crv in enumerate(curves):
            if i % 2 == 0:
                toolpath_flipped.append(gh.FlipCurve(crv)[0])
            else:
                toolpath_flipped.append(crv)
    
    for i in range(int(len(toolpath_flipped)-1)): lines.append(gh.Line(gh.EndPoints(toolpath_flipped[i])[0], gh.EndPoints(toolpath_flipped[i+1])[1]))
    
    toolpath_final = []
    
    toolpath_final.extend(toolpath_flipped)
    toolpath_final.extend(lines)
    
    
    toolpath_final = gh.JoinCurves(toolpath_final, False)
    return(toolpath_final, toolpath_flipped)



## Close toolpath with a double layered geometry:
def double_layered_closing(curves, layer_depth, recut, cutting_volume= 'none'):
    curves_offset = []
    
    
    if recut == False: 
        for crv in curves:
            curves_offset.append(gh.OffsetCurve(crv, layer_depth, gh.XYPlane(gh.ConstructPoint(0,0,0)), 1))
    
    
    if recut == True:
        for crv in curves:
            plane = gh.Planar(crv)[1]
            offset = gh.ExtendCurve(gh.OffsetCurve(crv, layer_depth, plane, 1), 2, 0.05, 0.05)
            
            bound = gh.Extrude(gh.BoundarySurfaces(gh.Rectangle(gh.XYPlane(gh.ConstructPoint(0,0,0)), gh.ConstructDomain(-10,10), gh.ConstructDomain(-10,10),0)[0]), gh.UnitZ(-10))
            cut = gh.TrimwithBrep(offset, bound)[1]
            
            curves_offset.append(cut)
    
    
    
    ## Cut the Curves by the lateral supports: 
    if cutting_volume != 'none': curves = gh.TrimwithBreps(curves, cutting_volume)[1]
    if cutting_volume != 'none': curves_offset = gh.TrimwithBreps(curves_offset, cutting_volume)[1]
    
    
    
    ## Close one side: 
    lines_close = []
    for i, crv in enumerate(curves): lines_close.append(gh.Line(gh.EndPoints(crv)[0], gh.EndPoints(curves_offset[i])[0]))
    
    
    
    ## Join the curves: 
    joined = []
    for i, crv in enumerate(curves): joined.append(gh.JoinCurves([lines_close[i], curves[i], curves_offset[i]], False))
    
    
    
    ## Create the fab export: 
    curves_single = []
    
    for i in range(len(curves)):
        curves_single.append(curves_offset[i])
        curves_single.append(curves[i])
    
    
    return(joined, curves_single)



#############################################################################################
## Main Part
#############################################################################################

## Filter out the print_path_elements: 
line_filtered = []
for ln in lines:
    if gh.Length(ln) < layer_depth*0.95: line_filtered.append(ln)



## Join, rebuild and interpolates the curves:
joined = gh.JoinCurves(line_filtered, False)
rebuilt = gh.RebuildCurve(joined, 2, 25, False)
flipped = gh.FlipCurve(rebuilt, rebuilt[0])[0]
sorted = gh.SortList(gh.Deconstruct(gh.CurveMiddle(flipped))[0], flipped)[1]

steps = []
interpolate = int(layer_depth/toolpath_height)

toolpath = []

for i in range(interpolate): steps.append(i/interpolate)
for i in range(int(len(joined)-1)): toolpath.extend(gh.TweenCurve(sorted[i], sorted[i+1], steps))

toolpath_a = gh.Move(toolpath, gh.UnitZ(-0.005-gh.EndPoints(toolpath[-1])[0][2]))[0]

# Cut toolpath: 
toolpath_loc = []
for i in range(len(toolpath_a)):
    plane_loc = gh.XYPlane(gh.ConstructPoint(0,0,0))
    int_loc = gh.CurveXPlane(toolpath_a[i], plane_loc)[1]
    shatter_loc = gh.Shatter(toolpath_a[i], int_loc)[1]
    toolpath_loc.append(shatter_loc)

toolpath_a = toolpath_loc



## Create lateral supports:
lateral_curve = gh.Line(gh.EndPoints(toolpath_loc[0])[0], gh.EndPoints(toolpath_loc[-1])[0])
lateral_curve = gh.ExtendCurve(lateral_curve, 0, 0.25, 0.05)

cross_plane = gh.XZPlane(gh.ConstructPoint(0,0,0))
tan = gh.Vector2Pt(gh.EndPoints(lateral_curve)[0], gh.EndPoints(lateral_curve)[1], False)[0]
plane_ref = gh.ConstructPlane(gh.EndPoints(lateral_curve)[0], tan, gh.UnitZ(1))
section_oriented = gh.Orient(anchor_cross_section, cross_plane, plane_ref)[0]

lateral_support = []
lateral_support.append(gh.Extrude(gh.BoundarySurfaces(section_oriented), tan))
lateral_support.append(gh.Mirror(lateral_support[0], gh.XZPlane(gh.ConstructPoint(0,0,0)))[0])



#############################################################################################
## Start Part
#############################################################################################

## Create the Main Surface: 
vec_start = gh.Vector2Pt(gh.EndPoints(toolpath_a[1])[0], gh.EndPoints(toolpath_a[0])[0], False)[0]
vec_start = gh.VectorXYZ(vec_start[0], vec_start[1], 0)[0]

points = gh.DivideCurve(toolpath_a[0], 50, False)[0]
points = points[:26]
points.reverse()


length_start = 0.14

curves_section = []
for i, pt in enumerate(points):
    
    x_move = (-length_start/(len(points)-1)) * i
    
    y_loc = ((length_start + points[0][0] - points[-1][0]) * vec_start[1]) / vec_start[0]
    y_move = (-y_loc/(len(points)-1)) * i
    
    point_end = gh.ConstructPoint(points[0][0]+x_move, 0, pt[2])
    point_mid = gh.ConstructPoint(points[0][0]+x_move, pt[1]+y_move, pt[2])
    
    if i > 0:
        line_loc = gh.PolyLine([point_end, point_mid, pt], False)
        line_loc = gh.FilletDistance(line_loc, fillet_start)
        
        curves_section.append(line_loc)


pts_loc = []
for crv in curves_section: pts_loc.append(gh.DivideCurve(crv, 50, False)[0])

loft_curves = []
for i in range(51):
    pts_loc_crv = []
    
    pts_loc_crv.append(points[0])
    for k in range(len(pts_loc)): pts_loc_crv.append(pts_loc[k][i])
    
    crv = gh.PolyLine(pts_loc_crv, False)
    loft_curves.append(crv)

options = gh.LoftOptions(False, False, 100, 0 ,0)
main_surface = gh.Loft(loft_curves, options)



## Cut the main Surface: 
start = gh.EndPoints(loft_curves[0])[1]
end = gh.EndPoints(loft_curves[-3])[1]

vec_a = gh.Vector2Pt(start, end, False)[0]
vec_b = gh.VectorXYZ(0, 1, -math.tan(math.radians(angle_start)))[0]

cutting_plane = gh.ConstructPlane(start, vec_a, vec_b)
cutting_curve = gh.BrepXPlane(main_surface, cutting_plane)[0]

main_surface_a = gh.SurfaceSplit(main_surface, cutting_curve)[0]
main_surface_b = gh.SurfaceSplit(main_surface, cutting_curve)[1]



## Create main Opening Surface: 
edges = gh.BrepEdges(main_surface_a)[0]
surface_div_new = gh.SurfaceClosestPoint(gh.DivideSurface(gh.EdgeSurface(edges[0], edges[1], edges[2], edges[3]), 10, 10)[0], main_surface_a)[0]

crvs_new = []
for i in range(11):
    
    points_loc = []
    
    for k in range(11): points_loc.append(surface_div_new[k*11+i])
    
    curve_new_loc = gh.Interpolate(points_loc, 3, False, 1)[0]
    curve_new_mirr = gh.Mirror(curve_new_loc, gh.XZPlane(gh.ConstructPoint(0,0,0)))[0]
    
    joined = gh.RebuildCurve(gh.JoinCurves([curve_new_loc, curve_new_mirr], False), 2, 50, True)
    crvs_new.append(joined)

path = []
path.extend(crvs_new[:-1])
path.extend(toolpath_a)


path = gh.FlipCurve(path, path[0])[0]
loft_new = gh.Loft(path, options)








### Build toolpath:
#toolpath_single_curves = []
#
#if type == 1:
#    toolpath_a = close_toolpath(toolpath_a, 'none', lateral_support)[0]
#
#if type == 2:
#    toolpath_a = gh.FlipCurve(toolpath_a)[0]
#    toolpath_a = close_toolpath(double_layered_closing(toolpath_a, toolpath_depth, True, lateral_support)[0], True)[0]

#toolpath_a = gh.Move(toolpath_a, gh.UnitZ(toolpath_height))[0]
# ---------- end generate_toolpath ----------

lateral_anchors = Brep(generate_toolpath.lateral_support)  # disabled

generate_toolpath_2 = GhPythonScript(
    lines=generate_toolpath.toolpath,
    layer_depth=layer_depth,
    type=type,
    toolpath_depth=toolpath_depth,
    toolpath_height=toolpath_height,
    fillet_start=fillet_start,
    angle_start=angle_start,
    lateral_anchors=lateral_anchors)  # -> printpath, main_surface_a, path; inputs lines: list of Curve, type: Int32, angle_start: Int32, lateral_anchors: list of Brep; disabled
# ---------- generate_toolpath_2: Python ----------
import ghpythonlib.components as gh
import math



#####################################################################################################
## Define Closing Functions: 
#####################################################################################################


## Close toolpath with one layer: 
def close_toolpath(curves, non_flip = 'none'):
    toolpath_flipped = []
    lines = []
    
    
    if non_flip != 'none': toolpath_flipped = curves
    else:
        for i, crv in enumerate(curves):
            if i % 2 == 0:
                toolpath_flipped.append(gh.FlipCurve(crv)[0])
            else:
                toolpath_flipped.append(crv)
    
    for i in range(int(len(toolpath_flipped)-1)): lines.append(gh.Line(gh.EndPoints(toolpath_flipped[i])[0], gh.EndPoints(toolpath_flipped[i+1])[1]))
    
    toolpath_final = []
    
    toolpath_final.extend(toolpath_flipped)
    toolpath_final.extend(lines)
    
    
    toolpath_final = gh.JoinCurves(toolpath_final, False)
    return(toolpath_final)


## Close toolpath with a double layered geometry:
def double_layered_closing(curves, layer_depth, recut):
    curves_offset = []
    
    
    if recut == False: 
        for crv in curves:
            curves_offset.append(gh.OffsetCurve(crv, layer_depth, gh.XYPlane(gh.ConstructPoint(0,0,0)), 1))
    
    
    if recut == True:
        for crv in curves:
            plane = gh.Planar(crv)[1]
            offset = gh.ExtendCurve(gh.OffsetCurve(crv, layer_depth, plane, 1), 2, 10, 10)
            
            plane_cut = gh.XYPlane(gh.ConstructPoint(0,0,0))
            cut = gh.CurveXPlane(offset, plane_cut)[1]
            
            curve_cut = gh.Shatter(offset, cut)[2]
            curves_offset.append(curve_cut)
    
    
    
    ## Close one side: 
    lines_close = []
    for i, crv in enumerate(curves): lines_close.append(gh.Line(gh.EndPoints(crv)[0], gh.EndPoints(curves_offset[i])[0]))
    
    
    
    ## Join the curves: 
    joined = []
    for i, crv in enumerate(curves): joined.append(gh.JoinCurves([lines_close[i], curves[i], curves_offset[i]], False))
    
    return(joined)

#####################################################################################################

toolpath = lines
toolpath = gh.Move(toolpath, gh.UnitZ(-gh.EndPoints(toolpath[0])[0][2]))[0]


#####################################################################################################
## Create the Closing of the geometry:
#####################################################################################################

## Main Curves: 
start_curve = gh.Shatter(gh.CurveDomain(toolpath[0], gh.ConstructDomain(0,1))[0], 0.5)[0]

pts_start = gh.DivideCurve(start_curve, 15, False)[0]
pts_mid = []
pts_end = []

factor = 0.75
factor_b = 0.85

for i in range(len(pts_start)):
    pts_end.append(gh.ConstructPoint(pts_start[i][1]*factor+pts_start[-1][0], 0, pts_start[i][2]))
    pts_mid.append(gh.ConstructPoint(pts_start[i][1]*factor+pts_start[-1][0], pts_start[i][1]*factor_b, pts_start[i][2]))



## Main Surface: 

base_curves = []
for i in range(len(pts_start)-1): base_curves.append(gh.PolyLine([pts_start[i], pts_mid[i], pts_end[i]], False))
base_curves = gh.FilletDistance(base_curves, fillet_start)


points_div = []
for i in range(len(base_curves)):
    
    points_loc = []
    
    curves_split = gh.Explode(base_curves[i], True)[0]
    for k in range(len(curves_split)):
        points_loc_temp = gh.DivideCurve(curves_split[k], 10, False)[0]
        if k > 0:
            points_loc_temp = points_loc_temp[1:] 
        points_loc.extend(points_loc_temp)
    
    points_div.append(points_loc)


points_end_extra = []
for i in range(len(points_div[0])): points_end_extra.append(pts_start[-1])
points_div.append(points_end_extra)


curves_loft = []
for i in range(len(points_div[0])):
    
    points_loc_crv = []
    
    for k in range(len(points_div)): points_loc_crv.append(points_div[k][i])
    
    curve_loc = gh.Interpolate(points_loc_crv, 3, False, 1)[0]
    curves_loft.append(curve_loc)

options = gh.LoftOptions(False, False, 0, 0, 0)
main_surface = gh.Loft(curves_loft, options)



## Cutting Planes for split Surface: 

p_a_plane = pts_end[0]
p_b_plane = gh.ConstructPoint(pts_end[-1][0],pts_start[0][1],0)

vec_a = gh.Vector2Pt(p_a_plane, p_b_plane, False)[0]
vec_b = gh.VectorXYZ(0, 1, -math.tan(math.radians(angle_start)))[0]

cutting_plane = gh.ConstructPlane(p_a_plane, vec_a, vec_b)
cutting_curve = gh.BrepXPlane(main_surface, cutting_plane)[0]


main_surface_a = gh.SurfaceSplit(main_surface, cutting_curve)[0]
main_surface_b = gh.SurfaceSplit(main_surface, cutting_curve)[1]



## Create main Opening Surface: 

edges = gh.BrepEdges(main_surface_a)[0]
surface_div_new = gh.SurfaceClosestPoint(gh.DivideSurface(gh.EdgeSurface(edges[0], edges[1], edges[2], edges[3]), 10, 10)[0], main_surface_a)[0]

crvs_new = []
for i in range(11):
    
    points_loc = []
    
    for k in range(11): points_loc.append(surface_div_new[k*11+i])
    
    curve_new_loc = gh.Interpolate(points_loc, 3, False, 1)[0]
    curve_new_mirr = gh.Mirror(curve_new_loc, gh.XZPlane(gh.ConstructPoint(0,0,0)))[0]
    
    joined = gh.RebuildCurve(gh.JoinCurves([curve_new_loc, curve_new_mirr], False), 2, 50, True)
    crvs_new.append(joined)

path = []
path.extend(crvs_new[:-1])
path.extend(toolpath)


path = gh.FlipCurve(path, path[0])[0]

loft_new = gh.Loft(crvs_new, options)



## Create main Opening Toolpath: 

divitions = int(gh.Length(gh.PolyLine(pts_end, False)) / toolpath_height)
points_new = gh.DivideSurface(loft_new, divitions, divitions)[0]

toolpath_opening_main = []
for i in range(divitions+1):
    
    points_loc = points_new[i*(divitions+1):i*(divitions+1)+1+divitions]
    
    curve_new_loc = gh.Interpolate(points_loc, 3, False, 1)[0]
    toolpath_opening_main.append(curve_new_loc)

toolpath_opening_main = toolpath_opening_main[0:-1]



## Create start Opening Toolpath: 

points_loc = gh.DeconstructBrep(main_surface_b)[2]

pt_a = points_loc[0]
pt_c = points_loc[1]
pt_b = gh.ConstructPoint(pt_a[0], pt_c[1]*factor_b, 0)

line_a = gh.Line(pt_a, pt_b)
line_b = gh.Line(pt_c, pt_b)

plane_mid = gh.ConstructPlane(pt_b, gh.VectorXYZ(-1,-1,0)[0],  gh.VectorXYZ(0,0,1)[0])
curve_sec = gh.BrepXPlane(main_surface_b, plane_mid)[0]

distance_mid = gh.Distance(gh.EndPoints(toolpath_opening_main[0])[0], gh.EndPoints(toolpath_opening_main[1])[0])
distance_down = gh.Distance(gh.CurveXPlane(toolpath_opening_main[0], plane_mid)[0], gh.CurveXPlane(toolpath_opening_main[1], plane_mid)[0])

divisions_mid = int(gh.Length(curve_sec) / distance_down)
div_mid = gh.DivideCurve(curve_sec, divisions_mid, False)[0]

div_a = gh.DivideLength(line_a, distance_mid)[0]
div_b = gh.DivideLength(line_b, distance_mid)[0]

cutting_planes = []

for i in range(len(div_mid)):
    
    line_center = gh.Line(div_a[i], div_b[i])
    mid = gh.CurveMiddle(line_center)
    
    vec_a = gh.Vector2Pt(mid, div_a[i], False)[0]
    vec_b = gh.Vector2Pt(mid, div_mid[i], False)[0]
    
    plane_new = gh.ConstructPlane(mid, vec_a, vec_b)
    cutting_planes.append(plane_new)

curves_start_opening = gh.BrepXPlane(main_surface_b, cutting_planes)[0]
curve_start = curves_start_opening[-1]

curves_start_opening = curves_start_opening[1:-1]
curve_start = gh.Shatter(curve_start, gh.CurveXCurve(curve_start, curves_start_opening[-1])[1])[1]
curve_start = gh.ExtendCurve(curve_start, 2, -distance_mid, -distance_mid)
curves_start_opening.append(curve_start)



######################################################################################################
## Create Printpath: 
######################################################################################################

if type == 1:
    printpath = []
    
    ## start: 
    
    curves_start_opening = gh.TrimwithBreps(curves_start_opening, lateral_anchors)[1]
    start_a = close_toolpath(curves_start_opening)
    start_b = gh.Mirror(start_a, gh.XZPlane(gh.ConstructPoint(0,0,0)))[0]
    printpath.extend([start_a, start_b])
# ---------- end generate_toolpath_2 ----------
geometry = Geometry(generate_toolpath_2.path)  # disabled
geometry_2 = Geometry(generate_toolpath.main_surface_b)
loft = Loft(Curves=geometry, Options={Adjust=False, Closed=False, LoftEnds=0, LoftSimp=0, LoftType=0, Rebuild=10, Refit=0.01})  # disabled
custom_preview_2 = CustomPreview(Geometry=generate_toolpath.toolpath_a, Material=ColourSwatch(SwatchColor=RGB(201, 0, 0)))
custom_preview_3 = CustomPreview(Geometry=generate_toolpath.lateral_support, Material=ColourSwatch(SwatchColor=RGB(161, 148, 119)))
geometry_3 = Geometry(generate_toolpath.loft_new)
geometry_4 = Geometry(generate_toolpath.toolpath)  # disabled
loft_2 = Loft(Curves=geometry_4, Options={Adjust=False, Closed=False, LoftEnds=0, LoftSimp=0, LoftType=0, Rebuild=10, Refit=0.01})  # disabled
